# Grasshopper definition General_Code_24.04.2023.gh (Grasshopper 1.0.7)
# plug-ins: Anemone, Pufferfish, Kangaroo2 Components, Weaverbird, Human, Noise 4D, treesloth01, MeshMachine, PlanktonGh, MeshEdit Components, Kangaroo Components

brep = Brep([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])
preview = CustomPreview(Geometry=brep, Material=ColourSwatch(SwatchColor=RGB(69, 69, 69)))
genes = GenePool(
    Decimals=2,
    Maximum=1,
    Minimum=0,
    Value=[0.82, 0.8023712662, 0.4888244185, 0.3306704514, 0.06270399041, 0.4042278167, 0.590117411, 0.4934762225, 0.2534258022, 0.2108282303, 0.6078914039, 0.577297678, 0.6662501733, 0.2347560843, 0.37883196, 0.9258874002, 0.07548371566, 0.6193912661, 0.39, 0.7506742546])  # disabled
genes_2 = GenePool(
    Decimals=2,
    Maximum=1,
    Minimum=0,
    Value=[0.2892057194, 0.5302154438, 0.8056295876, 0.6515341581, 0.9339509373, 0.6075144082, 0.6705615905, 0.2565956527, 0.446632365, 0.5165091881, 0.3394538003, 0.1591491854, 0.8174344971, 0.8956917747, 0.9739864883, 0.3105424821, 0.2389954185, 0.8028706921, 0.4627464542, 0.3654088375])
genes_3 = GenePool(
    Decimals=2,
    Maximum=1,
    Minimum=0,
    Value=[0.39, 0.5262262619, 0.6787302134, 0.3716462685, 0.1754705264, 0.4080706138, 0.8259621616, 0.8364019514, 0.6827995156, 0.8893099515, 0.5171260343, 0.003517787905, 0.2610088555, 0.4844701749, 0.689590033, 0.9061704431, 0.4544542089, 0.2572566822, 0.5397439569, 0.9645612384])  # disabled
genes_4 = GenePool(
    Decimals=2,
    Maximum=1,
    Minimum=0,
    Value=[0.7805272549, 0.8090199916, 0.06331146511, 0.7297795842, 0.5570395945, 0.3363257639, 0.560947629, 0.5651067964, 0.3408100122, 0.2446727446, 0.935078735, 0.8498750752, 0.9734114534, 0.2703588043, 0.4540829446, 0.04786462991, 0.5665632121, 0.9839217812, 0.6469207204, 0.822277497])

# ----
# GRID generator
number_slider = Slider(36, range=0..100)
number_slider_2 = Slider(6, range=0..12)
rectangle = Rectangle(Plane="0,0,0", XSize=number_slider, YSize=number_slider, Radius=0)  # -> Rectangle, Length
srf = Surface(rectangle.Rectangle)

division = Division(A=number_slider, B=2)  # disabled
division_2 = Division(A=number_slider, B=2)
rectangle_2 = Rectangle(Plane="0,0,0", XSize=division, YSize=number_slider, Radius=0)  # -> Rectangle, Length; disabled
rectangle_3 = Rectangle(Plane="0,0,0", XSize=division_2, YSize=number_slider, Radius=0)  # -> Rectangle, Length
pt = ConstructPoint(XCoordinate=genes, YCoordinate=genes_3, ZCoordinate=0)  # disabled
pt_2 = ConstructPoint(XCoordinate=genes_2, YCoordinate=genes_4, ZCoordinate=0)
crv = Curve([<curve referenced from the Rhino model> x5])
evalsrf = EvaluateSurface(Surface=reparameterize(rectangle_2.Rectangle), Point=pt)  # -> Point, Normal, UDirection, VDirection, Frame; disabled
evalsrf_2 = EvaluateSurface(Surface=reparameterize(rectangle_3.Rectangle), Point=pt_2)  # -> Point, Normal, UDirection, VDirection, Frame
area = Area(Geometry=rectangle.Rectangle)  # -> Area, Centroid; disabled
area_2 = Area(Geometry=crv)  # -> Area, Centroid
area_3 = Area(Geometry=rectangle.Rectangle)  # -> Area, Centroid
runion = RegionUnion(Curves=crv)
number_slider_3 = Slider(1, range=0..10)  # disabled
crv_2 = Curve([<curve referenced from the Rhino model> x5])
seam = Seam(Curve=reparameterize(runion), Seam=Slider(0.05, range=0..1))
number_slider_4 = Slider(31, range=0..100)  # disabled
number_slider_5 = Slider(10, range=0..10)  # disabled
crv_3 = Curve(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)
pt_3 = Point([Point(14.98281214, 23.6144077, 0), Point(10.92068546, 20.95927462, 0), Point(14.9601187, 18.89417111, 0), Point(18.4322158, 21.14082218, 0)])
points = PointList(Points=evalsrf.Point, Size=number_slider_3)  # disabled
points_2 = PointList(Points=evalsrf_2.Point, Size=Slider(1, range=0..10))
end = EndPoints(Curve=seam)  # -> Start, End
area_4 = Area(Geometry=crv_2)  # -> Area, Centroid
runion_2 = RegionUnion(Curves=crv_2)
fillet = Fillet(Curve=seam, Radius=Slider(0.96, range=0..2))
yz = YZPlane(Origin=area.Centroid)  # disabled
yz_2 = YZPlane(Origin=area_3.Centroid)
rad = Radians(Degrees=Slider(90, range=0..100))
pt_4 = Point(evalsrf.Point)  # disabled
pt_5 = Point(evalsrf_2.Point)
pop3d = Populate3D(Region={Plane=PlaneXY(0, 0, 0), X=Domain(0, 10), Y=Domain(0, 10), Z=Domain(0, 2)}, Count=number_slider_4, Seed=1)  # disabled
rad_2 = Radians(Degrees=Slider(90, range=0..100))
rad_3 = Radians(Degrees=Slider(90, range=0..100))
seam_2 = Seam(Curve=reparameterize(runion_2), Seam=Slider(0.17, range=0..1))
rad_4 = Radians(Degrees=Slider(90, range=0..100))
number_slider_6 = Slider(49, range=0..100)  # disabled
cir = Circle(Plane=pt_3, Radius=Slider(0.6, range=0..2))
mirror = Mirror(Geometry=pt_4, Plane=yz)  # -> Geometry, Transform; disabled
arc = Arc(Plane=PlaneXY(0, 0, 0), Radius=Slider(0.52, range=0..1), Angle=rad)  # -> Arc, Length
mirror_2 = Mirror(Geometry=pt_5, Plane=yz_2)  # -> Geometry, Transform
brec = BoundingRectangle(Geometry=fillet, Plane=PlaneXY(0, 0, 0), Axis=0, Slide=0, Union=True)  # -> Bounding, DimensionX, DimensionY
genes_5 = GenePool(
    Decimals=2,
    Maximum=1,
    Minimum=0,
    Value=[0.49, 0.61, 0.44, 0.51, 0.64, 0.2739360888, 0.63840962, 0.3509626814, 0.8301748973, 0.957915002, 0.2968928415, 0.4420590314, 0.4387725417, 0.00120359473, 0.5098545647, 0.5502861028, 0.1263843347, 0.5171786107, 0.6078658824, 0.7084297592])  # disabled
genes_6 = GenePool(
    Decimals=2,
    Maximum=1,
    Minimum=0,
    Value=[0.54, 0.44, 0.51, 0.03972785549, 0.53, 0.52, 0.01410773397, 0.06623706085, 0.8875104081, 0.3989614087, 0.5041069167, 0.09458396588, 0.632131026, 0.9464880596, 0.03836299388, 0.443252512, 0.8801761474, 0.5635090636, 0.4886237665, 0.001206020825])  # disabled
genes_7 = GenePool(
    Decimals=2,
    Maximum=1,
    Minimum=0,
    Value=[0.6, 0.54, 0.5930549649, 0.58, 0.59, 0.3623371103, 0.9864639435, 0.03643604044, 0.5223154032, 0.7853166432, 0.2632879774, 0.6452650845, 0.5816893124, 0.3197327342, 0.04829676638, 0.002007192933, 0.8720298074, 0.07570620537, 0.8378712115, 0.912712458])  # disabled
arc_2 = Arc(Plane=PlaneXY(0, 0, 0), Radius=Slider(0.28, range=0..1), Angle=rad_2)  # -> Arc, Length
end_2 = EndPoints(Curve=seam_2)  # -> Start, End
arc_3 = Arc(Plane=PlaneXY(0, 0, 0), Radius=Slider(0.45, range=0..1), Angle=rad_3)  # -> Arc, Length
voronoi³ = Voronoi3D(Points=pop3d)  # -> Cells, Boundary; disabled
arc_4 = Arc(Plane=PlaneXY(0, 0, 0), Radius=Slider(0.36, range=0..1), Angle=rad_4)  # -> Arc, Length

# ----
# Eligible Area
number_slider_7 = Slider(1, range=0..10)  # disabled
division_3 = Division(A=number_slider, B=number_slider_2)  # disabled
multiplication = Multiplication(A=division_3, B=number_slider_7)  # disabled
addition = Addition(A=number_slider_7, B=number_slider_7)  # disabled
neg = Negative(Value=multiplication)  # disabled
offset = OffsetCurve(Curve=rectangle.Rectangle, Distance=neg, Plane=PlaneXY(0, 0, 0), Corners=1)  # disabled
subtraction = Subtraction(A=number_slider_2, B=addition)  # disabled
srf_2 = Surface(offset)  # disabled

number_slider_8 = Slider(12, range=0..100)  # disabled
merge = Merge(Data1=mirror.Geometry, Data2=pt_4)  # disabled
merge_2 = Merge(Data1=mirror_2.Geometry, Data2=pt_5)
fillet_2 = Fillet(Curve=seam_2, Radius=Slider(0.66, range=0..2))
pt_6 = ConstructPoint(XCoordinate=0, YCoordinate=0, ZCoordinate=0)
boundary = BoundarySurfaces(Edges=flatten([cir, crv_3]))
end_3 = EndPoints(Curve=arc.Arc)  # -> Start, End
voronoi = Voronoi(Points=area_2.Centroid, Boundary=brec.Bounding, BruteForceOverride=False)
voronoi_2 = Voronoi(Points=merge, BruteForceOverride=False)  # disabled
pt_7 = ConstructPoint(XCoordinate=0, YCoordinate=0, ZCoordinate=0)
qrsettings = QuadRemeshSettings(
    TargetCount=Slider(500, range=0..10000),
    AdaptiveSize=0,
    AdaptiveCount=False,
    HardEdges=False,
    SeamEdges=0,
    Symmetry=0,
    GuideCurves=0)
pt_8 = ConstructPoint(XCoordinate=0, YCoordinate=0, ZCoordinate=0)
pt_9 = ConstructPoint(XCoordinate=0, YCoordinate=0, ZCoordinate=0)
end_4 = EndPoints(Curve=arc_2.Arc)  # -> Start, End
item = ListItem(List=voronoi³.Cells, Index=number_slider_6, Wrap=True)  # disabled
bbox = BoundingBox(Content=item, Plane=PlaneXY(0, 0, 0))  # -> Box, Box_2; disabled
end_5 = EndPoints(Curve=arc_3.Arc)  # -> Start, End
end_6 = EndPoints(Curve=arc_4.Arc)  # -> Start, End
voronoi_3 = Voronoi(Points=merge_2, BruteForceOverride=False)
dpipeline = DynamicGeometryPipeline(
    LayerFilter="Layer 01",
    TypeFilter="Curve",
    NameFilter="*",
    GroupByLayer=False,
    GroupByType=False,
    IncludeHidden=True,
    IncludeLocked=True,
    enableFullPath=False,
    listenToAttributes=True)
number_slider_9 = Slider(0.25, range=0..1)  # disabled
number_slider_10 = Slider(0.54, range=0..1)  # disabled
number_slider_11 = Slider(0.64, range=0..1)  # disabled
cir_2 = Circle(Plane=area_4.Centroid, Radius=Slider(0.6, range=0..2))
number_slider_12 = Slider(8, range=0..10)  # disabled
brec_2 = BoundingRectangle(Geometry=fillet_2, Plane=PlaneXY(0, 0, 0), Axis=0, Slide=0, Union=True)  # -> Bounding, DimensionX, DimensionY
ln = Line(StartPoint=pt_6, EndPoint=[end_3.Start, end_3.End])
area_5 = Area(Geometry=voronoi_2)  # -> Area, Centroid; disabled
area_6 = Area(Geometry=boundary)  # -> Area, Centroid
debox = DeconstructBox(Box=bbox.Box)  # -> Plane, X, Y, Z; disabled
cir_3 = Circle(Plane=[end_3.Start, end_3.End], Radius=Slider(0.116, range=0..1))
ln_2 = Line(StartPoint=pt_7, EndPoint=[end_4.Start, end_4.End])
pop3d_2 = Populate3D(Region=item, Count=number_slider_8, Seed=1)  # disabled
ln_3 = Line(StartPoint=pt_8, EndPoint=[end_5.Start, end_5.End])
ln_4 = Line(StartPoint=pt_9, EndPoint=[end_6.Start, end_6.End])
area_7 = Area(Geometry=voronoi_3)  # -> Area, Centroid
crv_4 = Curve(dpipeline)
cir_4 = Circle(Plane=[end_4.Start, end_4.End], Radius=Slider(0.043, range=0..1))
qrmesh = QuadRemesh(Mesh=boundary, Settings=qrsettings)
cir_5 = Circle(Plane=[end_5.Start, end_5.End], Radius=Slider(0.096, range=0..1))
cir_6 = Circle(Plane=[end_6.Start, end_6.End], Radius=Slider(0.067, range=0..1))
dist = Distance(PointA=area.Centroid, PointB=area_5.Centroid)  # disabled
join = JoinCurves(Curves=[ln, arc.Arc], Preserve=False)
boundary_2 = BoundarySurfaces(Edges=flatten([fillet_2, cir_2]))
panel = Panel(area_6.Area)
voronoi_4 = Voronoi(Points=area_4.Centroid, Boundary=brec_2.Bounding, BruteForceOverride=False)
qrsettings_2 = QuadRemeshSettings(
    TargetCount=Slider(309, range=0..10000),
    AdaptiveSize=0,
    AdaptiveCount=False,
    HardEdges=False,
    SeamEdges=0,
    Symmetry=0,
    GuideCurves=0)
end_7 = EndPoints(Curve=crv_4)  # -> Start, End
join_2 = JoinCurves(Curves=[ln_2, arc_2.Arc], Preserve=False)
join_3 = JoinCurves(Curves=[ln_3, arc_3.Arc], Preserve=False)
join_4 = JoinCurves(Curves=[ln_4, arc_4.Arc], Preserve=False)
remap = RemapNumbers(Value=genes_6, Source=Domain(0, 1), Target=debox.X)  # -> Mapped, Clipped; disabled
remap_2 = RemapNumbers(Value=genes_5, Source=Domain(0, 1), Target=debox.Y)  # -> Mapped, Clipped; disabled
remap_3 = RemapNumbers(Value=genes_7, Source=Domain(0, 1), Target=debox.Z)  # -> Mapped, Clipped; disabled
smaller = SmallerThan(FirstNumber=dist, SecondNumber=number_slider_12)  # -> SmallerThan, OrEqualTo; disabled
area_8 = Area(Geometry=boundary_2)  # -> Area, Centroid
pt_10 = Point(end_7.End)
unim = UnifyMesh(Mesh=qrmesh)  # -> Result, Count
rdiff = RegionDifference(CurvesA=join, CurvesB=cir_3)
pt_11 = ConstructPoint(XCoordinate=remap.Mapped, YCoordinate=remap_2.Mapped, ZCoordinate=remap_3.Mapped)  # disabled
bbox_2 = BoundingBox(Content=item, Plane=PlaneXY(0, 0, 0))  # -> Box, Box_2; disabled
dist_2 = Distance(PointA=area_7.Centroid, PointB=area_3.Centroid)
number_slider_13 = Slider(6, range=0..20)  # disabled
rdiff_2 = RegionDifference(CurvesA=join_2, CurvesB=cir_4)
dispatch = Dispatch(List=voronoi_2, DispatchPattern=smaller.SmallerThan)  # -> ListA, ListB; disabled
rdiff_3 = RegionDifference(CurvesA=join_3, CurvesB=cir_5)
rdiff_4 = RegionDifference(CurvesA=join_4, CurvesB=cir_6)
qrmesh_2 = QuadRemesh(Mesh=boundary_2, Settings=qrsettings_2)
Z = UnitZ(Factor=Slider(1.86, range=0..2))
line = LineSDL(Start=pt_10, Direction=Vector(0, 0, 1), Length=1)
divide = DivideDomain²(Domain=srf_2, UCount=subtraction, VCount=subtraction)  # disabled
number_slider_14 = Slider(1.1, range=0..10)  # disabled
panel_2 = Panel(area_8.Area)
Z_2 = UnitZ(Factor=Slider(1.64, range=0..2))
Z_3 = UnitZ(Factor=Slider(1.28, range=0..2))
medges = MeshEdges(Mesh=unim.Result)  # -> NakedEdges, InteriorEdges, NonManifoldEdges
smaller_2 = SmallerThan(FirstNumber=dist_2, SecondNumber=Slider(7, range=0..10))  # -> SmallerThan, OrEqualTo
area_9 = Area(Geometry=bbox_2.Box)  # -> Area, Centroid; disabled
area_10 = Area(Geometry=dispatch.ListA)  # -> Area, Centroid; disabled
split = SplitList(List=pt_11, Index=number_slider_13)  # -> ListA, ListB; disabled
brepinc = PointInBrep(Brep=item, Point=split.ListA, Strict=False)  # disabled
dispatch_2 = Dispatch(List=split.ListA, DispatchPattern=brepinc)  # -> ListA, ListB; disabled
pt_12 = Point(dispatch_2.ListA)  # disabled
move = Move(Geometry=rdiff, Motion=Z)  # -> Geometry, Transform
subsrf = Isotrim(Surface=srf_2, Domain=divide)  # disabled
revsrf = Revolution(Curve=crv_4, Axis=line, Domain=Domain(0, 6.283185307))
move_2 = Move(Geometry=rdiff_3, Motion=Z_2)  # -> Geometry, Transform
move_3 = Move(Geometry=rdiff_4, Motion=Z_3)  # -> Geometry, Transform
nv = NakedVertices(Mesh=unim.Result)  # -> ClothedIndex, NakedIndex, ClothedPts, NakedPts
join_5 = JoinCurves(Curves=medges.NakedEdges, Preserve=False)
dispatch_3 = Dispatch(List=voronoi_3, DispatchPattern=smaller_2.SmallerThan)  # -> ListA, ListB
pdecon = Deconstruct(Point=area_10.Centroid)  # -> XComponent, YComponent, ZComponent; disabled
unim_2 = UnifyMesh(Mesh=qrmesh_2)  # -> Result, Count
scale = Scale(Geometry=bbox_2.Box, Center=area_9.Centroid, Factor=number_slider_14)  # -> Geometry, Transform; disabled
explode = Explode(Curve=move.Geometry, Recursive=True)  # -> Segments, Vertices
number_slider_15 = Slider(22, range=0..36)  # disabled
previewmat = CustomPreviewMaterials(Geometry=revsrf, DiffuseColor=RGB(255, 255, 255))
len = Length(Curve=join_5)
area_11 = Area(Geometry=dispatch_3.ListA)  # -> Area, Centroid
voronoi³_2 = Voronoi3D(Points=pt_12, Box=scale.Geometry)  # -> Cells, Boundary; disabled
crv_5 = Curve(dispatch_3.ListA)
larger = LargerThan(FirstNumber=pdecon.XComponent, SecondNumber=division)  # -> LargerThan, OrEqualTo; disabled
medges_2 = MeshEdges(Mesh=unim_2.Result)  # -> NakedEdges, InteriorEdges, NonManifoldEdges
sort = SortList(Keys=len, ValuesA=join_5)  # -> Keys, ValuesA
loft = Loft(
    Curves=[rdiff_2, move_3.Geometry, move_2.Geometry],
    Options={Adjust=False, Closed=False, LoftEnds=0, LoftSimp=0, LoftType=0, Rebuild=10, Refit=0.01})
item_2 = ListItem(List=subsrf, Index=number_slider_15, Wrap=True)  # disabled
cir_7 = Circle(Plane=area_11.Centroid, Radius=Slider(0.55, range=0..1))
dispatch_4 = Dispatch(List=dispatch.ListA, DispatchPattern=larger.LargerThan)  # -> ListA, ListB; disabled
nv_2 = NakedVertices(Mesh=unim_2.Result)  # -> ClothedIndex, NakedIndex, ClothedPts, NakedPts
bbx = BrepBrep(BrepA=item, BrepB=voronoi³_2.Cells)  # -> Curves, Points; disabled
join_6 = JoinCurves(Curves=medges_2.NakedEdges, Preserve=False)

# ---- group: Pressure
# Pressure
facen = FaceNormals(Mesh=unim.Result)  # -> Centers, Normals
item_3 = ListItem(List=facen.Normals, Index=0, Wrap=True)
number_slider_16 = Slider(0.6274, range=0..1)
devec = DeconstructVector(Vector=item_3)  # -> XComponent, YComponent, ZComponent
larger_2 = LargerThan(FirstNumber=devec.ZComponent, SecondNumber=Slider(0, range=0..100))  # -> LargerThan, OrEqualTo
neg_2 = Negative(Value=number_slider_16)
filter = StreamFilter(Gate=larger_2.LargerThan, Stream0=neg_2, Stream1=number_slider_16)

# ----
cull_i = CullIndex(List=sort.ValuesA, Indices="-1", Wrap=True)
debrep = DeconstructBrep(Brep=loft)  # -> Faces, Edges, Vertices

# ---- group: Main Cell
mesh = Mesh(item_2)  # disabled
preview_2 = CustomPreview(
    Geometry=mesh,
    Material={diffuse=RGB(221, 160, 221), emission=RGB(66, 48, 66), shine=0.5, specular=RGB(255, 255, 255), transparency=0})  # disabled

# ----
crv_6 = Curve(dispatch_4.ListB)  # disabled
len_2 = Length(Curve=join_6)
panel_3 = Panel("""0
11""")
sint = SolidIntersection(BrepsA=voronoi³_2.Cells, BrepsB=item)  # disabled
crv_cp = CurveClosestPoint(Point=nv.NakedPts, Curve=graft(cull_i))  # -> Point, Parameter, Distance
fillet_3 = Fillet(Curve=crv_5, Radius=Slider(1.45, range=0..2))
mirror_3 = Mirror(Geometry=loft, Plane=PlaneYZ(0, 0, 0))  # -> Geometry, Transform
item_4 = ListItem(List=debrep.Edges, Index=panel_3, Wrap=True)
area_12 = Area(Geometry=mesh)  # -> Area, Centroid; disabled
sort_2 = SortList(Keys=len_2, ValuesA=join_6)  # -> Keys, ValuesA
genes_8 = GenePool(
    Decimals=2,
    Maximum=2.1,
    Minimum=1.6,
    Value=[1.6, 1.828745424, 2.1, 1.913129245, 2.007041754, 1.891996025, 1.860642036, 1.748651006, 1.86833974, 1.679473859])  # disabled
offset_2 = OffsetCurve(Curve=fillet_3, Distance=Slider(-0.01, range=-0.01..0), Corners=1)
number_slider_17 = Slider(4.59, range=0..10)  # disabled
genes_9 = GenePool(
    Decimals=2,
    Maximum=0.3,
    Minimum=0.12,
    Value=[0.18, 0.1761784047, 0.2698835519, 0.2444498604, 0.2689945405, 0.2665650848, 0.1246396733, 0.2090191966, 0.1699902613, 0.1991169636])  # disabled
lng = ListLength(List=cull_i)
debrep_2 = DeconstructBrep(Brep=sint)  # -> Faces, Edges, Vertices; disabled
relay = Relay([loft, mirror_3.Geometry])
number_slider_18 = Slider(0.03, range=0..1)  # disabled
crv_7 = Curve(reparameterize(item_4))

# ---- group: Pressure
# Pressure
facen_2 = FaceNormals(Mesh=unim_2.Result)  # -> Centers, Normals
item_5 = ListItem(List=facen_2.Normals, Index=0, Wrap=True)
number_slider_19 = Slider(0.6274, range=0..1)
devec_2 = DeconstructVector(Vector=item_5)  # -> XComponent, YComponent, ZComponent
larger_3 = LargerThan(FirstNumber=devec_2.ZComponent, SecondNumber=Slider(0, range=0..100))  # -> LargerThan, OrEqualTo
neg_3 = Negative(Value=number_slider_19)
filter_2 = StreamFilter(Gate=larger_3.LargerThan, Stream0=neg_3, Stream1=number_slider_19)

# ----
cull_i_2 = CullIndex(List=sort_2.ValuesA, Indices="-1", Wrap=True)
int = Integer(crv_cp.Distance)
area_13 = Area(Geometry=crv_6)  # -> Area, Centroid; disabled
boundary_3 = BoundarySurfaces(Edges=flatten([cir_7, offset_2]))
bool = Boolean(int)
dom = ConstructDomain(DomainStart=Slider(0, range=0..10), DomainEnd=Slider(2.6, range=0..10))
crv_8 = Curve(debrep_2.Edges)  # disabled
shatter = Shatter(Curve=crv_7, Parameters=Slider(0.74, range=0..1))
crv_cp_2 = CurveClosestPoint(Point=nv_2.NakedPts, Curve=graft(cull_i_2))  # -> Point, Parameter, Distance
genes_10 = GenePool(
    Decimals=2,
    Maximum=0.8,
    Minimum=0.2,
    Value=[0.35, 0.49, 0.25, 0.6670532968, 0.6563691461, 0.4101221499, 0.6422548576, 0.3203870315, 0.7360539737, 0.6232056136])  # disabled
genes_11 = GenePool(
    Decimals=2,
    Maximum=0.8,
    Minimum=0.1,
    Value=[0.1, 0.36, 0.29, 0.644895513, 0.6324306704, 0.3451425082, 0.6159640006, 0.2404515367, 0.7253963026, 0.5937398826])  # disabled
qrsettings_3 = QuadRemeshSettings(
    TargetCount=Slider(100, range=0..10000),
    AdaptiveSize=0,
    AdaptiveCount=False,
    HardEdges=False,
    SeamEdges=0,
    Symmetry=0,
    GuideCurves=0)
cull = CullPattern(List=nv.NakedPts, CullPattern=invert(bool))

# ---- group: Column Height
# Column Height
random = Random(Range=dom, Number=lng, Seed=2)
Z_4 = UnitZ(Factor=random)  # -> graft(UnitVector)
move_4 = Move(Geometry=cull, Motion=Z_4)  # -> Geometry, Transform

# ----
pipe = Pipe(Curve=crv_8, Radius=number_slider_18, Caps=0)  # disabled
subtraction_2 = Subtraction(A=number_slider_17, B=genes_8)  # disabled

number_slider_20 = Slider(1, range=0..100)  # disabled
# Random walk cells
button = Button()  # disabled
division_4 = Division(A=number_slider, B=number_slider_2)  # disabled
loop_start = LoopStart(Data=mesh, Count=number_slider_20, Trigger=button)  # -> port, Data, Counter; disabled
rec = DataRecorder(button, DataLimit=-10, RecordData=True)  # disabled
panel_4 = Panel("0")  # disabled
ma = MassAddition(Input=rec)  # -> Result, PartialResults; disabled
pt_13 = ConstructPoint(XCoordinate=panel_4, YCoordinate=division_4, ZCoordinate=panel_4)  # disabled
pt_14 = ConstructPoint(XCoordinate=division_4, YCoordinate=panel_4, ZCoordinate=panel_4)  # disabled
panel_5 = Panel(ma.Result)  # disabled
addition_2 = Addition(A=loop_start.Counter, B=ma.Result)  # disabled
pt_15 = Point([pt_14, pt_13])  # disabled
random_2 = Random(Range=loop_start.Counter, Number=1, Seed=addition_2)  # disabled
panel_6 = Panel(pt_15)  # disabled
item_6 = ListItem(List=panel_6, Index=random_2, Wrap=True)  # disabled
move_5 = Move(Geometry=loop_start.Data, Motion=item_6)  # -> Geometry, Transform; disabled
rec_2 = DataRecorder(button, DataLimit=-10, RecordData=True)  # disabled
ma_2 = MassAddition(Input=rec_2)  # -> Result, PartialResults; disabled
loop_end = LoopEnd(port=loop_start.port, Data=move_5.Geometry, state="Constant & Record")  # disabled
panel_7 = Panel("""90
180
270""")  # disabled
panel_8 = Panel(ma_2.Result)  # disabled
mesh_2 = Mesh(loop_end)  # disabled
item_7 = ListItem(List=panel_7, Index=panel_8, Wrap=True)  # disabled
rotate = Rotate(Geometry=mesh_2, Angle=degrees(item_7), Plane=area_12.Centroid)  # -> Geometry, Transform; disabled
mesh_3 = Mesh([mesh_2, rotate.Geometry])  # disabled
msh2psrf = MeshToPolysurface(Mesh=mesh_3, Triangles=False, FaceMerge=False)  # disabled
debrep_3 = DeconstructBrep(Brep=msh2psrf)  # -> Faces, Edges, Vertices; disabled
srf_3 = Surface([item_2, debrep_3.Faces])  # disabled

item_8 = ListItem(List=shatter, Index=0, Wrap=True)  # -> Item, Item1
lng_2 = ListLength(List=cull_i_2)
short = ShortestList(TrimMode=2)  # -> ListA, ListB, ListC; disabled
subtraction_3 = Subtraction(A=1, B=genes_9)  # disabled
branch = TreeBranch(Tree=cull, Path="{0;0;0;0;1}", MaintainPaths=True)
short_2 = ShortestList(ListC=genes_9, ListA=genes_8, ListB=crv_6, TrimMode=2)  # -> ListC, ListA, ListB; disabled
Z_5 = UnitZ(Factor=number_slider_17)  # disabled
int_2 = Integer(crv_cp_2.Distance)
item_9 = ListItem(List=explode.Vertices, Index=0, Wrap=True)  # -> Item, Item1, Item2, Item3, Item4
remap_4 = RemapNumbers(Value=Slider(178, range=0..300), Source=Slider(300, range=0..1000), Target=Slider(10, range=0..10))  # -> Mapped, Clipped
qrmesh_3 = QuadRemesh(Mesh=boundary_3, Settings=qrsettings_3)
pt_16 = Point(flatten(cull))
multiplication_2 = Multiplication(A=subtraction_2, B=genes_10)  # disabled
multiplication_3 = Multiplication(A=subtraction_3, B=genes_11)  # disabled
bool_2 = Boolean(int_2)
dom_2 = ConstructDomain(DomainStart=Slider(0, range=0..10), DomainEnd=Slider(2.6, range=0..10))
move_6 = Move(Geometry=crv_6, Motion=Z_5)  # -> simplify(graft(Geometry)), Transform; disabled
end_8 = EndPoints(Curve=item_8.Item1)  # -> Start, End
pt_17 = ConstructPoint(XCoordinate=0, YCoordinate=0, ZCoordinate=0)
genes_12 = GenePool(
    Decimals=2,
    Maximum=1,
    Minimum=0,
    Value=[0.04118706567, 0.8147077187, 0.2005940514, 0.6259105614, 0.197571552, 0, 0.1837707442, 0.8980496269, 0.8276167027, 0.8, 0.393752726, 0.07969519779, 0.5740845797, 0.4819383814, 0.4103603956, 0.7188341733, 0.09055225369, 0.86, 0.2702543793, 0.4555409879])  # disabled
cull_2 = CullPattern(List=nv_2.NakedPts, CullPattern=invert(bool_2))
addition_3 = Addition(A=multiplication_2, B=genes_8)  # disabled
addition_4 = Addition(A=genes_9, B=multiplication_3)  # disabled
number_slider_21 = Slider(0.15, range=0..1)  # disabled
index = ItemIndex(List=nv.NakedPts, Item=pt_16)
pt_18 = Point(pt_16)

# ---- group: Column Height
# Column Height
random_3 = Random(Range=dom_2, Number=lng_2, Seed=2)
Z_6 = UnitZ(Factor=random_3)  # -> graft(UnitVector)
move_7 = Move(Geometry=cull_2, Motion=Z_6)  # -> Geometry, Transform

# ----
merge_3 = Merge(Data1=item_9.Item, Data2=item_9.Item1)
pt_19 = Point(simplify(graft(merge_3)))
midpt = CurveMiddle(Curve=crv_7)  # -> simplify(graft(Midpoint))
pt_20 = Point(simplify(end_8.Start))
pt_21 = Point(simplify(end_8.End))
pt_22 = Point(flatten(move_4.Geometry))
line_2 = LineSDL(Start=pt_17, Direction=Vector(0, 0, 1), Length=1)
number_slider_22 = Slider(1, range=0..1)
ln_5 = Line(StartPoint=item_9.Item1, EndPoint=item_9.Item2)
ln_6 = Line(StartPoint=item_9.Item, EndPoint=item_9.Item4)
ln_7 = Line(StartPoint=item_9.Item3, EndPoint=item_9.Item4)
explode_2 = Explode(Curve=move_6.Geometry, Recursive=True)  # -> Segments, Vertices; disabled
branch_2 = TreeBranch(Tree=cull_2, Path="{0;0;0;0;1}", MaintainPaths=True)
unim_3 = UnifyMesh(Mesh=qrmesh_3)  # -> Result, Count
number_slider_23 = Slider(0, range=0..10)
cull_i_3 = CullIndex(List=nv.NakedPts, Indices=index, Wrap=True)

# ---- group: Boundary
# Anchoring Boundary Curve
item_10 = ListItem(List=sort.ValuesA, Index="-1", Wrap=True)
Z_7 = UnitZ(Factor=Slider(3.5, range=0..10))
move_8 = Move(Geometry=item_10, Motion=Z_7)  # -> Geometry, Transform
crv_cp_3 = CurveClosestPoint(Point=cull_i_3, Curve=move_8.Geometry)  # -> Point, Parameter, Distance

# ----
lng_3 = ListLength(List=cull_i_3)
panel_9 = Panel("0")  # disabled
remap_5 = RemapNumbers(Value=Slider(178, range=0..300), Source=Slider(300, range=0..1000), Target=Slider(10, range=0..10))  # -> Mapped, Clipped
divide_2 = DivideCurve(Curve=line_2, Count=lng_3, Kinks=False)  # -> Points, Tangents, Parameters
short_3 = ShortestList(ListC=addition_4, ListA=addition_3, ListB=crv_6, TrimMode=2)  # -> ListC, ListA, ListB; disabled
pt_23 = Point(flatten(cull_2))
pt_24 = Point(flatten(explode_2.Vertices))  # disabled
pt_25 = ConstructPoint(XCoordinate=0, YCoordinate=0, ZCoordinate=0)
X = UnitX(Factor=Slider(0.09, range=0..1))
X_2 = UnitX(Factor=Slider(0.18, range=0..1))
merge_4 = Merge(Data1=midpt, Data2=pt_20, Data3=pt_21, Data4=pt_19)
X_3 = UnitX(Factor=Slider(0.25, range=0..1))
X_4 = UnitX(Factor=Slider(0.06, range=0..1))
medges_3 = MeshEdges(Mesh=unim_3.Result)  # -> NakedEdges, InteriorEdges, NonManifoldEdges
pt_26 = Point(cull_i_3)
Z_8 = UnitZ(Factor=panel_9)  # disabled
pt_27 = Point(crv_cp_3.Point)
perlin = PerlinNoise(Values=divide_2.Points, Time=remap_4.Mapped, Scale=Slider(2, range=0..100))
scale_2 = Scale(Geometry=crv_6, Center=area_13.Centroid, Factor=number_slider_21)  # -> simplify(graft(Geometry)), Transform; disabled
duppt = RemoveDuplicatePts(Points=pt_24, Tolerance=0.01)  # disabled
pt_28 = Point(pt_23)
index_2 = ItemIndex(List=nv_2.NakedPts, Item=pt_23)
move_9 = Move(Geometry=pt_20, Motion=X)  # -> Geometry, Transform
move_10 = Move(Geometry=pt_21, Motion=X_2)  # -> Geometry, Transform
move_11 = Move(Geometry=pt_19, Motion=X_3)  # -> Geometry, Transform
move_12 = Move(Geometry=midpt, Motion=X_4)  # -> Geometry, Transform
scale_3 = Scale(Geometry=crv_6, Center=area_13.Centroid, Factor=short_3.ListC)  # -> Geometry, Transform; disabled
pt_29 = Point(flatten(move_7.Geometry))
nv_3 = NakedVertices(Mesh=unim_3.Result)  # -> ClothedIndex, NakedIndex, ClothedPts, NakedPts
line_3 = LineSDL(Start=pt_25, Direction=Vector(0, 0, 1), Length=1)
number_slider_24 = Slider(1, range=0..1)
scale_4 = Scale(Geometry=crv_6, Center=area_13.Centroid, Factor=short_2.ListC)  # -> Geometry, Transform; disabled
join_7 = JoinCurves(Curves=medges_3.NakedEdges, Preserve=False)
neg_4 = Negative(Value=number_slider_23)
Z_9 = UnitZ(Factor=short_3.ListA)  # disabled
pline = PolyLine(Vertices=merge_4, Closed=False)
short_4 = ShortestList(ListA=Z_8, ListB=duppt, TrimMode=2)  # -> ListA, ListB; disabled
number_slider_25 = Slider(0, range=0..10)
Z_10 = UnitZ(Factor=short_2.ListA)  # disabled
cull_i_4 = CullIndex(List=nv_2.NakedPts, Indices=index_2, Wrap=True)

# ---- group: Boundary
# Anchoring Boundary Curve
item_11 = ListItem(List=sort_2.ValuesA, Index="-1", Wrap=True)
Z_11 = UnitZ(Factor=Slider(3.5, range=0..10))
move_13 = Move(Geometry=item_11, Motion=Z_11)  # -> Geometry, Transform
crv_cp_4 = CurveClosestPoint(Point=cull_i_4, Curve=move_13.Geometry)  # -> Point, Parameter, Distance

# ----
lng_4 = ListLength(List=cull_i_4)
bnd = Bounds(Numbers=perlin)
dom_3 = ConstructDomain(DomainStart=neg_4, DomainEnd=number_slider_23)
cp = ClosestPoint(Point=explode_2.Vertices, Cloud=duppt)  # -> ClosestPoint, CPIndex, Distance; disabled
divide_3 = DivideCurve(Curve=line_3, Count=lng_4, Kinks=False)  # -> Points, Tangents, Parameters
len_3 = Length(Curve=join_7)
move_14 = Move(Geometry=scale_3.Geometry, Motion=Z_9)  # -> simplify(graft(Geometry)), Transform; disabled
move_15 = Move(Geometry=duppt, Motion=short_4.ListA)  # -> Geometry, Transform; disabled
merge_5 = Merge(Data1=move_12.Geometry, Data2=move_9.Geometry, Data3=move_10.Geometry, Data4=move_11.Geometry)
move_16 = Move(Geometry=scale_4.Geometry, Motion=Z_10)  # -> simplify(graft(Geometry)), Transform; disabled
pt_30 = Point(cull_i_4)
remap_6 = RemapNumbers(Value=perlin, Source=bnd, Target=dom_3)  # -> Mapped, Clipped
Z_12 = UnitZ(Factor=remap_6.Mapped)
pt_31 = Point(crv_cp_4.Point)
perlin_2 = PerlinNoise(Values=divide_3.Points, Time=remap_5.Mapped, Scale=Slider(2, range=0..100))
sort_3 = SortList(Keys=len_3, ValuesA=join_7)  # -> Keys, ValuesA
explode_3 = Explode(Curve=move_2.Geometry, Recursive=True)  # -> Segments, Vertices
move_17 = Move(Geometry=crv_cp_3.Point, Motion=Z_12)  # -> Geometry, Transform

# ---- group: Goals
edgelengths = EdgeLengths(Mesh=unim.Result, LengthFactor="0", Strength=1)
pressure = Pressure(M=unim.Result, Strength=filter)
anchor = Anchor(Point=pt_16, Target=pt_22, Strength=10000)
show = Show(G=unim.Result)
anchor_2 = Anchor(Point=cull_i_3, Target=move_17.Geometry, Strength=10000)

# ----
flip = FlipMatrix(Data=merge_4)
flip_2 = FlipMatrix(Data=merge_5)
entwine = Entwine(Branch00=show, Branch01=[edgelengths, anchor_2, anchor, pressure], FlattenInputs=True)
number_slider_26 = Slider(1.3, range=0.5..2)  # disabled
neg_5 = Negative(Value=number_slider_25)
item_12 = ListItem(List=move_15.Geometry, Index=cp.CPIndex, Wrap=True)  # disabled

# ---- group: Pressure
# Pressure
facen_3 = FaceNormals(Mesh=unim_3.Result)  # -> Centers, Normals
item_13 = ListItem(List=facen_3.Normals, Index=0, Wrap=True)
number_slider_27 = Slider(0.6274, range=0..1)
devec_3 = DeconstructVector(Vector=item_13)  # -> XComponent, YComponent, ZComponent
larger_4 = LargerThan(FirstNumber=devec_3.ZComponent, SecondNumber=Slider(0, range=0..100))  # -> LargerThan, OrEqualTo
neg_6 = Negative(Value=number_slider_27)
filter_3 = StreamFilter(Gate=larger_4.LargerThan, Stream0=neg_6, Stream1=number_slider_27)

# ----
pline_2 = PolyLine(Vertices=merge_5, Closed=False)
cull_i_5 = CullIndex(List=sort_3.ValuesA, Indices="-1", Wrap=True)
subtraction_4 = Subtraction(A=number_slider_17, B=short_3.ListA)  # -> graft(Result); disabled
graph = QuickGraph(perlin, SortOrder=0)
merge_6 = Merge(Data1=flip, Data2=reverse(flip_2))
bnd_2 = Bounds(Numbers=perlin_2)
dom_4 = ConstructDomain(DomainStart=neg_5, DomainEnd=number_slider_25)
zombiesolver = ZombieSolver(GoalObjects=entwine, Threshold=1e-10, Tolerance=0.0001, MaxIterations=50000)  # -> I, V, O
pline_3 = PolyLine(Vertices=item_12, Closed=False)  # -> simplify(Polyline); disabled
crv_cp_5 = CurveClosestPoint(Point=nv_3.NakedPts, Curve=graft(cull_i_5))  # -> Point, Parameter, Distance
pline_4 = PolyLine(Vertices=merge_6, Closed=invert(False))
remap_7 = RemapNumbers(Value=perlin_2, Source=bnd_2, Target=dom_4)  # -> Mapped, Clipped
Z_13 = UnitZ(Factor=remap_7.Mapped)
Z_14 = UnitZ(Factor=subtraction_4)  # disabled
loft_2 = Loft(
    Curves=[scale_2.Geometry, move_16.Geometry],
    Options={Adjust=False, Closed=False, LoftEnds=0, LoftSimp=0, LoftType=0, Rebuild=10, Refit=0.01})  # disabled
loft_3 = Loft(
    Curves=[move_16.Geometry, move_14.Geometry],
    Options={Adjust=False, Closed=False, LoftEnds=0, LoftSimp=0, LoftType=0, Rebuild=10, Refit=0.01})  # disabled
move_18 = Move(Geometry=crv_cp_4.Point, Motion=Z_13)  # -> Geometry, Transform

# ---- group: Goals
edgelengths_2 = EdgeLengths(Mesh=unim_2.Result, LengthFactor="0", Strength=1)
pressure_2 = Pressure(M=unim_2.Result, Strength=filter_2)
anchor_3 = Anchor(Point=pt_23, Target=pt_29, Strength=10000)
show_2 = Show(G=unim_2.Result)
anchor_4 = Anchor(Point=cull_i_4, Target=move_18.Geometry, Strength=10000)

# ----
entwine_2 = Entwine(Branch00=show_2, Branch01=[edgelengths_2, anchor_4, anchor_3, pressure_2], FlattenInputs=True)
lng_5 = ListLength(List=cull_i_5)
move_19 = Move(Geometry=move_14.Geometry, Motion=Z_14)  # -> simplify(Geometry), Transform; disabled
number_slider_28 = Slider(0.74, range=0..1)  # disabled
int_3 = Integer(crv_cp_5.Distance)
unflatten = UnflattenTree(Tree=zombiesolver.O, Guide=entwine)
graph_2 = QuickGraph(perlin_2, SortOrder=0)
debrep_4 = DeconstructBrep(Brep=loft_3)  # -> Faces, Edges, Vertices; disabled
bang = ExplodeTree(Data=unflatten)  # -> Branch0, Branch1
Z_15 = UnitZ(Factor=1)
vec = VectorXYZ(XComponent="1", YComponent="1", ZComponent=0)  # -> Vector, Length
bool_3 = Boolean(int_3)
zombiesolver_2 = ZombieSolver(GoalObjects=entwine_2, Threshold=1e-10, Tolerance=0.0001, MaxIterations=50000)  # -> I, V, O
dom_5 = ConstructDomain(DomainStart=Slider(0, range=0..10), DomainEnd=Slider(2.6, range=0..10))
crv_9 = Curve([pline_4, pline_2, pline])
mesh_4 = Mesh(bang.Branch0)
genes_13 = GenePool(
    Decimals=2,
    Maximum=1,
    Minimum=-1,
    Value=[-0.04, 0.1321092439, 0.03, -0.591026821, 0.1910556039, -0.04926633511, -0.2770535346, 0.5129438618, -0.4541457395, 0.009668636606])  # disabled
genes_14 = GenePool(
    Decimals=2,
    Maximum=1,
    Minimum=-1,
    Value=[0.1, 0.41, -0.33, -0.8091096821, -0.2385329172, 0.7273534638, -0.413979558, 0.1310917945, -0.2636852419, 0.7498682345])  # disabled
genes_15 = GenePool(
    Decimals=2,
    Maximum=1,
    Minimum=-1,
    Value=[-0.01600291162, 0.7237968136, 0.925353582, -0.9857165208, -0.4080251555, -0.6073660756, 0.4932578427, -0.1378724403, -0.229085514, 0.1048805644])  # disabled
cull_3 = CullPattern(List=nv_3.NakedPts, CullPattern=invert(bool_3))
neg_7 = Negative(Value=Slider(0.34, range=0..1))
loft_4 = Loft(
    Curves=[move_14.Geometry, pline_3],
    Options={Adjust=False, Closed=False, LoftEnds=0, LoftSimp=0, LoftType=0, Rebuild=10, Refit=0.01})  # disabled
debrep_5 = DeconstructBrep(Brep=[loft_2, loft_3, loft_4])  # -> Faces, Edges, Vertices; disabled

# ---- group: Column Height
# Column Height
random_4 = Random(Range=dom_5, Number=lng_5, Seed=2)
Z_16 = UnitZ(Factor=random_4)  # -> graft(UnitVector)
move_20 = Move(Geometry=cull_3, Motion=Z_16)  # -> Geometry, Transform

# ----
boundary_4 = BoundarySurfaces(Edges=move_14.Geometry)  # disabled
boundary_5 = BoundarySurfaces(Edges=move_19.Geometry)  # disabled
loft_5 = Loft(
    Curves=[move_19.Geometry, pline_3],
    Options={Adjust=False, Closed=False, LoftEnds=0, LoftSimp=0, LoftType=0, Rebuild=10, Refit=0.01})  # disabled
wboffset = WeaverbirdsOffsetMesh(MeshCurves=mesh_4, Distance=number_slider_28, OffsetType=0)  # disabled
pl = ConstructPlane(Origin=Point(0, 0, 0), XAxis=vec.Vector, YAxis=Z_15)
brep_2 = Brep(loft_4)  # disabled
number_slider_29 = Slider(0.74, range=0..1)  # disabled
number_slider_30 = Slider(296, range=0..1000)  # disabled
unflatten_2 = UnflattenTree(Tree=zombiesolver_2.O, Guide=entwine_2)
number_slider_31 = Slider(7, range=0..10)  # disabled
wboffset_2 = WeaverbirdsOffsetMesh(MeshCurves=mesh_4, Distance=neg_7, OffsetType=0)
bang_2 = ExplodeTree(Data=unflatten_2)  # -> Branch0, Branch1
debrep_6 = DeconstructBrep(Brep=debrep_5.Faces)  # -> Faces, Edges, Vertices; disabled
remap_8 = RemapNumbers(Value=Slider(178, range=0..300), Source=Slider(300, range=0..1000), Target=Slider(10, range=0..10))  # -> Mapped, Clipped
number_slider_32 = Slider(0.34, range=0..1)
number_slider_33 = Slider(1.68, range=0.01..2)  # disabled
entwine_3 = Entwine(Branch00=wboffset, Branch01=mesh_4, FlattenInputs=True)  # disabled
pt_32 = Point(flatten(cull_3))
pt_33 = ConstructPoint(XCoordinate=0, YCoordinate=0, ZCoordinate=0)
number_slider_34 = Slider(1, range=0..1)  # disabled
number_slider_35 = Slider(1.65, range=0.5..2)  # disabled
mesh_5 = Mesh(bang_2.Branch0)
item_14 = ListItem(List=debrep_6.Vertices, Index=0, Wrap=True)  # -> Item, Item1, Item2, Item3; disabled
join_8 = BrepJoin(Breps=[boundary_4, boundary_5, loft_5, brep_2])  # -> Breps, Closed; disabled
mirror_4 = Mirror(Geometry=crv_9, Plane=pl)  # -> Geometry, Transform
tri = Triangulate(Mesh=[mesh_4, wboffset_2])  # -> Mesh, Count; disabled
neg_8 = Negative(Value=number_slider_32)
index_3 = ItemIndex(List=nv_3.NakedPts, Item=pt_32)
pt_34 = Point(pt_32)
explode_4 = MeshExplode(Mesh=mesh_4, Interpolate=False)
trigger = Trigger(Interval=500, TimerInterval=500, Target=meshmachine)  # disabled
tri_2 = Triangulate(Mesh=wboffset_2)  # -> Mesh, Count; disabled
explode_5 = MeshExplode(Mesh=wboffset_2, Interpolate=False)
pt_35 = Point(flatten(move_20.Geometry))
line_4 = LineSDL(Start=pt_33, Direction=Vector(0, 0, 1), Length=1)
wboffset_3 = WeaverbirdsOffsetMesh(MeshCurves=mesh_5, Distance=number_slider_29, OffsetType=0)  # disabled
number_slider_36 = Slider(1, range=0..1)
move_21 = Move(Geometry=cull_i, Motion=flatten(Z_4))  # -> Geometry, Transform; disabled
popgeo = PopulateGeometry(Geometry=entwine_3, Count=number_slider_30, Seed=1)  # disabled
button_2 = Button()  # disabled
wbnaked = WeaverbirdsNakedBoundary(MeshClosedPolylines=wboffset_2)  # disabled
number_slider_37 = Slider(0.21, range=0..1)  # disabled
crv_10 = Curve(move_8.Geometry)  # disabled
number_slider_38 = Slider(0, range=0..10)
number_slider_39 = Slider(296, range=0..1000)  # disabled
multiplication_4 = Multiplication(A=genes_13, B=number_slider_33)  # disabled
multiplication_5 = Multiplication(A=genes_15, B=number_slider_33)  # disabled
multiplication_6 = Multiplication(A=genes_14, B=number_slider_33)  # disabled
ln_8 = Line(StartPoint=item_14.Item1, EndPoint=item_14.Item3)  # disabled
cull_i_6 = CullIndex(List=nv_3.NakedPts, Indices=index_3, Wrap=True)

# ---- group: Boundary
# Anchoring Boundary Curve
item_15 = ListItem(List=sort_3.ValuesA, Index="-1", Wrap=True)
Z_17 = UnitZ(Factor=Slider(3.5, range=0..10))
move_22 = Move(Geometry=item_15, Motion=Z_17)  # -> Geometry, Transform
crv_cp_6 = CurveClosestPoint(Point=cull_i_6, Curve=move_22.Geometry)  # -> Point, Parameter, Distance

# ----
lng_6 = ListLength(List=cull_i_6)
wboffset_4 = WeaverbirdsOffsetMesh(MeshCurves=mesh_5, Distance=number_slider_32, OffsetType=0)
volume = Volume(Geometry=join_8.Breps)  # -> Volume, Centroid; disabled
dam = DataDam(DataA=[tri.Mesh, tri_2.Mesh], BufferDelay=10000000, BufferMode=1)  # disabled
demesh = DeconstructMesh(Mesh=explode_4)  # -> Vertices, Faces, Colours, Normals
demesh_2 = DeconstructMesh(Mesh=explode_5)  # -> Vertices, Faces, Colours, Normals
divide_4 = DivideCurve(Curve=line_4, Count=lng_6, Kinks=False)  # -> Points, Tangents, Parameters
prox = Proximity3D(Points=flatten(popgeo), Group=5)  # -> flatten(Links), Topology; disabled
entwine_4 = Entwine(Branch00=wboffset_3, Branch01=mesh_5, FlattenInputs=True)  # disabled
pline_5 = PolyLine(Vertices=explode_3.Vertices, Closed=False)
mesh_6 = Mesh(move_21.Geometry)  # disabled
mesh_7 = Mesh(crv_10)  # disabled
crv_11 = Curve([mirror_4.Geometry, crv_9])
number_slider_40 = Slider(0.02, range=0..0.1)  # disabled
number_slider_41 = Slider(1, range=0..1)  # disabled
split_2 = SplitList(List=multiplication_6, Index=number_slider_31)  # -> ListA, ListB; disabled
split_3 = SplitList(List=multiplication_4, Index=number_slider_31)  # -> ListA, ListB; disabled
split_4 = SplitList(List=multiplication_5, Index=number_slider_31)  # -> ListA, ListB; disabled
number_slider_42 = Slider(1.65, range=0.5..2)  # disabled
pt_36 = Point(cull_i_6)
number_slider_43 = Slider(0.01, range=0..0.01)  # disabled
pt_37 = Point(crv_cp_6.Point)
meshmachine = MeshMachine(
    Geometry=tri_2.Mesh,
    Length=number_slider_35,
    FixCurves=wbnaked,
    Flip=1,
    PullStrength=0.8,
    CurvatureAdaptivity=0,
    Reset=button_2)  # disabled
perlin_3 = PerlinNoise(Values=divide_4.Points, Time=remap_8.Mapped, Scale=Slider(2, range=0..100))
srfsplit = SurfaceSplit(Surface=debrep_6.Faces, Curves=ln_8)  # -> flatten(Fragments); disabled
tri_3 = Triangulate(Mesh=[mesh_5, wboffset_4])  # -> Mesh, Count; disabled
explode_6 = MeshExplode(Mesh=mesh_5, Interpolate=False)
trigger_2 = Trigger(Interval=500, TimerInterval=500, Target=meshmachine_2)  # disabled
tri_4 = Triangulate(Mesh=wboffset_4)  # -> Mesh, Count; disabled
explode_7 = MeshExplode(Mesh=wboffset_4, Interpolate=False)
wbcarpet = WeaverbirdsSierpinskiCarpet(MeshPolylines=dam, Distance=number_slider_37, InsetType=0)  # disabled
faceb = FaceBoundaries(Mesh=[explode_5, explode_4])
move_23 = Move(Geometry=cull_i_2, Motion=flatten(Z_6))  # -> Geometry, Transform; disabled
neg_9 = Negative(Value=number_slider_38)
popgeo_2 = PopulateGeometry(Geometry=entwine_4, Count=number_slider_39, Seed=1)  # disabled
button_3 = Button()  # disabled
vec_2 = VectorXYZ(XComponent=split_3.ListA, YComponent=split_2.ListA, ZComponent=split_4.ListA)  # -> Vector, Length; disabled
wbnaked_2 = WeaverbirdsNakedBoundary(MeshClosedPolylines=wboffset_4)  # disabled
dupln = RemoveDuplicateLines(Lines=prox.Links, Tolerance=0.01)  # disabled
bbox_3 = BoundingBox(Content=join_8.Breps, Plane=PlaneXY(0, 0, 0))  # -> Box, Box_2; disabled
number_slider_44 = Slider(0.21, range=0..1)  # disabled
crv_12 = Curve(move_13.Geometry)  # disabled
panel_10 = Panel("1.1")  # disabled
pmesh = PlanktonMesh(meshmachine)  # disabled
brep_3 = Brep(relay)
bnd_3 = Bounds(Numbers=perlin_3)
dom_6 = ConstructDomain(DomainStart=neg_9, DomainEnd=number_slider_38)
dam_2 = DataDam(DataA=[tri_3.Mesh, tri_4.Mesh], BufferDelay=10000000, BufferMode=1)  # disabled
item_16 = ListItem(List=demesh_2.Vertices, Index=0, Wrap=True)  # -> Item, Item1, Item2, Item3
wbthicken = WeaverbirdsMeshThicken(MeshCurves=wbcarpet, Distance=number_slider_40, OffsetType=0)  # disabled
demesh_3 = DeconstructMesh(Mesh=explode_6)  # -> Vertices, Faces, Colours, Normals
demesh_4 = DeconstructMesh(Mesh=explode_7)  # -> Vertices, Faces, Colours, Normals
debrep_7 = DeconstructBrep(Brep=srfsplit)  # -> Faces, Edges, Vertices; disabled
item_17 = ListItem(List=demesh.Vertices, Index=0, Wrap=True)  # -> Item, Item1, Item2, Item3
geo = Geometry(debrep_6.Faces)  # disabled
move_24 = Move(Geometry=volume.Centroid, Motion=vec_2.Vector)  # -> Geometry, Transform; disabled
prox_2 = Proximity3D(Points=flatten(popgeo_2), Group=5)  # -> flatten(Links), Topology; disabled
pipe_2 = Pipe(Curve=dupln, Radius=number_slider_43, Caps=0)  # disabled
xz = XZPlane(Origin=Point(0, 0, 0))
mesh_8 = Mesh(move_23.Geometry)  # disabled
mesh_9 = Mesh(crv_12)  # disabled
crv_13 = Curve([ln_5, ln_7, ln_6, pline_5, crv_11])
number_slider_45 = Slider(0.02, range=0..0.1)  # disabled
scale_5 = Scale(Geometry=bbox_3.Box, Center=volume.Centroid, Factor=panel_10)  # -> Geometry, Transform; disabled
crv_14 = Curve(debrep_5.Edges)  # disabled
mesh_10 = Mesh(pmesh)  # disabled
remap_9 = RemapNumbers(Value=perlin_3, Source=bnd_3, Target=dom_6)  # -> Mapped, Clipped
Z_18 = UnitZ(Factor=remap_9.Mapped)
number_slider_46 = Slider(0.01, range=0..0.01)  # disabled
clean = CombineClean(Meshes=flatten([mesh_7, mesh_6, tri.Mesh]))  # disabled
meshmachine_2 = MeshMachine(
    Geometry=tri_4.Mesh,
    Length=number_slider_42,
    FixCurves=wbnaked_2,
    Flip=1,
    PullStrength=0.8,
    CurvatureAdaptivity=0,
    Reset=button_3)  # disabled
move_25 = Move(Geometry=crv_cp_6.Point, Motion=Z_18)  # -> Geometry, Transform

# ---- group: Goals
edgelengths_3 = EdgeLengths(Mesh=unim_3.Result, LengthFactor="0", Strength=1)
pressure_3 = Pressure(M=unim_3.Result, Strength=filter_3)
anchor_5 = Anchor(Point=pt_32, Target=pt_35, Strength=10000)
show_3 = Show(G=unim_3.Result)
anchor_6 = Anchor(Point=cull_i_6, Target=move_25.Geometry, Strength=10000)

# ----
debrep_8 = DeconstructBrep(Brep=debrep_7.Faces)  # -> Faces, Edges, Vertices; disabled
area_14 = Area(Geometry=debrep_7.Faces)  # -> Area, graft(Centroid); disabled
voronoi³_3 = Voronoi3D(Points=move_24.Geometry, Box=scale_5.Geometry)  # -> simplify(Cells), Boundary; disabled
previewmat_2 = CustomPreviewMaterials(Geometry=wbthicken, DiffuseColor=RGB(255, 254, 254))  # disabled
wbcarpet_2 = WeaverbirdsSierpinskiCarpet(MeshPolylines=dam_2, Distance=number_slider_44, InsetType=0)  # disabled
previewmat_3 = CustomPreviewMaterials(Geometry=dam, DiffuseColor=RGB(255, 254, 254))  # disabled
ln_9 = Line(StartPoint=item_16.Item, EndPoint=item_17.Item2)
faceb_2 = FaceBoundaries(Mesh=[explode_7, explode_6])
entwine_5 = Entwine(Branch00=show_3, Branch01=[edgelengths_3, anchor_6, anchor_5, pressure_3], FlattenInputs=True)
explode_8 = MeshExplode(Mesh=mesh_10, Interpolate=False)  # disabled
medges_4 = MeshEdges(Mesh=srf_3)  # -> NakedEdges, InteriorEdges, NonManifoldEdges; disabled
mirror_5 = Mirror(Geometry=crv_13, Plane=PlaneYZ(0, 0, 0))  # -> Geometry, Transform
mirror_6 = Mirror(Geometry=[crv_13, mirror_5.Geometry], Plane=xz)  # -> Geometry, Transform
mirror_7 = Mirror(Geometry=brep_3, Plane=xz)  # -> Geometry, Transform
ln_10 = Line(StartPoint=demesh_2.Vertices, EndPoint=demesh.Vertices)
dupln_2 = RemoveDuplicateLines(Lines=prox_2.Links, Tolerance=0.01)  # disabled
mirror_8 = Mirror(geo=geo, num=division)  # disabled
midpt_2 = CurveMiddle(Curve=debrep_8.Edges)  # disabled
graph_3 = QuickGraph(perlin_3, SortOrder=0)
pmesh_2 = PlanktonMesh(meshmachine_2)  # disabled
number_slider_47 = Slider(4, range=0..50)  # disabled
clean_2 = CleanTree(RemoveNulls=True, RemoveInvalid=True, RemoveEmpty=False, Tree=explode_8)  # disabled
item_18 = ListItem(List=demesh_4.Vertices, Index=0, Wrap=True)  # -> Item, Item1, Item2, Item3
wbthicken_2 = WeaverbirdsMeshThicken(MeshCurves=wbcarpet_2, Distance=number_slider_45, OffsetType=0)  # disabled
item_19 = ListItem(List=voronoi³_3.Cells, Index=0, Wrap=True)  # disabled
item_20 = ListItem(List=demesh_3.Vertices, Index=0, Wrap=True)  # -> Item, Item1, Item2, Item3
crv_15 = Curve([ln_9, faceb, ln_10])
join_9 = JoinCurves(Curves=medges_4.NakedEdges, Preserve=False)  # disabled
lng_7 = ListLength(List=voronoi³_3.Cells)  # disabled
crv_16 = Curve(flatten([mirror_5.Geometry, crv_13]))
pipe_3 = Pipe(Curve=dupln_2, Radius=number_slider_46, Caps=0)  # disabled
zombiesolver_3 = ZombieSolver(GoalObjects=entwine_5, Threshold=1e-10, Tolerance=0.0001, MaxIterations=50000)  # -> I, V, O
mesh_11 = Mesh(pmesh_2)  # disabled
clean_3 = CombineClean(Meshes=flatten([mesh_9, mesh_8, tri_3.Mesh]))  # disabled
explode_9 = Explode(Curve=crv_15, Recursive=True)  # -> flatten(Segments), Vertices
mjoin = MeshJoin(Meshes=clean_2)  # disabled
ln_11 = Line(StartPoint=area_14.Centroid, EndPoint=midpt_2)  # disabled
geo_2 = Geometry(mirror_8)  # disabled
previewmat_4 = CustomPreviewMaterials(Geometry=wbthicken_2, DiffuseColor=RGB(255, 254, 254))  # disabled
previewmat_5 = CustomPreviewMaterials(Geometry=dam_2, DiffuseColor=RGB(255, 254, 254))  # disabled
ln_12 = Line(StartPoint=item_18.Item, EndPoint=item_20.Item2)
explode_10 = MeshExplode(Mesh=mesh_11, Interpolate=False)  # disabled
explode_11 = Explode(Curve=[crv_16, mirror_6.Geometry], Recursive=True)  # -> Segments, Vertices
repeat = RepeatData(Data=join_8.Breps, Length=lng_7)  # disabled
ln_13 = Line(StartPoint=demesh_4.Vertices, EndPoint=demesh_3.Vertices)
clean_4 = CombineClean(Meshes=mjoin)  # disabled
division_5 = Division(A=division_3, B=number_slider_47)  # disabled
debrep_9 = DeconstructBrep(Brep=geo_2)  # -> Faces, Edges, Vertices; disabled
unflatten_3 = UnflattenTree(Tree=zombiesolver_3.O, Guide=entwine_5)
dupln_3 = RemoveDuplicateLines(Lines=explode_9.Segments, Tolerance=0.01)
bang_3 = ExplodeTree(Data=unflatten_3)  # -> Branch0, Branch1
number_slider_48 = Slider(0.34, range=0..1)
clean_5 = CleanTree(RemoveNulls=True, RemoveInvalid=True, RemoveEmpty=False, Tree=explode_10)  # disabled
pt_38 = Point(Point(0.2872911408, -4.682745697, 0))
crv_17 = Curve([ln_12, faceb_2, ln_13])
sint_2 = SolidIntersection(BrepsA=graft(repeat), BrepsB=graft(voronoi³_3.Cells))  # disabled
wbweave = WeaverbirdsMeshFromLinesWeaveBack(Lines=dupln_3, MaximumValence=4)
len_4 = Length(Curve=dupln_3)
neg_10 = Negative(Value=division_5)  # disabled
mesh_12 = Mesh(bang_3.Branch0)
orient = Orient(Geometry=[brep_3, mirror_7.Geometry], Source=PlaneXY(0, 0, 0), Target=pt_38)  # -> Geometry, Transform
pipe_4 = Pipe(Curve=dupln_3, Radius="0.01", Caps=0)
explode_12 = Explode(Curve=crv_17, Recursive=True)  # -> flatten(Segments), Vertices
crv_18 = Curve(debrep_9.Edges)  # disabled
mjoin_2 = MeshJoin(Meshes=clean_5)  # disabled
neg_11 = Negative(Value=number_slider_48)
debrep_10 = DeconstructBrep(Brep=sint_2)  # -> Faces, Edges, Vertices; disabled
end_9 = EndPoints(Curve=debrep_10.Edges)  # -> Start, End; disabled
debrep_11 = DeconstructBrep(Brep=join_8.Breps)  # -> Faces, simplify(Edges), Vertices; disabled
orient_2 = Orient(Geometry=explode_11.Segments, Source=PlaneXY(0, 0, 0), Target=pt_38)  # -> Geometry, Transform
bnd_4 = Bounds(Numbers=len_4)
offset_3 = OffsetCurve(Curve=flatten(join_9), Distance=neg_10, Plane=PlaneXY(0, 0, 0), Corners=1)  # disabled
clean_6 = CombineClean(Meshes=mjoin_2)  # disabled
ln_14 = Line(StartPoint=end_9.Start, EndPoint=end_9.End)  # disabled
crv_19 = Curve(simplify(debrep_10.Edges))  # disabled
cap = CapHoles(Brep=orient.Geometry)
dupln_4 = RemoveDuplicateLines(Lines=explode_12.Segments, Tolerance=0.01)
wboffset_5 = WeaverbirdsOffsetMesh(MeshCurves=mesh_12, Distance=number_slider_48, OffsetType=0)
pipe_5 = Pipe(Curve=orient_2.Geometry, Radius=Slider(0.01, range=0..0.1), Caps=0)
ma_3 = MassAddition(Input=len_4)  # -> Result, PartialResults
crv_20 = Curve(join_9)  # disabled
number_slider_49 = Slider(0.03, range=0..1)  # disabled
srf_4 = Surface(offset_3)  # disabled
crv_21 = Curve(ln_14)  # disabled
shift = ShiftPaths(Data=crv_19, Offset=-1)  # disabled
len_5 = Length(Curve=dupln_4)
srf_5 = Surface(crv_20)  # disabled
pipe_6 = Pipe(Curve=dupln_4, Radius="0.01", Caps=0)
Y = UnitY(Factor=Slider(-6, range=-10..0))
crv_22 = Curve(debrep_11.Edges)  # disabled
panel_11 = Panel(ma_3.Result)
join_10 = BrepJoin(Breps=flatten(srf_5))  # -> Breps, Closed; disabled
bnd_5 = Bounds(Numbers=len_5)
explode_13 = MeshExplode(Mesh=mesh_12, Interpolate=False)
explode_14 = MeshExplode(Mesh=wboffset_5, Interpolate=False)
move_26 = Move(Geometry=[pipe_4, boundary], Motion=Y)  # -> Geometry, Transform

preview_3 = CustomPreview(Geometry=cap, Material=ColourSwatch(SwatchColor=RGB(181, 181, 181)))
preview_4 = CustomPreview(Geometry=pipe_5, Material=ColourSwatch(SwatchColor=RGB(120, 120, 120)))

dupln_5 = RemoveDuplicateLines(Lines=flatten(shift), Tolerance=0.01)  # disabled
dupln_6 = RemoveDuplicateLines(Lines=shift, Tolerance=0.01)  # disabled
pipe_7 = Pipe(Curve=crv_22, Radius=number_slider_49, Caps=0)  # disabled
ma_4 = MassAddition(Input=len_5)  # -> Result, PartialResults
medges_5 = MeshEdges(Mesh=join_10.Breps)  # -> NakedEdges, InteriorEdges, NonManifoldEdges; disabled
Y_2 = UnitY(Factor=Slider(-6, range=-10..0))
panel_12 = Panel(ma_4.Result)
demesh_5 = DeconstructMesh(Mesh=explode_13)  # -> Vertices, Faces, Colours, Normals
demesh_6 = DeconstructMesh(Mesh=explode_14)  # -> Vertices, Faces, Colours, Normals
crv_23 = Curve(medges_5.NakedEdges)  # disabled
mirror_9 = Mirror(geo=crv_21, num=division)  # disabled
flatten = FlattenTree(Tree=dupln_5, Path="{0}")  # disabled
move_27 = Move(Geometry=[pipe_6, boundary_2], Motion=Y_2)  # -> Geometry, Transform
number_slider_50 = Slider(0.02, range=0..1)  # disabled
join_11 = JoinCurves(Curves=crv_23, Preserve=False)  # disabled

# ----
# Column place
number_slider_51 = Slider(4, range=0..10)  # disabled
number_slider_52 = Slider(1, range=0..10)  # disabled
number_slider_53 = Slider(2, range=0..10)  # disabled
number_slider_54 = Slider(3, range=0..10)  # disabled
item_21 = ListItem(List=flatten(srf_4), Index=number_slider_52, Wrap=True)  # disabled
item_22 = ListItem(List=flatten(srf_4), Index=number_slider_53, Wrap=True)  # disabled
item_23 = ListItem(List=flatten(srf_4), Index=number_slider_54, Wrap=True)  # disabled
item_24 = ListItem(List=flatten(srf_4), Index=number_slider_51, Wrap=True)  # disabled
number_slider_55 = Slider(-2, range=-10..10)  # disabled
addition_5 = Addition(A=division_3, B=number_slider_55)  # disabled
number_slider_56 = Slider(31, range=0..50)  # disabled
divide_5 = DivideDomain²(Domain=item_21, UCount=addition_5, VCount=addition_5)  # disabled
divide_6 = DivideDomain²(Domain=item_22, UCount=addition_5, VCount=addition_5)  # disabled
divide_7 = DivideDomain²(Domain=item_23, UCount=addition_5, VCount=addition_5)  # disabled
divide_8 = DivideDomain²(Domain=item_24, UCount=addition_5, VCount=addition_5)  # disabled
subsrf_2 = Isotrim(Surface=item_21, Domain=divide_5)  # disabled
subsrf_3 = Isotrim(Surface=item_22, Domain=divide_6)  # disabled
subsrf_4 = Isotrim(Surface=item_23, Domain=divide_7)  # disabled
subsrf_5 = Isotrim(Surface=item_24, Domain=divide_8)  # disabled
number_slider_57 = Slider(14, range=0..100)  # disabled
number_slider_58 = Slider(9, range=0..50)  # disabled
number_slider_59 = Slider(20, range=0..50)  # disabled
number_slider_60 = Slider(4, range=0..50)  # disabled
number_slider_61 = Slider(27, range=0..50)  # disabled
addition_6 = Addition(A=number_slider_56, B=number_slider_59)  # disabled
addition_7 = Addition(A=number_slider_56, B=number_slider_60)  # disabled
addition_8 = Addition(A=number_slider_56, B=number_slider_58)  # disabled
addition_9 = Addition(A=number_slider_56, B=number_slider_61)  # disabled
reduce = RandomReduce(List=subsrf_2, Reduction=number_slider_57, Seed=addition_6)  # disabled
reduce_2 = RandomReduce(List=subsrf_3, Reduction=number_slider_57, Seed=addition_8)  # disabled
reduce_3 = RandomReduce(List=subsrf_4, Reduction=number_slider_57, Seed=addition_9)  # disabled
reduce_4 = RandomReduce(List=subsrf_5, Reduction=number_slider_57, Seed=addition_7)  # disabled
swatch = ColourSwatch(SwatchColor=RGB(93, 156, 245))  # disabled
mesh_13 = Mesh([reduce_2, reduce_3, reduce, reduce_4])  # disabled
area_15 = Area(Geometry=mesh_13)  # -> Area, Centroid; disabled
preview_5 = CustomPreview(Geometry=mesh_13, Material=swatch)  # disabled

faceb_3 = FaceBoundaries(Mesh=[explode_14, explode_13])
midpt_3 = CurveMiddle(Curve=dupln_6)  # disabled
number_slider_62 = Slider(0.75, range=0..10)  # disabled
mcx = MultipleCurves(Curves=reparameterize(flatten))  # -> Points, IndexA, IndexB, ParamA, ParamB; disabled
line_5 = Line([crv_18, crv_21, mirror_9])  # disabled
item_25 = ListItem(List=demesh_6.Vertices, Index=0, Wrap=True)  # -> Item, Item1, Item2, Item3
pull = PullPoint(Point=midpt_3, Geometry=crv_22, ClosestOnly=True)  # -> ClosestPoint, Distance; disabled
item_26 = ListItem(List=demesh_5.Vertices, Index=0, Wrap=True)  # -> Item, Item1, Item2, Item3
pipe_8 = Pipe(Curve=line_5, Radius=number_slider_50, Caps=0)  # disabled
clone = CloneStructure(List=mcx.ParamB, Structure=mcx.IndexB)  # disabled
clone_2 = CloneStructure(List=mcx.ParamA, Structure=mcx.IndexA)  # disabled
number_slider_63 = Slider(3, range=0..10)  # disabled
neg_12 = Negative(Value=number_slider_62)  # disabled
dispatch_5 = Dispatch(List=dupln_6, DispatchPattern=pull.Distance)  # -> ListA, ListB; disabled
number_slider_64 = Slider(16, range=0..100)  # disabled
ln_15 = Line(StartPoint=item_25.Item, EndPoint=item_26.Item2)
ln_16 = Line(StartPoint=demesh_6.Vertices, EndPoint=demesh_5.Vertices)
shatter_2 = Shatter(Curve=reparameterize(graft(flatten)), Parameters=[clone_2, clone])  # -> flatten(Segments); disabled
offset_4 = OffsetCurve(Curve=flatten(join_11), Distance=neg_12, Plane=PlaneXY(0, 0, 0), Corners=1)  # disabled
crv_24 = Curve(dispatch_5.ListA)  # disabled
crv_25 = Curve([ln_15, faceb_3, ln_16])
explode_15 = Explode(Curve=crv_25, Recursive=True)  # -> flatten(Segments), Vertices
rebcrv = RebuildCurve(Curve=offset_4, Count=number_slider_64, Degree=number_slider_63, EndTangents=False)  # disabled
dupln_7 = RemoveDuplicateLines(Lines=shatter_2, Tolerance=0.01)  # disabled
crv_26 = Curve(rebcrv)  # disabled
dupln_8 = RemoveDuplicateLines(Lines=explode_15.Segments, Tolerance=0.01)
midpt_4 = CurveMiddle(Curve=dupln_7)  # disabled
wbweave_2 = WeaverbirdsMeshFromLinesWeaveBack(Lines=dupln_8, MaximumValence=4)
len_6 = Length(Curve=dupln_8)
pull_2 = PullPoint(Point=midpt_4, Geometry=crv_22, ClosestOnly=True)  # -> ClosestPoint, Distance; disabled
pull_3 = PullPoint(Point=midpt_4, Geometry=crv_24, ClosestOnly=True)  # -> ClosestPoint, Distance; disabled
pipe_9 = Pipe(Curve=dupln_8, Radius="0.01", Caps=0)
bnd_6 = Bounds(Numbers=len_6)
dispatch_6 = Dispatch(List=dupln_7, DispatchPattern=pull_2.Distance)  # -> ListA, ListB; disabled
dispatch_7 = Dispatch(List=dupln_7, DispatchPattern=pull_3.Distance)  # -> ListA, ListB; disabled
ma_5 = MassAddition(Input=len_6)  # -> Result, PartialResults
pt_39 = Point(debrep_11.Vertices)  # disabled

# ----
# Outline
crv_27 = Curve(crv_26)  # disabled
area_16 = Area(Geometry=crv_27)  # -> Area, Centroid; disabled
number_slider_65 = Slider(100, range=0..100)  # disabled
never_change = BooleanToggle(True)  # disabled
number_slider_66 = Slider(16, range=0..50)  # disabled
number_slider_67 = Slider(11, range=0..1000)  # disabled
number_slider_68 = Slider(8, range=0..100)  # disabled
maxradius = Slider(75, range=0..100)  # disabled
min_radius = Slider(91, range=0..100)  # disabled
number_slider_69 = Slider(3, range=0..100)  # disabled
scale_6 = Scale(Geometry=crv_27, Center=area_16.Centroid, Factor=number_slider_65)  # -> Geometry, Transform; disabled
number_slider_70 = Slider(70, range=0..1000)  # disabled
divide_curve = DivideCurve(Curve=scale_6.Geometry, Count=number_slider_66, Kinks=never_change)  # -> Points, Tangents, Parameters; disabled
offset_5 = OffsetCurve(Curve=scale_6.Geometry, Distance=number_slider_70, Plane=PlaneXY(0, 0, 0), Corners=1)  # disabled
point = Point(Point(104.9546522, 395.3045783, 0))  # disabled
c_script = CSharpScript(
    Points=divide_curve.Points,
    Iteration=number_slider_69,
    MaxRadius=maxradius,
    MinRadius=min_radius,
    T=number_slider_67,
    AttractPoint=point,
    Edge=offset_5,
    MaxCount=number_slider_68)  # -> out, OutPoints, Radiuses, OutTemp; inputs Points: list of Point3d, Iteration: Double, MaxRadius: Double, MinRadius: Double, T: Int32, AttractPoint: Point3d, Edge: Curve, MaxCount: Int32; disabled
# ---------- c_script: C# ----------
    // !Initialization
    List<Circle> circles = new List<Circle>();
    List<double> radiuses = new List<double>();


    for (int i = 0; i < Points.Count; i++)
    {
      radiuses.Add(Remap(Points[i].DistanceTo(AttractPoint), T, 0, MinRadius, MaxRadius));
    }

    //!Iteration
    for (int iteration = 0; iteration < Iteration; iteration++)
    {

      List<Vector3d> totalVector = new List<Vector3d>();
      List<double> counts = new List<double>();
      for (int i = 0; i < Points.Count; i++)
      {
        totalVector.Add(new Vector3d(0, 0, 0));
        counts.Add(0);
      }

      for (int i = 0; i < Points.Count; i++)
        for (int j = i + 1; j < Points.Count; j++)
        {
          double distance = Points[i].DistanceTo(Points[j]);
          if (radiuses[i] + radiuses[j] > distance)
          {

            Vector3d subVector = Points[i] - Points[j];
            subVector.Unitize();
            subVector *= 1 * (radiuses[i] + radiuses[j] - distance);
            // subVector *= 0.5 / distance;
            // subVector *= 
            totalVector[i] += subVector;
            totalVector[j] -= subVector;
            counts[i] += 1;
            counts[j] += 1;

          }


        }


      for (int k = 0; k < Points.Count; k++)
      {

        double t;
        if (k == 0 || k == Points.Count - 1) t = 0;
        else
        {
          Vector3d v0 = new Vector3d(Points[k - 1] - Points[k]);
          Vector3d v1 = new Vector3d(Points[k + 1] - Points[k]);

          t =Math.Abs(  Vector3d.VectorAngle(v0, v1));


          // if (t > Math.PI) t = t - Math.PI;

          // t = 1 - (t / Math.PI);
          t = (t / Math.PI);
        }

        if (iteration == Iteration-1 ) Print(t.ToString());
        if (counts[k] != 0)
        {

          if (Edge.Contains(Points[k], Plane.WorldXY, 0.01) == PointContainment.Inside)
          {
            Vector3d move = totalVector[k] / counts[k];
            Points[k] += move *t;
          }
        }

      }

      //! Add points
      if (Points.Count < MaxCount)
      {
        List<int> Indices = new List<int>();

        for (int i = 0; i < Points.Count - 1; i++)
        {
          if (Points[i].DistanceTo(Points[i + 1]) > radiuses[i] + radiuses[i + 1])
          { Indices.Add(i + 1 + Indices.Count); }
        }
        foreach (int Index in Indices)
        {
          if (Points.Count < MaxCount)
          {
            Point3d addPoint = 0.5 * (Points[Index - 1] + Points[Index]);
            Points.Insert(Index, addPoint);
          }
        }
      }


      // ! Generate the radius
      radiuses = new List<double>();
      for (int i = 0; i < Points.Count; i++)
      {
        radiuses.Add(Remap(Points[i].DistanceTo(AttractPoint), 20, 0, MinRadius, MaxRadius));
      }

      // Print(totalVector[54].Length.ToString());
    }


    //! Make curve




    //!Info
    // Print("Points.Count =" + Points.Count.ToString());
    // ! Output
    // zOutTemp = curves;
    OutPoints = Points;
    Radiuses = radiuses;
# ---------- c_script: C# additional code ----------
  bool IsLinear(Point3d p0, Point3d p1, Point3d p2)
  {

    Vector3d v1 = new Vector3d(p1 - p0);
    Vector3d v2 = new Vector3d(p2 - p1);


    double x = v1.X / v2.X;

    if (v1.Y / v2.Y == x && v1.Z / v2.Z == x) { return true; }
    else return false;
  }
  double Remap(double x, double t1, double t2, double s1, double s2)
  {
    double mapped = (s2 - s1) / (t2 - t1) * (x - t1) + s1;
    if (mapped < s1) mapped = s1;
    if (mapped > s2) mapped = s2;
    return mapped;
    // return (x - t1) / (t2 - t1) * (s2 - s1) + s1;
  }
# ---------- end c_script ----------
number_slider_71 = Slider(10, range=0..10)  # disabled
subtraction_5 = Subtraction(A=c_script.Radiuses, B=number_slider_71)  # disabled
c_script_2 = CSharpScript(Points=c_script.OutPoints, Radius=subtraction_5)  # -> out, Dir, OutTemp; inputs Points: list of Point3d, Radius: list of Double; disabled
# ---------- c_script_2: C# usings ----------
using Rhino.Geometry.Intersect;
# ---------- c_script_2: C# ----------
    //! Params and declarations
    // double maxTangentArcRadius = 0;
    // double minTangentArcRadius = 0.3;

    Random random = new Random();
    List<NurbsCurve> curves = new List<NurbsCurve>();
    List<NurbsCurve> tangents = new List<NurbsCurve>();
    NurbsCurve curve = new NurbsCurve(0, 0);
    List<bool> dir = new List<bool>();



    //! Dir
    bool initial = false;//! true: clockwise, false: anti-clockwise
    dir.Add(initial);
    dir.Add(initial);
    for (int i = 2; i < Points.Count - 1; i++)
    {
      // if

      // if (PointSideOfLine(Points[i - 1], Points[i + 1], Points[i]) != PointSideOfLine(Points[i - 2], Points[i], Points[i - 1])) initial = !initial;

      initial = !PointSideOfLine(Points[i - 1], Points[i + 1], Points[i]);


      if (Points[i].DistanceTo(Points[i - 1]) < Radius[i] + Radius[i - 1] && initial != dir[i - 1]) initial = !initial;
      dir.Add(initial);
      // bool flip = false;



      // if (Points[i].DistanceTo(Points[i + 1]) < Radius[i] + Radius[i + 1]) { flip = true; }
      // if (i > 1)
      // {
      // if (new Vector3d(Points[i ] - Points[i-1]) * new Vector3d(Points[i - 2] - Points[i - 1]) > 0) { flip = true; }
      // }
      // if (!flip) initial = !initial;
      // dir.Add(initial);


      // Print(flip.ToString());

    }
    dir.Add(initial);

    //! Curve
    for (int i = 0; i < Points.Count - 1; i++)
    {

      NurbsCurve l0 = new NurbsCurve(0, 0);
      NurbsCurve l1 = new NurbsCurve(0, 0);
      double radius = Points[i].DistanceTo(Points[i + 1]) * 2;

      // maxTangentArcRadius * (random.NextDouble() + minTangentArcRadius);

      if (dir[i] != dir[i + 1]) getTangentLineCurves(Points[i], Radius[i], Points[i + 1], Radius[i + 1], out l0, out l1);//* Tangent line

      else getTangentArcs(Points[i], Radius[i], Points[i + 1], Radius[i + 1], radius, out l0, out l1);//* Tangent Arc

      //!Add
      if (dir[i]) tangents.Add(l0);
      else tangents.Add(l1);

      //! Solve intersection
      // if (i > 0)
      // {
      //   if (IsLineLineIntersect(tangents[i - 1].PointAtStart, tangents[i - 1].PointAtEnd, tangents[i].PointAtStart, tangents[i].PointAtEnd))
      //   {
      //     getTangentArcs(Points[i - 1], Radius[i - 1], Points[i], Radius[i], radius, out l0, out l1);

      //     if (dir[i - 1]) tangents[i - 1] = l1;
      //     else tangents[i - 1] = l0;

      //     dir[i - 1] = !dir[i - 1];
      //     // flag = !flag;

      //     if (dir[i] != dir[i + 1]) getTangentLineCurves(Points[i], Radius[i], Points[i + 1], Radius[i + 1], out l0, out l1);//* Tangent line
      //     else getTangentArcs(Points[i], Radius[i], Points[i + 1], Radius[i + 1], radius, out l0, out l1);//* Tangent Arc
      //     if (dir[i]) tangents[i] = l1;
      //     else tangents[i] = l0;
      //     for (int k = i; i<dir.Count; k++){
      //       dir[k] = !dir[k];
      //     }

      //   }
      // }
    }


    //! Circle part

    for (int i = 0; i < tangents.Count - 1; i++)
    {
      curves.Add(tangents[i]);
      curves.Add(new Arc(tangents[i].PointAtEnd, tangents[i].TangentAtEnd, tangents[i + 1].PointAtStart).ToNurbsCurve());
      Print(tangents[i].PointAtEnd.ToString());
      Print(tangents[i].TangentAtEnd.ToString());
      Print(tangents[i + 1].PointAtStart.ToString());

    }
    curves.Add(tangents[tangents.Count - 1]);


    //! Output
    Dir = dir;
    // OutTemp = tangents;
    OutTemp = curves;
    //! End
# ---------- c_script_2: C# additional code ----------
  //! Start Tangent Arcs

  void getTangentArcs(Point3d p0, double r0, Point3d p1, double r1, double Radius, out NurbsCurve l0, out NurbsCurve l1)
  {

    double radius = (p0.DistanceTo(p1) - r0 - r1) / 2;
    if (radius < Radius)
    {

      Point3d intersectionPoint0 = new Point3d();
      Point3d intersectionPoint1 = new Point3d();

      CircleCircleIntersection(p0, r0 + Radius, p1, r1 + Radius, out intersectionPoint0, out intersectionPoint1);

      //! intersectionPoint0

      double t0 = r0 / p0.DistanceTo(intersectionPoint0);
      Point3d LCIntersection0 = p0 * (1 - t0) + intersectionPoint0 * t0;

      double t1 = r1 / p1.DistanceTo(intersectionPoint0);
      Point3d LCIntersection1 = p1 * (1 - t1) + intersectionPoint0 * t1;

      Vector3d centerToIntersectionPoint = new Vector3d(p0 - intersectionPoint0);

      Vector3d normal = new Vector3d(1, -centerToIntersectionPoint.X / centerToIntersectionPoint.Y, p0.Z);
      if (normal * new Vector3d(LCIntersection1 - LCIntersection0) < 0) { normal = -normal; }
      l0 = new Arc(LCIntersection0, normal, LCIntersection1).ToNurbsCurve();

      // l0 = new Line(intersectionPoint0, intersectionPoint1).ToNurbsCurve();


      //! IntersectionPoint1
      t0 = r0 / p0.DistanceTo(intersectionPoint1);
      LCIntersection0 = p0 * (1 - t0) + intersectionPoint1 * t0;

      t1 = r1 / p1.DistanceTo(intersectionPoint1);
      LCIntersection1 = p1 * (1 - t1) + intersectionPoint1 * t1;

      centerToIntersectionPoint = new Vector3d(p0 - intersectionPoint1);

      normal = new Vector3d(1, -centerToIntersectionPoint.X / centerToIntersectionPoint.Y, p0.Z);
      if (normal * new Vector3d(LCIntersection1 - LCIntersection0) < 0) { normal = -normal; }
      l1 = new Arc(LCIntersection0, normal, LCIntersection1).ToNurbsCurve();
      // l1 = null;


    }
    else
    {
      Vector3d v = new Vector3d(p1 - p0);
      v.Unitize();

      Point3d pt0 = p0 + v * r0;
      Point3d pt1 = p1 - v * r1;
      Vector3d normal = new Vector3d(1, -v.X / v.Y, v.Z);

      l0 = new Arc(pt0, normal, pt1).ToNurbsCurve();
      l1 = new Arc(pt0, -normal, pt1).ToNurbsCurve();

    }


  }

  void CircleCircleIntersection(Point3d p0, double r0, Point3d p1, double r1, out Point3d intersection0, out Point3d intersection1)
  {

    double d = p0.DistanceTo(p1);//AB
    // if (d == r0 + r1)
    // {
    //   Print("wow".ToString());
    //   Print(r0.ToString());
    //   Print(r1.ToString());
    //   Print(d.ToString());
    // }

    // Print((d == r0 + r1).ToString());

    double cosA = (r1 * r1 + d * d - r0 * r0) / (2 * r1 * d);
    double d1 = r1 * cosA;
    double t1 = d1 / d;
    Point3d midPt = p0 * t1 + p1 * (1 - t1);


    double h = Math.Sqrt(Math.Pow(r1, 2) - Math.Pow(d1, 2)); //CE
    // Print(h.ToString());
    Vector3d normal = new Vector3d(p0 - p1);
    normal.Transform(Transform.Rotation(Math.PI * 0.5, Vector3d.ZAxis, p0));
    normal.Unitize();
    normal *= h;

    intersection0 = midPt - normal; //!Clockwise one
    intersection1 = midPt + normal;//!Anti-clockwise one

    // intersection0 = midPt ;
    // intersection1 = midPt +Vector3d.YAxis;


  }


  //! Start Tangent Lines
  void getTangentLineCurves(Point3d p0, double r0, Point3d p1, double r1, out NurbsCurve l0, out NurbsCurve l1)
  {
    Point3d r1_low_point = new Point3d();
    Point3d r0_up_point = new Point3d();
    Point3d r0_low_point = new Point3d();
    Point3d r1_up_point = new Point3d();

    double aa = Math.Atan2((p1.Y - p0.Y), (p1.X - p0.X));  //求中两个圆心连线的斜率角度
    double centerLine;

    centerLine = p0.DistanceTo(p1); //求两个圆心连线长度

    double bb = Math.Acos((r0 + r1) / centerLine);  //求两个圆心连线和圆心到切点垂线的夹角
    double cc = bb - aa;
    double r2LowX = r1 * Math.Cos(cc);
    double r2LowY = r1 * Math.Sin(cc);
    double r1UpX = r0 * Math.Cos(cc);
    double r1UpY = r0 * Math.Sin(cc);
    r1_low_point.X = p1.X - r2LowX;
    r1_low_point.Y = p1.Y + r2LowY;
    r0_up_point.X = p0.X + r1UpX;
    r0_up_point.Y = p0.Y - r1UpY;
    Point3d r2_tempoint = Transition(r1_low_point.X - p1.X, r1_low_point.Y - p1.Y, 2 * bb, 1);
    r1_up_point.X = p1.X + r2_tempoint.X;
    r1_up_point.Y = p1.Y + r2_tempoint.Y;
    Point3d r1_tempoint = Transition(r0_up_point.X - p0.X, r0_up_point.Y - p0.Y, 2 * bb, 1);
    r0_low_point.X = p0.X + r1_tempoint.X;
    r0_low_point.Y = p0.Y + r1_tempoint.Y;


    l0 = new Line(r0_low_point, r1_up_point).ToNurbsCurve(); //!Clockwise one
    l1 = new Line(r0_up_point, r1_low_point).ToNurbsCurve();//!Anti-clockwise one


  }
  //点绕点旋转
  Point3d Transition(double _x, double _y, double _angle, int fx)
  {
    double newX = 0;
    double newY = 0;
    if (fx == 1)
    {
      newX = _x * Math.Cos(_angle) - _y * Math.Sin(_angle);
      newY = _x * Math.Sin(_angle) + _y * Math.Cos(_angle);
    }
    else
    {
      newX = _x * Math.Cos(_angle) + _y * Math.Sin(_angle);
      newY = _y * Math.Cos(_angle) - _x * Math.Sin(_angle);
    }
    return new Point3d(newX, newY, 0);
  }

  //! Line Line intersection by ChatGPT
  // Check if two lines intersect
  // The lines are defined by the points (x1, y1), (x2, y2)
  // and (x3, y3), (x4, y4) respectively
  // Returns true if the lines intersect, and false otherwise
  public static bool IsLineLineIntersect(Point3d p0, Point3d p1, Point3d p2, Point3d p3)
  {
    double x1 = p0.X;
    double y1 = p0.Y;
    double x2 = p1.X;
    double y2 = p1.Y;
    double x3 = p2.X;
    double y3 = p2.Y;
    double x4 = p3.X;
    double y4 = p3.Y;

    // Calculate the coefficients of the equations of the lines
    double a1 = y2 - y1;
    double b1 = x1 - x2;
    double c1 = a1 * x1 + b1 * y1;

    double a2 = y4 - y3;
    double b2 = x3 - x4;
    double c2 = a2 * x3 + b2 * y3;

    // Calculate the point of intersection
    double det = a1 * b2 - a2 * b1;
    if (det == 0)
    {
      // The lines are parallel
      return false;
    }
    else
    {
      double x = (b2 * c1 - b1 * c2) / det;
      double y = (a1 * c2 - a2 * c1) / det;

      // Check if the point of intersection is on both lines
      if ((x1 <= x && x <= x2 || x2 <= x && x <= x1) &&
        (x3 <= x && x <= x4 || x4 <= x && x <= x3) &&
        (y1 <= y && y <= y2 || y2 <= y && y <= y1) &&
        (y3 <= y && y <= y4 || y4 <= y && y <= y3))
      {
        // The lines intersect
        return true;
      }
      else
      {
        // The lines do not intersect
        return false;
      }
    }
  }


  //! Line side by ChatGPT
  public bool PointSideOfLine(Point3d p1, Point3d p2, Point3d p)
  {
    // Calculate the cross product of the two vectors determined by the three points.
    double crossProduct = (p2.X - p1.X) * (p.Y - p1.Y) - (p.X - p1.X) * (p2.Y - p1.Y);

    // If the cross product is positive, the point is on the left side of the line.
    if (crossProduct > 0)
    {
      return false; //left
    }
      // If the cross product is negative, the point is on the right side of the line.
    else
    {
      return true; //"right";
    }
  }
# ---------- end c_script_2 ----------
number_slider_72 = Slider(1, range=0..10)  # disabled
join_curves = JoinCurves(Curves=c_script_2.OutTemp, Preserve=False)  # disabled
number_slider_73 = Slider(0.01, range=0..0.01)  # disabled
clscrv = CloseCurve(Curve=join_curves, CloseType=number_slider_72, Bulge=0.5, Tolerance=0)  # -> Closed, R; disabled
scale_7 = Scale(Geometry=clscrv.Closed, Center=area_16.Centroid, Factor=number_slider_73)  # -> Geometry, Transform; disabled
number_slider_74 = Slider(3, range=0..10)  # disabled
number_slider_75 = Slider(36, range=0..100)  # disabled
rebcrv_2 = RebuildCurve(Curve=scale_7.Geometry, Count=number_slider_75, Degree=number_slider_74, EndTangents=False)  # disabled
crv_28 = Curve(rebcrv_2)  # disabled
number_slider_76 = Slider(0.154, range=-2..2)  # disabled
offset_6 = OffsetCurve(Curve=crv_28, Distance=number_slider_76, Plane=PlaneXY(0, 0, 0), Corners=1)  # disabled

crv_29 = Curve(dispatch_6.ListB)  # disabled
crv_30 = Curve(dispatch_7.ListB)  # disabled
panel_13 = Panel(ma_5.Result)
cluster = BranchLook(data=crv_29, i=0)  # disabled
cluster_2 = BranchLook(data=crv_30, i=0)  # disabled
cluster_3 = BranchLook(data=pt_39, i=0)  # disabled
number_slider_77 = Slider(0.01, range=0..0.01)  # disabled
number_slider_78 = Slider(87, range=0..1000)  # disabled
panel_14 = Panel("0")  # disabled
panel_15 = Panel("0")  # disabled
length_line = LengthLine(Line=crv_30, Length=panel_15, Strength=number_slider_77)  # disabled
length_line_2 = LengthLine(Line=crv_29, Length=panel_14, Strength=number_slider_78)  # disabled
anchor_7 = Anchor(Point=pt_39, Strength=10000)  # disabled
Y_3 = UnitY(Factor=Slider(12, range=0..100))
move_28 = Move(Geometry=[pipe_9, boundary_3], Motion=Y_3)  # -> Geometry, Transform
entwine_6 = Entwine(Branch00=length_line_2, Branch01=length_line, Branch02=anchor_7, FlattenInputs=True)  # disabled
zombiesolver_4 = ZombieSolver(GoalObjects=entwine_6, Threshold=1e-10, Tolerance=0.0001, MaxIterations=50000)  # -> I, V, O; disabled

# ---- group: Column Point Reference
pt_40 = Point([area_12.Centroid, area_15.Centroid])  # disabled

# ----
unflatten_4 = UnflattenTree(Tree=zombiesolver_4.O, Guide=entwine_6)  # disabled
bang_4 = ExplodeTree(Data=unflatten_4)  # -> Branch0, Branch1, Branch2; disabled
crv_31 = Curve(bang_4.Branch0)  # disabled
crv_32 = Curve(debrep_4.Edges)  # disabled
mirror_10 = Mirror(geo=[crv_31, crv_32], num=division)  # disabled
mirror_11 = Mirror(geo=bang_4.Branch1, num=division)  # disabled
dup = DuplicateData(Data=short_2.ListA, Number=2, Order=True)  # disabled
duppt_2 = RemoveDuplicatePts(Points=area_10.Centroid, Tolerance=0.01)  # disabled
number_slider_79 = Slider(0.02, range=0..1)  # disabled
number_slider_80 = Slider(0.05, range=0..1)  # disabled
number_slider_81 = Slider(0.44, range=0..1)  # disabled
line_6 = LineSDL(Start=duppt_2, Direction=Vector(0, 0, 1), Length=dup)  # disabled
pipe_10 = Pipe(Curve=line_6, Radius=number_slider_81, Caps=0)  # disabled
pipe_11 = Pipe(Curve=mirror_11, Radius=number_slider_79, Caps=0)  # disabled
number_slider_82 = Slider(35, range=0..100)  # disabled
pipe_12 = Pipe(Curve=mirror_10, Radius=number_slider_80, Caps=0)  # disabled
X_5 = UnitX(Factor=number_slider_82)  # disabled
move_29 = Move(Geometry=[pipe_12, pipe_11, pipe_10], Motion=X_5)  # -> Geometry, Transform; disabled
swatch_2 = ColourSwatch(SwatchColor=RGB(128, 128, 128))  # disabled
# Column Position
crv_33 = Curve(offset_6)  # disabled

# ---- group: Column Positions
number_slider_83 = Slider(21, range=0..100)  # disabled
number_slider_84 = Slider(9, range=0..10)  # disabled
number_slider_85 = Slider(5, range=0..10)  # disabled
offset_7 = OffsetCurve(Curve=crv_33, Distance=expr("-x", number_slider_83), Corners=1)  # disabled
pop2d = Populate2D(Region=offset_7, Count=number_slider_84, Seed=number_slider_85)  # disabled

# ----
number_slider_86 = Slider(0.5, range=0..1)  # disabled
number_slider_87 = Slider(0.3, range=0..1)  # disabled
lng_8 = ListLength(List=pt_40)  # disabled
dom_7 = ConstructDomain(DomainStart=number_slider_86, DomainEnd=number_slider_86)  # disabled

# ----
# Column Outline
random_5 = Random(Range=dom_7, Number=lng_8, Seed=2)  # disabled
cir_8 = Circle(Plane=pt_40, Radius=random_5)  # disabled

number_slider_88 = Slider(600, range=0..10000)  # disabled
boundary_6 = BoundarySurfaces(Edges=flatten([crv_33, cir_8]))  # disabled
# Remesh Settings
dam_3 = DataDam(DataA=boundary_6, BufferDelay=10000000, BufferMode=1)  # disabled

# ---- group: Remesh Settings
qrsettings_4 = QuadRemeshSettings(
    TargetCount=number_slider_88,
    AdaptiveSize=0,
    AdaptiveCount=False,
    HardEdges=False,
    SeamEdges=0,
    Symmetry=0,
    GuideCurves=0)  # disabled
qrmesh_4 = QuadRemesh(Mesh=dam_3, Settings=qrsettings_4)  # disabled

# ----
medges_6 = MeshEdges(Mesh=qrmesh_4)  # -> NakedEdges, InteriorEdges, NonManifoldEdges; disabled
join_12 = JoinCurves(Curves=medges_6.NakedEdges, Preserve=False)  # disabled
colom = CollisionOneMany(Collider=join_12, Obstacles=cir_8)  # -> Collision, Index; disabled
number_slider_89 = Slider(2, range=0..10)  # disabled
cull_4 = CullPattern(List=join_12, CullPattern=colom.Collision)  # disabled
panel_16 = Panel("""0.5
 to 1""")  # disabled
pcen = PolygonCenter(Polyline=cull_4)  # -> CenterV, CenterE, CenterA; disabled
range = Range(Domain=panel_16, Steps=number_slider_89)  # disabled
scale_8 = Scale(Geometry=graft(cull_4), Center=graft(pcen.CenterV), Factor=range)  # -> simplify(Geometry), Transform; disabled
shift_2 = ShiftList(List=scale_8.Geometry, Shift=1, Wrap=invert(True))  # disabled
short_5 = ShortestList(ListA=scale_8.Geometry, ListB=shift_2, TrimMode=2)  # -> ListA, ListB; disabled
merge_7 = Merge(Data1=graft(short_5.ListA), Data2=graft(short_5.ListB))  # disabled
loft_6 = Loft(Curves=merge_7, Options={Adjust=False, Closed=False, LoftEnds=0, LoftSimp=0, LoftType=0, Rebuild=10, Refit=0.01})  # -> simplify(Loft); disabled
pshift = ShiftPaths(Data=loft_6, Offset=-1)  # disabled
smesh = SimpleMesh(Brep=pshift)  # disabled
clean_7 = CombineClean(Meshes=flatten([smesh, qrmesh_4]))  # disabled
unim_4 = UnifyMesh(Mesh=clean_7)  # -> Result, Count; disabled
medges_7 = MeshEdges(Mesh=unim_4.Result)  # -> NakedEdges, InteriorEdges, NonManifoldEdges; disabled
nv_4 = NakedVertices(Mesh=unim_4.Result)  # -> ClothedIndex, NakedIndex, ClothedPts, NakedPts; disabled
join_13 = JoinCurves(Curves=medges_7.NakedEdges, Preserve=False)  # disabled
len_7 = Length(Curve=join_13)  # disabled
panel_17 = Panel("-1")  # disabled
sort_4 = SortList(Keys=len_7, ValuesA=join_13)  # -> Keys, ValuesA; disabled

# ---- group: Pressure
# Pressure
facen_4 = FaceNormals(Mesh=unim_4.Result)  # -> Centers, Normals; disabled
number_slider_90 = Slider(0, range=0..100)  # disabled
item_27 = ListItem(List=facen_4.Normals, Index=0, Wrap=True)  # disabled
number_slider_91 = Slider(0.6274, range=0..1)  # disabled
devec_4 = DeconstructVector(Vector=item_27)  # -> XComponent, YComponent, ZComponent; disabled
larger_5 = LargerThan(FirstNumber=devec_4.ZComponent, SecondNumber=number_slider_90)  # -> LargerThan, OrEqualTo; disabled
neg_13 = Negative(Value=number_slider_91)  # disabled
filter_4 = StreamFilter(Gate=larger_5.LargerThan, Stream0=neg_13, Stream1=number_slider_91)  # disabled

# ----
cull_i_7 = CullIndex(List=sort_4.ValuesA, Indices=panel_17, Wrap=True)  # disabled
number_slider_92 = Slider(178, range=0..300)  # disabled
crv_cp_7 = CurveClosestPoint(Point=nv_4.NakedPts, Curve=graft(cull_i_7))  # -> Point, Parameter, Distance; disabled
number_slider_93 = Slider(0, range=0..10)  # disabled
number_slider_94 = Slider(2.6, range=0..10)  # disabled
number_slider_95 = Slider(3.5, range=0..10)  # disabled
lng_9 = ListLength(List=cull_i_7)  # disabled
int_4 = Integer(crv_cp_7.Distance)  # disabled
number_slider_96 = Slider(300, range=0..1000)  # disabled
number_slider_97 = Slider(10, range=0..10)  # disabled
bool_4 = Boolean(int_4)  # disabled
dom_8 = ConstructDomain(DomainStart=number_slider_93, DomainEnd=number_slider_94)  # disabled
panel_18 = Panel("{0;0;0;0;1}")  # disabled
cull_5 = CullPattern(List=nv_4.NakedPts, CullPattern=invert(bool_4))  # disabled

# ---- group: Column Height
# Column Height
random_6 = Random(Range=dom_8, Number=lng_9, Seed=2)  # disabled
Z_19 = UnitZ(Factor=random_6)  # -> graft(UnitVector); disabled
move_30 = Move(Geometry=cull_5, Motion=Z_19)  # -> Geometry, Transform; disabled

# ----
branch_3 = TreeBranch(Tree=cull_5, Path=panel_18, MaintainPaths=True)  # disabled
remap_10 = RemapNumbers(Value=number_slider_92, Source=number_slider_96, Target=number_slider_97)  # -> Mapped, Clipped; disabled
pt_41 = Point(flatten(cull_5))  # disabled
pt_42 = ConstructPoint(XCoordinate=0, YCoordinate=0, ZCoordinate=0)  # disabled
pt_43 = Point(pt_41)  # disabled
index_4 = ItemIndex(List=nv_4.NakedPts, Item=pt_41)  # disabled
pt_44 = Point(flatten(move_30.Geometry))  # disabled
line_7 = LineSDL(Start=pt_42, Direction=Vector(0, 0, 1), Length=1)  # disabled
number_slider_98 = Slider(2, range=0..100)  # disabled
number_slider_99 = Slider(1, range=0..1)  # disabled
number_slider_100 = Slider(0.77, range=0..10)  # disabled
cull_i_8 = CullIndex(List=nv_4.NakedPts, Indices=index_4, Wrap=True)  # disabled

# ---- group: Boundary
# Anchoring Boundary Curve
item_28 = ListItem(List=sort_4.ValuesA, Index=panel_17, Wrap=True)  # disabled
Z_20 = UnitZ(Factor=number_slider_95)  # disabled
move_31 = Move(Geometry=item_28, Motion=Z_20)  # -> Geometry, Transform; disabled
crv_cp_8 = CurveClosestPoint(Point=cull_i_8, Curve=move_31.Geometry)  # -> Point, Parameter, Distance; disabled

# ----
lng_10 = ListLength(List=cull_i_8)  # disabled
divide_9 = DivideCurve(Curve=line_7, Count=lng_10, Kinks=False)  # -> Points, Tangents, Parameters; disabled
pt_45 = Point(cull_i_8)  # disabled
pt_46 = Point(crv_cp_8.Point)  # disabled
perlin_4 = PerlinNoise(Values=divide_9.Points, Time=remap_10.Mapped, Scale=number_slider_98)  # disabled
neg_14 = Negative(Value=number_slider_100)  # disabled
bnd_7 = Bounds(Numbers=perlin_4)  # disabled
dom_9 = ConstructDomain(DomainStart=neg_14, DomainEnd=number_slider_100)  # disabled
remap_11 = RemapNumbers(Value=perlin_4, Source=bnd_7, Target=dom_9)  # -> Mapped, Clipped; disabled
Z_21 = UnitZ(Factor=remap_11.Mapped)  # disabled
move_32 = Move(Geometry=crv_cp_8.Point, Motion=Z_21)  # -> Geometry, Transform; disabled

# ---- group: Goals
panel_19 = Panel("0")  # disabled
edgelengths_4 = EdgeLengths(Mesh=unim_4.Result, LengthFactor=panel_19, Strength=1)  # disabled
pressure_4 = Pressure(M=unim_4.Result, Strength=filter_4)  # disabled
anchor_8 = Anchor(Point=pt_41, Target=pt_44, Strength=10000)  # disabled
show_4 = Show(G=unim_4.Result)  # disabled
anchor_9 = Anchor(Point=cull_i_8, Target=move_32.Geometry, Strength=10000)  # disabled

# ----
entwine_7 = Entwine(Branch00=show_4, Branch01=[edgelengths_4, anchor_9, anchor_8, pressure_4], FlattenInputs=True)  # disabled
graph_4 = QuickGraph(perlin_4, SortOrder=0)  # disabled
zombiesolver_5 = ZombieSolver(GoalObjects=entwine_7, Threshold=1e-10, Tolerance=0.0001, MaxIterations=50000)  # -> I, V, O; disabled
number_slider_101 = Slider(0.74, range=0..1)  # disabled
unflatten_5 = UnflattenTree(Tree=zombiesolver_5.O, Guide=entwine_7)  # disabled
bang_5 = ExplodeTree(Data=unflatten_5)  # -> Branch0, Branch1; disabled
number_slider_102 = Slider(0.34, range=0..1)  # disabled
mesh_14 = Mesh(bang_5.Branch0)  # disabled
neg_15 = Negative(Value=number_slider_102)  # disabled
wboffset_6 = WeaverbirdsOffsetMesh(MeshCurves=mesh_14, Distance=number_slider_101, OffsetType=0)  # disabled
number_slider_103 = Slider(296, range=0..1000)  # disabled
wboffset_7 = WeaverbirdsOffsetMesh(MeshCurves=mesh_14, Distance=neg_15, OffsetType=0)  # disabled
entwine_8 = Entwine(Branch00=wboffset_6, Branch01=mesh_14, FlattenInputs=True)  # disabled
number_slider_104 = Slider(1, range=0..1)  # disabled
number_slider_105 = Slider(1.65, range=0.5..2)  # disabled
tri_5 = Triangulate(Mesh=[mesh_14, wboffset_7])  # -> Mesh, Count; disabled
trigger_3 = Trigger(Interval=500, TimerInterval=500, Target=meshmachine_3)  # disabled
tri_6 = Triangulate(Mesh=wboffset_7)  # -> Mesh, Count; disabled
move_33 = Move(Geometry=cull_i_7, Motion=flatten(Z_19))  # -> Geometry, Transform; disabled
popgeo_3 = PopulateGeometry(Geometry=entwine_8, Count=number_slider_103, Seed=1)  # disabled
button_4 = Button()  # disabled
wbnaked_3 = WeaverbirdsNakedBoundary(MeshClosedPolylines=wboffset_7)  # disabled
number_slider_106 = Slider(0.21, range=0..1)  # disabled
crv_34 = Curve(move_31.Geometry)  # disabled
dam_4 = DataDam(DataA=[tri_5.Mesh, tri_6.Mesh], BufferDelay=10000000, BufferMode=1)  # disabled
prox_3 = Proximity3D(Points=flatten(popgeo_3), Group=5)  # -> flatten(Links), Topology; disabled
mesh_15 = Mesh(move_33.Geometry)  # disabled
mesh_16 = Mesh(crv_34)  # disabled
number_slider_107 = Slider(0.02, range=0..0.1)  # disabled
number_slider_108 = Slider(0.01, range=0..0.01)  # disabled
meshmachine_3 = MeshMachine(
    Geometry=tri_6.Mesh,
    Length=number_slider_105,
    FixCurves=wbnaked_3,
    Flip=1,
    PullStrength=0.8,
    CurvatureAdaptivity=0,
    Reset=button_4)  # disabled
wbcarpet_3 = WeaverbirdsSierpinskiCarpet(MeshPolylines=dam_4, Distance=number_slider_106, InsetType=0)  # disabled
dupln_9 = RemoveDuplicateLines(Lines=prox_3.Links, Tolerance=0.01)  # disabled
pmesh_3 = PlanktonMesh(meshmachine_3)  # disabled
wbthicken_3 = WeaverbirdsMeshThicken(MeshCurves=wbcarpet_3, Distance=number_slider_107, OffsetType=0)  # disabled
pipe_13 = Pipe(Curve=dupln_9, Radius=number_slider_108, Caps=0)  # disabled
mesh_17 = Mesh(pmesh_3)  # disabled
clean_8 = CombineClean(Meshes=flatten([mesh_16, mesh_15, tri_5.Mesh]))  # disabled
previewmat_6 = CustomPreviewMaterials(Geometry=wbthicken_3, DiffuseColor=RGB(255, 254, 254))  # disabled
previewmat_7 = CustomPreviewMaterials(Geometry=dam_4, DiffuseColor=RGB(255, 254, 254))  # disabled
explode_16 = MeshExplode(Mesh=mesh_17, Interpolate=False)  # disabled
clean_9 = CleanTree(RemoveNulls=True, RemoveInvalid=True, RemoveEmpty=False, Tree=explode_16)  # disabled
mjoin_3 = MeshJoin(Meshes=clean_9)  # disabled
clean_10 = CombineClean(Meshes=mjoin_3)  # disabled

sdivide = DivideSurface(Surface=srf, UCount=number_slider_2, VCount=number_slider_2)  # -> Points, Normals, Parameters; disabled
number_slider_109 = Slider(0.35, range=0..1)  # disabled
number_slider_110 = Slider(0.35, range=0..1)  # disabled
rectangle_4 = Rectangle(Plane=sdivide.Points, XSize=number_slider_109, YSize=number_slider_110, Radius=0)  # -> Rectangle, Length; disabled
division_6 = Division(A=number_slider_109, B=2)  # disabled
division_7 = Division(A=number_slider_110, B=2)  # disabled
X_6 = UnitX(Factor=division_6)  # disabled
Y_4 = UnitY(Factor=division_7)  # disabled
neg_16 = Negative(Value=Y_4)  # disabled
neg_17 = Negative(Value=X_6)  # disabled
number_slider_111 = Slider(4.5, range=0..10)  # disabled
move_34 = Move(Geometry=rectangle_4.Rectangle, Motion=neg_17)  # -> Geometry, Transform; disabled
move_35 = Move(Geometry=move_34.Geometry, Motion=neg_16)  # -> Geometry, Transform; disabled
Z_22 = UnitZ(Factor=number_slider_111)  # disabled
swatch_3 = ColourSwatch(SwatchColor=RGB(128, 128, 128))  # disabled

# ---- group: columns
extr = Extrude(Base=move_35.Geometry, Direction=Z_22)  # disabled

# ----
preview_6 = CustomPreview(Geometry=extr, Material=swatch_3)  # disabled

move_36 = Move(Geometry=extr, Motion=X_5)  # -> Geometry, Transform; disabled
preview_7 = CustomPreview(Geometry=move_36.Geometry, Material=swatch_2)  # disabled

# ==== cluster Mirror
num = ClusterInput()
geo = ClusterInput()
num_2 = Number(num)
geo_2 = Geometry(geo)
pt = ConstructPoint(XCoordinate=num_2, YCoordinate=0, ZCoordinate=0)
yz = YZPlane(Origin=pt)
mirror = Mirror(Geometry=geo_2, Plane=yz)  # -> Geometry, Transform
merge = Merge(Data1=geo_2, Data2=mirror.Geometry)
geo_3 = Geometry(merge)
geo_4 = ClusterOutput(geo_3)

# ==== cluster BranchLook: To see the condition of branch data.
data = ClusterInput()
data_2 = Data(data)
tstat = TreeStatistics(Tree=data_2)  # -> Paths, Length, Count
i = ClusterInput()
item = ListItem(List=tstat.Paths, Index=i, Wrap=True)
branch = TreeBranch(Tree=data_2, Path=item, MaintainPaths=True)
B = ClusterOutput(branch)
