# Grasshopper definition HoberManBall.ghx (Grasshopper 1.0.7)
# plug-ins: Kangaroo2 Components, Human

crv = Curve([<curve referenced from the Rhino model> x6])
crv_2 = Curve([<curve referenced from the Rhino model> x6])
mesh = Mesh(<mesh referenced from the Rhino model>)
crv_3 = Curve([<curve referenced from the Rhino model> x6])
mesh_2 = Mesh(<mesh referenced from the Rhino model>)
mesh_3 = Mesh(<mesh referenced from the Rhino model>)
mesh_4 = Mesh(<mesh referenced from the Rhino model>)
crv_4 = Curve([<curve referenced from the Rhino model> x6])
area = Area(Geometry=crv_3)  # -> Area, Centroid
area_2 = Area(Geometry=crv)  # -> Area, Centroid
area_3 = Area(Geometry=crv_4)  # -> Area, Centroid
area_4 = Area(Geometry=crv_2)  # -> Area, Centroid
cluster = Cluster(L=area_3.Centroid)
cluster_2 = Cluster(L=area_2.Centroid)
cluster_3 = Cluster(L=area.Centroid)
cluster_4 = Cluster(L=area_4.Centroid)
panel = Panel(cluster_3)
entwine = Entwine(Branch00=cluster_3, Branch01=cluster_2, Branch02=cluster, Branch03=cluster_4, FlattenInputs=True)
points = PointList(Points=entwine, Size=Slider(3, range=0..10))
item = ListItem(List=cluster_3, Index=[Slider(2, range=0..5), Slider(3, range=0..5)], Wrap=True)
item_2 = ListItem(List=cluster_2, Index=[Slider(2, range=0..5), Slider(3, range=0..5)], Wrap=True)
item_3 = ListItem(List=cluster_3, Index=[Slider(4, range=0..5), Slider(5, range=0..5)], Wrap=True)
item_4 = ListItem(List=cluster, Index=[Slider(0, range=0..5), Slider(1, range=0..5)], Wrap=True)
item_5 = ListItem(List=cluster_2, Index=[Slider(4, range=0..5), Slider(5, range=0..5)], Wrap=True)
item_6 = ListItem(List=cluster_4, Index=[Slider(0, range=0..5), Slider(1, range=0..5)], Wrap=True)
item_7 = ListItem(List=cluster, Index=[Slider(2, range=0..5), Slider(3, range=0..5)], Wrap=True)
item_8 = ListItem(List=cluster_4, Index=[Slider(2, range=0..5), Slider(3, range=0..5)], Wrap=True)
item_9 = ListItem(List=cluster_3, Index=[Slider(0, range=0..5), Slider(1, range=0..5)], Wrap=True)
item_10 = ListItem(List=cluster_2, Index=[Slider(0, range=0..5), Slider(1, range=0..5)], Wrap=True)
rigidbodycollide = RigidBodyCollide(Strength=1)
ln = Line(StartPoint=item, EndPoint=item_2)
ln_2 = Line(StartPoint=item_3, EndPoint=item_4)
ln_3 = Line(StartPoint=item_5, EndPoint=item_6)
ln_4 = Line(StartPoint=item_7, EndPoint=item_8)
item_11 = ListItem(List=item_9, Index=0, Wrap=True)
pt = ConstructPoint(XCoordinate=0, YCoordinate=0, ZCoordinate=0)
item_12 = ListItem(List=item_10, Index=0, Wrap=True)
pt_2 = ConstructPoint(XCoordinate=0, YCoordinate=Slider(35, range=10..50), ZCoordinate=0)
orient = Orient(Geometry=item_9, Source=item_11, Target=pt)  # -> Geometry, Transform
orient_2 = Orient(Geometry=item_10, Source=item_12, Target=pt_2)  # -> Geometry, Transform
number_slider = Slider(100, range=0..100)
anchor = Anchor(Point=item_9, Target=orient.Geometry, Strength=10000)
anchor_2 = Anchor(Point=item_10, Target=orient_2.Geometry, Strength=10000)
rigidbody = RigidBody(Part=mesh, Points=cluster_3, Strength=number_slider)  # -> RigidBody, Planes
rigidbody_2 = RigidBody(Part=mesh_2, Points=cluster_2, Strength=number_slider)  # -> RigidBody, Planes
rigidbody_3 = RigidBody(Part=mesh_3, Points=cluster, Strength=number_slider)  # -> RigidBody, Planes
rigidbody_4 = RigidBody(Part=mesh_4, Points=cluster_4, Strength=number_slider)  # -> RigidBody, Planes
length_line = LengthLine(Line=[ln, ln_2, ln_3, ln_4], Length="0", Strength=Slider(1000, range=0..1000))
entwine_2 = Entwine(
    Branch00=rigidbody.RigidBody,
    Branch01=rigidbody_2.RigidBody,
    Branch02=rigidbody_3.RigidBody,
    Branch03=rigidbody_4.RigidBody,
    Branch04=length_line,
    Branch05=anchor,
    Branch06=anchor_2,
    FlattenInputs=True)
solver = Solver(GoalObjects=entwine_2, Reset=Button(), Threshold=1e-15, Tolerance=0.0001, On=Toggle(True))  # -> I, V, O
mesh_5 = Mesh(solver.O)
previewmat = CustomPreviewMaterials(Geometry=mesh_5, DiffuseColor=RGB(255, 255, 255))

# ==== cluster Cluster
L = ClusterInput()
partition = PartitionList(List=L, Size="2")
pdecon = Deconstruct(Point=partition)  # -> XComponent, YComponent, ZComponent
sort = SortList(Keys=pdecon.ZComponent, ValuesA=partition)  # -> Keys, flatten(ValuesA)
A = ClusterOutput(sort.ValuesA)
