# Grasshopper definition Mushroom Cluster for Optimize (1).gh (Grasshopper 1.0.7)
# plug-ins: Weaverbird, Kangaroo Components, MeshEdit Components, Human

# ----
# Ex. Col.
# Offset Clearance
number_slider = Slider(0.2, range=0..1)

# ----
# Existing Column
crv = Curve(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)
crv_2 = Curve(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)
crv_3 = Curve(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)
crv_4 = Curve(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)
area = Area(Geometry=crv)  # -> Area, Centroid
area_2 = Area(Geometry=crv_2)  # -> Area, Centroid
area_3 = Area(Geometry=crv_3)  # -> Area, Centroid
area_4 = Area(Geometry=crv_4)  # -> Area, Centroid

# ----
# Starting
# View Location
pt = Point(Point(3, 6, 0))

pt_2 = Point(Point(9.3, 8.825, 0))

# ----
# Ex. Column
# Boudrary
swatch = ColourSwatch(SwatchColor=RGB(0, 0, 0))
ln = Line(StartPoint=area_2.Centroid, EndPoint=area_3.Centroid)
ln_2 = Line(StartPoint=area.Centroid, EndPoint=area_2.Centroid)
ln_3 = Line(StartPoint=area_3.Centroid, EndPoint=area_4.Centroid)
ln_4 = Line(StartPoint=area.Centroid, EndPoint=area_4.Centroid)
preview = CustomPreview(Geometry=[ln_2, ln, ln_3, ln_4], Material=swatch)

offset = OffsetCurve(Curve=crv, Distance=number_slider, Corners=1)
offset_2 = OffsetCurve(Curve=crv_2, Distance=number_slider, Corners=1)
offset_3 = OffsetCurve(Curve=crv_3, Distance=number_slider, Corners=1)
offset_4 = OffsetCurve(Curve=crv_4, Distance=number_slider, Corners=1)
explode = Explode(Curve=offset_3, Recursive=True)  # -> Segments, Vertices
preview_2 = CustomPreview(Geometry=[offset, offset_2, offset_3, offset_4], Material=ColourSwatch(SwatchColor=RGBA(176, 135, 135, 124)))
explode_2 = Explode(Curve=offset, Recursive=True)  # -> Segments, Vertices
explode_3 = Explode(Curve=offset_2, Recursive=True)  # -> Segments, Vertices
explode_4 = Explode(Curve=offset_4, Recursive=True)  # -> Segments, Vertices
midpt = CurveMiddle(Curve=ln_4)
midpt_2 = CurveMiddle(Curve=ln_3)
midpt_3 = CurveMiddle(Curve=ln_2)

# ----
# Closet Pt to EX Column
item = ListItem(List=explode_3.Vertices, Index=0, Wrap=True)  # -> Item, Item1, Item2, Item3
pt_3 = Point(item.Item2)

# ----
# Closet Pt to EX Column
item_2 = ListItem(List=explode_4.Vertices, Index=0, Wrap=True)  # -> Item, Item1, Item2, Item3
pt_4 = Point(item_2.Item)

# ----
# Closet Pt to EX Column
item_3 = ListItem(List=explode.Vertices, Index=0, Wrap=True)  # -> Item, Item1, Item2, Item3
pt_5 = Point(item_3.Item3)

# ----
# Closet Pt to EX Column
item_4 = ListItem(List=explode_2.Vertices, Index=0, Wrap=True)  # -> Item, Item1, Item2, Item3
ex_col_1_pt_2 = Point(item_4.Item1)

# ----
# Symetrical Axis
ln_5 = Line(StartPoint=midpt_3, EndPoint=midpt_2)

pt_6 = Point(item_4.Item2)
pt_7 = Point(item_4.Item3)
pt_8 = Point(item_4.Item)
pt_9 = Point(item_2.Item3)

# ----
# Offseted Symetrical MidPt
number_slider_2 = Slider(0.65, range=0.5..0.65)
eval = EvaluateCurve(ExEdge3=reparameterize(ln_3), Parameter=number_slider_2)  # -> OffsetedMidPt, Tangent, Angle

Z = UnitZ(Factor=1)
extr = Extrude(Base=ln_5, Direction=Z)
angl_area1_2 = Slider(10, range=-10..30)
loc_area1 = Slider(0.54, range=0.5..0.8)
loc_area2 = Slider(1.05, range=0.85..1.23)
angl_area2_3 = Slider(7, range=-15..15)
subd = SubD(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)
subd_2 = SubD([<subd referenced from the Rhino model> x5])
subdedges = SubDEdges(SubD=subd_2, NewFormatting=False)  # -> Line, Edge, Tag, Id
cluster = Cluster(
    start_view=pt,
    syme_axis=ln_5,
    loc_area1=loc_area1,
    void=Slider(0.2, range=0..1),
    minor_void=Slider(0.5, range=0..1),
    loc_area2=loc_area2,
    angl_area1_2=angl_area1_2,
    angl_area2_3=angl_area2_3,
    area1_2_connect=Slider(0.5, range=0.45..0.6),
    area2_3_connect=Slider(0.54, range=0.5..0.65),
    offset_midpt=eval.OffsetedMidPt,
    mush_3_axis_shift=Slider(-0.4, range=-0.8..0.2),
    A=pt_8,
    B=item.Item3,
    ex_col_1_pt_2=ex_col_1_pt_2,
    ex_column1=pt_8,
    view_clr=eval.OffsetedMidPt,
    ex_col_3_clr=pt_7,
    main_view=pt,
    ex_col_3_pt_4=item_2.Item3,
    P=midpt,
    ex_col_1_clr=pt_2,
    mush1_wing=Slider(0.4, range=0.3..0.6),
    main_view_2=pt)  # -> total_area, mushroom1, mushrooom2, mushroom2_1, mushroom3, mushroom3_1, mush_1_poly, mush_2_poly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
subdverts = SubDVertices(SubD=subd)  # -> Point, Id, Tag
subdedges_2 = SubDEdges(SubD=subd, NewFormatting=False)  # -> Line, Edge, Tag, Id
crv_5 = Curve([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])
crv_6 = Curve(subdedges.Line)
crv_7 = Curve(subdedges_2.Line)
wbweave = WeaverbirdsMeshFromLinesWeaveBack(Lines=crv_6, MaximumValence=4)
wbweave_2 = WeaverbirdsMeshFromLinesWeaveBack(Lines=crv_7, MaximumValence=4)
xz = XZPlane(Origin=pt)
panel = Panel(cluster.total_area)
disjoint = DisjointMesh(Mesh=wbweave_2)  # -> graft(Meshes)
demesh = DeconstructMesh(Mesh=wbweave)  # -> Vertices, Faces, Colours, Normals
crv_8 = Curve([cluster.mushroom1, cluster.mushrooom2, cluster.mushroom2_1, cluster.mushroom3, cluster.mushroom3_1])
area_5 = Area(Geometry=cluster.mushroom1)  # -> Area, Centroid
area_6 = Area(Geometry=cluster.mushrooom2)  # -> Area, Centroid
area_7 = Area(Geometry=cluster.mushroom3)  # -> Area, Centroid
mirror = Mirror(Geometry=disjoint, Plane=xz)  # -> Geometry, Transform
flatten = FlattenTree(Tree=demesh.Vertices, Path="{0}")
merge = Merge(Data1=disjoint, Data2=mirror.Geometry)

# ----
# Column 1
number_slider_3 = Slider(0.5, range=0..1)
cir = Circle(Plane=area_5.Centroid, Radius=number_slider_3)
boundary = BoundarySurfaces(Edges=cir)
# Main Symetrical
preview_3 = CustomPreview(Geometry=[boundary, cluster.mushroom1], Material=ColourSwatch(SwatchColor=RGB(178, 162, 127)))

# ----
# Column 2
number_slider_4 = Slider(0.3, range=0..1)
cir_2 = Circle(Plane=area_6.Centroid, Radius=number_slider_4)
boundary_2 = BoundarySurfaces(Edges=cir_2)
# Main Symetrical
preview_4 = CustomPreview(Geometry=[boundary_2, cluster.mushrooom2, cluster.mushroom2_1], Material=ColourSwatch(SwatchColor=RGB(122, 151, 153)))

# ----
# Column 3
number_slider_5 = Slider(0.3, range=0..1)
cir_3 = Circle(Plane=area_7.Centroid, Radius=number_slider_5)
boundary_3 = BoundarySurfaces(Edges=cir_3)
preview_5 = CustomPreview(Geometry=[boundary_3, cluster.mushroom3, cluster.mushroom3_1], Material=ColourSwatch(SwatchColor=RGB(167, 126, 168)))

explode_5 = Explode(Curve=crv_8, Recursive=True)  # -> Segments, Vertices
cullpt = CullDuplicates(Points=flatten, Tolerance=Slider(0.03, range=0..0.1), CullMode=3)  # -> Points, Indices, Valence
bang = ExplodeTree(Data=merge)  # -> _0000, _0001, _0002
cp = ClosestPoint(Point=demesh.Vertices, Cloud=cullpt.Points)  # -> ClosestPoint, CPIndex, Distance
mesh = Mesh([bang._0000, bang._0002])
conmesh = ConstructMesh(Vertices=cp.ClosestPoint, Faces=demesh.Faces)
wbcatmullclark = WeaverbirdsCatmullClarkSubdivision(MeshCurves=conmesh, Level=1, SmoothNakedEdges=1)  # disabled

# ----
# Ex. Col.
# Offset Clearance
number_slider_6 = Slider(0.2, range=0..1)

# ----
# Existing Column
crv_9 = Curve(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)
crv_10 = Curve(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)
crv_11 = Curve(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)
crv_12 = Curve(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)
area_8 = Area(Geometry=crv_9)  # -> Area, Centroid
area_9 = Area(Geometry=crv_10)  # -> Area, Centroid
area_10 = Area(Geometry=crv_11)  # -> Area, Centroid
area_11 = Area(Geometry=crv_12)  # -> Area, Centroid

# ----
# Starting
# View Location
pt_10 = Point(Point(3, 6, 0))

pt_11 = Point(Point(9.3, 8.825, 0))

# ----
# Ex. Column
# Boudrary
swatch_2 = ColourSwatch(SwatchColor=RGB(0, 0, 0))
ln_6 = Line(StartPoint=area_9.Centroid, EndPoint=area_10.Centroid)
ln_7 = Line(StartPoint=area_8.Centroid, EndPoint=area_9.Centroid)
ln_8 = Line(StartPoint=area_10.Centroid, EndPoint=area_11.Centroid)
ln_9 = Line(StartPoint=area_8.Centroid, EndPoint=area_11.Centroid)
preview_6 = CustomPreview(Geometry=[ln_7, ln_6, ln_8, ln_9], Material=swatch_2)

offset_5 = OffsetCurve(Curve=crv_9, Distance=number_slider_6, Corners=1)
offset_6 = OffsetCurve(Curve=crv_10, Distance=number_slider_6, Corners=1)
offset_7 = OffsetCurve(Curve=crv_11, Distance=number_slider_6, Corners=1)
offset_8 = OffsetCurve(Curve=crv_12, Distance=number_slider_6, Corners=1)
explode_6 = Explode(Curve=offset_7, Recursive=True)  # -> Segments, Vertices
preview_7 = CustomPreview(Geometry=[offset_5, offset_6, offset_7, offset_8], Material=ColourSwatch(SwatchColor=RGBA(176, 135, 135, 124)))
explode_7 = Explode(Curve=offset_5, Recursive=True)  # -> Segments, Vertices
explode_8 = Explode(Curve=offset_6, Recursive=True)  # -> Segments, Vertices
explode_9 = Explode(Curve=offset_8, Recursive=True)  # -> Segments, Vertices
midpt_4 = CurveMiddle(Curve=ln_9)
midpt_5 = CurveMiddle(Curve=ln_8)
midpt_6 = CurveMiddle(Curve=ln_7)

# ----
# Closet Pt to EX Column
item_5 = ListItem(List=explode_8.Vertices, Index=0, Wrap=True)  # -> Item, Item1, Item2, Item3
pt_12 = Point(item_5.Item2)

# ----
# Closet Pt to EX Column
item_6 = ListItem(List=explode_9.Vertices, Index=0, Wrap=True)  # -> Item, Item1, Item2, Item3
pt_13 = Point(item_6.Item)

# ----
# Closet Pt to EX Column
item_7 = ListItem(List=explode_6.Vertices, Index=0, Wrap=True)  # -> Item, Item1, Item2, Item3
pt_14 = Point(item_7.Item3)

# ----
# Closet Pt to EX Column
item_8 = ListItem(List=explode_7.Vertices, Index=0, Wrap=True)  # -> Item, Item1, Item2, Item3
ex_col_1_pt_2_2 = Point(item_8.Item1)

# ----
# Symetrical Axis
ln_10 = Line(StartPoint=midpt_6, EndPoint=midpt_5)

pt_15 = Point(item_8.Item2)
pt_16 = Point(item_8.Item3)
pt_17 = Point(item_8.Item)
pt_18 = Point(item_6.Item3)

# ----
# Offseted Symetrical MidPt
number_slider_7 = Slider(0.65, range=0.5..0.65)
eval_2 = EvaluateCurve(ExEdge3=reparameterize(ln_8), Parameter=number_slider_7)  # -> OffsetedMidPt, Tangent, Angle

Z_2 = UnitZ(Factor=1)
extr_2 = Extrude(Base=ln_10, Direction=Z_2)
angl_area1_2_2 = Slider(13, range=4..21)
loc_area1_2 = Slider(0.61, range=0.5..0.67)
loc_area2_2 = Slider(1.02, range=0.85..1.2)
angl_area2_3_2 = Slider(-3, range=-15..15)
ln_11 = Line(ExCol1Clr=pt_11, EndPoint=pt_10)
ln_12 = Line(ExCol3Clr=pt_16, EndPoint=pt_10)
ext = ExtendCurve(Curve=ln_12, Type=0, Start=10, End=10)
ext_2 = ExtendCurve(Curve=ln_11, Type=0, Start=10, End=10)
eval_3 = EvaluateCurve(SymetricalAxis=ln_10, LocArea1=loc_area1_2)  # -> Point, Tangent, Angle
tweencrv = TweenCurve(CurveA=ext, CurveB=ext_2, Factor=0.5, BlendType=0)
crv_cp = CurveClosestPoint(Point=midpt_4, Curve=tweencrv)  # -> Point, Parameter, Distance

# ----
# Area 3
pt_19 = Point(crv_cp.Point)
cir_4 = Circle(Plane=pt_19, Radius=0.3)

# ----
# Area 1
pt_20 = Point(eval_3.Point)
cir_5 = Circle(Plane=pt_20, Radius=0.3)

ln_13 = Line(StartPoint=eval_2.OffsetedMidPt, StartView=pt_10)
ln_14 = Line(StartPoint=pt_20, ExColumn1=pt_17)
offset_9 = OffsetCurve(Curve=ln_13, LocArea2=loc_area2_2, Corners=1)
ccx = CurveCurve(CurveA=ln_14, CurveB=offset_9)  # -> Points, ParamsA, ParamsB

# ----
# Area 2
pt_21 = Point(ccx.Points)
cir_6 = Circle(Plane=pt_21, Radius=0.3)

# ----
# Center
# Connection
ln_15 = Line(StartPoint=pt_20, EndPoint=pt_21)
ln_16 = Line(StartPoint=pt_21, EndPoint=pt_19)
ln_17 = Line(StartPoint=pt_20, EndPoint=pt_19)

hframe = HorizontalFrame(Curve=ln_16, Area23Connect=Slider(0.61, range=0.5..0.61))
hframe_2 = HorizontalFrame(Curve=ln_15, Area12Connect=Slider(0.52, range=0.45..0.54))
deplane = DeconstructPlane(Plane=hframe_2)  # -> Origin, XAxis, YAxis, ZAxis
deplane_2 = DeconstructPlane(Plane=hframe)  # -> Origin, XAxis, YAxis, ZAxis

vrot = Rotate(Vector=deplane.YAxis, Axis=deplane.ZAxis, AnglArea12=degrees(angl_area1_2_2))
vrot_2 = Rotate(Vector=deplane_2.YAxis, Axis=deplane_2.ZAxis, AnglArea23=degrees(angl_area2_3_2))
line = LineSDL(Start=deplane.Origin, Direction=vrot, Length=15)
line_2 = LineSDL(Start=deplane_2.Origin, Direction=vrot_2, Length=10)
ccx_2 = CurveCurve(CurveA=line, SymeAxis=ln_10)  # -> Pt1Syme, ParamsA, ParamsB

ln_18 = Line(StartPoint=ccx_2.Pt1Syme, EndPoint=pt_21)
Z_3 = UnitZ(Factor=1)
extr_3 = Extrude(Base=ln_18, Direction=Z_3)

ln_19 = Line(StartPoint=pt_17, EndPoint=item_5.Item3)
ln_20 = Line(StartPoint=deplane.Origin, EndPoint=ccx_2.Pt1Syme)
crv_cp_2 = CurveClosestPoint(Point=ccx_2.Pt1Syme, ExEdge1=ln_19)  # -> Point, Parameter, Distance
ln_21 = Line(StartPoint=ccx_2.Pt1Syme, EndPoint=crv_cp_2.Point)
mirror_2 = Mirror(Geometry=deplane_2.Origin, Plane=extr_3)  # -> Geometry, Transform

# ----
# Crv. Extend
panel_2 = Panel("10")

ln_22 = Line(StartPoint=mirror_2.Geometry, ExCol1Pt2=ex_col_1_pt_2_2)
eval_4 = EvaluateCurve(Curve=reparameterize(ln_21), Parameter=Slider(0.1, range=0..1))  # -> Point, Tangent, Angle
ext_3 = ExtendCurve(Curve=line_2, Type=0, Start=panel_2, End=panel_2)
ext_4 = ExtendCurve(Curve=ln_20, Type=0, Start=panel_2, End=panel_2)
ext_5 = ExtendCurve(Curve=ln_22, Type=0, Start=panel_2, End=panel_2)
ccx_3 = CurveCurve(CurveA=ext_5, CurveB=ext_3)  # -> Points, ParamsA, ParamsB

Z_4 = UnitZ(Factor=1)
extr_4 = Extrude(Area3Syme=tweencrv, Direction=Z_4)
crv_cp_3 = CurveClosestPoint(Point=ccx_3.Points, Curve=extr_4)  # -> Point, Parameter, Distance
vec2pt = Vector2Pt(PointA=ccx_3.Points, PointB=crv_cp_3.Point, Unitize=False)  # -> Vector, Length
amp = Amplitude(Vector=vec2pt.Vector, Mush3AxisShift=Slider(-0.6, range=-0.8..0.2))
move = Move(Geometry=extr_4, Motion=amp)  # -> Geometry, Transform

ccx_4 = CurveCurve(CurveA=ext_3, CurveB=ext_4)  # -> Points, ParamsA, ParamsB

ln_23 = Line(ExCol3Pt4=item_6.Item3, EndPoint=ccx_4.Points)
eval_5 = EvaluateCurve(Curve=ln_23, Mush1Wing=Slider(0.4, range=0.3..0.6))  # -> Point, Tangent, Angle

Z_5 = UnitZ(Factor=1)
ccx_5 = CurveCurve(CurveA=ext_4, CurveB=tweencrv)  # -> Points, ParamsA, ParamsB
crv_cp_4 = CurveClosestPoint(Point=eval_5.Point, ClrOffset=offset_9)  # -> Point, Parameter, Distance
extr_5 = Extrude(MainSymetricalAxis=ln_10, Direction=Z_5)
merge_2 = Merge(Data1=ccx_4.Points, Data2=eval_5.Point)
ln_24 = Line(StartPoint=deplane.Origin, EndPoint=ccx_4.Points)
eval_6 = EvaluateCurve(Curve=reparameterize(ln_24), MinorVoid=Slider(0.59, range=0.3..0.79))  # -> Point, Tangent, Angle
mirror_3 = Mirror(Geometry=merge_2, ShiftedSyme=move.Geometry)  # -> Geometry, Transform
merge_3 = Merge(Data1=deplane_2.Origin, Data2=ccx_4.Points, Data3=eval_5.Point)
offset_midpt = Point(eval_2.OffsetedMidPt)
merge_4 = Merge(
    Data1=eval_4.Point,
    Data2=crv_cp_2.Point,
    Data3=mirror_2.Geometry,
    Data4=ccx_3.Points,
    Data6=deplane_2.Origin,
    Data7=ex_col_1_pt_2_2,
    Data8=deplane.Origin,
    Data9=eval_6.Point)
merge_5 = Merge(Data1=ccx_5.Points, Data2=merge_3, Data3=mirror_3.Geometry)
merge_6 = Merge(
    Data1=deplane.Origin,
    Data2=ccx_4.Points,
    Data3=eval_5.Point,
    Data4=crv_cp_4.Point,
    Data5=offset_midpt,
    Data6=eval_6.Point)
pt_22 = Point(ccx_5.Points)
pt_23 = Point(eval_4.Point)
pt_24 = Point(deplane.Origin)
crv_cp_5 = CurveClosestPoint(Point=pt_22, Curve=reparameterize(cir_4))  # -> Point, Parameter, Distance
crv_cp_6 = CurveClosestPoint(Point=pt_23, Curve=reparameterize(cir_6))  # -> Point, Parameter, Distance
crv_cp_7 = CurveClosestPoint(Point=pt_24, Curve=reparameterize(cir_5))  # -> Point, Parameter, Distance
seam = Seam(Curve=reparameterize(cir_4), Seam=crv_cp_5.Parameter)
seam_2 = Seam(Curve=reparameterize(cir_6), Seam=crv_cp_6.Parameter)
seam_3 = Seam(Curve=reparameterize(cir_5), Seam=crv_cp_7.Parameter)
mirror_4 = Mirror(Geometry=merge_6, Plane=extr_5)  # -> Geometry, Transform
alongcrv = SortAlongCurve(Points=flatten(merge_4), Column2Cir=seam_2)  # -> Points, Indices
alongcrv_2 = SortAlongCurve(Points=flatten(merge_5), Column3Cir=seam)  # -> Points, Indices
alongcrv_3 = SortAlongCurve(Points=flatten([merge_6, mirror_4.Geometry]), Column1Cir=seam_3)  # -> Points, Indices
number_slider_8 = Slider(0.25, range=0..1)
points = PointList(Points=alongcrv.Points, Size=Slider(0.27, range=0..1))
pline = PolyLine(Vertices=alongcrv.Points, Closed=invert(False))
pline_2 = PolyLine(Vertices=alongcrv_2.Points, Closed=invert(False))
pline_3 = PolyLine(Vertices=alongcrv_3.Points, Closed=invert(False))
entwine = Entwine(Branch00=alongcrv_3.Points, Branch01=alongcrv_2.Points, Branch02=alongcrv.Points, FlattenInputs=True)
fillet = FilletDistance(Curve=pline, Distance=number_slider_8)
fillet_2 = FilletDistance(Curve=pline_2, Distance=number_slider_8)
fillet_3 = FilletDistance(Curve=pline_3, Distance=number_slider_8)
cir_7 = Circle(Plane=entwine, Radius=Slider(0.06, range=0..1))
number_slider_9 = Slider(0.62, range=0..1)
boundary_4 = BoundarySurfaces(Edges=fillet)
boundary_5 = BoundarySurfaces(Edges=fillet_2)
boundary_6 = BoundarySurfaces(Edges=fillet_3)
pt_25 = Point(alongcrv.Points)
pt_26 = Point(alongcrv_2.Points)
explode_10 = Explode(Curve=fillet_3, Recursive=True)  # -> Segments, Vertices
previewlw = CustomPreviewLineweights(
    Geometry=cir_7,
    Shader=[ColourSwatch(SwatchColor=RGB(255, 0, 0)), ColourSwatch(SwatchColor=RGB(51, 255, 0)), ColourSwatch(SwatchColor=RGB(0, 47, 255))],
    Thickness=Slider(4, range=0..10),
    Absolute=False)
pt_27 = Point(alongcrv_3.Points)
connect_id3 = Slider(3, range=1..4)
connect_id2 = Slider(3, range=1..4)
basicsubdivision_1 = BasicSubdivision_1(pt_2=pt_27, pt=pt_10, R=Slider(0.47, range=0.3..1), t=Slider(0.35, range=0..1), D=number_slider_8)  # -> pt_7, R_2
connect_id1 = Slider(3, range=1..4)
basicsubdivision_2 = BasicSubdivision_2(
    pt_2=basicsubdivision_1.pt_7,
    pt_3=pt_25,
    pt=pt_10,
    col_rad=Slider(0.46, range=0.3..1),
    D=number_slider_8,
    X=Slider(0.43, range=0..1),
    Y=Slider(0.63, range=0..1))
basicsubdivision_3 = BasicSubdivision_3(
    pt_2=pt_26,
    pt=pt_10,
    col_rad=Slider(0.48, range=0.3..1),
    D=number_slider_8,
    X=Slider(0.54, range=0..1),
    Y=Slider(0.32, range=0..1))
merge_7 = Merge(Data1=boundary_4, Data2=boundary_5)
subdivision = Subdivision(num=number_slider_9, brep=basicsubdivision_1.R_2, V_2=connect_id1, V=connect_id2)  # disabled
subdivision_2 = Subdivision_2(num=number_slider_9, brep=basicsubdivision_2, V_2=connect_id2, V=connect_id3)
subdivision_3 = Subdivision_3(num=number_slider_9, brep=basicsubdivision_3, V_2=connect_id1, V=connect_id3)
mirror_5 = Mirror(Geometry=merge_7, Plane=extr_5)  # -> Geometry, Transform
explode_11 = Explode(Curve=subdivision, Recursive=True)  # -> Segments, Vertices
merge_8 = Merge(Data1=mirror_5.Geometry, Data2=boundary_6, Data3=merge_7)
explode_12 = Explode(Curve=boundary_4, Recursive=True)  # -> Segments, Vertices
explode_13 = Explode(Curve=boundary_5, Recursive=True)  # -> Segments, Vertices
explode_14 = Explode(Curve=boundary_6, Recursive=True)  # -> Segments, Vertices
explode_15 = Explode(Recursive=True)  # -> Segments, Vertices; disabled
explode_16 = Explode(Recursive=True)  # -> Segments, Vertices; disabled
brep = Brep(subdivision)
brep_2 = Brep(subdivision_2)
brep_3 = Brep(subdivision_3)
area_12 = Area(Geometry=flatten(merge_8))  # -> Area, Centroid
wbweave_3 = WeaverbirdsMeshFromLinesWeaveBack(Lines=explode_11.Segments, MaximumValence=4)
mirror_6 = Mirror(Geometry=boundary_4, Plane=extr_5)  # -> Mushroom21, Transform
mirror_7 = Mirror(Geometry=boundary_5, Plane=extr_5)  # -> Mushroom31, Transform
mirror_8 = Mirror(Geometry=pline, Plane=extr_5)  # -> Mush21Poly, Transform
mirror_9 = Mirror(Geometry=pline_2, Plane=extr_5)  # -> Mush31Poly, Transform
wbweave_4 = WeaverbirdsMeshFromLinesWeaveBack(Lines=explode_15.Segments, MaximumValence=4)  # disabled
wbweave_5 = WeaverbirdsMeshFromLinesWeaveBack(Lines=explode_16.Segments, MaximumValence=4)  # disabled
ma = MassAddition(Input=flatten(area_12.Area))  # -> TotalArea, PartialResults
clean = CombineClean(Meshes=flatten(wbweave_3))
clean_2 = CombineClean(Meshes=flatten(wbweave_4))  # disabled
clean_3 = CombineClean(Meshes=flatten(wbweave_5))  # disabled
explode_17 = MeshExplode(Mesh=clean, Interpolate=False)
panel_3 = Panel(ma.TotalArea)
crv_13 = Curve(flatten([boundary_6, boundary_4, mirror_6.Mushroom21, boundary_5, mirror_7.Mushroom31]))
area_13 = Area(Geometry=boundary_6)  # -> Area, Centroid
area_14 = Area(Geometry=boundary_4)  # -> Area, Centroid
area_15 = Area(Geometry=boundary_5)  # -> Area, Centroid

# ==== cluster Cluster
ex_col_3_clr = ClusterInput()
main_view = ClusterInput()
ex_col_1_clr = ClusterInput()
main_view_2 = ClusterInput()
mush_3_axis_shift = ClusterInput()
ex_column1 = ClusterInput()
view_clr = ClusterInput()
offset_midpt = ClusterInput()
start_view = ClusterInput()
syme_axis = ClusterInput()
loc_area1 = ClusterInput()
loc_area2 = ClusterInput()
angl_area1_2 = ClusterInput()
angl_area2_3 = ClusterInput()
area1_2_connect = ClusterInput()
area2_3_connect = ClusterInput()
ln = Line(ExCol1Clr=ex_col_1_clr, EndPoint=main_view_2)
ln_2 = Line(ExCol3Clr=ex_col_3_clr, EndPoint=main_view)
ext = ExtendCurve(Curve=ln_2, Type=0, Start=10, End=10)
ext_2 = ExtendCurve(Curve=ln, Type=0, Start=10, End=10)
eval = EvaluateCurve(SymetricalAxis=syme_axis, LocArea1=loc_area1)  # -> Point, Tangent, Angle
tweencrv = TweenCurve(CurveA=ext, CurveB=ext_2, Factor=0.5, BlendType=0)
P = ClusterInput()
crv_cp = CurveClosestPoint(Point=P, Curve=tweencrv)  # -> Point, Parameter, Distance

# ----
# Area 3
pt = Point(crv_cp.Point)
cir = Circle(Plane=pt, Radius=0.3)

# ----
# Area 1
pt_2 = Point(eval.Point)
cir_2 = Circle(Plane=pt_2, Radius=0.3)

ln_3 = Line(StartPoint=view_clr, StartView=start_view)
ln_4 = Line(StartPoint=pt_2, ExColumn1=ex_column1)
offset = OffsetCurve(Curve=ln_3, LocArea2=loc_area2, Corners=1)
ccx = CurveCurve(CurveA=ln_4, CurveB=offset)  # -> Points, ParamsA, ParamsB

# ----
# Area 2
pt_3 = Point(ccx.Points)
cir_3 = Circle(Plane=pt_3, Radius=0.3)

# ----
# Center
# Connection
ln_5 = Line(StartPoint=pt_2, EndPoint=pt_3)
ln_6 = Line(StartPoint=pt_3, EndPoint=pt)
ln_7 = Line(StartPoint=pt_2, EndPoint=pt)

hframe = HorizontalFrame(Curve=ln_6, Area23Connect=area2_3_connect)
hframe_2 = HorizontalFrame(Curve=ln_5, Area12Connect=area1_2_connect)
deplane = DeconstructPlane(Plane=hframe_2)  # -> Origin, XAxis, YAxis, ZAxis
deplane_2 = DeconstructPlane(Plane=hframe)  # -> Origin, XAxis, YAxis, ZAxis

vrot = Rotate(Vector=deplane.YAxis, Axis=deplane.ZAxis, AnglArea12=degrees(angl_area1_2))
vrot_2 = Rotate(Vector=deplane_2.YAxis, Axis=deplane_2.ZAxis, AnglArea23=degrees(angl_area2_3))
line = LineSDL(Start=deplane.Origin, Direction=vrot, Length=15)
line_2 = LineSDL(Start=deplane_2.Origin, Direction=vrot_2, Length=10)
ccx_2 = CurveCurve(CurveA=line, SymeAxis=syme_axis)  # -> Pt1Syme, ParamsA, ParamsB
A = ClusterInput()
B = ClusterInput()

ln_8 = Line(StartPoint=ccx_2.Pt1Syme, EndPoint=pt_3)
Z = UnitZ(Factor=1)
extr = Extrude(Base=ln_8, Direction=Z)

ln_9 = Line(StartPoint=A, EndPoint=B)
ln_10 = Line(StartPoint=deplane.Origin, EndPoint=ccx_2.Pt1Syme)
void = ClusterInput()
ex_col_3_pt_4 = ClusterInput()
ex_col_1_pt_2 = ClusterInput()
crv_cp_2 = CurveClosestPoint(Point=ccx_2.Pt1Syme, ExEdge1=ln_9)  # -> Point, Parameter, Distance
ln_11 = Line(StartPoint=ccx_2.Pt1Syme, EndPoint=crv_cp_2.Point)
mush1_wing = ClusterInput()
mirror = Mirror(Geometry=deplane_2.Origin, Plane=extr)  # -> Geometry, Transform

# ----
# Crv. Extend
panel = Panel("10")

ln_12 = Line(StartPoint=mirror.Geometry, ExCol1Pt2=ex_col_1_pt_2)
eval_2 = EvaluateCurve(Curve=reparameterize(ln_11), Parameter=void)  # -> Point, Tangent, Angle
ext_3 = ExtendCurve(Curve=line_2, Type=0, Start=panel, End=panel)
ext_4 = ExtendCurve(Curve=ln_10, Type=0, Start=panel, End=panel)
ext_5 = ExtendCurve(Curve=ln_12, Type=0, Start=panel, End=panel)
minor_void = ClusterInput()
ccx_3 = CurveCurve(CurveA=ext_5, CurveB=ext_3)  # -> Points, ParamsA, ParamsB

Z_2 = UnitZ(Factor=1)
extr_2 = Extrude(Area3Syme=tweencrv, Direction=Z_2)
crv_cp_3 = CurveClosestPoint(Point=ccx_3.Points, Curve=extr_2)  # -> Point, Parameter, Distance
vec2pt = Vector2Pt(PointA=ccx_3.Points, PointB=crv_cp_3.Point, Unitize=False)  # -> Vector, Length
amp = Amplitude(Vector=vec2pt.Vector, Mush3AxisShift=mush_3_axis_shift)
move = Move(Geometry=extr_2, Motion=amp)  # -> Geometry, Transform

ccx_4 = CurveCurve(CurveA=ext_3, CurveB=ext_4)  # -> Points, ParamsA, ParamsB

ln_13 = Line(ExCol3Pt4=ex_col_3_pt_4, EndPoint=ccx_4.Points)
eval_3 = EvaluateCurve(Curve=ln_13, Mush1Wing=mush1_wing)  # -> Point, Tangent, Angle

Z_3 = UnitZ(Factor=1)
ccx_5 = CurveCurve(CurveA=ext_4, CurveB=tweencrv)  # -> Points, ParamsA, ParamsB
crv_cp_4 = CurveClosestPoint(Point=eval_3.Point, ClrOffset=offset)  # -> Point, Parameter, Distance
extr_3 = Extrude(MainSymetricalAxis=syme_axis, Direction=Z_3)
merge = Merge(Data1=ccx_4.Points, Data2=eval_3.Point)
ln_14 = Line(StartPoint=deplane.Origin, EndPoint=ccx_4.Points)
eval_4 = EvaluateCurve(Curve=reparameterize(ln_14), MinorVoid=minor_void)  # -> Point, Tangent, Angle
mirror_2 = Mirror(Geometry=merge, ShiftedSyme=move.Geometry)  # -> Geometry, Transform
merge_2 = Merge(Data1=deplane_2.Origin, Data2=ccx_4.Points, Data3=eval_3.Point)
offset_midpt_2 = Point(offset_midpt)
merge_3 = Merge(Data1=deplane.Origin, Data2=ccx_4.Points, Data3=eval_3.Point, Data4=crv_cp_4.Point, Data5=offset_midpt_2)
merge_4 = Merge(Data1=ccx_5.Points, Data2=merge_2, Data3=mirror_2.Geometry)
merge_5 = Merge(
    Data1=eval_2.Point,
    Data2=crv_cp_2.Point,
    Data3=mirror.Geometry,
    Data4=ccx_3.Points,
    Data6=deplane_2.Origin,
    Data7=ex_col_1_pt_2,
    Data8=deplane.Origin,
    Data9=eval_4.Point)
mirror_3 = Mirror(Geometry=merge_3, Plane=extr_3)  # -> Geometry, Transform

alongcrv = SortAlongCurve(Points=flatten(merge_5), Column2Cir=cir_3)  # -> Points, Indices
pline = PolyLine(Vertices=alongcrv.Points, Closed=invert(False))
fillet = FilletDistance(Curve=pline, Distance=Slider(0.3, range=0..1))
boundary = BoundarySurfaces(Edges=fillet)

points = PointList(Points=alongcrv.Points, Size=Slider(1, range=0..10))

alongcrv_2 = SortAlongCurve(Points=flatten(merge_4), Column3Cir=cir)  # -> Points, Indices
pline_2 = PolyLine(Vertices=alongcrv_2.Points, Closed=invert(False))
fillet_2 = FilletDistance(Curve=pline_2, Distance=Slider(0.4, range=0..1))
boundary_2 = BoundarySurfaces(Edges=fillet_2)

alongcrv_3 = SortAlongCurve(Points=flatten(merge_5), Column2Cir=cir_3)  # -> Points, Indices; disabled
number_slider = Slider(0, range=0..1)  # disabled
pline_3 = PolyLine(Vertices=alongcrv_3.Points, Closed=invert(False))  # disabled
fillet_3 = FilletDistance(Curve=pline_3, Distance=number_slider)  # disabled
boundary_3 = BoundarySurfaces(Edges=fillet_3)  # disabled

alongcrv_4 = SortAlongCurve(Points=flatten(merge_4), Column3Cir=cir)  # -> Points, Indices; disabled
number_slider_2 = Slider(0, range=0..1)  # disabled
pline_4 = PolyLine(Vertices=alongcrv_4.Points, Closed=invert(False))  # disabled
fillet_4 = FilletDistance(Curve=pline_4, Distance=number_slider_2)  # disabled
boundary_4 = BoundarySurfaces(Edges=fillet_4)  # disabled

alongcrv_5 = SortAlongCurve(Points=flatten([merge_3, mirror_3.Geometry]), Column1Cir=cir_2)  # -> Points, Indices
pline_5 = PolyLine(Vertices=alongcrv_5.Points, Closed=invert(False))
# Mushroom 1
fillet_5 = FilletDistance(Curve=pline_5, Distance=Slider(0.3, range=0..1))
boundary_5 = BoundarySurfaces(Edges=fillet_5)

alongcrv_6 = SortAlongCurve(Points=flatten([merge_3, mirror_3.Geometry]), Column1Cir=cir_2)  # -> Points, Indices; disabled
number_slider_3 = Slider(0, range=0..1)  # disabled
pline_6 = PolyLine(Vertices=alongcrv_6.Points, Closed=invert(False))  # disabled
# Mushroom 1
fillet_6 = FilletDistance(Curve=pline_6, Distance=number_slider_3)  # disabled
boundary_6 = BoundarySurfaces(Edges=fillet_6)  # disabled

merge_6 = Merge(Data1=boundary, Data2=boundary_2)
crv = Curve(boundary_6)  # disabled
crv_2 = Curve(boundary_3)  # disabled
crv_3 = Curve(boundary_4)  # disabled
area = Area(Geometry=boundary_5)  # -> Area, Centroid
explode = Explode(Curve=crv, Recursive=True)  # -> Segments, Vertices; disabled
explode_2 = Explode(Curve=crv_2, Recursive=True)  # -> Segments, Vertices; disabled
explode_3 = Explode(Curve=crv_3, Recursive=True)  # -> Segments, Vertices; disabled
mirror_4 = Mirror(Geometry=merge_6, Plane=extr_3)  # -> Geometry, Transform
merge_7 = Merge(Data1=mirror_4.Geometry, Data2=boundary_5, Data3=merge_6)
area_2 = Area(Geometry=flatten(merge_7))  # -> Area, Centroid
mirror_5 = Mirror(Geometry=boundary, Plane=extr_3)  # -> Mushroom21, Transform
mirror_6 = Mirror(Geometry=boundary_2, Plane=extr_3)  # -> Mushroom31, Transform
mirror_7 = Mirror(Geometry=pline, Plane=extr_3)  # -> Mush21Poly, Transform
mirror_8 = Mirror(Geometry=pline_2, Plane=extr_3)  # -> Mush31Poly, Transform
ma = MassAddition(Input=flatten(area_2.Area))  # -> TotalArea, PartialResults
panel_2 = Panel(ma.TotalArea)
total_area = ClusterOutput(ma.TotalArea)
mushroom1 = ClusterOutput(boundary_5)
mushrooom2 = ClusterOutput(boundary)
mushroom2_1 = ClusterOutput(mirror_5.Mushroom21)
mushroom3 = ClusterOutput(boundary_2)
mushroom3_1 = ClusterOutput(mirror_6.Mushroom31)
mush_1_poly = ClusterOutput(pline_5)
mush_2_poly = ClusterOutput(pline)
mush_2_1_poly = ClusterOutput(mirror_7.Mush21Poly)
mush_3_poly = ClusterOutput(pline_2)
mush_3_1_poly = ClusterOutput(mirror_8.Mush31Poly)

# ==== cluster BasicSubdivision_1
pt = ClusterInput()
pt_2 = ClusterInput()
pt_3 = Point(pt)
pt_4 = Point(pt_2)
pline = PolyLine(Vertices=pt_4, Closed=invert(False))
xz = XZPlane(Origin=pt_3)
crv = Curve(pline)
R = ClusterInput()
t = ClusterInput()
D = ClusterInput()
pcx = CurvePlane(Curve=crv, Plane=xz)  # -> Points, ParamsC, ParamsP
explode = Explode(Curve=pline, Recursive=True)  # -> Segments, Vertices
pline_2 = PolyLine(Vertices=pcx.Points, Closed=False)
addition = Addition(A=R, B="0.3")
crv_2 = Curve(simplify(graft(explode.Segments)))
shift = ShiftList(List=explode.Segments, Shift="-1", Wrap=True)  # -> simplify(graft(List))
neg = Negative(Value=addition)
ext = ExtendCurve(Curve=pline_2, Type=0, Start=neg, End=neg)
merge = Merge(Data1=crv_2, Data2=shift)
pt_5 = Point(simplify(graft(explode.Vertices)))
eval = EvaluateCurve(Curve=reparameterize(ext), Parameter=t)  # -> Point, Tangent, Angle
join = JoinCurves(Curves=merge, Preserve=False)
item = ListItem(List=merge, Index=0, Wrap=True)  # -> Item, Item1
cir = Circle(Plane=eval.Point, Radius=R)
angle = Angle(VectorA=item.Item, VectorB=item.Item1)  # -> Angle, Reflex
min = Minimum(A=angle.Angle, B=angle.Reflex)
crv_3 = Curve(cir)
equals = Equality(FirstNumber=min, SecondNumber="0")  # -> Equality, Inequality
dispatch = Dispatch(List=join, DispatchPattern=equals.Equality)  # -> ListA, ListB
fillet = FilletDistance(Curve=pline, Distance=D)
explode_2 = Explode(Curve=dispatch.ListA, Recursive=True)  # -> Segments, Vertices
explode_3 = Explode(Curve=fillet, Recursive=True)  # -> Segments, Vertices
item_2 = ListItem(List=explode_2.Vertices, Index="1", Wrap=True)
merge_2 = Merge(Data1=item_2, Data2=explode_3.Vertices)  # -> flatten(Result)
clean = CleanTree(RemoveNulls=True, RemoveInvalid=True, RemoveEmpty=invert(False), Tree=merge_2)
duppt = RemoveDuplicatePts(Points=clean, Tolerance=0.01)
alongcrv = SortAlongCurve(Points=duppt, Curve=fillet)  # -> Points, Indices
explode_4 = Explode(Curve=fillet, Recursive=True)  # -> Segments, Vertices
pt_6 = Point(alongcrv.Points)
pline_3 = PolyLine(Vertices=alongcrv.Points, Closed=False)
panel = Panel("""0
1""")
panel_2 = Panel("""14
15""")
panel_3 = Panel("""15
21""")
panel_4 = Panel("""21
0""")
panel_5 = Panel("""13
14""")
panel_6 = Panel("""17
20""")
panel_7 = Panel("""18
19""")

panel_8 = Panel("""1
2""")
panel_9 = Panel("""12
13""")
item_3 = ListItem(List=alongcrv.Points, Index=panel_8, Wrap=True)
item_4 = ListItem(List=alongcrv.Points, Index=panel_9, Wrap=True)
pull = PullPoint(Point=item_3, Geometry=crv_3, ClosestOnly=True)  # -> ClosestPoint, Distance
pull_2 = PullPoint(Point=item_4, Geometry=crv_3, ClosestOnly=True)  # -> ClosestPoint, Distance
pline_4 = PolyLine(Vertices=item_3, Closed=False)
pline_5 = PolyLine(Vertices=pull.ClosestPoint, Closed=False)
pline_6 = PolyLine(Vertices=item_4, Closed=False)
pline_7 = PolyLine(Vertices=pull_2.ClosestPoint, Closed=False)
loft = Loft(
    Curves=flatten([pline_4, pline_5]),
    Options={Adjust=False, Closed=False, LoftEnds=0, LoftSimp=0, LoftType=0, Rebuild=10, Refit=0.01})
loft_2 = Loft(
    Curves=flatten([pline_6, pline_7]),
    Options={Adjust=False, Closed=False, LoftEnds=0, LoftSimp=0, LoftType=0, Rebuild=10, Refit=0.01})

points = PointList(Points=pt_6, Size=Slider(0.23, range=0..1))
points_2 = PointList(Points=alongcrv.Points, Size=Slider(0.23, range=0..1))
item_5 = ListItem(List=alongcrv.Points, Index=panel_4, Wrap=True)
item_6 = ListItem(List=alongcrv.Points, Index=panel_6, Wrap=True)
item_7 = ListItem(List=alongcrv.Points, Index=panel_3, Wrap=True)
item_8 = ListItem(List=alongcrv.Points, Index=panel_7, Wrap=True)
item_9 = ListItem(List=alongcrv.Points, Index=panel, Wrap=True)
item_10 = ListItem(List=alongcrv.Points, Index=panel_2, Wrap=True)
item_11 = ListItem(List=alongcrv.Points, Index=panel_5, Wrap=True)
pt_7 = ClusterOutput(pt_6)
pull_3 = PullPoint(Point=item_5, Geometry=crv_3, ClosestOnly=True)  # -> ClosestPoint, Distance
pull_4 = PullPoint(Point=item_7, Geometry=crv_3, ClosestOnly=True)  # -> ClosestPoint, Distance
pull_5 = PullPoint(Point=item_9, Geometry=crv_3, ClosestOnly=True)  # -> ClosestPoint, Distance
pull_6 = PullPoint(Point=item_10, Geometry=crv_3, ClosestOnly=True)  # -> ClosestPoint, Distance
pull_7 = PullPoint(Point=item_11, Geometry=crv_3, ClosestOnly=True)  # -> ClosestPoint, Distance
pline_8 = PolyLine(Vertices=item_6, Closed=False)
pline_9 = PolyLine(Vertices=item_8, Closed=False)
pline_10 = PolyLine(Vertices=item_5, Closed=False)
pline_11 = PolyLine(Vertices=pull_3.ClosestPoint, Closed=False)
pline_12 = PolyLine(Vertices=item_7, Closed=False)
pline_13 = PolyLine(Vertices=pull_4.ClosestPoint, Closed=False)
pline_14 = PolyLine(Vertices=item_9, Closed=False)
pline_15 = PolyLine(Vertices=pull_5.ClosestPoint, Closed=False)
pline_16 = PolyLine(Vertices=item_10, Closed=False)
pline_17 = PolyLine(Vertices=pull_6.ClosestPoint, Closed=False)
pline_18 = PolyLine(Vertices=item_11, Closed=False)
pline_19 = PolyLine(Vertices=pull_7.ClosestPoint, Closed=False)
loft_3 = Loft(
    Curves=flatten([pline_10, pline_11]),
    Options={Adjust=False, Closed=False, LoftEnds=0, LoftSimp=0, LoftType=0, Rebuild=10, Refit=0.01})
loft_4 = Loft(
    Curves=flatten([pline_8, pline_12]),
    Options={Adjust=False, Closed=False, LoftEnds=0, LoftSimp=0, LoftType=0, Rebuild=10, Refit=0.01})
loft_5 = Loft(
    Curves=flatten([pline_12, pline_13]),
    Options={Adjust=False, Closed=False, LoftEnds=0, LoftSimp=0, LoftType=0, Rebuild=10, Refit=0.01})
loft_6 = Loft(
    Curves=flatten([pline_9, pline_8]),
    Options={Adjust=False, Closed=False, LoftEnds=0, LoftSimp=0, LoftType=0, Rebuild=10, Refit=0.01})
loft_7 = Loft(
    Curves=flatten([pline_14, pline_15]),
    Options={Adjust=False, Closed=False, LoftEnds=0, LoftSimp=0, LoftType=0, Rebuild=10, Refit=0.01})
loft_8 = Loft(
    Curves=flatten([pline_16, pline_17]),
    Options={Adjust=False, Closed=False, LoftEnds=0, LoftSimp=0, LoftType=0, Rebuild=10, Refit=0.01})
loft_9 = Loft(
    Curves=flatten([pline_18, pline_19]),
    Options={Adjust=False, Closed=False, LoftEnds=0, LoftSimp=0, LoftType=0, Rebuild=10, Refit=0.01})
merge_3 = Merge(Data1=loft, Data2=loft_2)
tstat = TreeStatistics(Tree=merge_3)  # -> Paths, Length, Count
entwine = Entwine(
    Branch00=loft_7,
    Branch01=loft_9,
    Branch02=loft_8,
    Branch03=loft_5,
    Branch04=loft_3,
    Branch05=loft_4,
    Branch06=loft_6,
    FlattenInputs=True)
replace = ReplacePaths(Data=merge_3, Search=tstat.Paths, Replace="{0;8}")
panel_10 = Panel(replace)
xz_2 = XZPlane(Origin=pt_3)
number_slider = Slider(0.32, range=0..1)  # disabled
mirror = Mirror(Geometry=entwine, Plane=xz_2)  # -> Geometry, Transform
area = Area(Geometry=flatten(entwine))  # -> Area, Centroid; disabled
points_3 = PointList(Points=area.Centroid, Size=number_slider)
merge_4 = Merge(Data1=entwine, Data2=mirror.Geometry, Data3=replace)
R_2 = ClusterOutput(merge_4)

# ==== cluster Subdivision
num = ClusterInput()
brep = ClusterInput()
V = ClusterInput()
V_2 = ClusterInput()
num_2 = Number(num)
brep_2 = Brep(brep)
item = ListItem(List=brep_2, Index=0, Wrap=True)  # -> flatten(Item)
number_slider = Slider(2, range=0..10)
area = Area(Geometry=item)  # -> Area, Centroid
tstat = TreeStatistics(Tree=brep_2)  # -> Paths, Length, Count
panel = Panel("""2
5
6
7""")
panel_2 = Panel("""0
1
2
3
4
8""")
panel_3 = Panel("""1
8""")
points = PointList(Points=area.Centroid, Size=Slider(0.26, range=0..1))
item_2 = ListItem(List=tstat.Paths, Index=panel_2, Wrap=True)
split = SplitTree(Data=brep_2, Masks=flatten(item_2))  # -> Positive, simplify(Negative)
debrep = DeconstructBrep(Brep=split.Positive)  # -> Faces, Edges, Vertices
item_3 = ListItem(List=debrep.Edges, Index="0", Wrap=True)  # -> flatten(Item)
len = Length(Curve=item_3)
bnd = Bounds(Numbers=len)
dedomain = DeconstructDomain(Domain=bnd)  # -> Start, End
division = Division(A=dedomain.End, B=num_2)
number_slider_2 = Slider(5, range=1..5)
round = Round(Number=division)  # -> Nearest, Floor, Ceiling
divide = DivideDomain²(Domain=graft(split.Positive), UCount=round.Ceiling, VCount=Slider(1, range=1..5))
panel_4 = Panel(divide)
subsrf = Isotrim(Surface=graft(split.Positive), Domain=divide)  # -> simplify(Surface)
shift = ShiftPaths(Data=subsrf, Offset=-1)
merge = Merge(Data1=shift, Data2=split.Negative)
tstat_2 = TreeStatistics(Tree=merge)  # -> Paths, Length, Count
item_4 = ListItem(List=tstat_2.Paths, Index=panel_3, Wrap=True)
split_2 = SplitTree(Data=merge, Masks=flatten(item_4))  # -> Positive, simplify(Negative)
debrep_2 = DeconstructBrep(Brep=split_2.Positive)  # -> Faces, Edges, Vertices
item_5 = ListItem(List=debrep_2.Edges, Index="1", Wrap=True)  # -> flatten(Item)
len_2 = Length(Curve=item_5)
bnd_2 = Bounds(Numbers=len_2)
dedomain_2 = DeconstructDomain(Domain=bnd_2)  # -> Start, End
division_2 = Division(A=dedomain_2.End, B=num_2)
round_2 = Round(Number=division_2)  # -> Nearest, Floor, Ceiling
divide_2 = DivideDomain²(Domain=graft(split_2.Positive), UCount=Slider(1, range=1..5), VCount=round_2.Ceiling)
panel_5 = Panel(divide_2)
subsrf_2 = Isotrim(Surface=graft(split_2.Positive), Domain=divide_2)  # -> simplify(Surface)
shift_2 = ShiftPaths(Data=subsrf_2, Offset=-1)
merge_2 = Merge(Data1=shift_2, Data2=split_2.Negative)
tstat_3 = TreeStatistics(Tree=merge_2)  # -> Paths, Length, Count
item_6 = ListItem(List=tstat_3.Paths, Index=panel, Wrap=True)
split_3 = SplitTree(Data=merge_2, Masks=flatten(item_6))  # -> Positive, simplify(Negative)
debrep_3 = DeconstructBrep(Brep=split_3.Positive)  # -> Faces, Edges, Vertices
item_7 = ListItem(List=debrep_3.Edges, Index="1", Wrap=True)  # -> flatten(Item)
len_3 = Length(Curve=item_7)
bnd_3 = Bounds(Numbers=len_3)
dedomain_3 = DeconstructDomain(Domain=bnd_3)  # -> Start, End
division_3 = Division(A=dedomain_3.End, B=num_2)
round_3 = Round(Number=division_3)  # -> Nearest, Floor, Ceiling
divide_3 = DivideDomain²(Domain=graft(split_3.Positive), UCount=Slider(1, range=1..5), VCount=V_2)
panel_6 = Panel(divide_3)
subsrf_3 = Isotrim(Surface=graft(split_3.Positive), Domain=divide_3)  # -> simplify(Surface)
shift_3 = ShiftPaths(Data=subsrf_3, Offset=-1)
merge_3 = Merge(Data1=shift_3, Data2=split_3.Negative)
tstat_4 = TreeStatistics(Tree=merge_3)  # -> Paths, Length, Count
item_8 = ListItem(List=tstat_4.Paths, Index="6", Wrap=True)
split_4 = SplitTree(Data=merge_3, Masks=flatten(item_8))  # -> Positive, simplify(Negative)
debrep_4 = DeconstructBrep(Brep=split_4.Positive)  # -> Faces, Edges, Vertices
item_9 = ListItem(List=debrep_4.Edges, Index="0", Wrap=True)  # -> flatten(Item)
len_4 = Length(Curve=item_9)
bnd_4 = Bounds(Numbers=len_4)
dedomain_4 = DeconstructDomain(Domain=bnd_4)  # -> Start, End
division_4 = Division(A=dedomain_4.End, B=num_2)
round_4 = Round(Number=division_4)  # -> Nearest, Floor, Ceiling
divide_4 = DivideDomain²(Domain=graft(split_4.Positive), UCount=round_4.Ceiling, VCount=Slider(1, range=1..5))
panel_7 = Panel(divide_4)
subsrf_4 = Isotrim(Surface=graft(split_4.Positive), Domain=divide_4)  # -> simplify(Surface)
shift_4 = ShiftPaths(Data=subsrf_4, Offset=-1)
merge_4 = Merge(Data1=shift_4, Data2=split_4.Negative)
tstat_5 = TreeStatistics(Tree=merge_4)  # -> Paths, Length, Count
item_10 = ListItem(List=tstat_5.Paths, Index="3", Wrap=True)
split_5 = SplitTree(Data=merge_4, Masks=flatten(item_10))  # -> Positive, simplify(Negative)
debrep_5 = DeconstructBrep(Brep=split_5.Positive)  # -> Faces, Edges, Vertices
item_11 = ListItem(List=debrep_5.Edges, Index="0", Wrap=True)  # -> flatten(Item)
len_5 = Length(Curve=item_11)
bnd_5 = Bounds(Numbers=len_5)
dedomain_5 = DeconstructDomain(Domain=bnd_5)  # -> Start, End
division_5 = Division(A=dedomain_5.End, B=num_2)
round_5 = Round(Number=division_5)  # -> Nearest, Floor, Ceiling
divide_5 = DivideDomain²(Domain=graft(split_5.Positive), UCount=Slider(1, range=1..5), VCount=V)
panel_8 = Panel(divide_5)
subsrf_5 = Isotrim(Surface=graft(split_5.Positive), Domain=divide_5)  # -> simplify(Surface)
shift_5 = ShiftPaths(Data=subsrf_5, Offset=-1)
merge_5 = Merge(Data1=shift_5, Data2=split_5.Negative)
explode = Explode(Curve=merge_3, Recursive=True)  # -> Segments, Vertices
explode_2 = Explode(Curve=merge_2, Recursive=True)  # -> Segments, Vertices
brep_3 = Brep(merge_4)
brep_4 = Brep(merge_5)
brep_5 = ClusterOutput(brep_4)
wbweave = WeaverbirdsMeshFromLinesWeaveBack(Lines=explode.Segments, MaximumValence=4)
wbweave_2 = WeaverbirdsMeshFromLinesWeaveBack(Lines=explode_2.Segments, MaximumValence=4)

# ==== cluster BasicSubdivision_2
pt = ClusterInput()
col_rad = ClusterInput()  # col_rad
D = ClusterInput()
Y = ClusterInput()
X = ClusterInput()
pt_2 = ClusterInput()
pt_3 = ClusterInput()
pt_4 = Point(pt)
pt_5 = Point(pt_2)
pt_6 = Point(pt_3)
pline = PolyLine(Vertices=pt_6, Closed=invert(False))
xz = XZPlane(Origin=pt_4)
points = PointList(Points=pt_6, Size=Slider(0.59, range=0..1))
fillet = FilletDistance(Curve=pline, Distance=D)
number_slider = Slider(0.37, range=0..1)
number_slider_2 = Slider(0.57, range=0..1)
addition = Addition(A=col_rad, B="0.25")
polyoffset = PolylineOffset(
    Polylines=pline,
    Distance=addition,
    Plane=Plane(origin=(0, 0, 0), x=(0, 0, 0), y=(0, 0, 0)),
    Tolerance=0.01,
    ClosedFillet=1,
    OpenFillet=1,
    Miter=2)  # -> Contour, Holes
pt_7 = ConstructPoint(XCoordinate=X, YCoordinate=Y, ZCoordinate=0)
crv = Curve(polyoffset.Holes)
boundary = BoundarySurfaces(Edges=crv)
evalsrf = EvaluateSurface(Surface=reparameterize(boundary), Point=pt_7)  # -> Point, Normal, UDirection, VDirection, Frame
srf_cp = SurfaceClosestPoint(Point=evalsrf.Point, Surface=boundary)  # -> Point, UVPoint, Distance
cir = Circle(Plane=srf_cp.Point, Radius=col_rad)
crv_2 = Curve(cir)
explode = Explode(Curve=fillet, Recursive=True)  # -> Segments, Vertices
pt_8 = Point(explode.Vertices)
pline_2 = PolyLine(Vertices=explode.Vertices, Closed=False)
panel = Panel("""0
1""")
panel_2 = Panel("""1
2""")
panel_3 = Panel("""2
3""")
panel_4 = Panel("""3
4""")
panel_5 = Panel("""4
5""")
panel_6 = Panel("""5
11""")
panel_7 = Panel("""11
12""")
panel_8 = Panel("""12
13""")
panel_9 = Panel("""13
14""")
panel_10 = Panel("""14
15""")
panel_11 = Panel("""15
16""")
panel_12 = Panel("""6
9""")
panel_13 = Panel("""7
8""")
points_2 = PointList(Points=pt_8, Size=Slider(0.19, range=0..1))
item = ListItem(List=explode.Vertices, Index=panel_2, Wrap=True)
item_2 = ListItem(List=explode.Vertices, Index=panel, Wrap=True)
item_3 = ListItem(List=explode.Vertices, Index=panel_3, Wrap=True)
item_4 = ListItem(List=explode.Vertices, Index=panel_4, Wrap=True)
item_5 = ListItem(List=explode.Vertices, Index=panel_5, Wrap=True)
item_6 = ListItem(List=explode.Vertices, Index=panel_6, Wrap=True)
item_7 = ListItem(List=explode.Vertices, Index=panel_7, Wrap=True)
item_8 = ListItem(List=explode.Vertices, Index=panel_8, Wrap=True)
item_9 = ListItem(List=explode.Vertices, Index=panel_9, Wrap=True)
item_10 = ListItem(List=explode.Vertices, Index=panel_10, Wrap=True)
item_11 = ListItem(List=explode.Vertices, Index=panel_11, Wrap=True)
item_12 = ListItem(List=explode.Vertices, Index=panel_12, Wrap=True)
item_13 = ListItem(List=explode.Vertices, Index=panel_13, Wrap=True)
pull = PullPoint(Point=item, Geometry=crv_2, ClosestOnly=True)  # -> ClosestPoint, Distance
pull_2 = PullPoint(Point=item_2, Geometry=crv_2, ClosestOnly=True)  # -> ClosestPoint, Distance
pull_3 = PullPoint(Point=item_3, Geometry=crv_2, ClosestOnly=True)  # -> ClosestPoint, Distance
pull_4 = PullPoint(Point=item_4, Geometry=crv_2, ClosestOnly=True)  # -> ClosestPoint, Distance
pull_5 = PullPoint(Point=item_5, Geometry=crv_2, ClosestOnly=True)  # -> ClosestPoint, Distance
pull_6 = PullPoint(Point=item_6, Geometry=crv_2, ClosestOnly=True)  # -> ClosestPoint, Distance
pull_7 = PullPoint(Point=item_7, Geometry=crv_2, ClosestOnly=True)  # -> ClosestPoint, Distance
pull_8 = PullPoint(Point=item_8, Geometry=crv_2, ClosestOnly=True)  # -> ClosestPoint, Distance
pull_9 = PullPoint(Point=item_9, Geometry=crv_2, ClosestOnly=True)  # -> ClosestPoint, Distance
pull_10 = PullPoint(Point=item_10, Geometry=crv_2, ClosestOnly=True)  # -> ClosestPoint, Distance
pull_11 = PullPoint(Point=item_11, Geometry=crv_2, ClosestOnly=True)  # -> ClosestPoint, Distance
pline_3 = PolyLine(Vertices=item, Closed=False)
pline_4 = PolyLine(Vertices=pull.ClosestPoint, Closed=False)
pline_5 = PolyLine(Vertices=item_2, Closed=False)
pline_6 = PolyLine(Vertices=pull_2.ClosestPoint, Closed=False)
pline_7 = PolyLine(Vertices=item_3, Closed=False)
pline_8 = PolyLine(Vertices=pull_3.ClosestPoint, Closed=False)
pline_9 = PolyLine(Vertices=item_4, Closed=False)
pline_10 = PolyLine(Vertices=pull_4.ClosestPoint, Closed=False)
pline_11 = PolyLine(Vertices=item_5, Closed=False)
pline_12 = PolyLine(Vertices=pull_5.ClosestPoint, Closed=False)
pline_13 = PolyLine(Vertices=item_6, Closed=False)
pline_14 = PolyLine(Vertices=pull_6.ClosestPoint, Closed=False)
pline_15 = PolyLine(Vertices=item_7, Closed=False)
pline_16 = PolyLine(Vertices=pull_7.ClosestPoint, Closed=False)
pline_17 = PolyLine(Vertices=item_8, Closed=False)
pline_18 = PolyLine(Vertices=pull_8.ClosestPoint, Closed=False)
pline_19 = PolyLine(Vertices=item_9, Closed=False)
pline_20 = PolyLine(Vertices=pull_9.ClosestPoint, Closed=False)
pline_21 = PolyLine(Vertices=item_10, Closed=False)
pline_22 = PolyLine(Vertices=pull_10.ClosestPoint, Closed=False)
pline_23 = PolyLine(Vertices=item_11, Closed=False)
pline_24 = PolyLine(Vertices=pull_11.ClosestPoint, Closed=False)
pline_25 = PolyLine(Vertices=item_12, Closed=False)
pline_26 = PolyLine(Vertices=item_13, Closed=False)
loft = Loft(
    Curves=flatten([pline_5, pline_6]),
    Options={Adjust=False, Closed=False, LoftEnds=0, LoftSimp=0, LoftType=0, Rebuild=10, Refit=0.01})
loft_2 = Loft(
    Curves=flatten([pline_3, pline_4]),
    Options={Adjust=False, Closed=False, LoftEnds=0, LoftSimp=0, LoftType=0, Rebuild=10, Refit=0.01})
loft_3 = Loft(
    Curves=flatten([pline_7, pline_8]),
    Options={Adjust=False, Closed=False, LoftEnds=0, LoftSimp=0, LoftType=0, Rebuild=10, Refit=0.01})
loft_4 = Loft(
    Curves=flatten([pline_9, pline_10]),
    Options={Adjust=False, Closed=False, LoftEnds=0, LoftSimp=0, LoftType=0, Rebuild=10, Refit=0.01})
loft_5 = Loft(
    Curves=flatten([pline_11, pline_12]),
    Options={Adjust=False, Closed=False, LoftEnds=0, LoftSimp=0, LoftType=0, Rebuild=10, Refit=0.01})
loft_6 = Loft(
    Curves=flatten([pline_13, pline_14]),
    Options={Adjust=False, Closed=False, LoftEnds=0, LoftSimp=0, LoftType=0, Rebuild=10, Refit=0.01})
loft_7 = Loft(
    Curves=flatten([pline_15, pline_16]),
    Options={Adjust=False, Closed=False, LoftEnds=0, LoftSimp=0, LoftType=0, Rebuild=10, Refit=0.01})
loft_8 = Loft(
    Curves=flatten([pline_17, pline_18]),
    Options={Adjust=False, Closed=False, LoftEnds=0, LoftSimp=0, LoftType=0, Rebuild=10, Refit=0.01})
loft_9 = Loft(
    Curves=flatten([pline_19, pline_20]),
    Options={Adjust=False, Closed=False, LoftEnds=0, LoftSimp=0, LoftType=0, Rebuild=10, Refit=0.01})
loft_10 = Loft(
    Curves=flatten([pline_21, pline_22]),
    Options={Adjust=False, Closed=False, LoftEnds=0, LoftSimp=0, LoftType=0, Rebuild=10, Refit=0.01})
loft_11 = Loft(
    Curves=flatten([pline_23, pline_24]),
    Options={Adjust=False, Closed=False, LoftEnds=0, LoftSimp=0, LoftType=0, Rebuild=10, Refit=0.01})
loft_12 = Loft(
    Curves=flatten([pline_25, pline_13]),
    Options={Adjust=False, Closed=False, LoftEnds=0, LoftSimp=0, LoftType=0, Rebuild=10, Refit=0.01})
loft_13 = Loft(
    Curves=flatten([pline_26, pline_25]),
    Options={Adjust=False, Closed=False, LoftEnds=0, LoftSimp=0, LoftType=0, Rebuild=10, Refit=0.01})
entwine = Entwine(
    Branch00=loft,
    Branch01=loft_2,
    Branch02=loft_3,
    Branch03=loft_4,
    Branch04=loft_5,
    Branch05=loft_6,
    Branch06=loft_7,
    Branch07=loft_8,
    Branch08=loft_9,
    Branch09=loft_10,
    Branch010=loft_11,
    Branch011=loft_12,
    Branch012=loft_13,
    FlattenInputs=True)
xz_2 = XZPlane(Origin=pt_4)
mirror = Mirror(Geometry=entwine, Plane=xz_2)  # -> Geometry, Transform
area = Area(Geometry=flatten(entwine))  # -> Area, Centroid
points_3 = PointList(Points=area.Centroid, Size=Slider(0.32, range=0..1))
merge = Merge(Data1=entwine, Data2=mirror.Geometry)
R = ClusterOutput(merge)

# ==== cluster Subdivision_2
number_slider = Slider(0.44, range=0..1)
num = ClusterInput()
brep = ClusterInput()
brep_2 = Brep(simplify(brep))
num_2 = Number(num)
item = ListItem(List=brep_2, Index=0, Wrap=True)  # -> flatten(Item)
series = Series(Start=0, Step=1, Count="11")
area = Area(Geometry=item)  # -> Area, Centroid
tstat = TreeStatistics(Tree=brep_2)  # -> Paths, Length, Count
panel = Panel("""1
6
8
10""")
panel_2 = Panel("""5
11
12""")
points = PointList(Points=area.Centroid, Size=Slider(0.2, range=0..1))
item_2 = ListItem(List=tstat.Paths, Index=series, Wrap=True)
split = SplitTree(Data=brep_2, Masks=flatten(item_2))  # -> Positive, simplify(Negative)
debrep = DeconstructBrep(Brep=split.Positive)  # -> Faces, Edges, Vertices
item_3 = ListItem(List=debrep.Edges, Index="0", Wrap=True)  # -> flatten(Item)
len = Length(Curve=item_3)
bnd = Bounds(Numbers=len)
dedomain = DeconstructDomain(Domain=bnd)  # -> Start, End
V = ClusterInput()
V_2 = ClusterInput()
division = Division(A=dedomain.End, B=num_2)
panel_3 = Panel(V)
number_slider_2 = Slider(5, range=1..5)
number_slider_3 = Slider(3, range=0..10)
round = Round(Number=division)  # -> Nearest, Floor, Ceiling
divide = DivideDomain²(Domain=graft(split.Positive), UCount=round.Ceiling, VCount=Slider(1, range=1..5))
panel_4 = Panel(V_2)
subsrf = Isotrim(Surface=graft(split.Positive), Domain=divide)  # -> simplify(Surface)
shift = ShiftPaths(Data=subsrf, Offset=-1)
merge = Merge(Data1=shift, Data2=split.Negative)
tstat_2 = TreeStatistics(Tree=merge)  # -> Paths, Length, Count
item_4 = ListItem(List=tstat_2.Paths, Index=panel, Wrap=True)
split_2 = SplitTree(Data=merge, Masks=flatten(item_4))  # -> Positive, simplify(Negative)
debrep_2 = DeconstructBrep(Brep=split_2.Positive)  # -> Faces, Edges, Vertices
item_5 = ListItem(List=debrep_2.Edges, Index="1", Wrap=True)  # -> flatten(Item)
len_2 = Length(Curve=item_5)
bnd_2 = Bounds(Numbers=len_2)
dedomain_2 = DeconstructDomain(Domain=bnd_2)  # -> Start, End
division_2 = Division(A=dedomain_2.End, B=num_2)
round_2 = Round(Number=division_2)  # -> Nearest, Floor, Ceiling
divide_2 = DivideDomain²(Domain=graft(split_2.Positive), UCount=Slider(1, range=1..5), VCount=round_2.Ceiling)
subsrf_2 = Isotrim(Surface=graft(split_2.Positive), Domain=divide_2)  # -> simplify(Surface)
shift_2 = ShiftPaths(Data=subsrf_2, Offset=-1)
tstat_3 = TreeStatistics(Tree=shift_2)  # -> Paths, Length, Count
replace = ReplacePaths(Data=shift_2, Search=tstat_3.Paths, Replace=panel)
merge_2 = Merge(Data1=replace, Data2=split_2.Negative)
tstat_4 = TreeStatistics(Tree=merge_2)  # -> Paths, Length, Count
item_6 = ListItem(List=tstat_4.Paths, Index="3", Wrap=True)
split_3 = SplitTree(Data=merge_2, Masks=flatten(item_6))  # -> Positive, Negative
debrep_3 = DeconstructBrep(Brep=split_3.Positive)  # -> Faces, Edges, Vertices
item_7 = ListItem(List=debrep_3.Edges, Index="1", Wrap=True)  # -> flatten(Item)
len_3 = Length(Curve=item_7)
bnd_3 = Bounds(Numbers=len_3)
dedomain_3 = DeconstructDomain(Domain=bnd_3)  # -> Start, End
division_3 = Division(A=dedomain_3.End, B=num_2)
round_3 = Round(Number=division_3)  # -> Nearest, Floor, Ceiling
divide_3 = DivideDomain²(Domain=graft(split_3.Positive), UCount=Slider(1, range=1..5), VCount=V_2)
subsrf_3 = Isotrim(Surface=graft(split_3.Positive), Domain=divide_3)  # -> simplify(Surface)
shift_3 = ShiftPaths(Data=subsrf_3, Offset=-1)
tstat_5 = TreeStatistics(Tree=shift_3)  # -> Paths, Length, Count
replace_2 = ReplacePaths(Data=shift_3, Search=tstat_5.Paths, Replace="3")
merge_3 = Merge(Data1=replace_2, Data2=split_3.Negative)
tstat_6 = TreeStatistics(Tree=merge_3)  # -> Paths, Length, Count
item_8 = ListItem(List=tstat_6.Paths, Index="11", Wrap=True)
split_4 = SplitTree(Data=merge_3, Masks=flatten(item_8))  # -> Positive, simplify(Negative)
debrep_4 = DeconstructBrep(Brep=split_4.Positive)  # -> Faces, Edges, Vertices
item_9 = ListItem(List=debrep_4.Edges, Index="0", Wrap=True)  # -> flatten(Item)
len_4 = Length(Curve=item_9)
bnd_4 = Bounds(Numbers=len_4)
dedomain_4 = DeconstructDomain(Domain=bnd_4)  # -> Start, End
division_4 = Division(A=dedomain_4.End, B=num_2)
round_4 = Round(Number=division_4)  # -> Nearest, Floor, Ceiling
divide_4 = DivideDomain²(Domain=graft(split_4.Positive), UCount=round_4.Ceiling, VCount=Slider(1, range=1..5))
subsrf_4 = Isotrim(Surface=graft(split_4.Positive), Domain=divide_4)  # -> simplify(Surface)
shift_4 = ShiftPaths(Data=subsrf_4, Offset=-1)
tstat_7 = TreeStatistics(Tree=shift_4)  # -> Paths, Length, Count
replace_3 = ReplacePaths(Data=shift_4, Search=tstat_7.Paths, Replace="11")
merge_4 = Merge(Data1=replace_3, Data2=split_4.Negative)
tstat_8 = TreeStatistics(Tree=merge_4)  # -> Paths, Length, Count
item_10 = ListItem(List=tstat_8.Paths, Index=panel_2, Wrap=True)
split_5 = SplitTree(Data=merge_4, Masks=flatten(item_10))  # -> Positive, simplify(Negative)
debrep_5 = DeconstructBrep(Brep=split_5.Positive)  # -> Faces, Edges, Vertices
item_11 = ListItem(List=debrep_5.Edges, Index="0", Wrap=True)  # -> flatten(Item)
len_5 = Length(Curve=item_11)
bnd_5 = Bounds(Numbers=len_5)
dedomain_5 = DeconstructDomain(Domain=bnd_5)  # -> Start, End
division_5 = Division(A=dedomain_5.End, B=num_2)
round_5 = Round(Number=division_5)  # -> Nearest, Floor, Ceiling
divide_5 = DivideDomain²(Domain=graft(split_5.Positive), UCount=Slider(1, range=1..5), VCount=V)
subsrf_5 = Isotrim(Surface=graft(split_5.Positive), Domain=divide_5)  # -> simplify(Surface)
shift_5 = ShiftPaths(Data=subsrf_5, Offset=-1)
tstat_9 = TreeStatistics(Tree=shift_5)  # -> Paths, Length, Count
replace_4 = ReplacePaths(Data=shift_5, Search=tstat_9.Paths, Replace=panel_2)
merge_5 = Merge(Data1=replace_4, Data2=split_5.Negative)
panel_5 = Panel(replace)
panel_6 = Panel(replace_2)
panel_7 = Panel(replace_3)
panel_8 = Panel(replace_4)
explode = Explode(Curve=merge_3, Recursive=True)  # -> Segments, Vertices
explode_2 = Explode(Curve=merge_2, Recursive=True)  # -> Segments, Vertices
brep_3 = Brep(merge_5)
brep_4 = Brep(merge_4)
wbweave = WeaverbirdsMeshFromLinesWeaveBack(Lines=explode.Segments, MaximumValence=4)
wbweave_2 = WeaverbirdsMeshFromLinesWeaveBack(Lines=explode_2.Segments, MaximumValence=4)
brep_5 = ClusterOutput(brep_3)

# ==== cluster BasicSubdivision_3
pt = ClusterInput()
col_rad = ClusterInput()  # col_rad
D = ClusterInput()
Y = ClusterInput()
X = ClusterInput()
pt_2 = ClusterInput()
pt_3 = Point(pt)
pt_4 = Point(pt_2)
pline = PolyLine(Vertices=pt_4, Closed=invert(False))
xz = XZPlane(Origin=pt_3)
points = PointList(Points=pt_4, Size=Slider(0.59, range=0..1))
fillet = FilletDistance(Curve=pline, Distance=D)
number_slider = Slider(0.37, range=0..1)
number_slider_2 = Slider(0.57, range=0..1)
addition = Addition(A=col_rad, B="0.25")
polyoffset = PolylineOffset(
    Polylines=pline,
    Distance=addition,
    Plane=Plane(origin=(0, 0, 0), x=(0, 0, 0), y=(0, 0, 0)),
    Tolerance=0.01,
    ClosedFillet=1,
    OpenFillet=1,
    Miter=2)  # -> Contour, Holes
pt_5 = ConstructPoint(XCoordinate=X, YCoordinate=Y, ZCoordinate=0)
crv = Curve(polyoffset.Holes)
boundary = BoundarySurfaces(Edges=crv)
evalsrf = EvaluateSurface(Surface=reparameterize(boundary), Point=pt_5)  # -> Point, Normal, UDirection, VDirection, Frame
srf_cp = SurfaceClosestPoint(Point=evalsrf.Point, Surface=boundary)  # -> Point, UVPoint, Distance
cir = Circle(Plane=srf_cp.Point, Radius=col_rad)
crv_2 = Curve(cir)
explode = Explode(Curve=fillet, Recursive=True)  # -> Segments, Vertices
pt_6 = Point(explode.Vertices)
pline_2 = PolyLine(Vertices=explode.Vertices, Closed=False)
panel = Panel("""0
1""")
panel_2 = Panel("""1
2""")
panel_3 = Panel("""2
3""")
panel_4 = Panel("""3
4""")
panel_5 = Panel("""4
5""")
panel_6 = Panel("""5
6""")
panel_7 = Panel("""6
7""")
panel_8 = Panel("""7
8""")
panel_9 = Panel("""8
9""")
panel_10 = Panel("""9
10""")
panel_11 = Panel("""10
11""")
panel_12 = Panel("""11
12""")
points_2 = PointList(Points=pt_6, Size=Slider(0.19, range=0..1))
item = ListItem(List=explode.Vertices, Index=panel_2, Wrap=True)
item_2 = ListItem(List=explode.Vertices, Index=panel, Wrap=True)
item_3 = ListItem(List=explode.Vertices, Index=panel_3, Wrap=True)
item_4 = ListItem(List=explode.Vertices, Index=panel_4, Wrap=True)
item_5 = ListItem(List=explode.Vertices, Index=panel_5, Wrap=True)
item_6 = ListItem(List=explode.Vertices, Index=panel_6, Wrap=True)
item_7 = ListItem(List=explode.Vertices, Index=panel_7, Wrap=True)
item_8 = ListItem(List=explode.Vertices, Index=panel_8, Wrap=True)
item_9 = ListItem(List=explode.Vertices, Index=panel_9, Wrap=True)
item_10 = ListItem(List=explode.Vertices, Index=panel_10, Wrap=True)
item_11 = ListItem(List=explode.Vertices, Index=panel_11, Wrap=True)
item_12 = ListItem(List=explode.Vertices, Index=panel_12, Wrap=True)
pull = PullPoint(Point=item, Geometry=crv_2, ClosestOnly=True)  # -> ClosestPoint, Distance
pull_2 = PullPoint(Point=item_2, Geometry=crv_2, ClosestOnly=True)  # -> ClosestPoint, Distance
pull_3 = PullPoint(Point=item_3, Geometry=crv_2, ClosestOnly=True)  # -> ClosestPoint, Distance
pull_4 = PullPoint(Point=item_4, Geometry=crv_2, ClosestOnly=True)  # -> ClosestPoint, Distance
pull_5 = PullPoint(Point=item_5, Geometry=crv_2, ClosestOnly=True)  # -> ClosestPoint, Distance
pull_6 = PullPoint(Point=item_6, Geometry=crv_2, ClosestOnly=True)  # -> ClosestPoint, Distance
pull_7 = PullPoint(Point=item_7, Geometry=crv_2, ClosestOnly=True)  # -> ClosestPoint, Distance
pull_8 = PullPoint(Point=item_8, Geometry=crv_2, ClosestOnly=True)  # -> ClosestPoint, Distance
pull_9 = PullPoint(Point=item_9, Geometry=crv_2, ClosestOnly=True)  # -> ClosestPoint, Distance
pull_10 = PullPoint(Point=item_10, Geometry=crv_2, ClosestOnly=True)  # -> ClosestPoint, Distance
pull_11 = PullPoint(Point=item_11, Geometry=crv_2, ClosestOnly=True)  # -> ClosestPoint, Distance
pull_12 = PullPoint(Point=item_12, Geometry=crv_2, ClosestOnly=True)  # -> ClosestPoint, Distance
pline_3 = PolyLine(Vertices=item, Closed=False)
pline_4 = PolyLine(Vertices=pull.ClosestPoint, Closed=False)
pline_5 = PolyLine(Vertices=item_2, Closed=False)
pline_6 = PolyLine(Vertices=pull_2.ClosestPoint, Closed=False)
pline_7 = PolyLine(Vertices=item_3, Closed=False)
pline_8 = PolyLine(Vertices=pull_3.ClosestPoint, Closed=False)
pline_9 = PolyLine(Vertices=item_4, Closed=False)
pline_10 = PolyLine(Vertices=pull_4.ClosestPoint, Closed=False)
pline_11 = PolyLine(Vertices=item_5, Closed=False)
pline_12 = PolyLine(Vertices=pull_5.ClosestPoint, Closed=False)
pline_13 = PolyLine(Vertices=item_6, Closed=False)
pline_14 = PolyLine(Vertices=pull_6.ClosestPoint, Closed=False)
pline_15 = PolyLine(Vertices=item_7, Closed=False)
pline_16 = PolyLine(Vertices=pull_7.ClosestPoint, Closed=False)
pline_17 = PolyLine(Vertices=item_8, Closed=False)
pline_18 = PolyLine(Vertices=pull_8.ClosestPoint, Closed=False)
pline_19 = PolyLine(Vertices=item_9, Closed=False)
pline_20 = PolyLine(Vertices=pull_9.ClosestPoint, Closed=False)
pline_21 = PolyLine(Vertices=item_10, Closed=False)
pline_22 = PolyLine(Vertices=pull_10.ClosestPoint, Closed=False)
pline_23 = PolyLine(Vertices=item_11, Closed=False)
pline_24 = PolyLine(Vertices=pull_11.ClosestPoint, Closed=False)
pline_25 = PolyLine(Vertices=item_12, Closed=False)
pline_26 = PolyLine(Vertices=pull_12.ClosestPoint, Closed=False)
loft = Loft(
    Curves=flatten([pline_5, pline_6]),
    Options={Adjust=False, Closed=False, LoftEnds=0, LoftSimp=0, LoftType=0, Rebuild=10, Refit=0.01})
loft_2 = Loft(
    Curves=flatten([pline_3, pline_4]),
    Options={Adjust=False, Closed=False, LoftEnds=0, LoftSimp=0, LoftType=0, Rebuild=10, Refit=0.01})
loft_3 = Loft(
    Curves=flatten([pline_7, pline_8]),
    Options={Adjust=False, Closed=False, LoftEnds=0, LoftSimp=0, LoftType=0, Rebuild=10, Refit=0.01})
loft_4 = Loft(
    Curves=flatten([pline_9, pline_10]),
    Options={Adjust=False, Closed=False, LoftEnds=0, LoftSimp=0, LoftType=0, Rebuild=10, Refit=0.01})
loft_5 = Loft(
    Curves=flatten([pline_11, pline_12]),
    Options={Adjust=False, Closed=False, LoftEnds=0, LoftSimp=0, LoftType=0, Rebuild=10, Refit=0.01})
loft_6 = Loft(
    Curves=flatten([pline_13, pline_14]),
    Options={Adjust=False, Closed=False, LoftEnds=0, LoftSimp=0, LoftType=0, Rebuild=10, Refit=0.01})
loft_7 = Loft(
    Curves=flatten([pline_15, pline_16]),
    Options={Adjust=False, Closed=False, LoftEnds=0, LoftSimp=0, LoftType=0, Rebuild=10, Refit=0.01})
loft_8 = Loft(
    Curves=flatten([pline_17, pline_18]),
    Options={Adjust=False, Closed=False, LoftEnds=0, LoftSimp=0, LoftType=0, Rebuild=10, Refit=0.01})
loft_9 = Loft(
    Curves=flatten([pline_19, pline_20]),
    Options={Adjust=False, Closed=False, LoftEnds=0, LoftSimp=0, LoftType=0, Rebuild=10, Refit=0.01})
loft_10 = Loft(
    Curves=flatten([pline_21, pline_22]),
    Options={Adjust=False, Closed=False, LoftEnds=0, LoftSimp=0, LoftType=0, Rebuild=10, Refit=0.01})
loft_11 = Loft(
    Curves=flatten([pline_23, pline_24]),
    Options={Adjust=False, Closed=False, LoftEnds=0, LoftSimp=0, LoftType=0, Rebuild=10, Refit=0.01})
loft_12 = Loft(
    Curves=flatten([pline_25, pline_26]),
    Options={Adjust=False, Closed=False, LoftEnds=0, LoftSimp=0, LoftType=0, Rebuild=10, Refit=0.01})
entwine = Entwine(
    Branch00=loft,
    Branch01=loft_2,
    Branch02=loft_3,
    Branch03=loft_4,
    Branch04=loft_5,
    Branch05=loft_6,
    Branch06=loft_7,
    Branch07=loft_8,
    Branch08=loft_9,
    Branch09=loft_10,
    Branch010=loft_11,
    Branch011=loft_12,
    FlattenInputs=True)
xz_2 = XZPlane(Origin=pt_3)
number_slider_3 = Slider(0.32, range=0..1)  # disabled
mirror = Mirror(Geometry=entwine, Plane=xz_2)  # -> Geometry, Transform
area = Area(Geometry=flatten(entwine))  # -> Area, Centroid; disabled
points_3 = PointList(Points=area.Centroid, Size=number_slider_3)  # disabled
merge = Merge(Data1=entwine, Data2=mirror.Geometry)
R = ClusterOutput(merge)

# ==== cluster Subdivision_3
number_slider = Slider(0.44, range=0..1)
num = ClusterInput()
brep = ClusterInput()
brep_2 = Brep(simplify(brep))
num_2 = Number(num)
item = ListItem(List=brep_2, Index=0, Wrap=True)  # -> flatten(Item)
series = Series(Start=0, Step=1, Count="12")
area = Area(Geometry=item)  # -> Area, Centroid
tstat = TreeStatistics(Tree=brep_2)  # -> Paths, Length, Count
panel = Panel("""1
3
5
11""")
points = PointList(Points=area.Centroid, Size=Slider(0.2, range=0..1))
item_2 = ListItem(List=tstat.Paths, Index=series, Wrap=True)
split = SplitTree(Data=brep_2, Masks=flatten(item_2))  # -> Positive, simplify(Negative)
debrep = DeconstructBrep(Brep=split.Positive)  # -> Faces, Edges, Vertices
item_3 = ListItem(List=debrep.Edges, Index="0", Wrap=True)  # -> flatten(Item)
len = Length(Curve=item_3)
bnd = Bounds(Numbers=len)
dedomain = DeconstructDomain(Domain=bnd)  # -> Start, End
V = ClusterInput()
V_2 = ClusterInput()
division = Division(A=dedomain.End, B=num_2)
number_slider_2 = Slider(5, range=1..5)
number_slider_3 = Slider(3, range=0..10)
round = Round(Number=division)  # -> Nearest, Floor, Ceiling
divide = DivideDomain²(Domain=graft(split.Positive), UCount=round.Ceiling, VCount=Slider(1, range=1..5))
subsrf = Isotrim(Surface=graft(split.Positive), Domain=divide)  # -> simplify(Surface)
shift = ShiftPaths(Data=subsrf, Offset=-1)
tstat_2 = TreeStatistics(Tree=shift)  # -> Paths, Length, Count
clean = CleanTree(RemoveNulls=True, RemoveInvalid=True, RemoveEmpty=False, Tree=split.Negative)
replace = ReplacePaths(Data=shift, Search=tstat_2.Paths, Replace=series)
merge = Merge(Data1=replace, Data2=clean)
clean_2 = CleanTree(RemoveNulls=True, RemoveInvalid=True, RemoveEmpty=invert(False), Tree=merge)
tstat_3 = TreeStatistics(Tree=clean_2)  # -> Paths, Length, Count
item_4 = ListItem(List=tstat_3.Paths, Index=panel, Wrap=True)
split_2 = SplitTree(Data=clean_2, Masks=flatten(item_4))  # -> Positive, simplify(Negative)
debrep_2 = DeconstructBrep(Brep=split_2.Positive)  # -> Faces, Edges, Vertices
item_5 = ListItem(List=debrep_2.Edges, Index="1", Wrap=True)  # -> flatten(Item)
len_2 = Length(Curve=item_5)
bnd_2 = Bounds(Numbers=len_2)
dedomain_2 = DeconstructDomain(Domain=bnd_2)  # -> Start, End
division_2 = Division(A=dedomain_2.End, B=num_2)
round_2 = Round(Number=division_2)  # -> Nearest, Floor, Ceiling
divide_2 = DivideDomain²(Domain=graft(split_2.Positive), UCount=Slider(1, range=1..5), VCount=round_2.Ceiling)
subsrf_2 = Isotrim(Surface=graft(split_2.Positive), Domain=divide_2)  # -> simplify(Surface)
shift_2 = ShiftPaths(Data=subsrf_2, Offset=-1)
tstat_4 = TreeStatistics(Tree=shift_2)  # -> Paths, Length, Count
replace_2 = ReplacePaths(Data=shift_2, Search=tstat_4.Paths, Replace=panel)
merge_2 = Merge(Data1=replace_2, Data2=split_2.Negative)
tstat_5 = TreeStatistics(Tree=merge_2)  # -> Paths, Length, Count
item_6 = ListItem(List=tstat_5.Paths, Index="9", Wrap=True)
split_3 = SplitTree(Data=merge_2, Masks=flatten(item_6))  # -> Positive, simplify(Negative)
debrep_3 = DeconstructBrep(Brep=split_3.Positive)  # -> Faces, Edges, Vertices
item_7 = ListItem(List=debrep_3.Edges, Index="1", Wrap=True)  # -> flatten(Item)
len_3 = Length(Curve=item_7)
bnd_3 = Bounds(Numbers=len_3)
dedomain_3 = DeconstructDomain(Domain=bnd_3)  # -> Start, End
division_3 = Division(A=dedomain_3.End, B=num_2)
round_3 = Round(Number=division_3)  # -> Nearest, Floor, Ceiling
divide_3 = DivideDomain²(Domain=graft(split_3.Positive), UCount=Slider(1, range=1..5), VCount=V_2)
subsrf_3 = Isotrim(Surface=graft(split_3.Positive), Domain=divide_3)  # -> simplify(Surface)
shift_3 = ShiftPaths(Data=subsrf_3, Offset=-1)
tstat_6 = TreeStatistics(Tree=shift_3)  # -> Paths, Length, Count
replace_3 = ReplacePaths(Data=shift_3, Search=tstat_6.Paths, Replace="9")
merge_3 = Merge(Data1=replace_3, Data2=split_3.Negative)
tstat_7 = TreeStatistics(Tree=merge_3)  # -> Paths, Length, Count
item_8 = ListItem(List=tstat_7.Paths, Index="7", Wrap=True)
split_4 = SplitTree(Data=merge_3, Masks=flatten(item_8))  # -> Positive, simplify(Negative)
debrep_4 = DeconstructBrep(Brep=split_4.Positive)  # -> Faces, Edges, Vertices
item_9 = ListItem(List=debrep_4.Edges, Index="0", Wrap=True)  # -> flatten(Item)
len_4 = Length(Curve=item_9)
bnd_4 = Bounds(Numbers=len_4)
dedomain_4 = DeconstructDomain(Domain=bnd_4)  # -> Start, End
division_4 = Division(A=dedomain_4.End, B=num_2)
round_4 = Round(Number=division_4)  # -> Nearest, Floor, Ceiling
divide_4 = DivideDomain²(Domain=graft(split_4.Positive), UCount=Slider(1, range=1..5), VCount=V)
subsrf_4 = Isotrim(Surface=graft(split_4.Positive), Domain=divide_4)  # -> simplify(Surface)
shift_4 = ShiftPaths(Data=subsrf_4, Offset=-1)
tstat_8 = TreeStatistics(Tree=shift_4)  # -> Paths, Length, Count
replace_4 = ReplacePaths(Data=shift_4, Search=tstat_8.Paths, Replace="7")
merge_4 = Merge(Data1=replace_4, Data2=split_4.Negative)
explode = Explode(Curve=merge_3, Recursive=True)  # -> Segments, Vertices
explode_2 = Explode(Curve=merge_2, Recursive=True)  # -> Segments, Vertices
brep_3 = Brep(merge_4)
wbweave = WeaverbirdsMeshFromLinesWeaveBack(Lines=explode.Segments, MaximumValence=4)
wbweave_2 = WeaverbirdsMeshFromLinesWeaveBack(Lines=explode_2.Segments, MaximumValence=4)
brep_4 = ClusterOutput(brep_3)
