# Grasshopper definition Mushroom_outline (5).gh (Grasshopper 1.0.7)
# plug-ins: MeshMachine, Kangaroo Components

# ----
# Ex. Col.
# Offset Clearance
number_slider = Slider(0.2, range=0..1)

# ----
# Starting
# View Location
pt = Point(Point(3, 6, 0))

# ----
# Existing Column
crv = Curve(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)
crv_2 = Curve(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)
crv_3 = Curve(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)
crv_4 = Curve(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)
area = Area(Geometry=crv)  # -> Area, Centroid
area_2 = Area(Geometry=crv_2)  # -> Area, Centroid
area_3 = Area(Geometry=crv_3)  # -> Area, Centroid
area_4 = Area(Geometry=crv_4)  # -> Area, Centroid

# ----
# Ex. Col.
# Offset Clearance
number_slider_2 = Slider(0.2, range=0..1)
pt_2 = Point(<point referenced from the Rhino model>)
# Starting
# View Location
pt_3 = Point(Point(3, 6, 0))
# Existing Column
crv_5 = Curve(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)
crv_6 = Curve(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)
crv_7 = Curve(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)
crv_8 = Curve(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)
pt_4 = Point(<point referenced from the Rhino model>)
area_5 = Area(Geometry=crv_5)  # -> Area, Centroid
area_6 = Area(Geometry=crv_6)  # -> Area, Centroid
area_7 = Area(Geometry=crv_7)  # -> Area, Centroid
area_8 = Area(Geometry=crv_8)  # -> Area, Centroid
ln = Line(ExColClr=pt_2, EndPoint=pt)
ln_2 = Line(ExColClr=pt_4, EndPoint=pt_3)

# ----
# Ex. Column
# Boudrary
swatch = ColourSwatch(SwatchColor=RGB(0, 0, 0))
ln_3 = Line(StartPoint=area_2.Centroid, EndPoint=area_3.Centroid)
ln_4 = Line(StartPoint=area.Centroid, EndPoint=area_2.Centroid)
ln_5 = Line(StartPoint=area_3.Centroid, EndPoint=area_4.Centroid)
ln_6 = Line(StartPoint=area.Centroid, EndPoint=area_4.Centroid)
preview = CustomPreview(Geometry=[ln_4, ln_3, ln_5, ln_6], Material=swatch)

offset = OffsetCurve(Curve=crv, Distance=number_slider, Corners=1)
offset_2 = OffsetCurve(Curve=crv_2, Distance=number_slider, Corners=1)
offset_3 = OffsetCurve(Curve=crv_3, Distance=number_slider, Corners=1)
offset_4 = OffsetCurve(Curve=crv_4, Distance=number_slider, Corners=1)
ext = ExtendCurve(Curve=ln, Type=0, Start=10, End=10)
ln_7 = Line(StartPoint=area_6.Centroid, EndPoint=area_7.Centroid)
offset_5 = OffsetCurve(Curve=crv_5, Distance=number_slider_2, Corners=1)
offset_6 = OffsetCurve(Curve=crv_6, Distance=number_slider_2, Corners=1)
offset_7 = OffsetCurve(Curve=crv_7, Distance=number_slider_2, Corners=1)
ln_8 = Line(StartPoint=area_5.Centroid, EndPoint=area_6.Centroid)
ln_9 = Line(StartPoint=area_7.Centroid, EndPoint=area_8.Centroid)
offset_8 = OffsetCurve(Curve=crv_8, Distance=number_slider_2, Corners=1)
# Ex. Column
# Boudrary
ln_10 = Line(StartPoint=area_5.Centroid, EndPoint=area_8.Centroid)
explode = Explode(Curve=offset_3, Recursive=True)  # -> Segments, Vertices
explode_2 = Explode(Curve=offset, Recursive=True)  # -> Segments, Vertices
preview_2 = CustomPreview(Geometry=[offset, offset_2, offset_3, offset_4], Material=ColourSwatch(SwatchColor=RGBA(176, 135, 135, 124)))
explode_3 = Explode(Curve=offset_2, Recursive=True)  # -> Segments, Vertices
ext_2 = ExtendCurve(Curve=ln_2, Type=0, Start=10, End=10)
explode_4 = Explode(Curve=offset_4, Recursive=True)  # -> Segments, Vertices
explode_5 = Explode(Curve=offset_7, Recursive=True)  # -> Segments, Vertices
midpt = CurveMiddle(Curve=ln_4)
midpt_2 = CurveMiddle(Curve=ln_5)
preview_3 = CustomPreview(Geometry=[ln_8, ln_7, ln_9, ln_10], Material=ColourSwatch(SwatchColor=RGB(0, 0, 0)))
midpt_3 = CurveMiddle(Curve=ln_6)
explode_6 = Explode(Curve=offset_5, Recursive=True)  # -> Segments, Vertices
preview_4 = CustomPreview(Geometry=[offset_5, offset_6, offset_7, offset_8], Material=ColourSwatch(SwatchColor=RGBA(176, 135, 135, 124)))
explode_7 = Explode(Curve=offset_6, Recursive=True)  # -> Segments, Vertices
explode_8 = Explode(Curve=offset_8, Recursive=True)  # -> Segments, Vertices

# ----
# Closet Pt to EX Column
item = ListItem(List=explode_3.Vertices, Index=0, Wrap=True)  # -> Item, Item1, Item2, Item3
pt_5 = Point(item.Item2)

# ----
# Closet Pt to EX Column
item_2 = ListItem(List=explode_4.Vertices, Index=0, Wrap=True)  # -> Item, Item1, Item2, Item3
pt_6 = Point(item_2.Item)

# ----
# Closet Pt to EX Column
item_3 = ListItem(List=explode_2.Vertices, Index=0, Wrap=True)  # -> Item, Item1, Item2, Item3
pt_7 = Point(item_3.Item1)

# ----
# Closet Pt to EX Column
item_4 = ListItem(List=explode.Vertices, Index=0, Wrap=True)  # -> Item, Item1, Item2, Item3
pt_8 = Point(item_4.Item3)

midpt_4 = CurveMiddle(Curve=ln_8)
midpt_5 = CurveMiddle(Curve=ln_9)
# Shifted Symetrical MidPt
midpt_6 = CurveMiddle(Curve=ln_10)
# Closet Pt to EX Column
item_5 = ListItem(List=explode_7.Vertices, Index=0, Wrap=True)  # -> Item, Item1, Item2, Item3
# Closet Pt to EX Column
# Closet Pt to EX Column
item_6 = ListItem(List=explode_8.Vertices, Index=0, Wrap=True)  # -> Item, Item1, Item2, Item3
item_7 = ListItem(List=explode_6.Vertices, Index=0, Wrap=True)  # -> Item, Item1, Item2, Item3
# Closet Pt to EX Column
item_8 = ListItem(List=explode_5.Vertices, Index=0, Wrap=True)  # -> Item, Item1, Item2, Item3

# ----
# Shifted Symetrical MidPt
number_slider_3 = Slider(0.63, range=0.5..0.65)
eval = EvaluateCurve(ExEdge3=reparameterize(ln_5), Parameter=number_slider_3)  # -> Point, Tangent, Angle

pt_9 = Point(item_3.Item2)
pt_10 = Point(item_3.Item3)
ln_11 = Line(ExColClr=pt_10, EndPoint=pt)
ext_3 = ExtendCurve(Curve=ln_11, Type=0, Start=10, End=10)
tweencrv = TweenCurve(CurveA=ext_3, CurveB=ext, Factor=0.5, BlendType=0)
crv_cp = CurveClosestPoint(Point=midpt_3, Curve=tweencrv)  # -> Point, Parameter, Distance

# ----
# Area 3
pt_11 = Point(crv_cp.Point)
cir = Circle(Plane=pt_11, Radius=0.3)

pt_12 = Point(item_3.Item)
pt_13 = Point(item_2.Item3)
pt_14 = Point(item_8.Item3)
pt_15 = Point(item_7.Item)
pt_16 = Point(item_7.Item1)
pt_17 = Point(item_7.Item2)
pt_18 = Point(item_7.Item3)
ln_12 = Line(ExColClr=pt_18, EndPoint=pt_3)
ext_4 = ExtendCurve(Curve=ln_12, Type=0, Start=10, End=10)
tweencrv_2 = TweenCurve(CurveA=ext_4, CurveB=ext_2, Factor=0.5, BlendType=0)
crv_cp_2 = CurveClosestPoint(Point=midpt_6, Curve=tweencrv_2)  # -> Point, Parameter, Distance
# Area 3
pt_19 = Point(crv_cp_2.Point)
pt_20 = Point(item_5.Item2)
pt_21 = Point(item_6.Item)
pt_22 = Point(item_6.Item3)
cir_2 = Circle(Plane=pt_19, Radius=0.3)

# ----
# Symetrical Axis
ln_13 = Line(StartPoint=midpt, EndPoint=midpt_2)

eval_2 = EvaluateCurve(SymetricalAxis=ln_13, Parameter=Slider(0.67, range=0.5..0.8))  # -> Point, Tangent, Angle

# ----
# Area 1
pt_23 = Point(eval_2.Point)
cir_3 = Circle(Plane=pt_23, Radius=0.3)

ln_14 = Line(StartPoint=eval.Point, StartView=pt)
ln_15 = Line(StartPoint=pt_23, ExColumn1=pt_12)
offset_9 = OffsetCurve(Curve=ln_14, Distance=Slider(1.23, range=0.85..1.23), Corners=1)
ccx = CurveCurve(CurveA=ln_15, CurveB=offset_9)  # -> Points, ParamsA, ParamsB

# ----
# Area 2
pt_24 = Point(ccx.Points)
cir_4 = Circle(Plane=pt_24, Radius=0.3)

# ----
# Center
# Connection
ln_16 = Line(StartPoint=pt_23, EndPoint=pt_24)
ln_17 = Line(StartPoint=pt_24, EndPoint=pt_11)
ln_18 = Line(StartPoint=pt_23, EndPoint=pt_11)

# ----
# Symetrical Axis
ln_19 = Line(StartPoint=midpt_4, EndPoint=midpt_5)
eval_3 = EvaluateCurve(SymetricalAxis=ln_19, Parameter=Slider(0.67, range=0.5..0.8))  # -> Point, Tangent, Angle
# Area 1
pt_25 = Point(eval_3.Point)
ln_20 = Line(StartPoint=pt_25, ExColumn1=pt_15)
cir_5 = Circle(Plane=pt_25, Radius=0.3)
Z = UnitZ(Factor=1)
ln_21 = Line(StartPoint=pt_25, EndPoint=pt_19)
eval_4 = EvaluateCurve(ExEdge3=reparameterize(ln_9), Parameter=Slider(0.63, range=0.5..0.65))  # -> Point, Tangent, Angle
ln_22 = Line(StartPoint=eval_4.Point, StartView=pt_3)
offset_10 = OffsetCurve(Curve=ln_22, Distance=Slider(1.23, range=0.85..1.23), Corners=1)
ccx_2 = CurveCurve(CurveA=ln_20, CurveB=offset_10)  # -> Points, ParamsA, ParamsB
# Area 2
pt_26 = Point(ccx_2.Points)
cir_6 = Circle(Plane=pt_26, Radius=0.3)
# Center
# Connection
ln_23 = Line(StartPoint=pt_25, EndPoint=pt_26)
ln_24 = Line(StartPoint=pt_26, EndPoint=pt_19)
Z_2 = UnitZ(Factor=1)
extr = Extrude(Base=ln_13, Direction=Z)

hframe = HorizontalFrame(Curve=ln_16, Parameter=Slider(0.45, range=0.45..0.6))
hframe_2 = HorizontalFrame(Curve=ln_17, Parameter=Slider(0.5, range=0.5..0.65))
deplane = DeconstructPlane(Plane=hframe)  # -> Origin, XAxis, YAxis, ZAxis
deplane_2 = DeconstructPlane(Plane=hframe_2)  # -> Origin, XAxis, YAxis, ZAxis

extr_2 = Extrude(Base=ln_19, Direction=Z_2)
hframe_3 = HorizontalFrame(Curve=ln_23, Parameter=Slider(0.45, range=0.45..0.6))
hframe_4 = HorizontalFrame(Curve=ln_24, Parameter=Slider(0.5, range=0.5..0.65))
deplane_3 = DeconstructPlane(Plane=hframe_3)  # -> Origin, XAxis, YAxis, ZAxis
deplane_4 = DeconstructPlane(Plane=hframe_4)  # -> Origin, XAxis, YAxis, ZAxis
vrot = Rotate(Vector=deplane_2.YAxis, Axis=deplane_2.ZAxis, Angle=degrees(Slider(15, range=-15..15)))
vrot_2 = Rotate(Vector=deplane.YAxis, Axis=deplane.ZAxis, Angle=degrees(Slider(8, range=-10..30)))
vrot_3 = Rotate(Vector=deplane_4.YAxis, Axis=deplane_4.ZAxis, Angle=degrees(Slider(15, range=-15..15)))
vrot_4 = Rotate(Vector=deplane_3.YAxis, Axis=deplane_3.ZAxis, Angle=degrees(Slider(8, range=-10..30)))
line = LineSDL(Start=deplane_2.Origin, Direction=vrot, Length=10)
line_2 = LineSDL(Start=deplane.Origin, Direction=vrot_2, Length=15)
line_3 = LineSDL(Start=deplane_4.Origin, Direction=vrot_3, Length=10)
line_4 = LineSDL(Start=deplane_3.Origin, Direction=vrot_4, Length=15)
ccx_3 = CurveCurve(CurveA=line_2, SymeAxis=ln_13)  # -> Pt1Syme, ParamsA, ParamsB
ccx_4 = CurveCurve(CurveA=line_4, SymeAxis=ln_19)  # -> Pt1Syme, ParamsA, ParamsB

ln_25 = Line(StartPoint=ccx_3.Pt1Syme, EndPoint=pt_24)
Z_3 = UnitZ(Factor=1)
extr_3 = Extrude(Base=ln_25, Direction=Z_3)

ln_26 = Line(StartPoint=ccx_4.Pt1Syme, EndPoint=pt_26)
ln_27 = Line(StartPoint=pt_12, EndPoint=item.Item3)
ln_28 = Line(StartPoint=deplane.Origin, EndPoint=ccx_3.Pt1Syme)
Z_4 = UnitZ(Factor=1)
ln_29 = Line(StartPoint=pt_15, EndPoint=item_5.Item3)
ln_30 = Line(StartPoint=deplane_3.Origin, EndPoint=ccx_4.Pt1Syme)
crv_cp_3 = CurveClosestPoint(Point=ccx_3.Pt1Syme, ExEdge1=ln_27)  # -> Point, Parameter, Distance
extr_4 = Extrude(Base=ln_26, Direction=Z_4)
crv_cp_4 = CurveClosestPoint(Point=ccx_4.Pt1Syme, ExEdge1=ln_29)  # -> Point, Parameter, Distance
mirror = Mirror(Geometry=deplane_2.Origin, Plane=extr_3)  # -> Geometry, Transform

# ----
# Crv. Extend
panel = Panel("10")

mirror_2 = Mirror(Geometry=deplane_4.Origin, Plane=extr_4)  # -> Geometry, Transform
# Crv. Extend
panel_2 = Panel("10")
ln_31 = Line(StartPoint=mirror.Geometry, EndPoint=pt_7)
ln_32 = Line(StartPoint=mirror_2.Geometry, EndPoint=pt_16)
ext_5 = ExtendCurve(Curve=line, Type=0, Start=panel, End=panel)
ext_6 = ExtendCurve(Curve=ln_28, Type=0, Start=panel, End=panel)
ext_7 = ExtendCurve(Curve=ln_31, Type=0, Start=panel, End=panel)
Z_5 = UnitZ(Factor=1)
ext_8 = ExtendCurve(Curve=line_3, Type=0, Start=panel_2, End=panel_2)
ext_9 = ExtendCurve(Curve=ln_30, Type=0, Start=panel_2, End=panel_2)
ext_10 = ExtendCurve(Curve=ln_32, Type=0, Start=panel_2, End=panel_2)
extr_5 = Extrude(Area3Syme=tweencrv_2, Direction=Z_5)
ccx_5 = CurveCurve(CurveA=ext_6, CurveB=tweencrv)  # -> Points, ParamsA, ParamsB
ccx_6 = CurveCurve(CurveA=ext_7, CurveB=ext_5)  # -> Points, ParamsA, ParamsB

Z_6 = UnitZ(Factor=1)
extr_6 = Extrude(Area3Syme=tweencrv, Direction=Z_6)
crv_cp_5 = CurveClosestPoint(Point=ccx_6.Points, Curve=extr_6)  # -> Point, Parameter, Distance
vec2pt = Vector2Pt(PointA=ccx_6.Points, PointB=crv_cp_5.Point, Unitize=False)  # -> Vector, Length
amp = Amplitude(Vector=vec2pt.Vector, Amplitude=Slider(-0.5, range=-3..0))
move = Move(Geometry=extr_6, Motion=amp)  # -> Geometry, Transform

ccx_7 = CurveCurve(CurveA=ext_5, CurveB=ext_6)  # -> Points, ParamsA, ParamsB

ln_33 = Line(StartPoint=item_2.Item3, EndPoint=ccx_7.Points)
eval_5 = EvaluateCurve(Curve=ln_33, Parameter=Slider(0.3, range=0.3..0.6))  # -> Point, Tangent, Angle

ccx_8 = CurveCurve(CurveA=ext_9, CurveB=tweencrv_2)  # -> Points, ParamsA, ParamsB
ccx_9 = CurveCurve(CurveA=ext_10, CurveB=ext_8)  # -> Points, ParamsA, ParamsB
ccx_10 = CurveCurve(CurveA=ext_8, CurveB=ext_9)  # -> Points, ParamsA, ParamsB
ln_34 = Line(StartPoint=item_6.Item3, EndPoint=ccx_10.Points)
eval_6 = EvaluateCurve(Curve=ln_34, Parameter=Slider(0.3, range=0.3..0.6))  # -> Point, Tangent, Angle
crv_cp_6 = CurveClosestPoint(Point=ccx_9.Points, Curve=extr_5)  # -> Point, Parameter, Distance
crv_cp_7 = CurveClosestPoint(Point=eval_5.Point, ClrOffset=offset_9)  # -> Point, Parameter, Distance
merge = Merge(Data1=ccx_7.Points, Data2=eval_5.Point)
vec2pt_2 = Vector2Pt(PointA=ccx_9.Points, PointB=crv_cp_6.Point, Unitize=False)  # -> Vector, Length
amp_2 = Amplitude(Vector=vec2pt_2.Vector, Amplitude=Slider(-0.5, range=-3..0))
crv_cp_8 = CurveClosestPoint(Point=eval_6.Point, ClrOffset=offset_10)  # -> Point, Parameter, Distance
merge_2 = Merge(Data1=ccx_10.Points, Data2=eval_6.Point)
mirror_3 = Mirror(Geometry=merge, ShiftedSyme=move.Geometry)  # -> Geometry, Transform
move_2 = Move(Geometry=extr_5, Motion=amp_2)  # -> Geometry, Transform
merge_3 = Merge(Data1=deplane_2.Origin, Data2=ccx_7.Points, Data3=eval_5.Point)
mirror_4 = Mirror(Geometry=merge_2, ShiftedSyme=move_2.Geometry)  # -> Geometry, Transform
merge_4 = Merge(Data1=deplane_4.Origin, Data2=ccx_10.Points, Data3=eval_6.Point)
merge_5 = Merge(
    Data1=deplane.Origin,
    Data2=ccx_7.Points,
    Data3=eval_5.Point,
    Data4=crv_cp_7.Point,
    Data5=eval.Point,
    Data6=ccx_3.Pt1Syme)

# ----
# Main Symetrical
mirror_5 = Mirror(Geometry=merge_5, Plane=extr)  # -> Geometry, Transform

merge_6 = Merge(Data1=ccx_5.Points, Data2=merge_3, Data3=mirror_3.Geometry)
merge_7 = Merge(
    Data1=ccx_3.Pt1Syme,
    Data2=crv_cp_3.Point,
    Data3=mirror.Geometry,
    Data4=ccx_6.Points,
    Data5=ccx_7.Points,
    Data6=deplane_2.Origin,
    Data7=pt_7)
merge_8 = Merge(
    Data1=deplane_3.Origin,
    Data2=ccx_10.Points,
    Data3=eval_6.Point,
    Data4=crv_cp_8.Point,
    Data5=eval_4.Point,
    Data6=ccx_4.Pt1Syme)
# Main Symetrical
mirror_6 = Mirror(Geometry=merge_8, Plane=extr_2)  # -> Geometry, Transform
merge_9 = Merge(Data1=ccx_8.Points, Data2=merge_4, Data3=mirror_4.Geometry)
merge_10 = Merge(
    Data1=ccx_4.Pt1Syme,
    Data2=crv_cp_4.Point,
    Data3=mirror_2.Geometry,
    Data4=ccx_9.Points,
    Data5=ccx_10.Points,
    Data6=deplane_4.Origin,
    Data7=pt_16)

alongcrv = SortAlongCurve(Points=flatten(merge_7), Column2Cir=cir_4)  # -> Points, Indices
pline = PolyLine(Vertices=alongcrv.Points, Closed=invert(False))
fillet = FilletDistance(Curve=pline, Distance=Slider(0.3, range=0..1))
boundary = BoundarySurfaces(Edges=fillet)

alongcrv_2 = SortAlongCurve(Points=flatten([merge_5, mirror_5.Geometry]), Column1Cir=cir_3)  # -> Points, Indices
pline_2 = PolyLine(Vertices=alongcrv_2.Points, Closed=invert(False))
# Mushroom 1
fillet_2 = FilletDistance(Curve=pline_2, Distance=Slider(0.3, range=0..1))
boundary_2 = BoundarySurfaces(Edges=fillet_2)

alongcrv_3 = SortAlongCurve(Points=flatten(merge_6), Column3Cir=cir)  # -> Points, Indices
pline_3 = PolyLine(Vertices=alongcrv_3.Points, Closed=invert(False))
fillet_3 = FilletDistance(Curve=pline_3, Distance=Slider(0.4, range=0..1))
boundary_3 = BoundarySurfaces(Edges=fillet_3)

alongcrv_4 = SortAlongCurve(Points=flatten(merge_10), Column2Cir=cir_6)  # -> Points, Indices
alongcrv_5 = SortAlongCurve(Points=flatten([merge_8, mirror_6.Geometry]), Column1Cir=cir_5)  # -> Points, Indices
alongcrv_6 = SortAlongCurve(Points=flatten(merge_9), Column3Cir=cir_2)  # -> Points, Indices
pline_4 = PolyLine(Vertices=alongcrv_4.Points, Closed=invert(False))
pline_5 = PolyLine(Vertices=alongcrv_5.Points, Closed=invert(False))
pline_6 = PolyLine(Vertices=alongcrv_6.Points, Closed=invert(False))
fillet_4 = FilletDistance(Curve=pline_4, Distance=Slider(0.3, range=0..1))
# Mushroom 1
fillet_5 = FilletDistance(Curve=pline_5, Distance=Slider(0.3, range=0..1))
fillet_6 = FilletDistance(Curve=pline_6, Distance=Slider(0.4, range=0..1))
boundary_4 = BoundarySurfaces(Edges=fillet_6)
boundary_5 = BoundarySurfaces(Edges=fillet_4)
boundary_6 = BoundarySurfaces(Edges=fillet_5)
area_9 = Area(Geometry=boundary_3)  # -> Area, Centroid
area_10 = Area(Geometry=boundary)  # -> Area, Centroid
area_11 = Area(Geometry=boundary_2)  # -> Area, Centroid
area_12 = Area(Geometry=boundary_4)  # -> Area, Centroid
area_13 = Area(Geometry=boundary_5)  # -> Area, Centroid
area_14 = Area(Geometry=boundary_6)  # -> Area, Centroid

# ----
# Column 2
number_slider_4 = Slider(0.3, range=0..1)
cir_7 = Circle(Plane=area_10.Centroid, Radius=number_slider_4)
boundary_7 = BoundarySurfaces(Edges=cir_7)
preview_5 = CustomPreview(Geometry=[boundary_7, boundary], Material=ColourSwatch(SwatchColor=RGB(122, 151, 153)))

# ----
# Column 3
number_slider_5 = Slider(0.3, range=0..1)
cir_8 = Circle(Plane=area_9.Centroid, Radius=number_slider_5)
boundary_8 = BoundarySurfaces(Edges=cir_8)
preview_6 = CustomPreview(Geometry=[boundary_8, boundary_3], Material=ColourSwatch(SwatchColor=RGB(167, 126, 168)))

# ----
# Column 2
number_slider_6 = Slider(0.3, range=0..1)
# Column 3
number_slider_7 = Slider(0.3, range=0..1)
# Column 1
number_slider_8 = Slider(0.55, range=0..1)
merge_11 = Merge(Data1=boundary, Data2=boundary_3)
merge_12 = Merge(Data1=boundary_5, Data2=boundary_4)

# ----
# Main Symetrical
mirror_7 = Mirror(Geometry=merge_11, Plane=extr)  # -> Geometry, Transform

cir_9 = Circle(Plane=area_13.Centroid, Radius=number_slider_6)
cir_10 = Circle(Plane=area_12.Centroid, Radius=number_slider_7)
# Main Symetrical
mirror_8 = Mirror(Geometry=merge_12, Plane=extr_2)  # -> Geometry, Transform
cir_11 = Circle(Plane=area_14.Centroid, Radius=number_slider_8)
Z_7 = UnitZ(Factor=Slider(2, range=0..10))
boundary_9 = BoundarySurfaces(Edges=cir_9)
boundary_10 = BoundarySurfaces(Edges=cir_10)
merge_13 = Merge(Data1=mirror_7.Geometry, Data2=boundary_2, Data3=merge_11)
Z_8 = UnitZ(Factor=Slider(2, range=0..10))
boundary_11 = BoundarySurfaces(Edges=cir_11)
Z_9 = UnitZ(Factor=Slider(2, range=0..10))
merge_14 = Merge(Data1=mirror_8.Geometry, Data2=boundary_6, Data3=merge_12)
preview_7 = CustomPreview(Geometry=[boundary_9, boundary_5], Material=ColourSwatch(SwatchColor=RGB(122, 151, 153)))
area_15 = Area(Geometry=flatten(merge_13))  # -> Area, Centroid
preview_8 = CustomPreview(Geometry=[boundary_10, boundary_4], Material=ColourSwatch(SwatchColor=RGB(167, 126, 168)))
extr_7 = Extrude(Base=[cir_10, cir_11, cir_9], Direction=Z_8)
extr_8 = Extrude(Base=cir_11, Direction=Z_9)
preview_9 = CustomPreview(Geometry=[extr_8, boundary_6], Material=ColourSwatch(SwatchColor=RGB(178, 162, 127)))
area_16 = Area(Geometry=flatten(merge_14))  # -> Area, Centroid
extr_9 = Extrude()
ma = MassAddition(Input=flatten(area_15.Area))  # -> Result, PartialResults
cluster = Cluster(B=1)  # -> P, mesh_2; disabled
extr_10 = Extrude()
cluster_2 = Cluster(B=1)  # -> P, mesh_2; disabled
ma_2 = MassAddition(Input=flatten(area_16.Area))  # -> Result, PartialResults
cluster_3 = Cluster(B=1)  # -> P, mesh_2; disabled
panel_3 = Panel(ma.Result)
panel_4 = Panel(ma_2.Result)
meshmachine = MeshMachine(
    Geometry=<missing>,
    Length=<missing>,
    FixCurves=<missing>,
    Flip=1,
    PullStrength=0.8,
    CurvatureAdaptivity=0,
    Reset=<missing>)  # disabled
clean = CombineClean(Meshes=<missing>)  # disabled

# ----
# Column 1
number_slider_9 = Slider(0.55, range=0..1)
cir_12 = Circle(Plane=area_11.Centroid, Radius=number_slider_9)
boundary_12 = BoundarySurfaces(Edges=cir_12)

Z_10 = UnitZ(Factor=Slider(2, range=0..10))
extr_11 = Extrude(Base=[cir_8, cir_12, cir_7], Direction=Z_10)
cluster_4 = Cluster(B=1)  # -> P, mesh_2; disabled

extr_12 = Extrude(Base=cir_12, Direction=Z_7)

preview_10 = CustomPreview(Geometry=[extr_12, boundary_2], Material=ColourSwatch(SwatchColor=RGB(178, 162, 127)))

# ==== cluster Cluster
M = ClusterInput()
unim = UnifyMesh(Mesh=M)  # -> Result, Count
medges = MeshEdges(Mesh=unim.Result)  # -> NakedEdges, InteriorEdges, NonManifoldEdges
nv = NakedVertices(Mesh=unim.Result)  # -> ClothedIndex, NakedIndex, ClothedPts, NakedPts
join = JoinCurves(Curves=medges.NakedEdges, Preserve=False)
len = Length(Curve=join)
sort = SortList(Keys=len, ValuesA=join)  # -> Keys, ValuesA
cull_i = CullIndex(List=sort.ValuesA, Indices="-1", Wrap=True)

# ---- group: Pressure
# Pressure
facen = FaceNormals(Mesh=unim.Result)  # -> Centers, Normals
item = ListItem(List=facen.Normals, Index=0, Wrap=True)
number_slider = Slider(0.6274, range=0..1)
devec = DeconstructVector(Vector=item)  # -> XComponent, YComponent, ZComponent
larger = LargerThan(FirstNumber=devec.ZComponent, SecondNumber=Slider(0, range=0..100))  # -> LargerThan, OrEqualTo
neg = Negative(Value=number_slider)
filter = StreamFilter(Gate=larger.LargerThan, Stream0=neg, Stream1=number_slider)

# ----
crv_cp = CurveClosestPoint(Point=nv.NakedPts, Curve=graft(cull_i))  # -> Point, Parameter, Distance
B = ClusterInput()
lng = ListLength(List=cull_i)
int = Integer(crv_cp.Distance)
# Column Height
dom = ConstructDomain(DomainStart=Slider(0, range=0..10), DomainEnd=B)
bool = Boolean(int)
cull = CullPattern(List=nv.NakedPts, CullPattern=invert(bool))

# ---- group: Column Height
random = Random(Range=dom, Number=lng, Seed=2)
Z = UnitZ(Factor=random)  # -> graft(UnitVector)
move = Move(Geometry=cull, Motion=Z)  # -> Geometry, Transform

# ----
branch = TreeBranch(Tree=cull, Path="{0;0;0;0;1}", MaintainPaths=True)
remap = RemapNumbers(Value=Slider(178, range=0..300), Source=Slider(300, range=0..1000), Target=Slider(10, range=0..10))  # -> Mapped, Clipped
pt = Point(flatten(cull))
pt_2 = ConstructPoint(XCoordinate=0, YCoordinate=0, ZCoordinate=0)
pt_3 = Point(pt)
index = ItemIndex(List=nv.NakedPts, Item=pt)
pt_4 = Point(flatten(move.Geometry))
line = LineSDL(Start=pt_2, Direction=Vector(0, 0, 1), Length=1)
number_slider_2 = Slider(1, range=0..1)
number_slider_3 = Slider(0, range=0..10)
cull_i_2 = CullIndex(List=nv.NakedPts, Indices=index, Wrap=True)

# ---- group: Boundary
# Anchoring Boundary Curve
item_2 = ListItem(List=sort.ValuesA, Index="-1", Wrap=True)
Z_2 = UnitZ(Factor=Slider(3, range=0..10))
move_2 = Move(Geometry=item_2, Motion=Z_2)  # -> Geometry, Transform
crv_cp_2 = CurveClosestPoint(Point=cull_i_2, Curve=move_2.Geometry)  # -> Point, Parameter, Distance

# ----
lng_2 = ListLength(List=cull_i_2)
pt_5 = Point(crv_cp_2.Point)
divide = DivideCurve(Curve=line, Count=lng_2, Kinks=False)  # -> Points, Tangents, Parameters
pt_6 = Point(cull_i_2)
perlin = PerlinNoise(Values=divide.Points, Time=remap.Mapped, Scale=Slider(2, range=0..100))
neg_2 = Negative(Value=number_slider_3)
bnd = Bounds(Numbers=perlin)
dom_2 = ConstructDomain(DomainStart=neg_2, DomainEnd=number_slider_3)
remap_2 = RemapNumbers(Value=perlin, Source=bnd, Target=dom_2)  # -> Mapped, Clipped
Z_3 = UnitZ(Factor=remap_2.Mapped)
move_3 = Move(Geometry=crv_cp_2.Point, Motion=Z_3)  # -> Geometry, Transform

# ---- group: Goals
pressure = Pressure(M=unim.Result, Strength=filter)
edgelengths = EdgeLengths(Mesh=unim.Result, LengthFactor="0", Strength=1)
show = Show(G=unim.Result)
anchor = Anchor(Point=pt, Target=pt_4, Strength=10000)
anchor_2 = Anchor(Point=cull_i_2, Target=move_3.Geometry, Strength=10000)

# ----
entwine = Entwine(Branch00=show, Branch01=[edgelengths, anchor_2, anchor, pressure], FlattenInputs=True)
graph = QuickGraph(perlin, SortOrder=0)
zombiesolver = ZombieSolver(GoalObjects=entwine, Threshold=1e-10, Tolerance=0.0001, MaxIterations=50000)  # -> I, V, O
unflatten = UnflattenTree(Tree=zombiesolver.O, Guide=entwine)
bang = ExplodeTree(Data=unflatten)  # -> Branch0, Branch1
neg_3 = Negative(Value=Slider(0.34, range=0..1))
mesh = Mesh(bang.Branch0)
mesh_2 = ClusterOutput(mesh)
wboffset = WeaverbirdsOffsetMesh(MeshCurves=mesh, Distance=neg_3, OffsetType=0)
explode = MeshExplode(Mesh=wboffset, Interpolate=False)
explode_2 = MeshExplode(Mesh=mesh, Interpolate=False)
move_4 = Move(Geometry=cull_i, Motion=flatten(Z))  # -> Geometry, Transform; disabled
crv = Curve(move_2.Geometry)  # disabled
mesh_3 = Mesh(move_4.Geometry)  # disabled
mesh_4 = Mesh(crv)  # disabled
demesh = DeconstructMesh(Mesh=explode)  # -> Vertices, Faces, Colours, Normals
demesh_2 = DeconstructMesh(Mesh=explode_2)  # -> Vertices, Faces, Colours, Normals
number_slider_4 = Slider(0.01, range=0..0.01)  # disabled
faceb = FaceBoundaries(Mesh=[explode, explode_2])
item_3 = ListItem(List=demesh_2.Vertices, Index=0, Wrap=True)  # -> Item, Item1, Item2, Item3
item_4 = ListItem(List=demesh.Vertices, Index=0, Wrap=True)  # -> Item, Item1, Item2, Item3
pipe = Pipe(Radius=number_slider_4, Caps=0)  # disabled
clean = CombineClean(Meshes=flatten([mesh_4, mesh_3]))  # disabled
ln = Line(StartPoint=item_4.Item, EndPoint=item_3.Item2)
ln_2 = Line(StartPoint=demesh.Vertices, EndPoint=demesh_2.Vertices)
crv_2 = Curve([ln, faceb, ln_2])
explode_3 = Explode(Curve=crv_2, Recursive=True)  # -> flatten(Segments), Vertices
dupln = RemoveDuplicateLines(Lines=explode_3.Segments, Tolerance=0.01)
pipe_2 = Pipe(Curve=dupln, Radius="0.01", Caps=0)
len_2 = Length(Curve=dupln)
P = ClusterOutput(pipe_2)
bnd_2 = Bounds(Numbers=len_2)
ma = MassAddition(Input=len_2)  # -> Result, PartialResults
panel = Panel(ma.Result)
