# Grasshopper definition SliderArm.ghx (Grasshopper 1.0.7)
# plug-ins: Kangaroo2 Components

# ---- group: red arm
brep = Brep(<brep referenced from the Rhino model>)
debrep = DeconstructBrep(Brep=brep)  # -> Faces, Edges, Vertices
pt = Point([<point referenced from the Rhino model> x4])
rigidbody = RigidBody(Part=brep, Points=flatten([debrep.Vertices, pt]), Strength=100)

# ---- group: green arm
brep_2 = Brep(<brep referenced from the Rhino model>)
debrep_2 = DeconstructBrep(Brep=brep_2)  # -> Faces, Edges, Vertices
pt_2 = Point([<point referenced from the Rhino model> x4])
rigidbody_2 = RigidBody(Part=brep_2, Points=flatten([debrep_2.Vertices, pt_2]), Strength=1)

# ---- group: yellow slider
brep_3 = Brep(<brep referenced from the Rhino model>)
debrep_3 = DeconstructBrep(Brep=brep_3)  # -> Faces, Edges, Vertices
pt_3 = Point([<point referenced from the Rhino model> x2])
rigidbody_3 = RigidBody(Part=brep_3, Points=flatten([debrep_3.Vertices, pt_3]), Strength=1)

# ---- group: limit the sliding distance of the red arm on the blue base
crv = Curve([<curve referenced from the Rhino model> x2])
clamplength = ClampLength(Line=crv, LowerLimit=10, UpperLimit=1e+10, Strength=1)

# ---- group: keep the blue base fixed, and constrain the red arm to slide along it
pt_4 = Point([<point referenced from the Rhino model> x2])
pt_5 = Point([<point referenced from the Rhino model> x2])
anchor = Anchor(Point=pt_5, Strength=1000)
colinear = CoLinear(Points=[pt_4, pt_5], Strength=10000)

# ---- group: keep the yellow slider aligned with the hole of the green arm
pt_6 = Point([<point referenced from the Rhino model> x4])
colinear_2 = CoLinear(Points=pt_6, Strength=100)

# ---- group: limit the sliding distance of the yellow slider in the green arm
crv_2 = Curve([<curve referenced from the Rhino model> x2])
clamplength_2 = ClampLength(Line=crv_2, LowerLimit=3, UpperLimit=19, Strength=1)

# ----
pt_7 = Point(<point referenced from the Rhino model>)
pt_8 = Point(Point(61, 28, 10))
pt_9 = Point(<point referenced from the Rhino model>)
pt_10 = Point(Point(61, 34, 10))

# ---- group: blue base
brep_4 = Brep(<brep referenced from the Rhino model>)

# ----
ln = Line(StartPoint=pt_7, EndPoint=pt_8)
ln_2 = Line(StartPoint=pt_9, EndPoint=pt_10)
length_line = LengthLine(Line=ln, Length="0", Strength="1000")
length_line_2 = LengthLine(Line=ln_2, Length="0", Strength="1000")
grab = Grab(On=True, Strength=1, Range=3)  # -> Grab, Anchors
reset = Button()
solver = Solver(
    GoalObjects=[rigidbody, colinear, anchor, length_line, length_line_2, rigidbody_2, rigidbody_3, colinear_2, clamplength_2, clamplength, grab.Grab],
    Reset=reset,
    Threshold=1e-15,
    Tolerance=0.01,
    On=True)  # -> I, V, O
colourful = Colourful(geo=[solver.O, brep_4])

# ==== cluster Colourful: Display objects in bright colours
geo = ClusterInput()
geo_2 = Geometry(geo)
clean = CleanTree(RemoveNulls=True, RemoveInvalid=True, RemoveEmpty=False, Tree=flatten(geo_2))
lng = ListLength(List=clean)
S = Shader([{diffuse=RGB(11, 125, 222), emission=RGB(3, 38, 67), shine=0.5, specular=RGB(255, 255, 255), transparency=0}, {diffuse=RGB(222, 37, 11), emission=RGB(67, 11, 3), shine=0.5, specular=RGB(255, 255, 255), transparency=0}, {diffuse=RGB(71, 222, 11), emission=RGB(21, 67, 3), shine=0.5, specular=RGB(255, 255, 255), transparency=0}, {diffuse=RGB(222, 194, 11), emission=RGB(67, 58, 3), shine=0.5, specular=RGB(255, 255, 255), transparency=0}])
repeat = RepeatData(Data=S, Length=lng)
preview = CustomPreview(Geometry=clean, Shader=repeat)
