# Grasshopper definition first.ghx (Grasshopper 1.0.7)
# plug-ins: treesloth01, Axolotl Info, Kangaroo2 Components

number_slider = Slider(5, range=0..10)
sqgrid = Square(Plane=PlaneXY(0, 0, 0), Size=Slider(60, range=0..100), ExtentX=number_slider, ExtentY=number_slider)  # -> Cells, Points
area = Area(Geometry=sqgrid.Cells)  # -> Area, flatten(Centroid)
dom = ConstructDomain(DomainStart=0, DomainEnd=Slider(60, range=0..100))
lng = ListLength(List=area.Centroid)
random = Random(Range=dom, Number=lng, Seed=2)
number_slider_2 = Slider(50, range=0..100)
Z = UnitZ(Factor=random)
move = Move(Geometry=area.Centroid, Motion=Z)  # -> Geometry, Transform
number_slider_3 = Slider(200, range=0..1000)
pt = ConstructPoint(XCoordinate=number_slider_2, YCoordinate=number_slider_2, ZCoordinate=0)
srfgrid = SurfaceFromPoints(Points=move.Geometry, UCount=number_slider, Interpolate=Toggle(True))
planesrf = PlaneSurface(Plane=pt, XSize=number_slider_3, YSize=number_slider_3)
wires = BrepWireframe(Brep=srfgrid, Density=-1)
pop2d = Populate2D(Region=planesrf, Count=Slider(20, range=0..100), Seed=1)
Z_2 = UnitZ(Factor=1)
join = JoinCurves(Curves=wires, Preserve=False)
project = ProjectPoint(Point=pop2d, Direction=Z_2, Geometry=srfgrid)  # -> Point, Index
divide = DivideCurve(Curve=join, Count=Slider(15, range=0..100), Kinks=False)  # -> Points, Tangents, Parameters
merge = Merge(Data1=divide.Points, Data2=project.Point)  # -> flatten(Result)
del = DelaunayMesh(Points=merge, Plane=PlaneXY(0, 0, 0))
con = DelaunayEdges(Points=merge, Plane=PlaneXY(0, 0, 0))  # -> Connectivity, Edges

number_slider_4 = Slider(16, range=0..100)
subtraction = Subtraction(A=Slider(8, range=0..10), B=Slider(1.2, range=0..10))

yz = YZPlane(Origin=Point(0, 0, 0))
pt_2 = ConstructPoint(XCoordinate=Slider(10, range=0..10), YCoordinate=0, ZCoordinate=0)
cir = Circle(Plane=yz, Radius=1)
yz_2 = YZPlane(Origin=pt_2)
sph = Sphere(Base=pt_2, Radius=Slider(2, range=0..10))
sph_2 = Sphere(Base=PlaneXY(0, 0, 0), Radius=Slider(3, range=0..10))
yz_3 = YZPlane(Origin=Point(0, 0, 0))
boundary = BoundarySurfaces(Edges=cir)
X = UnitX(Factor=Slider(10, range=0..10))
X_2 = UnitX(Factor=Slider(2, range=0..10))
sec = BrepPlane(Brep=sph, Plane=yz_2)  # -> Curves, Points
sec_2 = BrepPlane(Brep=sph_2, Plane=yz_3)  # -> Curves, Points
extr = Extrude(Base=boundary, Direction=X_2)
loft = Loft(
    Curves=[sec.Curves, sec_2.Curves],
    Options={Adjust=False, Closed=False, LoftEnds=0, LoftSimp=0, LoftType=0, Rebuild=10, Refit=0.01})
move_2 = Move(Geometry=extr, Motion=X)  # -> Geometry, Transform
cap = CapHoles(Brep=loft)
sunion = SolidUnion(Breps=flatten([cap, sph, sph_2]))

number_slider_5 = Slider(8.25, range=0..10)
panel = Panel(subtraction)
crv = Curve(<curve referenced from the Rhino model>)

yz_4 = YZPlane(Origin=Point(0, 0, 0))
pt_3 = ConstructPoint(XCoordinate=Slider(38, range=0..100), YCoordinate=0, ZCoordinate=0)
cir_2 = Circle(Plane=yz_4, Radius=number_slider_5)
yz_5 = YZPlane(Origin=pt_3)
sph_3 = Sphere(Base=pt_3, Radius=Slider(12, range=0..100))
sph_4 = Sphere(Base=PlaneXY(0, 0, 0), Radius=Slider(15, range=0..100))
yz_6 = YZPlane(Origin=Point(0, 0, 0))
boundary_2 = BoundarySurfaces(Edges=cir_2)
X_3 = UnitX(Factor=Slider(8, range=0..10))
X_4 = UnitX(Factor=Slider(50, range=0..50))
sec_3 = BrepPlane(Brep=sph_3, Plane=yz_5)  # -> Curves, Points
sec_4 = BrepPlane(Brep=sph_4, Plane=yz_6)  # -> Curves, Points
extr_2 = Extrude(Base=boundary_2, Direction=X_4)
loft_2 = Loft(
    Curves=[sec_3.Curves, sec_4.Curves],
    Options={Adjust=False, Closed=False, LoftEnds=0, LoftSimp=0, LoftType=0, Rebuild=10, Refit=0.01})
move_3 = Move(Geometry=extr_2, Motion=X_3)  # -> Geometry, Transform
cap_2 = CapHoles(Brep=loft_2)
sunion_2 = SolidUnion(Breps=flatten([cap_2, sph_3, sph_4]))

crv_2 = Curve(<curve referenced from the Rhino model>)
crv_3 = Curve([<curve referenced from the Rhino model> x5])
cull_i = CullIndex(List=crv_3, Indices="0", Wrap=True)
midpt = CurveMiddle(Curve=cull_i)
neg = Negative(Value="1")
neg_2 = Negative(Value="1")
number_slider_6 = Slider(31, range=0..100)
number_slider_7 = Slider(31, range=0..100)
Z_3 = UnitZ(Factor=neg)
Z_4 = UnitZ(Factor=neg_2)
points = PointList(Points=midpt, Size=Slider(11, range=0..100))
move_4 = Move(Geometry=crv, Motion=Z_3)  # -> Geometry, Transform
move_5 = Move(Geometry=crv_2, Motion=Z_4)  # -> Geometry, Transform
offset = OffsetCurve(Curve=crv, Distance=Slider(11, range=0..100), Corners=1)
offset_2 = OffsetCurve(Curve=crv_2, Distance=Slider(11, range=0..100), Corners=1)
boundary_3 = BoundarySurfaces(Edges=move_4.Geometry)
boundary_4 = BoundarySurfaces(Edges=move_5.Geometry)
Z_5 = UnitZ(Factor=number_slider_6)
Z_6 = UnitZ(Factor=number_slider_7)
Z_7 = UnitZ(Factor=expr("x+2", number_slider_6))
Z_8 = UnitZ(Factor=expr("x+2", number_slider_7))
boundary_5 = BoundarySurfaces(Edges=flatten(offset))

curvepoint = PointOnCurve(con.Edges, parameter=0.5)
lng_2 = ListLength(List=curvepoint)
series = Series(Start=0, Step=1, Count=lng_2)
int = Integer(series)
tag = TextTag3D(Location=curvepoint, Text=int, Size=Slider(4, range=0..10), Justification=7)

boundary_6 = BoundarySurfaces(Edges=flatten(offset_2))

pt_4 = ConstructPoint(XCoordinate=0, YCoordinate=0, ZCoordinate=0)
xy = XYPlane(Origin=Point(0, 0, 0))
sdiff = SolidDifference(BrepsA=sunion, BrepsB=move_2.Geometry)
end = EndPoints(Curve=con.Edges)  # -> Start, End
pl_3pt = Plane3Pt(PointA=end.Start, PointB=end.End, PointC=pt_4)  # -> simplify(graft(Plane))
pl_3pt_2 = Plane3Pt(PointA=end.End, PointB=end.Start, PointC=pt_4)  # -> simplify(graft(Plane))
orient = Orient(Geometry=sdiff, Source=xy, Target=pl_3pt)  # -> Geometry, Transform
orient_2 = Orient(Geometry=sdiff, Source=xy, Target=pl_3pt_2)  # -> Geometry, Transform

neg_3 = Negative(Value=Slider(10, range=0..10))
extr_3 = Extrude(Base=boundary_3, Direction=Z_7)
extr_4 = Extrude(Base=boundary_4, Direction=Z_8)
extr_5 = Extrude(Base=boundary_5, Direction=Z_5)
extr_6 = Extrude(Base=boundary_6, Direction=Z_6)
ext = ExtendCurve(Curve=con.Edges, Type=0, Start=neg_3, End=neg_3)
pipe = Pipe(Curve=ext, Radius=1, Caps=0)
brep = Brep(flatten([orient.Geometry, orient_2.Geometry]))
cap_3 = CapHoles(Brep=pipe)
swatch = ColourSwatch(SwatchColor=RGB(255, 255, 255))  # disabled

pt_5 = ConstructPoint(XCoordinate=0, YCoordinate=0, ZCoordinate=0)
xy_2 = XYPlane(Origin=Point(0, 0, 0))
sdiff_2 = SolidDifference(BrepsA=sunion_2, BrepsB=move_3.Geometry)
end_2 = EndPoints(Curve=cull_i)  # -> Start, End
pl_3pt_3 = Plane3Pt(PointA=end_2.Start, PointB=end_2.End, PointC=pt_5)  # -> simplify(graft(Plane))
pl_3pt_4 = Plane3Pt(PointA=end_2.End, PointB=end_2.Start, PointC=pt_5)  # -> simplify(graft(Plane))
orient_3 = Orient(Geometry=sdiff_2, Source=xy_2, Target=pl_3pt_3)  # -> Geometry, Transform
orient_4 = Orient(Geometry=sdiff_2, Source=xy_2, Target=pl_3pt_4)  # -> Geometry, Transform

brep_2 = Brep(flatten([orient_3.Geometry, orient_4.Geometry]))
item = ListItem(List=flatten(brep_2), Index=[Slider(1, range=0..1), Slider(3, range=0..10)], Wrap=True)
area_2 = Area(Geometry=flatten(brep_2))  # -> Area, Centroid
item_2 = ListItem(List=flatten(brep_2), Index=[Slider(0, range=0..10), Slider(4, range=0..10)], Wrap=True)
item_3 = ListItem(List=flatten(brep_2), Index=[Slider(3, range=0..10), Slider(1, range=0..10)], Wrap=True)
join_2 = JoinCurves(Curves=cull_i, Preserve=False)
graft = GraftTree(Tree=brep, IncludeEmptyLists=True, IncludeNullItems=True)
preview = CustomPreview(Geometry=cap_3, Shader=swatch)  # disabled
neg_4 = Negative(Value=Slider(8, range=0..100))
sunion_3 = SolidUnion(Breps=flatten([extr_6, item_3]))
number_slider_8 = Slider(1, range=0..1)
sunion_4 = SolidUnion(Breps=flatten([extr_5, item_2]))
points_2 = PointList(Points=area_2.Centroid, Size=Slider(10, range=0..10))
brepinc = PointInBrep(Brep=graft, Point=merge, Strict=False)
duppt = RemoveDuplicatePts(Points=flatten([end_2.Start, end_2.End]), Tolerance=0.01)
ext_2 = ExtendCurve(Curve=join_2, Type=0, Start=neg_4, End=neg_4)
sdiff_3 = SolidDifference(BrepsA=sunion_3, BrepsB=extr_4)
nullrep = ReplaceNulls(Items=brepinc, Replacements=Toggle(False))  # -> Items, Count
pipe_2 = Pipe(Curve=ext_2, Radius=number_slider_5, Caps=1)  # -> flatten(Pipe)
python = GhPythonScript(x=nullrep.Items)  # -> a; inputs x: tree
# ---------- python: Python ----------
a = []
for b in x.Branches:
    for id, bool in enumerate(b):
        if bool == True:
            a.append(id)
            print(id)
# ---------- end python ----------
brep_3 = Brep(flatten([orient_3.Geometry, orient_4.Geometry]))
sdiff_4 = SolidDifference(BrepsA=sunion_4, BrepsB=extr_3)
number_slider_9 = Slider(60, range=0..100)
clone = CloneStructure(List=brep, Structure=python)

# ---- group: Branch Look
cluster = BranchLook(data=clone, i=Slider(0, range=0..1))

# ----
area_3 = Area(Geometry=cluster)  # -> Area, Centroid
distance_wrapper = DistanceWrapper(Geometry=cluster)
python_2 = GhPythonScript(x=cluster)  # -> out, a; inputs x: list of Brep; disabled
# ---------- python_2: Python ----------
import Rhino.Geometry as rg


a = rg.Brep.CreateBooleanUnion(x, 0.01)
# ---------- end python_2 ----------
avr = Average(Input=area_3.Centroid)
boolean_union = BooleanUnion(DistanceObjectS=distance_wrapper)
graft_2 = GraftTree(Tree=brep_3, IncludeEmptyLists=True, IncludeNullItems=True)
bbox = BoundingBox(Content=cluster, Plane=PlaneXY(0, 0, 0), UnionBox=True)  # -> Box, Box_2
distance_wrapper_2 = DistanceWrapper(Geometry=extr_5)
number_slider_10 = Slider(1, range=0..1)
distance_wrapper_3 = DistanceWrapper(Geometry=item_2)
distance_wrapper_4 = DistanceWrapper(Geometry=extr_3)
sunion_5 = SolidUnion(Breps=clone)  # disabled
brepinc_2 = PointInBrep(Brep=graft_2, Point=duppt, Strict=False)
crv_4 = Curve(<curve referenced from the Rhino model>)
nullrep_2 = ReplaceNulls(Items=brepinc_2, Replacements=Toggle(False))  # -> Items, Count
isosurface_distancefunction = IsosurfaceDistancefunction(
    BoundingBox=bbox.Box,
    NumberX=number_slider_9,
    NumberY=number_slider_9,
    NumberZ=number_slider_9,
    Isovalue=0,
    Capped=False,
    DistanceObject=boolean_union,
    Refine=True)  # disabled
midpt_2 = CurveMiddle(Curve=crv_4)
python_3 = GhPythonScript(x=nullrep_2.Items)  # -> a; inputs x: tree; same code as python
boolean_union_2 = BooleanUnion(DistanceObjectS=distance_wrapper_3, DistanceObject=distance_wrapper_2)
panel_2 = Panel(isosurface_distancefunction)
python_4 = GhPythonScript(x=sdiff_4)  # -> out, a; inputs x: list of Brep; disabled; same code as python_2
yz_7 = YZPlane(Origin=midpt_2)
number_slider_11 = Slider(80, range=0..100)
clone_2 = CloneStructure(List=brep_3, Structure=python_3)

# ---- group: Branch Look
cluster_2 = BranchLook(data=clone_2, i=Slider(0, range=0..1))

# ----
boolean_subtract = BooleanSubtract(DistanceObject=boolean_union_2, DistanceObject_2=distance_wrapper_4)
bbox_2 = BoundingBox(Content=sdiff_4, Plane=PlaneXY(0, 0, 0), UnionBox=True)  # -> Box, Box_2
brep_4 = Brep(sdiff_4)
sunion_6 = SolidUnion(Breps=clone_2)  # disabled
mirror = Mirror(Geometry=brep_4, Plane=yz_7)  # -> Geometry, Transform
isosurface_distancefunction_2 = IsosurfaceDistancefunction(
    BoundingBox=bbox_2.Box,
    NumberX=number_slider_11,
    NumberY=number_slider_11,
    NumberZ=number_slider_11,
    Isovalue=0,
    Capped=False,
    DistanceObject=boolean_subtract,
    Refine=True)  # disabled
panel_3 = Panel(isosurface_distancefunction_2)
X_5 = UnitX(Factor=Slider(700, range=0..1000))
move_6 = Move(Geometry=crv, Motion=X_5)  # -> Geometry, Transform
move_7 = Move(Geometry=cull_i, Motion=X_5)  # -> Geometry, Transform
move_8 = Move(Geometry=crv_2, Motion=X_5)  # -> Geometry, Transform
crv_5 = Curve(move_6.Geometry)

yz_8 = YZPlane(Origin=Point(0, 0, 0))
pt_6 = ConstructPoint(XCoordinate=Slider(38, range=0..100), YCoordinate=0, ZCoordinate=0)
cir_3 = Circle(Plane=yz_8, Radius=number_slider_5)
yz_9 = YZPlane(Origin=pt_6)
sph_5 = Sphere(Base=pt_6, Radius=Slider(12, range=0..100))
sph_6 = Sphere(Base=PlaneXY(0, 0, 0), Radius=Slider(15, range=0..100))
yz_10 = YZPlane(Origin=Point(0, 0, 0))
boundary_7 = BoundarySurfaces(Edges=cir_3)
X_6 = UnitX(Factor=Slider(8, range=0..10))
X_7 = UnitX(Factor=Slider(50, range=0..50))
sec_5 = BrepPlane(Brep=sph_5, Plane=yz_9)  # -> Curves, Points
sec_6 = BrepPlane(Brep=sph_6, Plane=yz_10)  # -> Curves, Points
extr_7 = Extrude(Base=boundary_7, Direction=X_7)
loft_3 = Loft(
    Curves=[sec_5.Curves, sec_6.Curves],
    Options={Adjust=False, Closed=False, LoftEnds=0, LoftSimp=0, LoftType=0, Rebuild=10, Refit=0.01})
move_9 = Move(Geometry=extr_7, Motion=X_6)  # -> Geometry, Transform
cap_4 = CapHoles(Brep=loft_3)
sunion_7 = SolidUnion(Breps=flatten([cap_4, sph_5, sph_6]))

crv_6 = Curve(move_8.Geometry)
midpt_3 = CurveMiddle(Curve=move_7.Geometry)
neg_5 = Negative(Value="1")
number_slider_12 = Slider(31, range=0..100)
number_slider_13 = Slider(31, range=0..100)
Z_9 = UnitZ(Factor=neg_5)
Z_10 = UnitZ(Factor="1")
points_3 = PointList(Points=midpt_3, Size=Slider(11, range=0..100))
move_10 = Move(Geometry=crv_5, Motion=Z_9)  # -> Geometry, Transform
move_11 = Move(Geometry=crv_6, Motion=Z_10)  # -> Geometry, Transform
multiplication = Multiplication(A=number_slider_13, B=2)
offset_3 = OffsetCurve(Curve=crv_5, Distance=Slider(11, range=0..100), Corners=1)
offset_4 = OffsetCurve(Curve=crv_6, Distance=Slider(11, range=0..100), Corners=1)
boundary_8 = BoundarySurfaces(Edges=move_10.Geometry)
boundary_9 = BoundarySurfaces(Edges=move_11.Geometry)
multiplication_2 = Multiplication(A=number_slider_12, B=2)
Z_11 = UnitZ(Factor=number_slider_13)
Z_12 = UnitZ(Factor=number_slider_12)
Z_13 = UnitZ(Factor=multiplication)
boundary_10 = BoundarySurfaces(Edges=flatten(offset_3))
boundary_11 = BoundarySurfaces(Edges=flatten(offset_4))
Z_14 = UnitZ(Factor=multiplication_2)
extr_8 = Extrude(Base=boundary_8, Direction=Z_13)
extr_9 = Extrude(Base=boundary_9, Direction=Z_14)
extr_10 = Extrude(Base=boundary_10, Direction=Z_11)
extr_11 = Extrude(Base=boundary_11, Direction=Z_12)
join_3 = JoinCurves(Curves=move_7.Geometry, Preserve=False)
neg_6 = Negative(Value=Slider(8, range=0..100))
ext_3 = ExtendCurve(Curve=join_3, Type=0, Start=neg_6, End=neg_6)
pipe_3 = Pipe(Curve=ext_3, Radius=number_slider_5, Caps=1)  # -> flatten(Pipe)

pt_7 = ConstructPoint(XCoordinate=0, YCoordinate=0, ZCoordinate=0)
xy_3 = XYPlane(Origin=Point(0, 0, 0))
sdiff_5 = SolidDifference(BrepsA=sunion_7, BrepsB=move_9.Geometry)
end_3 = EndPoints(Curve=move_7.Geometry)  # -> Start, End
pl_3pt_5 = Plane3Pt(PointA=end_3.Start, PointB=end_3.End, PointC=pt_7)  # -> simplify(graft(Plane))
pl_3pt_6 = Plane3Pt(PointA=end_3.End, PointB=end_3.Start, PointC=pt_7)  # -> simplify(graft(Plane))
orient_5 = Orient(Geometry=sdiff_5, Source=xy_3, Target=pl_3pt_5)  # -> Geometry, Transform
orient_6 = Orient(Geometry=sdiff_5, Source=xy_3, Target=pl_3pt_6)  # -> Geometry, Transform

brep_5 = Brep(flatten([orient_5.Geometry, orient_6.Geometry]))
item_4 = ListItem(List=flatten(brep_5), Index=[Slider(1, range=0..1), Slider(3, range=0..10)], Wrap=True)
area_4 = Area(Geometry=flatten(brep_5))  # -> Area, Centroid
item_5 = ListItem(List=flatten(brep_5), Index=[Slider(0, range=0..10), Slider(4, range=0..10)], Wrap=True)
item_6 = ListItem(List=flatten(brep_5), Index=[Slider(3, range=0..10), Slider(1, range=0..10)], Wrap=True)
sunion_8 = SolidUnion(Breps=flatten([extr_10, item_5, extr_8]))
points_4 = PointList(Points=area_4.Centroid, Size=Slider(10, range=0..10))
duppt_2 = RemoveDuplicatePts(Points=flatten([end_3.Start, end_3.End]), Tolerance=0.01)
sunion_9 = SolidUnion(Breps=flatten([extr_11, item_6, extr_9]))
brep_6 = Brep(flatten([orient_5.Geometry, orient_6.Geometry]))
graft_3 = GraftTree(Tree=brep_6, IncludeEmptyLists=True, IncludeNullItems=True)
move_12 = Move(Geometry=crv_4, Motion=X_5)  # -> Geometry, Transform
distance_wrapper_5 = DistanceWrapper(Geometry=extr_10)
number_slider_14 = Slider(1, range=0..1)
distance_wrapper_6 = DistanceWrapper(Geometry=item_5)
distance_wrapper_7 = DistanceWrapper(Geometry=extr_8)
brepinc_3 = PointInBrep(Brep=graft_3, Point=duppt_2, Strict=False)
crv_7 = Curve(move_12.Geometry)
nullrep_3 = ReplaceNulls(Items=brepinc_3, Replacements=Toggle(False))  # -> Items, Count
midpt_4 = CurveMiddle(Curve=crv_7)
python_5 = GhPythonScript(x=nullrep_3.Items)  # -> a; inputs x: tree; same code as python
boolean_union_3 = BooleanUnion(DistanceObjectS=distance_wrapper_6, DistanceObject=distance_wrapper_5)
python_6 = GhPythonScript(x=sunion_8)  # -> out, a; inputs x: list of Brep; disabled; same code as python_2
brep_7 = Brep(sunion_8)
number_slider_15 = Slider(80, range=0..100)
clone_3 = CloneStructure(List=brep_6, Structure=python_5)

# ---- group: Branch Look
cluster_3 = BranchLook(data=clone_3, i=Slider(0, range=0..1))

# ----
yz_11 = YZPlane(Origin=midpt_4)
boolean_subtract_2 = BooleanSubtract(DistanceObject=boolean_union_3, DistanceObject_2=distance_wrapper_7)
bbox_3 = BoundingBox(Content=sunion_8, Plane=PlaneXY(0, 0, 0), UnionBox=True)  # -> Box, Box_2
sunion_10 = SolidUnion(Breps=clone_3)  # disabled
mirror_2 = Mirror(Geometry=brep_7, Plane=yz_11)  # -> Geometry, Transform
isosurface_distancefunction_3 = IsosurfaceDistancefunction(
    BoundingBox=bbox_3.Box,
    NumberX=number_slider_15,
    NumberY=number_slider_15,
    NumberZ=number_slider_15,
    Isovalue=0,
    Capped=False,
    DistanceObject=boolean_subtract_2,
    Refine=True)  # disabled
panel_4 = Panel(isosurface_distancefunction_3)

# ==== cluster BranchLook: To see the condition of branch data.
data = ClusterInput()
data_2 = Data(data)
tstat = TreeStatistics(Tree=data_2)  # -> Paths, Length, Count
i = ClusterInput()
item = ListItem(List=tstat.Paths, Index=i, Wrap=True)
branch = TreeBranch(Tree=data_2, Path=item, MaintainPaths=True)
B = ClusterOutput(branch)
