# Grasshopper definition magnetForce.gh (Grasshopper 1.0.7)
# plug-ins: MeshMachine, Kangaroo Components, Pufferfish, ClipperComponents, MeshEdit Components, Weaverbird, treesloth01, Kangaroo2 Components

brep = Brep([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])
vec = VectorXYZ(XComponent=Slider(2.82, range=0..10), YComponent=Slider(3.13, range=0..10), ZComponent=0)  # -> Vector, Length
move = Move(Geometry=brep, Motion=vec.Vector)  # -> Geometry, Transform
preview = CustomPreview(Geometry=move.Geometry, Material=ColourSwatch(SwatchColor=RGB(69, 69, 69)))

# ----
# Area 2
number_slider = Slider(0.4, range=0..1)
pt = Point(Point(16.46079099, 7.442545306, 0))
cir = Circle(Plane=pt, Radius=number_slider)

# ----
# Area 3
number_slider_2 = Slider(0.2, range=0..1)
pt_2 = Point(Point(17.50635162, 9.417901377, 0))
cir_2 = Circle(Plane=pt_2, Radius=number_slider_2)

# ----
# Existing Column
crv = Curve(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)
crv_2 = Curve(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)
crv_3 = Curve(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)
crv_4 = Curve(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)
area = Area(Geometry=crv)  # -> Area, Centroid
area_2 = Area(Geometry=crv_2)  # -> Area, Centroid
area_3 = Area(Geometry=crv_3)  # -> Area, Centroid
area_4 = Area(Geometry=crv_4)  # -> Area, Centroid

# ----
# Offset Clearance
number_slider_3 = Slider(0.2, range=0..1)

# ----
# Area 1
pt_3 = Point(Point(18.88003692, 6, 0))

# ----
# Column
# Boudrary
swatch = ColourSwatch(SwatchColor=RGB(0, 0, 0))
ln = Line(StartPoint=area_2.Centroid, EndPoint=area_3.Centroid)
ln_2 = Line(StartPoint=area.Centroid, EndPoint=area_2.Centroid)
ln_3 = Line(StartPoint=area_3.Centroid, EndPoint=area_4.Centroid)
ln_4 = Line(StartPoint=area.Centroid, EndPoint=area_4.Centroid)
preview_2 = CustomPreview(Geometry=[ln_2, ln, ln_3, ln_4], Material=swatch)

offset = OffsetCurve(Curve=crv, Distance=number_slider_3, Corners=1)
offset_2 = OffsetCurve(Curve=crv_2, Distance=number_slider_3, Corners=1)
offset_3 = OffsetCurve(Curve=crv_3, Distance=number_slider_3, Corners=1)
offset_4 = OffsetCurve(Curve=crv_4, Distance=number_slider_3, Corners=1)
explode = Explode(Curve=offset_3, Recursive=True)  # -> Segments, Vertices
preview_3 = CustomPreview(Geometry=[offset, offset_2, offset_3, offset_4], Material=ColourSwatch(SwatchColor=RGBA(176, 135, 135, 124)))
explode_2 = Explode(Curve=offset, Recursive=True)  # -> Segments, Vertices
explode_3 = Explode(Curve=offset_2, Recursive=True)  # -> Segments, Vertices
explode_4 = Explode(Curve=offset_4, Recursive=True)  # -> Segments, Vertices
midpt = CurveMiddle(Curve=ln_2)
midpt_2 = CurveMiddle(Curve=ln_3)

# ----
# Closet Pt to EX Column
item = ListItem(List=explode_3.Vertices, Index=0, Wrap=True)  # -> Item, Item1, Item2, Item3
pt_4 = Point(item.Item2)

# ----
# Closet Pt to EX Column
item_2 = ListItem(List=explode_2.Vertices, Index=0, Wrap=True)  # -> Item, Item1
pt_5 = Point(item_2.Item1)

# ----
# Closet Pt to EX Column
item_3 = ListItem(List=explode.Vertices, Index=0, Wrap=True)  # -> Item, Item1, Item2, Item3
pt_6 = Point(item_3.Item3)

# ----
# Closet Pt to EX Column
item_4 = ListItem(List=explode_4.Vertices, Index=0, Wrap=True)  # -> Item, Item1
pt_7 = Point(item_4.Item)

# ----
# Center
# Connection
ln_5 = Line(StartPoint=pt_3, EndPoint=pt_2)
ln_6 = Line(StartPoint=pt_3, EndPoint=pt)
ln_7 = Line(StartPoint=pt, EndPoint=pt_2)

Z = UnitZ(Factor=1)

# ----
# Symetrical Axis
ln_8 = Line(StartPoint=midpt, EndPoint=midpt_2)

extr = Extrude(Base=ln_8, Direction=Z)

number_slider_4 = Slider(0.54, range=0.5..0.6)
hframe = HorizontalFrame(Curve=ln_7, Parameter=number_slider_4)
hframe_2 = HorizontalFrame(Curve=ln_6, Parameter=number_slider_4)
deplane = DeconstructPlane(Plane=hframe)  # -> Origin, XAxis, YAxis, ZAxis
deplane_2 = DeconstructPlane(Plane=hframe_2)  # -> Origin, XAxis, YAxis, ZAxis

# ----
# Shifted Symetrical MidPt
number_slider_5 = Slider(0.63, range=0.5..1.5)
eval = EvaluateCurve(Curve=ln_3, Parameter=number_slider_5)  # -> Point, Tangent, Angle

neg = Negative(Value=Slider(-8, range=-90..90))
vrot = Rotate(Vector=deplane_2.YAxis, Axis=deplane_2.ZAxis, Angle=degrees(neg))
vrot_2 = Rotate(Vector=deplane.YAxis, Axis=deplane.ZAxis, Angle=degrees(Slider(-21, range=-90..90)))
line = LineSDL(Start=deplane_2.Origin, Direction=vrot, Length=Slider(10, range=0..10))
line_2 = LineSDL(Start=deplane.Origin, Direction=vrot_2, Length=Slider(10, range=0..10))
ccx = CurveCurve(CurveA=line, CurveB=ln_8)  # -> Points, ParamsA, ParamsB
ln_9 = Line(StartPoint=ccx.Points, EndPoint=pt)
Z_2 = UnitZ(Factor=1)
ln_10 = Line(StartPoint=deplane_2.Origin, EndPoint=ccx.Points)
extr_2 = Extrude(Base=ln_9, Direction=Z_2)
number_slider_6 = Slider(6, range=0..10)
number_slider_7 = Slider(5, range=0..10)
mirror = Mirror(Geometry=deplane.Origin, Plane=extr_2)  # -> Geometry, Transform

X = UnitX(Factor=1)
Z_3 = UnitZ(Factor=1)
line_3 = LineSDL(Start=pt_2, Direction=X, Length=1)
extr_3 = Extrude(Base=line_3, Direction=Z_3)

ln_11 = Line(StartPoint=mirror.Geometry, EndPoint=pt_5)
ln_12 = Line(StartPoint=midpt, EndPoint=mirror.Geometry)
ext = ExtendCurve(Curve=line_2, Type=0, Start=number_slider_7, End=number_slider_7)
ln_13 = Line(StartPoint=ccx.Points, EndPoint=midpt)
ext_2 = ExtendCurve(Curve=ln_10, Type=0, Start=number_slider_6, End=number_slider_6)
ext_3 = ExtendCurve(Curve=ln_11, Type=0, Start=Slider(2, range=0..10), End=Slider(6, range=0..10))
mirror_2 = Mirror(Geometry=[ext_2, ext], Plane=extr_3)  # -> flatten(Geometry), Transform

merge = Merge(Data1=ext_2, Data2=ln_13, Data3=ln_12, Data4=ext_3, Data5=ext)  # -> flatten(Result)
mcx = MultipleCurves(Curves=merge)  # -> Points, IndexA, IndexB, ParamA, ParamB
alongcrv = SortAlongCurve(Points=mcx.Points, Curve=cir)  # -> Points, Indices
pline = PolyLine(Vertices=alongcrv.Points, Closed=invert(False))
fillet = FilletDistance(Curve=pline, Distance=Slider(0.4, range=0..1))
boundary = BoundarySurfaces(Edges=fillet)

merge_2 = Merge(Data1=ext_2, Data2=mirror_2.Geometry, Data3=ext)  # -> flatten(Result)
item_5 = ListItem(List=mirror_2.Geometry, Index=0, Wrap=True)  # -> Item, Item1
item_6 = ListItem(List=mcx.Points, Index=0, Wrap=True)
ln_14 = Line(StartPoint=item_6, EndPoint=eval.Point)

mcx_2 = MultipleCurves(Curves=merge_2)  # -> Points, IndexA, IndexB, ParamA, ParamB
alongcrv_2 = SortAlongCurve(Points=mcx_2.Points, Curve=cir_2)  # -> Points, Indices
pline_2 = PolyLine(Vertices=alongcrv_2.Points, Closed=invert(False))
fillet_2 = FilletDistance(Curve=pline_2, Distance=Slider(0.4, range=0..1))
boundary_2 = BoundarySurfaces(Edges=fillet_2)

ccx_2 = CurveCurve(CurveA=ln_14, CurveB=item_5.Item1)  # -> Points, ParamsA, ParamsB
ln_15 = Line(StartPoint=ccx_2.Points, EndPoint=eval.Point)
crv_cp = CurveClosestPoint(Point=ccx_2.Points, Curve=ln_4)  # -> Point, Parameter, Distance
ln_16 = Line(StartPoint=ccx_2.Points, EndPoint=crv_cp.Point)
area_5 = Area(Geometry=boundary)  # -> Area, Centroid
merge_3 = Merge(Data1=crv_cp.Point, Data2=ccx_2.Points, Data3=eval.Point)
crv_cp_2 = CurveClosestPoint(Point=item_6, Curve=ln_8)  # -> Point, Parameter, Distance
ccx_3 = CurveCurve(CurveA=ext_2, CurveB=item_5.Item1)  # -> Points, ParamsA, ParamsB

# ----
# Main Symetrical
mirror_3 = Mirror(Geometry=eval.Point, Plane=extr)  # -> Geometry, Transform

# ----
# Main Symetrical
mirror_4 = Mirror(Geometry=deplane_2.Origin, Plane=extr)  # -> Geometry, Transform

ln_17 = Line(StartPoint=ccx_3.Points, EndPoint=deplane_2.Origin)
ln_18 = Line(StartPoint=crv_cp.Point, EndPoint=ccx_3.Points)
ln_19 = Line(StartPoint=eval.Point, EndPoint=mirror_3.Geometry)

# ---- group: ExistingColumns
existing_columns = Geometry([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])

# ----
area_6 = Area(Geometry=boundary_2)  # -> Area, Centroid
merge_4 = Merge(Data1=deplane_2.Origin, Data2=crv_cp_2.Point, Data3=mirror_4.Geometry)
merge_5 = Merge(Data1=ln_15, Data2=ln_16, Data3=ln_18, Data4=ln_17)
intcrv = Interpolate(Vertices=flatten(merge_4), Degree=3, Periodic=False, KnotStyle=1)  # -> Curve, Length, Domain
join = JoinCurves(Curves=merge_5, Preserve=False)
merge_6 = Merge(Data1=boundary, Data2=boundary_2)

# ---- group: Axes
lateralaxisr = Curve(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)
lateralaxisl = Curve(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)
centralaxis = Curve(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)
rightaxis = Curve(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)
leftaxis = Curve(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)

# ----
# Main Symetrical
mirror_5 = Mirror(Geometry=join, Plane=extr)  # -> Geometry, Transform

# ----
# Main Symetrical
mirror_6 = Mirror(Geometry=merge_6, Plane=extr)  # -> Geometry, Transform

number_slider_8 = Slider(0.25, range=0..1)
number_slider_9 = Slider(0.6, range=0..1)

# ----
# Mushroom 1
number_slider_10 = Slider(0.6, range=0..1)
join_2 = JoinCurves(Curves=flatten([ln_19, mirror_5.Geometry, intcrv.Curve, join]), Preserve=False)
fillet_3 = Fillet(Curve=join_2, Radius=number_slider_10)
boundary_3 = BoundarySurfaces(Edges=fillet_3)
area_7 = Area(Geometry=fillet_3)  # -> Area, Centroid

# ---- group: ColumnLocation
# Vector Fields Approach
eval_2 = EvaluateCurve(Curve=reparameterize(centralaxis), Parameter=number_slider_8)  # -> Point, Tangent, Angle
eval_3 = EvaluateCurve(Curve=reparameterize(lateralaxisl), Parameter=number_slider_8)  # -> Point, Tangent, Angle
eval_4 = EvaluateCurve(Curve=reparameterize(leftaxis), Parameter=number_slider_9)  # -> Point, Tangent, Angle
eval_5 = EvaluateCurve(Curve=reparameterize(lateralaxisr), Parameter=number_slider_8)  # -> Point, Tangent, Angle
eval_6 = EvaluateCurve(Curve=reparameterize(rightaxis), Parameter=number_slider_9)  # -> Point, Tangent, Angle

# ----
# Column 1
number_slider_11 = Slider(0.35, range=0..1)
cir_3 = Circle(Plane=area_7.Centroid, Radius=number_slider_11)
boundary_4 = BoundarySurfaces(Edges=cir_3)
preview_4 = CustomPreview(Geometry=boundary_4, Material=ColourSwatch(SwatchColor=RGB(252, 176, 10)))

# ----
# Column 2
number_slider_12 = Slider(0.2, range=0..1)
cir_4 = Circle(Plane=area_5.Centroid, Radius=number_slider_12)
boundary_5 = BoundarySurfaces(Edges=cir_4)
preview_5 = CustomPreview(Geometry=boundary_5, Material=ColourSwatch(SwatchColor=RGB(0, 238, 255)))

# ----
# Column 3
number_slider_13 = Slider(0.2, range=0..1)
cir_5 = Circle(Plane=area_6.Centroid, Radius=number_slider_13)
boundary_6 = BoundarySurfaces(Edges=cir_5)
preview_6 = CustomPreview(Geometry=boundary_6, Material=ColourSwatch(SwatchColor=RGB(247, 0, 255)))

merge_7 = Merge(Data1=eval_2.Point, Data2=eval_3.Point, Data3=eval_5.Point, Data4=eval_4.Point, Data5=eval_6.Point)
merge_8 = Merge(Data1=mirror_6.Geometry, Data2=boundary_3, Data3=merge_6)
meshmachine = MeshMachine(Length=1, Flip=1, PullStrength=0.8, CurvatureAdaptivity=0, Reset=True)  # disabled
boundary_7 = BoundarySurfaces(Edges=[cir_4, fillet])

# ---- group: Charges
c2 = Slider(-1.5, range=-10..10)
c4 = Slider(-1.5, range=-10..10)
c1 = Slider(-1.5, range=-10..10)
c3 = Slider(-1.5, range=-10..10)
c5 = Slider(-1.5, range=-10..10)
merge_9 = Merge(Data1=c1, Data2=c2, Data3=c3, Data4=c4, Data5=c5)

# ----
split = SplitBrep(Brep=boundary_3, Cutter=cir_3)
split_2 = SplitBrep(Brep=boundary_2, Cutter=cir_5)
number_slider_14 = Slider(400, range=0..10000)  # disabled
clean = CombineClean()  # disabled
item_7 = ListItem(List=split_2, Index=0, Wrap=True)  # -> Item, Item1
item_8 = ListItem(List=split, Index=0, Wrap=True)  # -> Item, Item1
brep_2 = Brep(boundary_7)
brep_3 = Brep(item_8.Item1)
brep_4 = Brep(item_7.Item1)
mirror_7 = Mirror(Geometry=[brep_2, brep_4], Plane=extr)  # -> Geometry, Transform
number_slider_15 = Slider(7, range=0..10)
number_slider_16 = Slider(1.2, range=0..10)
number_slider_17 = Slider(1, range=0..10)
number_slider_18 = Slider(2, range=0..10)
neg_2 = Negative(Value=Slider(0.03, range=0..1))
number_slider_19 = Slider(3, range=0..10)  # disabled
brep_5 = Brep(item_7.Item1)
brep_6 = Brep(item_8.Item1)
loft = Loft(Curves=[cir_4, fillet], Options={Adjust=False, Closed=False, LoftEnds=0, LoftSimp=0, LoftType=0, Rebuild=10, Refit=0.01})  # disabled
neg_3 = Negative(Value=number_slider_15)
brep_7 = Brep(flatten([brep_2, brep_4, brep_3, mirror_7.Geometry]))
brep_8 = Brep(brep_7)
debrep = DeconstructBrep(Brep=brep_8)  # -> Faces, Edges, Vertices
brec = BoundingRectangle(Geometry=brep_8, Plane=PlaneXY(0, 0, 0), Axis=0, Slide=0, Union=True)  # -> Bounding, DimensionX, DimensionY
crv_5 = Curve(debrep.Edges)
join_3 = JoinCurves(Curves=crv_5, Preserve=False)
len = Length(Curve=join_3)
sort = SortList(Keys=len, ValuesA=join_3)  # -> Keys, ValuesA
item_9 = ListItem(List=sort.ValuesA, Index=0, Wrap=True)  # -> Item, Item1
area_8 = Area(Geometry=item_9.Item)  # -> Area, flatten(Centroid)

# ---- group: ColumnLocations
pt_8 = Point(flatten(area_8.Centroid))

# ----
points = PointList(Points=flatten(pt_8), Size=Slider(0.34, range=0..1))
crv_6 = Curve(item_9.Item1)
area_9 = Area(Geometry=brec.Bounding)  # -> Area, Centroid
offset_5 = OffsetCurve(Curve=crv_6, Distance=neg_2, Corners=1)
crv_7 = Curve(item_9.Item)
divlength = DivideLength(Curve=offset_5, Length=Slider(0.5, range=0..1))  # -> Points, Tangents, Parameters
qrsettings = QuadRemeshSettings(
    TargetCount=number_slider_14,
    AdaptiveSize=0,
    AdaptiveCount=False,
    HardEdges=False,
    SeamEdges=0,
    Symmetry=0,
    GuideCurves=0)  # disabled
Z_4 = UnitZ(Factor=number_slider_19)  # disabled

# ---- group: Forces
fspin = SpinForce(Plane=pt_8, Strength=number_slider_15, Radius=number_slider_17, Decay=number_slider_18, Bounds=brec.Bounding)
pcharge = PointCharge(Point=pt_8, Charge=merge_9, Decay=number_slider_16, Bounds=brec.Bounding)
fspin_2 = SpinForce(Plane=pt_8, Strength=neg_3, Radius=number_slider_17, Decay=number_slider_18, Bounds=brec.Bounding)
pcharge_2 = PointCharge(Point=pt_8, Charge=merge_9, Decay=number_slider_16, Bounds=brec.Bounding)

# ----
pdecon = Deconstruct(Point=divlength.Points)  # -> XComponent, YComponent, ZComponent
pdecon_2 = Deconstruct(Point=area_9.Centroid)  # -> XComponent, YComponent, ZComponent
divide = DivideCurve(Curve=crv_7, Count=10, Kinks=False)  # -> Points, Tangents, Parameters
number_slider_20 = Slider(400, range=0..10000)  # disabled
debrep_2 = DeconstructBrep(Brep=brep_7)  # -> Faces, Edges, Vertices

# ---- group: Radii
merge_10 = Merge(
    Data1=Slider(2.78, range=0..10),
    Data2=Slider(1.8, range=0..10),
    Data3=Slider(1.8, range=0..10),
    Data4=Slider(2.1, range=0..10),
    Data5=Slider(2.1, range=0..10))

# ----
Z_5 = UnitZ(Factor=Slider(2, range=0..10))  # disabled
number_slider_21 = Slider(600, range=0..10000)  # disabled
boundary_8 = BoundarySurfaces(Edges=[cir_4, fillet])  # disabled

mergef = MergeFields(Fields=[pcharge, fspin])
mergef_2 = MergeFields(Fields=[fspin_2, pcharge_2])

pdecon_3 = Deconstruct(Point=divide.Points)  # -> XComponent, YComponent, ZComponent

# ---- group: ModuleOutlinePolygon
number_slider_22 = Slider(6, range=0..10)
polygon = Polygon(Plane=pt_8, Radius=merge_10, Segments=number_slider_22, FilletRadius=0)  # -> Polygon, Length
rotate = Rotate(Geometry=polygon.Polygon, Angle=degrees(Slider(331, range=0..360)), Plane=pt_8)  # -> Geometry, Transform

# ----
number_slider_23 = Slider(2, range=1.2..2.5)  # disabled
qrmesh = QuadRemesh(Mesh=loft, Settings=qrsettings)  # disabled
pdecon_4 = Deconstruct(Point=area_9.Centroid)  # -> XComponent, YComponent, ZComponent
crv_8 = Curve(debrep_2.Edges)
larger = LargerThan(FirstNumber=pdecon.YComponent, SecondNumber=pdecon_2.YComponent)  # -> LargerThan, OrEqualTo
move_2 = Move(Geometry=boundary, Motion=Z_4)  # -> Geometry, Transform; disabled
move_3 = Move(Geometry=cir_4, Motion=Z_5)  # -> Geometry, Transform; disabled
join_4 = JoinCurves(Curves=crv_8, Preserve=False)
dispatch = Dispatch(List=divlength.Points, DispatchPattern=larger.LargerThan)  # -> ListA, ListB
cluster = Cluster(M=qrmesh, B=number_slider_23)  # -> P, mesh_2; disabled
larger_2 = LargerThan(FirstNumber=pdecon_3.YComponent, SecondNumber=pdecon_4.YComponent)  # -> LargerThan, OrEqualTo
qrsettings_2 = QuadRemeshSettings(
    TargetCount=number_slider_20,
    AdaptiveSize=0,
    AdaptiveCount=False,
    HardEdges=False,
    SeamEdges=0,
    Symmetry=0,
    GuideCurves=0)  # disabled
len_2 = Length(Curve=join_4)
qrsettings_3 = QuadRemeshSettings(
    TargetCount=number_slider_21,
    AdaptiveSize=0,
    AdaptiveCount=False,
    HardEdges=False,
    SeamEdges=0,
    Symmetry=0,
    GuideCurves=0)  # disabled
xz = XZPlane(Origin=area_9.Centroid)
dispatch_2 = Dispatch(List=divide.Points, DispatchPattern=larger_2.LargerThan)  # -> ListA, ListB
pt_9 = Point(dispatch.ListA)
number_slider_24 = Slider(1.5, range=1.2..2.5)  # disabled
qrmesh_2 = QuadRemesh(Mesh=brep_5, Settings=qrsettings_2)  # disabled
number_slider_25 = Slider(2.3, range=1.2..2.5)  # disabled
sort_2 = SortList(Keys=len_2, ValuesA=join_4)  # -> Keys, ValuesA
qrmesh_3 = QuadRemesh(Mesh=brep_6, Settings=qrsettings_3)  # disabled
xz_2 = XZPlane(Origin=area_9.Centroid)
pt_10 = Point(dispatch_2.ListA)
cluster_2 = Cluster(M=qrmesh_2, B=number_slider_24)  # -> P, mesh_2; disabled
item_10 = ListItem(List=sort_2.ValuesA, Index=0, Wrap=True)  # -> Item, Item1
mirror_8 = Mirror(Geometry=pt_9, Plane=xz)  # -> Geometry, Transform
cluster_3 = Cluster(M=qrmesh_3, B=number_slider_25)  # -> P, mesh_2; disabled
number_slider_26 = Slider(0, range=0..100)
graft = GraftTree(Tree=brep_8, IncludeEmptyLists=True, IncludeNullItems=True)
mirror_9 = Mirror(Geometry=pt_10, Plane=xz_2)  # -> Geometry, Transform
number_slider_27 = Slider(0.5, range=0..1)
merge_11 = Merge(Data1=pt_9, Data2=mirror_8.Geometry)  # -> flatten(Result)
number_slider_28 = Slider(0.1, range=0..0.1)
mesh = Mesh([cluster_2.mesh_2, cluster.mesh_2])  # disabled
mesh_2 = Mesh(cluster_3.mesh_2)  # disabled
pt_11 = Point(<point referenced from the Rhino model>)
crv_9 = Curve([<curve referenced from the Rhino model> x24])
multiplication = Multiplication(A=number_slider_22, B=Slider(4, range=0..10))
swatch_2 = ColourSwatch(SwatchColor=RGB(201, 201, 201))  # disabled
pull = PullPoint(Point=merge_11, Geometry=graft, ClosestOnly=True)  # -> ClosestPoint, Distance
merge_12 = Merge(Data1=pt_10, Data2=mirror_9.Geometry)  # -> flatten(Result)
polyoffset = PolylineOffset(
    Polylines=item_10.Item1,
    Distance=Slider(0.39, range=0..10),
    Plane=Plane(origin=(0, 0, 0), x=(0, 0, 0), y=(0, 0, 0)),
    Tolerance=0.01,
    ClosedFillet=number_slider_26,
    OpenFillet=number_slider_26,
    Miter=2)  # -> Contour, Holes
graft_2 = GraftTree(Tree=brep_8, IncludeEmptyLists=True, IncludeNullItems=True)

# ----
# Main Symetrical
mirror_10 = Mirror(Geometry=mesh, Plane=extr)  # -> Geometry, Transform; disabled

number_slider_29 = Slider(0.01, range=0..1)
number_slider_30 = Slider(500, range=0..500)
xz_3 = XZPlane(Origin=pt_11)
number_slider_31 = Slider(100, range=0..100)
medges = MeshEdges(Mesh=mesh_2)  # -> NakedEdges, InteriorEdges, NonManifoldEdges; disabled
dispatch_3 = Dispatch(List=merge_11, DispatchPattern=pull.Distance)  # -> ListA, ListB
preview_7 = CustomPreview(Geometry=[mesh_2, mirror_10.Geometry, mesh], Material=swatch_2)  # disabled
qrsettings_4 = QuadRemeshSettings(
    TargetCount=Slider(300, range=0..1000),
    AdaptiveSize=Slider(1, range=0..1),
    AdaptiveCount=False,
    HardEdges=False,
    SeamEdges=0,
    Symmetry=0,
    GuideCurves=0)
crv_10 = Curve(polyoffset.Holes)
pull_2 = PullPoint(Point=merge_12, Geometry=graft_2, ClosestOnly=True)  # -> ClosestPoint, Distance
join_5 = JoinCurves(Curves=medges.NakedEdges, Preserve=False)  # disabled
mirror_11 = Mirror(Geometry=crv_9, Plane=xz_3)  # -> Geometry, Transform
number_slider_32 = Slider(3, range=0..5)
item_11 = ListItem(List=flatten(join_5), Index=0, Wrap=True)  # -> Item, Item1; disabled
pt_12 = Point(dispatch_3.ListB)
qrmesh_4 = QuadRemesh(Mesh=graft(brep_7), Settings=qrsettings_4)  # disabled
relay = Relay([mirror_11.Geometry, crv_9])
mcx_3 = MultipleCurves(Curves=reparameterize(relay))  # -> Points, IndexA, IndexB, ParamA, ParamB
Z_6 = UnitZ(Factor=number_slider_25)  # disabled
clone = CloneStructure(List=mcx_3.ParamA, Structure=mcx_3.IndexA)
clone_2 = CloneStructure(List=mcx_3.ParamB, Structure=mcx_3.IndexB)

# ---- group: FieldLines
fline = FieldLine(Field=mergef, Point=pt_12, Steps=number_slider_30, Accuracy=number_slider_29, Method=3)
fline_2 = FieldLine(Field=mergef_2, Point=pt_12, Steps=number_slider_30, Accuracy=number_slider_29, Method=3)

# ----
merge_13 = Merge(Data1=fline, Data2=fline_2)
merge_14 = Merge(Data1=fline, Data2=fline_2)
dispatch_4 = Dispatch(List=merge_12, DispatchPattern=pull_2.Distance)  # -> ListA, ListB
cluster_4 = BranchLook(data=graft(brep_7), i=number_slider_32)
cluster_5 = BranchLook(data=merge_14, i=number_slider_32)
crv_11 = Curve(item_11.Item1)  # disabled
neg_4 = Negative(Value=Z_6)  # disabled
explode_5 = MeshExplode(Mesh=qrmesh_4, Interpolate=False)
qrmesh_5 = QuadRemesh(Mesh=graft(brep_7), Guides=merge_13, Settings=qrsettings_4)
shatter = Shatter(Curve=reparameterize(graft(relay)), Parameters=[clone, clone_2])  # -> flatten(Segments)
pt_13 = Point(dispatch_4.ListB)
extr_4 = Extrude(Base=item_11.Item1, Direction=neg_4)  # disabled
demesh = DeconstructMesh(Mesh=explode_5)  # -> Vertices, Faces, Colours, Normals
wbweave = WeaverbirdsMeshFromLinesWeaveBack(Lines=shatter, MaximumValence=4)
item_12 = ListItem(List=demesh.Vertices, Index=0, Wrap=True)  # -> Item, Item1, Item2, Item3
mjoin = MeshJoin(Meshes=wbweave)
clean_2 = CombineClean(Meshes=mjoin)
ln_20 = Line(StartPoint=item_12.Item, EndPoint=item_12.Item2)
ln_21 = Line(StartPoint=item_12.Item1, EndPoint=item_12.Item3)
wbcatmullclark = WeaverbirdsCatmullClarkSubdivision(MeshCurves=clean_2, Level=Slider(1, range=0..10), SmoothNakedEdges=Slider(1, range=0..2))
explode_6 = MeshExplode(Mesh=wbcatmullclark, Interpolate=False)
demesh_2 = DeconstructMesh(Mesh=explode_6)  # -> Vertices, Faces, Colours, Normals
item_13 = ListItem(List=demesh_2.Vertices, Index=0, Wrap=True)  # -> Item, Item1, Item2, Item3
wbnaked = WeaverbirdsNakedBoundary(MeshClosedPolylines=wbcatmullclark)
ln_22 = Line(StartPoint=item_13.Item, EndPoint=item_13.Item2)
ln_23 = Line(StartPoint=item_13.Item1, EndPoint=item_13.Item3)
explode_7 = Explode(Curve=flatten([wbnaked, ln_22, ln_23]), Recursive=True)  # -> flatten(Segments), Vertices
dupln = RemoveDuplicateLines(Lines=explode_7.Segments, Tolerance=0.01)
end = EndPoints(Curve=dupln)  # -> Start, End
ln_24 = Line(StartPoint=end.Start, EndPoint=end.End)
mcx_4 = MultipleCurves(Curves=reparameterize(ln_24))  # -> Points, IndexA, IndexB, ParamA, ParamB
clone_3 = CloneStructure(List=mcx_4.ParamB, Structure=mcx_4.IndexB)
clone_4 = CloneStructure(List=mcx_4.ParamA, Structure=mcx_4.IndexA)
shatter_2 = Shatter(Curve=reparameterize(graft(ln_24)), Parameters=[clone_4, clone_3])  # -> flatten(Segments)
wbweave_2 = WeaverbirdsMeshFromLinesWeaveBack(Lines=shatter_2, MaximumValence=4)
mjoin_2 = MeshJoin(Meshes=wbweave_2)
clean_3 = CombineClean(Meshes=mjoin_2)
cluster_6 = Cluster(M=clean_3, B=Slider(1.9, range=1.2..2.5))  # -> P, mesh_2
brep_9 = Brep(cluster_6.P)
mesh_3 = Mesh(cluster_6.mesh_2)
X_2 = UnitX(Factor=Slider(4, range=0..10))
demesh_3 = DeconstructMesh(Mesh=mesh_3)  # -> Vertices, Faces, Colours, Normals
move_4 = Move(Geometry=brep_9, Motion=X_2)  # -> Geometry, Transform
pdecon_5 = Deconstruct(Point=demesh_3.Vertices)  # -> XComponent, YComponent, ZComponent
dom = ConstructDomain(DomainStart=Slider(0.19, range=0..1), DomainEnd=Slider(0.12, range=0..1))
bnd = Bounds(Numbers=pdecon_5.ZComponent)
remap = RemapNumbers(Value=pdecon_5.ZComponent, Source=bnd, Target=dom)  # -> Mapped, Clipped
amp = Amplitude(Vector=demesh_3.Normals, Amplitude=remap.Mapped)
move_5 = Move(Geometry=demesh_3.Vertices, Motion=amp)  # -> Geometry, Transform
conmesh = ConstructMesh(Vertices=move_5.Geometry, Faces=demesh_3.Faces)
mesh_4 = Mesh(conmesh)
mesh_5 = Mesh(mesh_3)
wbvertices = WeaverbirdsVerticesComponent(MeshClosedPolylinesGroup=mesh_4, Weld=True)
wbvertices_2 = WeaverbirdsVerticesComponent(MeshClosedPolylinesGroup=mesh_5, Weld=True)
explode_8 = MeshExplode(Mesh=mesh_4, Interpolate=False)
tri = Triangulate(Mesh=mesh_4)  # -> Mesh, Count
tri_2 = Triangulate(Mesh=mesh_5)  # -> Mesh, Count
ln_25 = Line(StartPoint=wbvertices_2, EndPoint=wbvertices)
wbedges = WeaverbirdsMeshEdges(MeshOrPolylines=mesh_5)
wbedges_2 = WeaverbirdsMeshEdges(MeshOrPolylines=mesh_4)
demesh_4 = DeconstructMesh(Mesh=explode_8)  # -> Vertices, Faces, Colours, Normals
wbedges_3 = WeaverbirdsMeshEdges(MeshOrPolylines=tri.Mesh)
wbedges_4 = WeaverbirdsMeshEdges(MeshOrPolylines=tri_2.Mesh)
lng = ListLength(List=demesh_4.Vertices)
equals = Equality(FirstNumber=lng, SecondNumber="3")  # -> Equality, Inequality
sift = SiftPattern(List=demesh_4.Vertices, SiftPattern=equals.Equality)  # -> Output0, Output1
line_4 = Line(flatten([ln_25, wbedges_4, wbedges_3]))
combine = CombineData()  # -> Result, Index
item_14 = ListItem(List=sift.Output0, Index=0, Wrap=True)  # -> Item, Item1, Item2, Item3
pt_14 = Point(sift.Output0)
pipe = Pipe(Curve=line_4, Radius="0.008", Caps=0)
ln_26 = Line(StartPoint=item_14.Item, EndPoint=item_14.Item2)
ln_27 = Line(StartPoint=item_14.Item1, EndPoint=item_14.Item3)
line_5 = Line([ln_26, ln_27])
len_3 = Length(Curve=line_5)
sort_3 = SortList(Keys=len_3, ValuesA=line_5)  # -> Keys, ValuesA
item_15 = ListItem(List=sort_3.ValuesA, Index=0, Wrap=True)
line_6 = Line(item_15)

# ==== cluster Cluster
M = ClusterInput()
unim = UnifyMesh(Mesh=M)  # -> Result, Count
medges = MeshEdges(Mesh=unim.Result)  # -> NakedEdges, InteriorEdges, NonManifoldEdges
nv = NakedVertices(Mesh=unim.Result)  # -> ClothedIndex, NakedIndex, ClothedPts, NakedPts
join = JoinCurves(Curves=medges.NakedEdges, Preserve=False)
len = Length(Curve=join)
sort = SortList(Keys=len, ValuesA=join)  # -> Keys, ValuesA
cull_i = CullIndex(List=sort.ValuesA, Indices="-1", Wrap=True)

# ---- group: Pressure
# Pressure
facen = FaceNormals(Mesh=unim.Result)  # -> Centers, Normals
item = ListItem(List=facen.Normals, Index=0, Wrap=True)
number_slider = Slider(0.6274, range=0..1)
devec = DeconstructVector(Vector=item)  # -> XComponent, YComponent, ZComponent
larger = LargerThan(FirstNumber=devec.ZComponent, SecondNumber=Slider(0, range=0..100))  # -> LargerThan, OrEqualTo
neg = Negative(Value=number_slider)
filter = StreamFilter(Gate=larger.LargerThan, Stream0=neg, Stream1=number_slider)

# ----
crv_cp = CurveClosestPoint(Point=nv.NakedPts, Curve=graft(cull_i))  # -> Point, Parameter, Distance
B = ClusterInput()
lng = ListLength(List=cull_i)
int = Integer(crv_cp.Distance)
# Column Height
dom = ConstructDomain(DomainStart=Slider(0, range=0..10), DomainEnd=B)
bool = Boolean(int)
cull = CullPattern(List=nv.NakedPts, CullPattern=invert(bool))

# ---- group: Column Height
random = Random(Range=dom, Number=lng, Seed=2)
Z = UnitZ(Factor=random)  # -> graft(UnitVector)
move = Move(Geometry=cull, Motion=Z)  # -> Geometry, Transform

# ----
branch = TreeBranch(Tree=cull, Path="{0;0;0;0;1}", MaintainPaths=True)
remap = RemapNumbers(Value=Slider(178, range=0..300), Source=Slider(300, range=0..1000), Target=Slider(10, range=0..10))  # -> Mapped, Clipped
pt = Point(flatten(cull))
pt_2 = ConstructPoint(XCoordinate=0, YCoordinate=0, ZCoordinate=0)
index = ItemIndex(List=nv.NakedPts, Item=pt)
pt_3 = Point(pt)
pt_4 = Point(flatten(move.Geometry))
line = LineSDL(Start=pt_2, Direction=Vector(0, 0, 1), Length=1)
number_slider_2 = Slider(1, range=0..1)
number_slider_3 = Slider(0, range=0..10)
cull_i_2 = CullIndex(List=nv.NakedPts, Indices=index, Wrap=True)

# ---- group: Boundary
# Anchoring Boundary Curve
item_2 = ListItem(List=sort.ValuesA, Index="-1", Wrap=True)
Z_2 = UnitZ(Factor=Slider(3, range=0..10))
move_2 = Move(Geometry=item_2, Motion=Z_2)  # -> Geometry, Transform
crv_cp_2 = CurveClosestPoint(Point=cull_i_2, Curve=move_2.Geometry)  # -> Point, Parameter, Distance

# ----
lng_2 = ListLength(List=cull_i_2)
pt_5 = Point(crv_cp_2.Point)
divide = DivideCurve(Curve=line, Count=lng_2, Kinks=False)  # -> Points, Tangents, Parameters
pt_6 = Point(cull_i_2)
perlin = PerlinNoise(Values=divide.Points, Time=remap.Mapped, Scale=Slider(2, range=0..100))
neg_2 = Negative(Value=number_slider_3)
bnd = Bounds(Numbers=perlin)
dom_2 = ConstructDomain(DomainStart=neg_2, DomainEnd=number_slider_3)
remap_2 = RemapNumbers(Value=perlin, Source=bnd, Target=dom_2)  # -> Mapped, Clipped
Z_3 = UnitZ(Factor=remap_2.Mapped)
move_3 = Move(Geometry=crv_cp_2.Point, Motion=Z_3)  # -> Geometry, Transform

# ---- group: Goals
edgelengths = EdgeLengths(Mesh=unim.Result, LengthFactor="0", Strength=1)
pressure = Pressure(M=unim.Result, Strength=filter)
anchor = Anchor(Point=pt, Target=pt_4, Strength=10000)
show = Show(G=unim.Result)
anchor_2 = Anchor(Point=cull_i_2, Target=move_3.Geometry, Strength=10000)

# ----
entwine = Entwine(Branch00=show, Branch01=[edgelengths, anchor_2, anchor, pressure], FlattenInputs=True)
graph = QuickGraph(perlin, SortOrder=0)
zombiesolver = ZombieSolver(GoalObjects=entwine, Threshold=1e-10, Tolerance=0.0001, MaxIterations=50000)  # -> I, V, O
unflatten = UnflattenTree(Tree=zombiesolver.O, Guide=entwine)
bang = ExplodeTree(Data=unflatten)  # -> Branch0, Branch1
neg_3 = Negative(Value=Slider(0.34, range=0..1))
mesh = Mesh(bang.Branch0)
mesh_2 = ClusterOutput(mesh)
wboffset = WeaverbirdsOffsetMesh(MeshCurves=mesh, Distance=neg_3, OffsetType=0)
explode = MeshExplode(Mesh=wboffset, Interpolate=False)
explode_2 = MeshExplode(Mesh=mesh, Interpolate=False)
move_4 = Move(Geometry=cull_i, Motion=flatten(Z))  # -> Geometry, Transform; disabled
crv = Curve(move_2.Geometry)  # disabled
mesh_3 = Mesh(move_4.Geometry)  # disabled
mesh_4 = Mesh(crv)  # disabled
demesh = DeconstructMesh(Mesh=explode)  # -> Vertices, Faces, Colours, Normals
demesh_2 = DeconstructMesh(Mesh=explode_2)  # -> Vertices, Faces, Colours, Normals
number_slider_4 = Slider(0.01, range=0..0.01)  # disabled
faceb = FaceBoundaries(Mesh=[explode, explode_2])
item_3 = ListItem(List=demesh_2.Vertices, Index=0, Wrap=True)  # -> Item, Item1, Item2, Item3
item_4 = ListItem(List=demesh.Vertices, Index=0, Wrap=True)  # -> Item, Item1, Item2, Item3
pipe = Pipe(Radius=number_slider_4, Caps=0)  # disabled
clean = CombineClean(Meshes=flatten([mesh_4, mesh_3]))  # disabled
ln = Line(StartPoint=item_4.Item, EndPoint=item_3.Item2)
ln_2 = Line(StartPoint=demesh.Vertices, EndPoint=demesh_2.Vertices)
crv_2 = Curve([ln, faceb, ln_2])
explode_3 = Explode(Curve=crv_2, Recursive=True)  # -> flatten(Segments), Vertices
dupln = RemoveDuplicateLines(Lines=explode_3.Segments, Tolerance=0.01)
pipe_2 = Pipe(Curve=dupln, Radius="0.01", Caps=0)
len_2 = Length(Curve=dupln)
P = ClusterOutput(pipe_2)
bnd_2 = Bounds(Numbers=len_2)
ma = MassAddition(Input=len_2)  # -> Result, PartialResults
panel = Panel(ma.Result)

# ==== cluster BranchLook: To see the condition of branch data.
data = ClusterInput()
data_2 = Data(data)
tstat = TreeStatistics(Tree=data_2)  # -> Paths, Length, Count
i = ClusterInput()
item = ListItem(List=tstat.Paths, Index=i, Wrap=True)
branch = TreeBranch(Tree=data_2, Path=item, MaintainPaths=True)
B = ClusterOutput(branch)
