# Grasshopper definition outline.gh (Grasshopper 1.0.7)
# plug-ins: Pufferfish, Kangaroo2 Components, Weaverbird, Human, Noise 4D, MeshMachine, PlanktonGh, MeshEdit Components, Kangaroo Components

crv = Curve([<curve referenced from the Rhino model> x5])
area = Area(Geometry=crv)  # -> Area, Centroid
runion = RegionUnion(Curves=crv)
seam = Seam(Curve=reparameterize(runion), Seam=Slider(0.05, range=0..1))
crv_2 = Curve(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)
pt = Point([Point(14.98281214, 23.6144077, 0), Point(10.92068546, 20.95927462, 0), Point(14.9601187, 18.89417111, 0), Point(18.4322158, 21.14082218, 0)])
end = EndPoints(Curve=seam)  # -> Start, End
fillet = Fillet(Curve=seam, Radius=Slider(0.96, range=0..2))
cir = Circle(Plane=pt, Radius=Slider(0.6, range=0..2))
brec = BoundingRectangle(Geometry=fillet, Plane=PlaneXY(0, 0, 0), Axis=0, Slide=0, Union=True)  # -> Bounding, DimensionX, DimensionY
boundary = BoundarySurfaces(Edges=flatten([cir, crv_2]))
voronoi = Voronoi(Points=area.Centroid, Boundary=brec.Bounding, BruteForceOverride=False)
qrsettings = QuadRemeshSettings(
    TargetCount=Slider(309, range=0..10000),
    AdaptiveSize=0,
    AdaptiveCount=False,
    HardEdges=False,
    SeamEdges=0,
    Symmetry=0,
    GuideCurves=0)
area_2 = Area(Geometry=boundary)  # -> Area, Centroid
qrmesh = QuadRemesh(Mesh=boundary, Settings=qrsettings)
panel = Panel(area_2.Area)
unim = UnifyMesh(Mesh=qrmesh)  # -> Result, Count
medges = MeshEdges(Mesh=unim.Result)  # -> NakedEdges, InteriorEdges, NonManifoldEdges
nv = NakedVertices(Mesh=unim.Result)  # -> ClothedIndex, NakedIndex, ClothedPts, NakedPts
join = JoinCurves(Curves=medges.NakedEdges, Preserve=False)
len = Length(Curve=join)
sort = SortList(Keys=len, ValuesA=join)  # -> Keys, ValuesA

# ---- group: Pressure
# Pressure
facen = FaceNormals(Mesh=unim.Result)  # -> Centers, Normals
item = ListItem(List=facen.Normals, Index=0, Wrap=True)
number_slider = Slider(0.6274, range=0..1)
devec = DeconstructVector(Vector=item)  # -> XComponent, YComponent, ZComponent
larger = LargerThan(FirstNumber=devec.ZComponent, SecondNumber=Slider(0, range=0..100))  # -> LargerThan, OrEqualTo
neg = Negative(Value=number_slider)
filter = StreamFilter(Gate=larger.LargerThan, Stream0=neg, Stream1=number_slider)

# ----
cull_i = CullIndex(List=sort.ValuesA, Indices="-1", Wrap=True)
crv_cp = CurveClosestPoint(Point=nv.NakedPts, Curve=graft(cull_i))  # -> Point, Parameter, Distance
lng = ListLength(List=cull_i)
int = Integer(crv_cp.Distance)
bool = Boolean(int)
dom = ConstructDomain(DomainStart=Slider(0, range=0..10), DomainEnd=Slider(2.6, range=0..10))
cull = CullPattern(List=nv.NakedPts, CullPattern=invert(bool))

# ---- group: Column Height
# Column Height
random = Random(Range=dom, Number=lng, Seed=2)
Z = UnitZ(Factor=random)  # -> graft(UnitVector)
move = Move(Geometry=cull, Motion=Z)  # -> Geometry, Transform

# ----
branch = TreeBranch(Tree=cull, Path="{0;0;0;0;1}", MaintainPaths=True)
remap = RemapNumbers(Value=Slider(178, range=0..300), Source=Slider(300, range=0..1000), Target=Slider(10, range=0..10))  # -> Mapped, Clipped
pt_2 = Point(flatten(cull))
pt_3 = ConstructPoint(XCoordinate=0, YCoordinate=0, ZCoordinate=0)
pt_4 = Point(pt_2)
index = ItemIndex(List=nv.NakedPts, Item=pt_2)
pt_5 = Point(flatten(move.Geometry))
line = LineSDL(Start=pt_3, Direction=Vector(0, 0, 1), Length=1)
number_slider_2 = Slider(1, range=0..1)
number_slider_3 = Slider(0, range=0..10)
cull_i_2 = CullIndex(List=nv.NakedPts, Indices=index, Wrap=True)

# ---- group: Boundary
# Anchoring Boundary Curve
item_2 = ListItem(List=sort.ValuesA, Index="-1", Wrap=True)
Z_2 = UnitZ(Factor=Slider(3.5, range=0..10))
move_2 = Move(Geometry=item_2, Motion=Z_2)  # -> Geometry, Transform
crv_cp_2 = CurveClosestPoint(Point=cull_i_2, Curve=move_2.Geometry)  # -> Point, Parameter, Distance

# ----
lng_2 = ListLength(List=cull_i_2)
divide = DivideCurve(Curve=line, Count=lng_2, Kinks=False)  # -> Points, Tangents, Parameters
pt_6 = Point(cull_i_2)
pt_7 = Point(crv_cp_2.Point)
perlin = PerlinNoise(Values=divide.Points, Time=remap.Mapped, Scale=Slider(2, range=0..100))
neg_2 = Negative(Value=number_slider_3)
bnd = Bounds(Numbers=perlin)
dom_2 = ConstructDomain(DomainStart=neg_2, DomainEnd=number_slider_3)
remap_2 = RemapNumbers(Value=perlin, Source=bnd, Target=dom_2)  # -> Mapped, Clipped
Z_3 = UnitZ(Factor=remap_2.Mapped)
move_3 = Move(Geometry=crv_cp_2.Point, Motion=Z_3)  # -> Geometry, Transform

# ---- group: Goals
edgelengths = EdgeLengths(Mesh=unim.Result, LengthFactor="0", Strength=1)
pressure = Pressure(M=unim.Result, Strength=filter)
anchor = Anchor(Point=pt_2, Target=pt_5, Strength=10000)
show = Show(G=unim.Result)
anchor_2 = Anchor(Point=cull_i_2, Target=move_3.Geometry, Strength=10000)

# ----
entwine = Entwine(Branch00=show, Branch01=[edgelengths, anchor_2, anchor, pressure], FlattenInputs=True)
graph = QuickGraph(perlin, SortOrder=0)
zombiesolver = ZombieSolver(GoalObjects=entwine, Threshold=1e-10, Tolerance=0.0001, MaxIterations=50000)  # -> I, V, O
number_slider_4 = Slider(0.74, range=0..1)  # disabled
unflatten = UnflattenTree(Tree=zombiesolver.O, Guide=entwine)
bang = ExplodeTree(Data=unflatten)  # -> Branch0, Branch1
mesh = Mesh(bang.Branch0)
neg_3 = Negative(Value=Slider(0.34, range=0..1))
wboffset = WeaverbirdsOffsetMesh(MeshCurves=mesh, Distance=number_slider_4, OffsetType=0)  # disabled
number_slider_5 = Slider(296, range=0..1000)  # disabled
wboffset_2 = WeaverbirdsOffsetMesh(MeshCurves=mesh, Distance=neg_3, OffsetType=0)
entwine_2 = Entwine(Branch00=wboffset, Branch01=mesh, FlattenInputs=True)  # disabled
number_slider_6 = Slider(1, range=0..1)  # disabled
number_slider_7 = Slider(1.65, range=0.5..2)  # disabled
tri = Triangulate(Mesh=[mesh, wboffset_2])  # -> Mesh, Count; disabled
explode = MeshExplode(Mesh=mesh, Interpolate=False)
trigger = Trigger(Interval=500, TimerInterval=500, Target=meshmachine)  # disabled
tri_2 = Triangulate(Mesh=wboffset_2)  # -> Mesh, Count; disabled
explode_2 = MeshExplode(Mesh=wboffset_2, Interpolate=False)
move_4 = Move(Geometry=cull_i, Motion=flatten(Z))  # -> Geometry, Transform; disabled
popgeo = PopulateGeometry(Geometry=entwine_2, Count=number_slider_5, Seed=1)  # disabled
button = Button()  # disabled
wbnaked = WeaverbirdsNakedBoundary(MeshClosedPolylines=wboffset_2)  # disabled
number_slider_8 = Slider(0.21, range=0..1)  # disabled
crv_3 = Curve(move_2.Geometry)  # disabled
dam = DataDam(DataA=[tri.Mesh, tri_2.Mesh], BufferDelay=10000000, BufferMode=1)  # disabled
demesh = DeconstructMesh(Mesh=explode)  # -> Vertices, Faces, Colours, Normals
demesh_2 = DeconstructMesh(Mesh=explode_2)  # -> Vertices, Faces, Colours, Normals
prox = Proximity3D(Points=flatten(popgeo), Group=5)  # -> flatten(Links), Topology; disabled
mesh_2 = Mesh(move_4.Geometry)  # disabled
mesh_3 = Mesh(crv_3)  # disabled
number_slider_9 = Slider(0.02, range=0..0.1)  # disabled
number_slider_10 = Slider(0.01, range=0..0.01)  # disabled
meshmachine = MeshMachine(
    Geometry=tri_2.Mesh,
    Length=number_slider_7,
    FixCurves=wbnaked,
    Flip=1,
    PullStrength=0.8,
    CurvatureAdaptivity=0,
    Reset=button)  # disabled
wbcarpet = WeaverbirdsSierpinskiCarpet(MeshPolylines=dam, Distance=number_slider_8, InsetType=0)  # disabled
faceb = FaceBoundaries(Mesh=[explode_2, explode])
dupln = RemoveDuplicateLines(Lines=prox.Links, Tolerance=0.01)  # disabled
pmesh = PlanktonMesh(meshmachine)  # disabled
item_3 = ListItem(List=demesh_2.Vertices, Index=0, Wrap=True)  # -> Item, Item1, Item2, Item3
wbthicken = WeaverbirdsMeshThicken(MeshCurves=wbcarpet, Distance=number_slider_9, OffsetType=0)  # disabled
item_4 = ListItem(List=demesh.Vertices, Index=0, Wrap=True)  # -> Item, Item1, Item2, Item3
pipe = Pipe(Curve=dupln, Radius=number_slider_10, Caps=0)  # disabled
mesh_4 = Mesh(pmesh)  # disabled
clean = CombineClean(Meshes=flatten([mesh_3, mesh_2, tri.Mesh]))  # disabled
previewmat = CustomPreviewMaterials(Geometry=wbthicken, DiffuseColor=RGB(255, 254, 254))  # disabled
previewmat_2 = CustomPreviewMaterials(Geometry=dam, DiffuseColor=RGB(255, 254, 254))  # disabled
ln = Line(StartPoint=item_3.Item, EndPoint=item_4.Item2)
explode_3 = MeshExplode(Mesh=mesh_4, Interpolate=False)  # disabled
ln_2 = Line(StartPoint=demesh_2.Vertices, EndPoint=demesh.Vertices)
clean_2 = CleanTree(RemoveNulls=True, RemoveInvalid=True, RemoveEmpty=False, Tree=explode_3)  # disabled
crv_4 = Curve([ln, faceb, ln_2])
explode_4 = Explode(Curve=crv_4, Recursive=True)  # -> flatten(Segments), Vertices
mjoin = MeshJoin(Meshes=clean_2)  # disabled
clean_3 = CombineClean(Meshes=mjoin)  # disabled
dupln_2 = RemoveDuplicateLines(Lines=explode_4.Segments, Tolerance=0.01)
wbweave = WeaverbirdsMeshFromLinesWeaveBack(Lines=dupln_2, MaximumValence=4)
len_2 = Length(Curve=dupln_2)
number_slider_11 = Slider(100, range=0..100)
number_slider_12 = Slider(10000, range=0..10000)
pt_8 = Point(<point referenced from the Rhino model>)
pipe_2 = Pipe(Curve=dupln_2, Radius="0.01", Caps=0)
bnd_2 = Bounds(Numbers=len_2)
scale = Scale(Geometry=pipe_2, Center=pt_8, Factor=Slider(1000, range=0..1000))  # -> Geometry, Transform
ma = MassAddition(Input=len_2)  # -> Result, PartialResults
X = UnitX(Factor=Slider(23291, range=0..100000))
panel_2 = Panel(ma.Result)
move_5 = Move(Geometry=scale.Geometry, Motion=X)  # -> Geometry, Transform
