# Grasshopper definition space_frame_wing.gh (Grasshopper 1.0.7)
# plug-ins: Human, treesloth01, Kangaroo2 Components, Weaverbird, MeshEdit Components, Pufferfish, Karamba3D, ClipperComponents, NGon, LunchBox

number_slider = Slider(2.87, range=0..10)  # disabled
number_slider_2 = Slider(9.12, range=0..10)  # disabled
neg = Negative(Value=number_slider_2)  # disabled
brep = Brep([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])  # disabled
vec = VectorXYZ(XComponent=number_slider, YComponent=neg, ZComponent=0)  # -> Vector, Length; disabled
swatch = ColourSwatch(SwatchColor=RGB(69, 69, 69))  # disabled
move = Move(Geometry=brep, Motion=vec.Vector)  # -> Geometry, Transform; disabled

# ----
# Ex. Col.
# Offset Clearance
number_slider_3 = Slider(0.2, range=0..1)

# ----
# Starting
# View Location
pt = Point(Point(3, 6, 0))

# ----
# Existing Column
crv = Curve(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)
crv_2 = Curve(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)
crv_3 = Curve(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)
crv_4 = Curve(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)
area = Area(Geometry=crv)  # -> Area, Centroid
area_2 = Area(Geometry=crv_2)  # -> Area, Centroid
area_3 = Area(Geometry=crv_3)  # -> Area, Centroid
area_4 = Area(Geometry=crv_4)  # -> Area, Centroid

preview = CustomPreview(Geometry=move.Geometry, Material=swatch)  # disabled

# ----
# Ex. Column
# Boudrary
swatch_2 = ColourSwatch(SwatchColor=RGB(0, 0, 0))
ln = Line(StartPoint=area_2.Centroid, EndPoint=area_3.Centroid)
ln_2 = Line(StartPoint=area.Centroid, EndPoint=area_2.Centroid)
ln_3 = Line(StartPoint=area_3.Centroid, EndPoint=area_4.Centroid)
ln_4 = Line(StartPoint=area.Centroid, EndPoint=area_4.Centroid)
preview_2 = CustomPreview(Geometry=[ln_2, ln, ln_3, ln_4], Material=swatch_2)

offset = OffsetCurve(Curve=crv, Distance=number_slider_3, Corners=1)
offset_2 = OffsetCurve(Curve=crv_2, Distance=number_slider_3, Corners=1)
offset_3 = OffsetCurve(Curve=crv_3, Distance=number_slider_3, Corners=1)
offset_4 = OffsetCurve(Curve=crv_4, Distance=number_slider_3, Corners=1)
explode = Explode(Curve=offset_3, Recursive=True)  # -> Segments, Vertices
preview_3 = CustomPreview(Geometry=[offset, offset_2, offset_3, offset_4], Material=ColourSwatch(SwatchColor=RGBA(176, 135, 135, 124)))
explode_2 = Explode(Curve=offset, Recursive=True)  # -> Segments, Vertices
explode_3 = Explode(Curve=offset_2, Recursive=True)  # -> Segments, Vertices
explode_4 = Explode(Curve=offset_4, Recursive=True)  # -> Segments, Vertices
midpt = CurveMiddle(Curve=ln_2)
midpt_2 = CurveMiddle(Curve=ln_3)

# ----
# Closet Pt to EX Column
item = ListItem(List=explode_3.Vertices, Index=0, Wrap=True)  # -> Item, Item1, Item2, Item3
pt_2 = Point(item.Item2)

# ----
# Closet Pt to EX Column
item_2 = ListItem(List=explode_4.Vertices, Index=0, Wrap=True)  # -> Item, Item1
pt_3 = Point(item_2.Item)

# ----
# Closet Pt to EX Column
item_3 = ListItem(List=explode_2.Vertices, Index=0, Wrap=True)  # -> Item, Item1
pt_4 = Point(item_3.Item1)

# ----
# Closet Pt to EX Column
item_4 = ListItem(List=explode.Vertices, Index=0, Wrap=True)  # -> Item, Item1, Item2, Item3
pt_5 = Point(item_4.Item3)

# ----
# Area 3
number_slider_4 = Slider(0.2, range=0..1)
pt_6 = Point(Point(17.92727553, 9.489372472, 0))
cir = Circle(Plane=pt_6, Radius=number_slider_4)

# ----
# Shifted Symetrical MidPt
number_slider_5 = Slider(0.61, range=0.5..0.65)
eval = EvaluateCurve(ExEdge3=reparameterize(ln_3), Parameter=number_slider_5)  # -> Point, Tangent, Angle

pt_7 = Point(item_3.Item)

# ----
# Symetrical Axis
ln_5 = Line(StartPoint=midpt, EndPoint=midpt_2)

eval_2 = EvaluateCurve(SymetricalAxis=ln_5, Parameter=Slider(0.63, range=0.5..0.85))  # -> Point, Tangent, Angle

# ----
# Area 1
number_slider_6 = Slider(0.3, range=0..1)
pt_8 = Point(eval_2.Point)
cir_2 = Circle(Plane=pt_8, Radius=number_slider_6)

Z = UnitZ(Factor=1)
extr = Extrude(Base=ln_5, Direction=Z)
ln_6 = Line(StartPoint=pt_6, SymeOffset=eval.Point)

# ----
# Crv. Extend
panel = Panel("6")

xz = XZPlane(Origin=pt)
cluster = Cluster(B=1)  # -> P, mesh_2; disabled

# ---- group: ExistingColumns
existing_columns = Geometry([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])

# ---- group: Axes
lateralaxisl = Curve(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)
lateralaxisr = Curve(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)
centralaxis = Curve(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)
rightaxis = Curve(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)
leftaxis = Curve(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)

# ----
number_slider_7 = Slider(0.25, range=0..1)
number_slider_8 = Slider(0.6, range=0..1)

# ---- group: ColumnLocation
# Vector Fields Approach
eval_3 = EvaluateCurve(Curve=reparameterize(centralaxis), Parameter=number_slider_7)  # -> Point, Tangent, Angle
eval_4 = EvaluateCurve(Curve=reparameterize(lateralaxisl), Parameter=number_slider_7)  # -> Point, Tangent, Angle
eval_5 = EvaluateCurve(Curve=reparameterize(leftaxis), Parameter=number_slider_8)  # -> Point, Tangent, Angle
eval_6 = EvaluateCurve(Curve=reparameterize(lateralaxisr), Parameter=number_slider_7)  # -> Point, Tangent, Angle
eval_7 = EvaluateCurve(Curve=reparameterize(rightaxis), Parameter=number_slider_8)  # -> Point, Tangent, Angle

# ----
brep_2 = Brep(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)
merge = Merge(Data1=eval_3.Point, Data2=eval_4.Point, Data3=eval_6.Point, Data4=eval_5.Point, Data5=eval_7.Point)
hex = HexagonCells(Surface=brep_2, UDivisions=Slider(7, range=0..10), VDivisions=Slider(7, range=0..10), TParameter=0.25)  # -> HexagonCells, Centers
pt_9 = Point(Point(30.9970077, 9.350338547, 0))

number_slider_9 = Slider(0.49, range=0.2..0.8)
number_slider_10 = Slider(0.49, range=0.2..0.8)
number_slider_11 = Slider(0.58, range=0.2..0.8)
number_slider_12 = Slider(0.54, range=0.2..0.8)
number_slider_13 = Slider(0.39, range=0.2..0.6)

crv_5 = Curve(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)
xz_2 = XZPlane(Origin=pt_8)
pull = PullPoint(Point=hex.Centers, Geometry=crv_5, ClosestOnly=True)  # -> ClosestPoint, Distance
dist = Distance(PointA=hex.Centers, PointB=pt_9)
number_slider_14 = Slider(0.45, range=0..1)

# ---- group: Charges
c2 = Slider(-1.5, range=-10..10)
c4 = Slider(-1.5, range=-10..10)
c1 = Slider(-1.5, range=-10..10)
c3 = Slider(-1.5, range=-10..10)
c5 = Slider(-1.5, range=-10..10)
merge_2 = Merge(Data1=c1, Data2=c2, Data3=c3, Data4=c4, Data5=c5)

# ----
smaller = SmallerThan(FirstNumber=pull.Distance, SecondNumber=Slider(4.01, range=0..10))  # -> SmallerThan, OrEqualTo
pdecon = Deconstruct(Point=pt)  # -> XComponent, YComponent, ZComponent
dispatch = Dispatch(List=hex.HexagonCells, DispatchPattern=smaller.SmallerThan)  # -> ListA, ListB; disabled
dispatch_2 = Dispatch(List=hex.Centers, DispatchPattern=smaller.SmallerThan)  # -> ListA, ListB; disabled
pt_10 = ConstructPoint(XCoordinate=number_slider_9, YCoordinate=number_slider_10, ZCoordinate=0)
pt_11 = ConstructPoint(XCoordinate=number_slider_11, YCoordinate=number_slider_12, ZCoordinate=0)
pt_12 = Point(dispatch_2.ListA)
crv_6 = Curve(dispatch.ListA)
number_slider_15 = Slider(7, range=0..10)
number_slider_16 = Slider(1.2, range=0..10)
number_slider_17 = Slider(1, range=0..10)
number_slider_18 = Slider(2, range=0..10)
neg_2 = Negative(Value=Slider(0.03, range=0..1))
cir_3 = Circle(Plane=pt_12, Radius=Slider(0.3, range=0..1))
explode_5 = Explode(Curve=crv_6, Recursive=True)  # -> Segments, Vertices
neg_3 = Negative(Value=number_slider_15)
crv_cp = CurveClosestPoint(Point=explode_5.Vertices, Curve=graft(cir_3))  # -> Point, Parameter, Distance

number_slider_19 = Slider(0.28, range=0.2..0.4)
number_slider_20 = Slider(0.31, range=0.2..0.4)
number_slider_21 = Slider(0.31, range=0.2..0.4)

pline = PolyLine(Vertices=explode_5.Vertices, Closed=False)
pline_2 = PolyLine(Vertices=crv_cp.Point, Closed=False)

# ---- group: Radii
merge_3 = Merge(
    Data1=Slider(2.78, range=0..10),
    Data2=Slider(1.8, range=0..10),
    Data3=Slider(1.8, range=0..10),
    Data4=Slider(2.1, range=0..10),
    Data5=Slider(2.1, range=0..10))

# ----
loft = Loft(
    Curves=[pline, pline_2],
    Options={Adjust=False, Closed=False, LoftEnds=0, LoftSimp=0, LoftType=0, Rebuild=10, Refit=0.01})  # -> flatten(Loft)
debrep = DeconstructBrep(Brep=loft)  # -> Faces, Edges, Vertices
cluster_2 = BranchLook(data=debrep.Faces, i=0)
item_5 = ListItem(List=cluster_2, Index=0, Wrap=True)
srf = Surface(reparameterize(item_5))
srf_2 = Surface(reparameterize(debrep.Faces))
number_slider_22 = Slider(0, range=0..100)
divide = DivideDomain²(Domain=srf, UCount=Slider(2, range=0..10), VCount=Slider(1, range=0..10))
panel_2 = Panel("Layer 02")  # disabled
panel_3 = Panel("Curve")  # disabled
number_slider_23 = Slider(0.5, range=0..1)
shift = ShiftPaths(Data=divide, Offset=-1)
number_slider_24 = Slider(0.1, range=0..0.1)
subsrf = Isotrim(Surface=graft(srf_2), Domain=divide)
dpipeline = DynamicGeometryPipeline(
    LayerFilter=panel_2,
    TypeFilter=panel_3,
    NameFilter="*",
    GroupByLayer=False,
    GroupByType=False,
    IncludeHidden=True,
    IncludeLocked=True,
    enableFullPath=False,
    listenToAttributes=True)  # disabled
number_slider_25 = Slider(0.01, range=0..1)
number_slider_26 = Slider(500, range=0..500)
number_slider_27 = Slider(100, range=0..100)
debrep_2 = DeconstructBrep(Brep=subsrf)  # -> Faces, Edges, Vertices
qrsettings = QuadRemeshSettings(
    TargetCount=Slider(300, range=0..1000),
    AdaptiveSize=Slider(1, range=0..1),
    AdaptiveCount=False,
    HardEdges=False,
    SeamEdges=0,
    Symmetry=0,
    GuideCurves=0)
number_slider_28 = Slider(3, range=0..5)
wbweave = WeaverbirdsMeshFromLinesWeaveBack(Lines=debrep_2.Edges, MaximumValence=4)  # -> flatten(Mesh)
mjoin = MeshJoin(Meshes=wbweave)
wbcatmullclark = WeaverbirdsCatmullClarkSubdivision(MeshCurves=mjoin, Level=1, SmoothNakedEdges=1)
mesh = Mesh(wbcatmullclark)
mesh_2 = Mesh(wbcatmullclark)
wbnaked = WeaverbirdsNakedBoundary(MeshClosedPolylines=mesh_2)
wbnaked_2 = WeaverbirdsNakedBoundary(MeshClosedPolylines=mesh)
len = Length(Curve=wbnaked)
len_2 = Length(Curve=wbnaked_2)
sort = SortList(Keys=len, ValuesA=wbnaked)  # -> Keys, reverse(ValuesA)
explode_6 = Explode(Curve=sort.ValuesA, Recursive=True)  # -> Segments, Vertices
sort_2 = SortList(Keys=len_2, ValuesA=wbnaked_2)  # -> Keys, ValuesA
shift_2 = ShiftPaths(Data=explode_6.Vertices, Offset=-1)
demesh = DeconstructMesh(Mesh=mesh)  # -> Vertices, Faces, Colours, Normals
cull_i = CullIndex(List=reverse(sort_2.ValuesA), Indices="0", Wrap=True)
item_6 = ListItem(List=reverse(sort_2.ValuesA), Index=0, Wrap=True)
duppt = RemoveDuplicatePts(Points=explode_6.Vertices, Tolerance=0.01)
pull_2 = PullPoint(Point=demesh.Vertices, Geometry=cull_i, ClosestOnly=True)  # -> ClosestPoint, Distance
pt_13 = Point(duppt)
tstat = TreeStatistics(Tree=pt_13)  # -> Paths, Length, Count
area_5 = Area(Geometry=cull_i)  # -> Area, Centroid
bool = Boolean(pull_2.Distance)
item_7 = ListItem(List=tstat.Paths, Index=0, Wrap=True)
unim = UnifyMesh(Mesh=mesh_2)  # -> Result, Count
scale = Scale(Geometry=cull_i, Center=area_5.Centroid, Factor=Slider(0.74, range=0..1))  # -> Geometry, Transform
mesh_3 = Mesh(mesh_2)
sift = SiftPattern(List=demesh.Vertices, SiftPattern=bool)  # -> Output0, Output1
split = SplitTree(Data=pt_13, Masks=flatten(item_7))  # -> Positive, Negative
pt_14 = Point(sift.Output0)
pt_15 = Point(split.Negative)
medges = MeshEdges(Mesh=mesh_3)  # -> NakedEdges, InteriorEdges, NonManifoldEdges
pull_3 = PullPoint(Point=pt_14, Geometry=scale.Geometry, ClosestOnly=True)  # -> ClosestPoint, Distance
join = JoinCurves(Curves=medges.NakedEdges, Preserve=False)
xz_3 = XZPlane(Origin=pt)
combine = CombineData(Input0=pull_3.ClosestPoint, Input1=sift.Output1)  # -> Result, Index
len_3 = Length(Curve=join)
conmesh = ConstructMesh(Vertices=combine.Result, Faces=demesh.Faces)
sort_3 = SortList(Keys=len_3, ValuesA=join)  # -> Keys, ValuesA
clean = CombineClean(Meshes=conmesh)

# ---- group: Pressure
facen = FaceNormals(Mesh=unim.Result)  # -> Centers, Normals
item_8 = ListItem(List=facen.Normals, Index=0, Wrap=True)
number_slider_29 = Slider(0.0625, range=0..1)
devec = DeconstructVector(Vector=item_8)  # -> XComponent, YComponent, ZComponent
larger = LargerThan(FirstNumber=devec.ZComponent, SecondNumber=Slider(0, range=0..100))  # -> LargerThan, OrEqualTo
neg_4 = Negative(Value=number_slider_29)
filter = StreamFilter(Gate=larger.LargerThan, Stream0=neg_4, Stream1=number_slider_29)

# ----
cull_i_2 = CullIndex(List=sort_3.ValuesA, Indices="-1", Wrap=True)
avr = Average(Input=flatten(pt_15))
pdecon_2 = Deconstruct(Point=avr)  # -> XComponent, YComponent, ZComponent
mesh_4 = Mesh(clean)
wbnaked_3 = WeaverbirdsNakedBoundary(MeshClosedPolylines=mesh_4)
len_4 = Length(Curve=wbnaked_3)
lng = ListLength(List=cull_i_2)
neg_5 = Negative(Value=Slider(0.8617, range=0..10))
int = Integer(pdecon_2.XComponent)
sort_4 = SortList(Keys=len_4, ValuesA=wbnaked_3)  # -> Keys, reverse(ValuesA)
dom = ConstructDomain(DomainStart=Slider(0.78, range=0..10), DomainEnd=Slider(1.9, range=1.2..2.5))
pt_16 = Point(pt_15)
explode_7 = Explode(Curve=sort_4.ValuesA, Recursive=True)  # -> Segments, Vertices

# ---- group: Column Height
random = Random(Range=dom, Number=lng, Seed=int)
Z_2 = UnitZ(Factor=random)  # -> graft(UnitVector)
move_2 = Move(Geometry=pt_15, Motion=Z_2)  # -> Geometry, Transform

# ----
shift_3 = ShiftPaths(Data=explode_7.Vertices, Offset=-1)
number_slider_30 = Slider(20000, range=0..100000)
pt_17 = Point(split.Positive)

# ---- group: Boundary
item_9 = ListItem(List=sort_3.ValuesA, Index="-1", Wrap=True)
Z_3 = UnitZ(Factor=Slider(3, range=0..10))
move_3 = Move(Geometry=item_9, Motion=Z_3)  # -> Geometry, Transform
crv_cp_2 = CurveClosestPoint(Point=pt_17, Curve=move_3.Geometry)  # -> Point, Parameter, Distance

# ----
duppt_2 = RemoveDuplicatePts(Points=explode_7.Vertices, Tolerance=0.01)
mesh_5 = Mesh(unim.Result)
pt_18 = Point(duppt_2)
tstat_2 = TreeStatistics(Tree=pt_18)  # -> Paths, Length, Count
item_10 = ListItem(List=tstat_2.Paths, Index=0, Wrap=True)
unim_2 = UnifyMesh(Mesh=mesh_4)  # -> Result, Count
mesh_6 = Mesh(mesh_4)
split_2 = SplitTree(Data=pt_18, Masks=flatten(item_10))  # -> Positive, Negative
pt_19 = Point(split_2.Negative)
medges_2 = MeshEdges(Mesh=mesh_6)  # -> NakedEdges, InteriorEdges, NonManifoldEdges
number_slider_31 = Slider(0.5, range=0..1)
wbvertices = WeaverbirdsVerticesComponent(MeshClosedPolylinesGroup=unim.Result, Weld=True)  # -> flatten(Points)
join_2 = JoinCurves(Curves=medges_2.NakedEdges, Preserve=False)
pt_20 = Point(move_2.Geometry)
duppt_3 = RemoveDuplicatePts(Points=wbvertices, Tolerance=0.01)
len_5 = Length(Curve=join_2)

# ---- group: Goals
edgelengths = EdgeLengths(Mesh=unim.Result, LengthFactor="0", Strength=Slider(1, range=0..1))
anchor = Anchor(Point=pt_16, Target=pt_20, Strength=number_slider_30)
show = Show(G=unim.Result)
anchor_2 = Anchor(Point=pt_17, Target=crv_cp_2.Point, Strength=number_slider_30)

# ----
sort_5 = SortList(Keys=len_5, ValuesA=join_2)  # -> Keys, ValuesA
load = Load(Point=duppt_3, ForceVector=Vector(0, 0, 1), Weighting=number_slider_29)

# ---- group: Pressure
facen_2 = FaceNormals(Mesh=unim_2.Result)  # -> Centers, Normals
item_11 = ListItem(List=facen_2.Normals, Index=0, Wrap=True)
number_slider_32 = Slider(0, range=0..1)
devec_2 = DeconstructVector(Vector=item_11)  # -> XComponent, YComponent, ZComponent
larger_2 = LargerThan(FirstNumber=devec_2.ZComponent, SecondNumber=Slider(0, range=0..100))  # -> LargerThan, OrEqualTo
neg_6 = Negative(Value=number_slider_32)
filter_2 = StreamFilter(Gate=larger_2.LargerThan, Stream0=neg_6, Stream1=number_slider_32)

# ----
entwine = Entwine(Branch00=show, Branch01=[edgelengths, anchor_2, anchor, load], FlattenInputs=True)
cull_i_3 = CullIndex(List=sort_5.ValuesA, Indices="-1", Wrap=True)
avr_2 = Average(Input=flatten(pt_19))
zombiesolver = ZombieSolver(GoalObjects=entwine, Threshold=1e-10, Tolerance=0.0001, MaxIterations=50000)  # -> I, V, O
pdecon_3 = Deconstruct(Point=avr_2)  # -> XComponent, YComponent, ZComponent
lng_2 = ListLength(List=cull_i_3)
unflatten = UnflattenTree(Tree=zombiesolver.O, Guide=entwine)
neg_7 = Negative(Value=Slider(0.8617, range=0..10))
int_2 = Integer(pdecon_3.XComponent)
dom_2 = ConstructDomain(DomainStart=Slider(2.15, range=0..10), DomainEnd=Slider(1.9, range=1.2..2.5))
bang = ExplodeTree(Data=unflatten)  # -> Branch0, Branch1
pt_21 = Point(pt_19)

# ---- group: Column Height
random_2 = Random(Range=dom_2, Number=lng_2, Seed=int_2)
Z_4 = UnitZ(Factor=random_2)  # -> graft(UnitVector)
move_4 = Move(Geometry=pt_19, Motion=Z_4)  # -> Geometry, Transform

# ----
number_slider_33 = Slider(20000, range=0..100000)
pt_22 = Point(split_2.Positive)

# ---- group: Boundary
item_12 = ListItem(List=sort_5.ValuesA, Index="-1", Wrap=True)
Z_5 = UnitZ(Factor=Slider(3.1, range=0..10))
move_5 = Move(Geometry=item_12, Motion=Z_5)  # -> Geometry, Transform
crv_cp_3 = CurveClosestPoint(Point=pt_22, Curve=move_5.Geometry)  # -> Point, Parameter, Distance

# ----
mesh_7 = Mesh(unim_2.Result)
number_slider_34 = Slider(0.12, range=0..1)  # disabled
number_slider_35 = Slider(0.19, range=0..1)  # disabled
number_slider_36 = Slider(0.5, range=0..1)
wbvertices_2 = WeaverbirdsVerticesComponent(MeshClosedPolylinesGroup=unim_2.Result, Weld=True)  # -> flatten(Points)
pt_23 = Point(move_4.Geometry)
duppt_4 = RemoveDuplicatePts(Points=wbvertices_2, Tolerance=0.01)
dom_3 = ConstructDomain(DomainStart=number_slider_35, DomainEnd=number_slider_34)  # disabled

# ---- group: Goals
edgelengths_2 = EdgeLengths(Mesh=unim_2.Result, LengthFactor="0", Strength=Slider(0.031, range=0..1))
anchor_3 = Anchor(Point=pt_21, Target=pt_23, Strength=number_slider_33)
show_2 = Show(G=unim_2.Result)
anchor_4 = Anchor(Point=pt_22, Target=crv_cp_3.Point, Strength=number_slider_33)

# ----
load_2 = Load(Point=duppt_4, ForceVector=Vector(0, 0, 1), Weighting=number_slider_32)

# ---- group: Define Materials
matselect = MaterialSelectionKaramba3D(menu=[dropdown(1), dropdown(1)])

# ----
entwine_2 = Entwine(Branch00=show_2, Branch01=[edgelengths_2, anchor_4, anchor_3, load_2], FlattenInputs=True)
number_slider_37 = Slider(0, range=0..100)

# ---- group: define cross sections
range = Range(Domain="10 to 110", Steps=20)
expression = Expression(x="Shell", y=range, Expression="x&\" \"&y")
cross_section = CrossSectionKaramba3D(
    FamilyNameOfCrossSection="Shell",
    NameOfCrossSection=graft(expression),
    Material=matselect,
    Height_cm=graft(range),
    mode="Shell - Const")  # -> flatten(CrossSection)
crosecselect = CrossSectionSelectorKaramba3D(CrossSections=cross_section, ElementsIdentifiers="S")  # -> CrossSection, Info

# ----
zombiesolver_2 = ZombieSolver(GoalObjects=entwine_2, Threshold=1e-10, Tolerance=0.0001, MaxIterations=50000)  # -> I, V, O
dom_4 = ConstructDomain(DomainStart=Slider(0.19, range=0..1), DomainEnd=Slider(0.12, range=0..1))
number_slider_38 = Slider(0.116, range=0..0.2)
mesh_8 = Mesh(bang.Branch0)
unflatten_2 = UnflattenTree(Tree=zombiesolver_2.O, Guide=entwine_2)
bang_2 = ExplodeTree(Data=unflatten_2)  # -> Branch0, Branch1
recipricalthickness = RecipricalThickness(Mesh=mesh_8, Angle=Slider(13, range=0..100), Distance="0", Width=Slider(0.007, range=0..0.02))  # disabled
division = Division(A=Slider(0.04, range=0..1), B=2)  # disabled
boundary = BoundarySurfaces(Edges=recipricalthickness)  # disabled
mesh_9 = Mesh([bang_2.Branch0, mesh_8])
offsrf = OffsetSurface(Surface=boundary, Distance=division, BothSides=0, CreateSolid=True)  # disabled
recipricalthickness_2 = RecipricalThickness(Mesh=mesh_9, Angle=Slider(13, range=0..100), Distance="0", Width=Slider(0.007, range=0..0.02))
panel_4 = Panel("3")  # disabled
division_2 = Division(A=Slider(0.04, range=0..1), B=2)
boundary_2 = BoundarySurfaces(Edges=recipricalthickness_2)
edges = BrepEdges(Brep=offsrf)  # -> Naked, Interior, NonManifold; disabled
duppt_5 = RemoveDuplicatePts(Tolerance=0.01)
swatch_3 = ColourSwatch(SwatchColor=RGB(255, 255, 255))  # disabled
swatch_4 = ColourSwatch(SwatchColor=RGB(0, 0, 0))  # disabled
offsrf_2 = OffsetSurface(Surface=boundary_2, Distance=division_2, BothSides=0, CreateSolid=True)
panel_5 = Panel("0.008")  # disabled
number_slider_39 = Slider(0.01, range=0..0.01)  # disabled
preview_4 = CustomPreview(Geometry=offsrf, Material=swatch_3)  # disabled
previewlw = CustomPreviewLineweights(Geometry=edges.Interior, Shader=swatch_4, Absolute=False)  # disabled
edges_2 = BrepEdges(Brep=offsrf_2)  # -> Naked, Interior, NonManifold
pipe = Pipe(Radius=number_slider_39, Caps=0)  # disabled
# Pressure
preview_5 = CustomPreview(Geometry=offsrf_2, Material=ColourSwatch(SwatchColor=RGB(255, 255, 255)))
previewlw_2 = CustomPreviewLineweights(Geometry=edges_2.Interior, Shader=ColourSwatch(SwatchColor=RGB(0, 0, 0)), Absolute=False)
galapagos = Galapagos(
    fitness=opticrosec,
    gene=[number_slider_9, number_slider_10, number_slider_11, number_slider_12, number_slider_13, number_slider_20, number_slider_21, number_slider_19])

ln_7 = Line(StartPoint=eval.Point, StartView=pt)
ln_8 = Line(StartPoint=pt_8, ExColumn1=pt_7)

# ----
# Area 2
number_slider_40 = Slider(0.4, range=0..1)

# ----
# Center
# Connection
ln_9 = Line(StartPoint=pt_8, EndPoint=pt_6)

number_slider_41 = Slider(0.56, range=0.5..0.6)

Z_6 = UnitZ(Factor=1)

# ----
# Column 1
number_slider_42 = Slider(0.35, range=0..1)

multiplication = Multiplication(A=number_slider_42, B=Slider(2.2, range=1.5..3))
offset_5 = OffsetCurve(Curve=ln_7, Distance=multiplication, Corners=1)
ccx = CurveCurve(CurveA=ln_8, CurveB=offset_5)  # -> Points, ParamsA, ParamsB

pt_24 = Point(ccx.Points)
cir_4 = Circle(Plane=pt_24, Radius=number_slider_40)

ln_10 = Line(StartPoint=pt_8, EndPoint=pt_24)
ln_11 = Line(StartPoint=pt_24, EndPoint=pt_6)

hframe = HorizontalFrame(Curve=ln_10, Parameter=number_slider_41)
hframe_2 = HorizontalFrame(Curve=ln_11, Parameter=number_slider_41)
deplane = DeconstructPlane(Plane=hframe)  # -> Origin, XAxis, YAxis, ZAxis
deplane_2 = DeconstructPlane(Plane=hframe_2)  # -> Origin, XAxis, YAxis, ZAxis

vrot = Rotate(Vector=deplane_2.YAxis, Axis=deplane_2.ZAxis, Angle=degrees(Slider(-12, range=-15..15)))
vrot_2 = Rotate(Vector=deplane.YAxis, Axis=deplane.ZAxis, Angle=degrees(Slider(2, range=-20..20)))
line = LineSDL(Start=deplane.Origin, Direction=vrot_2, Length=10)
line_2 = LineSDL(Start=deplane_2.Origin, Direction=vrot, Length=10)
ccx_2 = CurveCurve(CurveA=line, SymeAxis=ln_5)  # -> Pt1Syme, ParamsA, ParamsB

ln_12 = Line(StartPoint=ccx_2.Pt1Syme, EndPoint=pt_24)
extr_2 = Extrude(Base=ln_12, Direction=Z_6)

crv_cp_4 = CurveClosestPoint(Point=ccx_2.Pt1Syme, ExEdge1=ln_2)  # -> Point, Parameter, Distance
ln_13 = Line(StartPoint=deplane.Origin, EndPoint=ccx_2.Pt1Syme)
mirror = Mirror(Geometry=deplane_2.Origin, Plane=extr_2)  # -> Geometry, Transform
ln_14 = Line(StartPoint=mirror.Geometry, EndPoint=pt_4)
ext = ExtendCurve(Curve=ln_13, Type=0, Start=panel, End=panel)
ccx_3 = CurveCurve(MainConnect=ext, CurveB=ln_6)  # -> Points, ParamsA, ParamsB
ln_15 = Line(StartPoint=pt_3, EndPoint=ccx_3.Points)
eval_8 = EvaluateCurve(Curve=ln_15, Parameter=Slider(0.42, range=0.3..0.6))  # -> Point, Tangent, Angle
crv_cp_5 = CurveClosestPoint(Point=eval_8.Point, ClrOffset=offset_5)  # -> Point, Parameter, Distance
merge_4 = Merge(
    Data1=deplane.Origin,
    Data2=ccx_3.Points,
    Data3=eval_8.Point,
    Data4=crv_cp_5.Point,
    Data5=eval.Point,
    Data6=ccx_2.Pt1Syme)
ext_2 = ExtendCurve(Curve=ln_14, Type=0, Start=panel, End=panel)
ext_3 = ExtendCurve(Curve=line_2, Type=0, Start=panel, End=panel)
midpt_3 = CurveMiddle(Curve=ext_3)

# ----
# Main Symetrical
mirror_2 = Mirror(Geometry=merge_4, Plane=extr)  # -> Geometry, Transform

orient = Orient(Geometry=ext_3, Source=midpt_3, ExCol3Clr=pt_3)  # -> Geometry, Transform
ccx_4 = CurveCurve(CurveA=orient.Geometry, CurveB=[ext, ext_2])  # -> Points, ParamsA, ParamsB
ccx_5 = CurveCurve(CurveA=ext_3, CurveB=[ext_2, ext])  # -> Points, ParamsA, ParamsB
merge_5 = Merge(Data1=ccx_5.Points, Data2=ccx_4.Points)
merge_6 = Merge(Data1=ccx_2.Pt1Syme, Data2=crv_cp_4.Point, Data3=mirror.Geometry, Data4=ccx_5.Points)

alongcrv = SortAlongCurve(Points=flatten(merge_6), Column2Cir=cir_4)  # -> Points, Indices
pline_3 = PolyLine(Vertices=alongcrv.Points, Closed=invert(False))
fillet = FilletDistance(Curve=pline_3, Distance=Slider(0.6, range=0..1))
boundary_3 = BoundarySurfaces(Edges=fillet)

alongcrv_2 = SortAlongCurve(Points=flatten(merge_5), Column3Cir=cir)  # -> Points, Indices
pline_4 = PolyLine(Vertices=alongcrv_2.Points, Closed=invert(False))
fillet_2 = FilletDistance(Curve=pline_4, Distance=Slider(0.6, range=0..1))
boundary_4 = BoundarySurfaces(Edges=fillet_2)

alongcrv_3 = SortAlongCurve(Points=flatten([merge_4, mirror_2.Geometry]), Column1Cir=cir_2)  # -> Points, Indices
pline_5 = PolyLine(Vertices=alongcrv_3.Points, Closed=invert(False))
# Mushroom 1
fillet_3 = FilletDistance(Curve=pline_5, Distance=Slider(0.5, range=0..1))
boundary_5 = BoundarySurfaces(Edges=fillet_3)

crv_7 = Curve(pline_4)
crv_8 = Curve(pline_3)
crv_9 = Curve(pline_5)
mirror_3 = Mirror(Geometry=[crv_8, crv_7], Plane=xz)  # -> Geometry, Transform
merge_7 = Merge(Data1=crv_8, Data2=crv_7, Data3=crv_9)  # -> flatten(Result)
entwine_3 = Entwine(Branch00=crv_8, Branch01=crv_7, Branch02=crv_9, FlattenInputs=True)
area_6 = Area(Geometry=boundary_3)  # -> Area, Centroid
merge_8 = Merge(Data1=[crv_8, crv_7], Data2=mirror_3.Geometry, Data3=crv_9)
area_7 = Area(Geometry=boundary_4)  # -> Area, Centroid
area_8 = Area(Geometry=boundary_5)  # -> Area, Centroid
disc = Discontinuity(Curve=merge_7, Level=1)  # -> Points, Parameters
merge_9 = Merge(Data1=boundary_3, Data2=boundary_4)

# ----
# Column 2
number_slider_43 = Slider(0.2, range=0..1)
cir_5 = Circle(Plane=area_6.Centroid, Radius=number_slider_43)
boundary_6 = BoundarySurfaces(Edges=cir_5)
preview_6 = CustomPreview(Geometry=boundary_6, Material=ColourSwatch(SwatchColor=RGB(0, 238, 255)))  # disabled

# ----
# Column 3
number_slider_44 = Slider(0.2, range=0..1)
cir_6 = Circle(Plane=area_7.Centroid, Radius=number_slider_44)
boundary_7 = BoundarySurfaces(Edges=cir_6)
preview_7 = CustomPreview(Geometry=boundary_7, Material=ColourSwatch(SwatchColor=RGB(247, 0, 255)))  # disabled

brec = BoundingRectangle(Geometry=flatten(merge_8), Plane=PlaneXY(0, 0, 0), Axis=0, Slide=0, Union=True)  # -> Bounding, DimensionX, DimensionY
shatter = Shatter(Curve=graft(merge_7), Parameters=disc.Parameters)
end = EndPoints(Curve=shatter)  # -> Start, End
area_9 = Area(Geometry=brec.Bounding)  # -> Area, Centroid

# ----
# Main Symetrical
mirror_4 = Mirror(Geometry=merge_9, Plane=extr)  # -> Geometry, Transform

cir_7 = Circle(Plane=area_8.Centroid, Radius=number_slider_42)
boundary_8 = BoundarySurfaces(Edges=cir_7)
preview_8 = CustomPreview(Geometry=boundary_8, Material=ColourSwatch(SwatchColor=RGB(252, 176, 10)))  # disabled

ln_16 = Line(StartPoint=end.Start, EndPoint=end.End)
scale_2 = Scale(Geometry=merge_8, Center=area_9.Centroid, Factor=Slider(1.26, range=0..10))  # -> Geometry, Transform
merge_10 = Merge(Data1=mirror_4.Geometry, Data2=boundary_5, Data3=merge_9)
explode_8 = Explode(Curve=ln_16, Recursive=True)  # -> flatten(Segments), Vertices
previewlw_3 = CustomPreviewLineweights(
    Geometry=scale_2.Geometry,
    Shader=ColourSwatch(SwatchColor=RGB(0, 0, 0)),
    Thickness=Slider(2, range=0..10),
    Absolute=False)
mcx = MultipleCurves(Curves=reparameterize(explode_8.Segments))  # -> Points, IndexA, IndexB, ParamA, ParamB
clone = CloneStructure(List=mcx.ParamA, Structure=mcx.IndexA)
clone_2 = CloneStructure(List=mcx.ParamB, Structure=mcx.IndexB)
shatter_2 = Shatter(Curve=reparameterize(graft(explode_8.Segments)), Parameters=[clone, clone_2])  # -> flatten(Segments)
midpt_4 = CurveMiddle(Curve=shatter_2)
crv_10 = Curve(entwine_3)
pull_4 = PullPoint(Point=midpt_4, Geometry=crv_10, ClosestOnly=True)  # -> ClosestPoint, Distance
dispatch_3 = Dispatch(List=shatter_2, DispatchPattern=pull_4.Distance)  # -> ListA, ListB
crv_11 = Curve(dispatch_3.ListB)
bang_3 = ExplodeTree(Data=crv_11)  # -> Branch0, Branch1, Branch2
crv_12 = Curve(bang_3.Branch2)
shatter_3 = Shatter(Curve=reparameterize(crv_12), Parameters="0.5")
midpt_5 = CurveMiddle(Curve=shatter_3)
pcx = CurvePlane(Curve=bang_3.Branch2, Plane=xz_2)  # -> flatten(Points), ParamsC, ParamsP
pdecon_4 = Deconstruct(Point=midpt_5)  # -> XComponent, YComponent, ZComponent
boundary_9 = BoundarySurfaces(Edges=bang_3.Branch0)
boundary_10 = BoundarySurfaces(Edges=bang_3.Branch1)
duppt_6 = RemoveDuplicatePts(Points=pcx.Points, Tolerance=0.01)
smaller_2 = SmallerThan(FirstNumber=pdecon_4.YComponent, SecondNumber=pdecon.YComponent)  # -> SmallerThan, OrEqualTo
polyoffset = PolylineOffset(
    Polylines=boundary_9,
    Distance=number_slider_14,
    Plane=Plane(origin=(0, 0, 0), x=(0, 0, 0), y=(0, 0, 0)),
    Tolerance=0.01,
    ClosedFillet=1,
    OpenFillet=1,
    Miter=2)  # -> Contour, Holes
polyoffset_2 = PolylineOffset(
    Polylines=boundary_10,
    Distance=number_slider_14,
    Plane=Plane(origin=(0, 0, 0), x=(0, 0, 0), y=(0, 0, 0)),
    Tolerance=0.01,
    ClosedFillet=1,
    OpenFillet=1,
    Miter=2)  # -> Contour, Holes
pline_6 = PolyLine(Vertices=duppt_6, Closed=False)
dispatch_4 = Dispatch(List=shatter_3, DispatchPattern=smaller_2.SmallerThan)  # -> ListA, ListB
evalsrf = EvaluateSurface(Surface=reparameterize(boundary_10), Point=pt_11)  # -> Point, Normal, UDirection, VDirection, Frame
evalsrf_2 = EvaluateSurface(Surface=reparameterize(boundary_9), Point=pt_10)  # -> Point, Normal, UDirection, VDirection, Frame
crv_13 = Curve(polyoffset.Holes)
crv_14 = Curve(polyoffset_2.Holes)
eval_9 = EvaluateCurve(Curve=pline_6, Parameter=number_slider_13)  # -> Point, Tangent, Angle
crv_15 = Curve(dispatch_4.ListB)
boundary_11 = BoundarySurfaces(Edges=crv_13)
boundary_12 = BoundarySurfaces(Edges=crv_14)
srf_cp = SurfaceClosestPoint(Point=evalsrf_2.Point, Surface=boundary_11)  # -> Point, UVPoint, Distance
srf_cp_2 = SurfaceClosestPoint(Point=evalsrf.Point, Surface=boundary_12)  # -> Point, UVPoint, Distance
brep_3 = Brep(flatten(merge_10))
brep_4 = Brep(brep_3)
debrep_3 = DeconstructBrep(Brep=brep_4)  # -> Faces, Edges, Vertices
brec_2 = BoundingRectangle(Geometry=brep_4, Plane=PlaneXY(0, 0, 0), Axis=0, Slide=0, Union=True)  # -> Bounding, DimensionX, DimensionY
crv_16 = Curve(debrep_3.Edges)
join_3 = JoinCurves(Curves=crv_16, Preserve=False)
len_6 = Length(Curve=join_3)
sort_6 = SortList(Keys=len_6, ValuesA=join_3)  # -> Keys, ValuesA
item_13 = ListItem(List=sort_6.ValuesA, Index=0, Wrap=True)  # -> Item, Item1
area_10 = Area(Geometry=item_13.Item)  # -> Area, flatten(Centroid)

# ---- group: ColumnLocations
pt_25 = Point(flatten(area_10.Centroid))

# ----
points = PointList(Points=flatten(pt_25), Size=Slider(0.34, range=0..1))
crv_17 = Curve(item_13.Item1)
area_11 = Area(Geometry=brec_2.Bounding)  # -> Area, Centroid
offset_6 = OffsetCurve(Curve=crv_17, Distance=neg_2, Corners=1)
join_4 = JoinCurves(Curves=crv_15, Preserve=False)  # -> flatten(Curves)
crv_18 = Curve(item_13.Item)
divlength = DivideLength(Curve=offset_6, Length=Slider(0.5, range=0..1))  # -> Points, Tangents, Parameters

# ---- group: Forces
fspin = SpinForce(Plane=pt_25, Strength=number_slider_15, Radius=number_slider_17, Decay=number_slider_18, Bounds=brec_2.Bounding)
pcharge = PointCharge(Point=pt_25, Charge=merge_2, Decay=number_slider_16, Bounds=brec_2.Bounding)
fspin_2 = SpinForce(Plane=pt_25, Strength=neg_3, Radius=number_slider_17, Decay=number_slider_18, Bounds=brec_2.Bounding)
pcharge_2 = PointCharge(Point=pt_25, Charge=merge_2, Decay=number_slider_16, Bounds=brec_2.Bounding)

# ----
cir_8 = Circle(Plane=eval_9.Point, Radius=number_slider_19)
cir_9 = Circle(Plane=srf_cp.Point, Radius=number_slider_20)
cir_10 = Circle(Plane=srf_cp_2.Point, Radius=number_slider_21)
pdecon_5 = Deconstruct(Point=divlength.Points)  # -> XComponent, YComponent, ZComponent
pdecon_6 = Deconstruct(Point=area_11.Centroid)  # -> XComponent, YComponent, ZComponent
divide_2 = DivideCurve(Curve=crv_18, Count=10, Kinks=False)  # -> Points, Tangents, Parameters
debrep_4 = DeconstructBrep(Brep=brep_3)  # -> Faces, Edges, Vertices

mergef = MergeFields(Fields=[pcharge, fspin])
mergef_2 = MergeFields(Fields=[fspin_2, pcharge_2])

pdecon_7 = Deconstruct(Point=divide_2.Points)  # -> XComponent, YComponent, ZComponent

# ---- group: ModuleOutlinePolygon
number_slider_45 = Slider(6, range=0..10)
polygon = Polygon(Plane=pt_25, Radius=merge_3, Segments=number_slider_45, FilletRadius=0)  # -> Polygon, Length
rotate = Rotate(Geometry=polygon.Polygon, Angle=degrees(Slider(331, range=0..360)), Plane=pt_25)  # -> Geometry, Transform

# ----
pdecon_8 = Deconstruct(Point=area_11.Centroid)  # -> XComponent, YComponent, ZComponent
crv_19 = Curve(debrep_4.Edges)
larger_3 = LargerThan(FirstNumber=pdecon_5.YComponent, SecondNumber=pdecon_6.YComponent)  # -> LargerThan, OrEqualTo
join_5 = JoinCurves(Curves=crv_19, Preserve=False)
dispatch_5 = Dispatch(List=divlength.Points, DispatchPattern=larger_3.LargerThan)  # -> ListA, ListB
larger_4 = LargerThan(FirstNumber=pdecon_7.YComponent, SecondNumber=pdecon_8.YComponent)  # -> LargerThan, OrEqualTo
len_7 = Length(Curve=join_5)
xz_4 = XZPlane(Origin=area_11.Centroid)
join_6 = JoinCurves(Curves=bang_3.Branch2, Preserve=False)
join_7 = JoinCurves(Curves=bang_3.Branch1, Preserve=False)
dispatch_6 = Dispatch(List=divide_2.Points, DispatchPattern=larger_4.LargerThan)  # -> ListA, ListB
pt_26 = Point(dispatch_5.ListA)
end_2 = EndPoints(Curve=bang_3.Branch1)  # -> Start, End
end_3 = EndPoints(Curve=bang_3.Branch0)  # -> Start, End
sort_7 = SortList(Keys=len_7, ValuesA=join_5)  # -> Keys, ValuesA
xz_5 = XZPlane(Origin=area_11.Centroid)
pt_27 = Point(dispatch_6.ListA)
midpt_6 = CurveMiddle(Curve=bang_3.Branch2)
item_14 = ListItem(List=sort_7.ValuesA, Index=0, Wrap=True)  # -> Item, Item1
mirror_5 = Mirror(Geometry=pt_26, Plane=xz_4)  # -> Geometry, Transform
duppt_7 = RemoveDuplicatePts(Points=[end_2.Start, end_2.End], Tolerance=0.01)
duppt_8 = RemoveDuplicatePts(Points=[end_3.Start, end_3.End], Tolerance=0.01)
pull_5 = PullPoint(Point=duppt_8, Geometry=join_6, ClosestOnly=True)  # -> ClosestPoint, Distance
dispatch_7 = Dispatch(List=duppt_8, DispatchPattern=pull_5.Distance)  # -> ListA, ListB
pull_6 = PullPoint(Point=duppt_6, Geometry=cir_8, ClosestOnly=True)  # -> ClosestPoint, Distance
pdecon_9 = Deconstruct(Point=midpt_6)  # -> XComponent, YComponent, ZComponent
graft = GraftTree(Tree=brep_4, IncludeEmptyLists=True, IncludeNullItems=True)
pt_28 = Point(dispatch_7.ListB)
mirror_6 = Mirror(Geometry=pt_27, Plane=xz_5)  # -> Geometry, Transform
merge_11 = Merge(Data1=pt_26, Data2=mirror_5.Geometry)  # -> flatten(Result)
pull_7 = PullPoint(Point=duppt_7, Geometry=cir_10, ClosestOnly=True)  # -> ClosestPoint, Distance
pull_8 = PullPoint(Point=duppt_8, Geometry=cir_9, ClosestOnly=True)  # -> ClosestPoint, Distance
alongcrv_4 = SortAlongCurve(Points=pull_7.ClosestPoint, Curve=cir_10)  # -> Points, Indices
alongcrv_5 = SortAlongCurve(Points=pull_8.ClosestPoint, Curve=cir_9)  # -> Points, Indices
sort_8 = SortList(Keys=pdecon_9.YComponent, ValuesA=bang_3.Branch2, ValuesB=midpt_6)  # -> reverse(Keys), reverse(ValuesA), reverse(ValuesB)
ln_17 = Line(StartPoint=duppt_6, EndPoint=pull_6.ClosestPoint)
pull_9 = PullPoint(Point=pt_28, Geometry=join_7, ClosestOnly=True)  # -> ClosestPoint, Distance
ln_18 = Line(StartPoint=duppt_7, EndPoint=pull_7.ClosestPoint)
multiplication_2 = Multiplication(A=number_slider_45, B=Slider(4, range=0..10))
ln_19 = Line(StartPoint=duppt_8, EndPoint=pull_8.ClosestPoint)
pull_10 = PullPoint(Point=merge_11, Geometry=graft, ClosestOnly=True)  # -> ClosestPoint, Distance
merge_12 = Merge(Data1=pt_27, Data2=mirror_6.Geometry)  # -> flatten(Result)
pline_7 = PolyLine(Vertices=alongcrv_4.Points, Closed=invert(False))
pline_8 = PolyLine(Vertices=alongcrv_5.Points, Closed=invert(False))
polyoffset_3 = PolylineOffset(
    Polylines=item_14.Item1,
    Distance=Slider(0.39, range=0..10),
    Plane=Plane(origin=(0, 0, 0), x=(0, 0, 0), y=(0, 0, 0)),
    Tolerance=0.01,
    ClosedFillet=number_slider_22,
    OpenFillet=number_slider_22,
    Miter=2)  # -> Contour, Holes
graft_2 = GraftTree(Tree=brep_4, IncludeEmptyLists=True, IncludeNullItems=True)
item_15 = ListItem(List=ln_17, Index=0, Wrap=True)  # -> Item, Item1
dispatch_8 = Dispatch(List=pt_28, DispatchPattern=pull_9.Distance)  # -> ListA, ListB
item_16 = ListItem(List=sort_8.ValuesA, Index=0, Wrap=True)
item_17 = ListItem(List=sort_8.ValuesB, Index=0, Wrap=True)
dispatch_9 = Dispatch(List=merge_11, DispatchPattern=pull_10.Distance)  # -> ListA, ListB
pt_29 = Point(crv_cp_5.Point)
crv_20 = Curve(flatten([pline_7, ln_18, bang_3.Branch1]))
crv_21 = Curve(polyoffset_3.Holes)
pt_30 = Point(dispatch_8.ListB)
crv_22 = Curve(flatten([pline_8, ln_19, bang_3.Branch0]))
pt_31 = Point(dispatch_8.ListA)
pull_11 = PullPoint(Point=merge_12, Geometry=graft_2, ClosestOnly=True)  # -> ClosestPoint, Distance
midpt_7 = CurveMiddle(Curve=item_15.Item1)
pt_32 = Point(dispatch_9.ListB)
ln_20 = Line(StartPoint=pt_30, EndPoint=pt_29)
explode_9 = Explode(Curve=crv_20, Recursive=True)  # -> flatten(Segments), Vertices
qrmesh = QuadRemesh(Mesh=graft(brep_3), Settings=qrsettings)  # disabled
explode_10 = Explode(Curve=crv_22, Recursive=True)  # -> flatten(Segments), Vertices

# ---- group: FieldLines
fline = FieldLine(Field=mergef, Point=pt_32, Steps=number_slider_26, Accuracy=number_slider_25, Method=3)
fline_2 = FieldLine(Field=mergef_2, Point=pt_32, Steps=number_slider_26, Accuracy=number_slider_25, Method=3)

# ----
merge_13 = Merge(Data1=fline, Data2=fline_2)
merge_14 = Merge(Data1=fline, Data2=fline_2)
dispatch_10 = Dispatch(List=merge_12, DispatchPattern=pull_11.Distance)  # -> ListA, ListB
cluster_3 = BranchLook(data=graft(brep_3), i=number_slider_28)
cluster_4 = BranchLook(data=merge_14, i=number_slider_28)
explode_11 = MeshExplode(Mesh=qrmesh, Interpolate=False)
qrmesh_2 = QuadRemesh(Mesh=graft(brep_3), Guides=merge_13, Settings=qrsettings)
wbweave_2 = WeaverbirdsMeshFromLinesWeaveBack(Lines=explode_9.Segments, MaximumValence=4)
wbweave_3 = WeaverbirdsMeshFromLinesWeaveBack(Lines=explode_10.Segments, MaximumValence=4)
pt_33 = Point(dispatch_10.ListB)
demesh_2 = DeconstructMesh(Mesh=explode_11)  # -> Vertices, Faces, Colours, Normals
ln_21 = Line(StartPoint=pt_29, EndPoint=midpt_7)
merge_15 = Merge(Data1=pt_30, Data3=pt_29)
item_18 = ListItem(List=demesh_2.Vertices, Index=0, Wrap=True)  # -> Item, Item1, Item2, Item3
pull_12 = PullPoint(Point=merge_15, Geometry=cir_8, ClosestOnly=True)  # -> ClosestPoint, Distance
merge_16 = Merge(Data1=pull_12.ClosestPoint, Data2=pull_6.ClosestPoint)  # -> flatten(Result)
alongcrv_6 = SortAlongCurve(Points=merge_16, Curve=cir_8)  # -> Points, Indices
pline_9 = PolyLine(Vertices=alongcrv_6.Points, Closed=False)
ln_22 = Line(StartPoint=item_18.Item, EndPoint=item_18.Item2)
ln_23 = Line(StartPoint=item_18.Item1, EndPoint=item_18.Item3)
ln_24 = Line(StartPoint=merge_15, EndPoint=pull_12.ClosestPoint)  # -> flatten(Line)
merge_17 = Merge(Data1=ln_20, Data2=ln_21, Data4=join_4, Data5=ln_24, Data6=ln_17, Data7=pline_9)  # -> flatten(Result)
mcx_2 = MultipleCurves(Curves=reparameterize(merge_17))  # -> Points, IndexA, IndexB, ParamA, ParamB
clone_3 = CloneStructure(List=mcx_2.ParamA, Structure=mcx_2.IndexA)
clone_4 = CloneStructure(List=mcx_2.ParamB, Structure=mcx_2.IndexB)
shatter_4 = Shatter(Curve=reparameterize(graft(merge_17)), Parameters=[clone_3, clone_4])  # -> flatten(Segments)
merge_18 = Merge(Data1=wbweave_3, Data2=wbweave_2)
wbweave_4 = WeaverbirdsMeshFromLinesWeaveBack(Lines=shatter_4, MaximumValence=4)
explode_12 = MeshExplode(Mesh=merge_18, Interpolate=False)
mirror_7 = Mirror(Geometry=wbweave_4, Plane=xz_3)  # -> Geometry, Transform
wbedges = WeaverbirdsMeshEdges(MeshOrPolylines=explode_12)
item_19 = ListItem(List=explode_12, Index=0, Wrap=True)  # -> Item, Item1
wbnaked_4 = WeaverbirdsNakedBoundary(MeshClosedPolylines=explode_12)
mjoin_2 = MeshJoin(Meshes=[mirror_7.Geometry, wbweave_4])
explode_13 = MeshExplode(Mesh=mjoin_2, Interpolate=False)
wbnaked_5 = WeaverbirdsNakedBoundary(MeshClosedPolylines=explode_13)
mirror_8 = Mirror(Geometry=merge_18, Plane=xz_3)  # -> Geometry, Transform
explode_14 = Explode(Curve=wbnaked_4, Recursive=True)  # -> simplify(Segments), Vertices
explode_15 = Explode(Curve=wbnaked_5, Recursive=True)  # -> simplify(Segments), Vertices
lng_3 = ListLength(List=explode_14.Segments)
mesh_10 = Mesh([merge_18, mirror_8.Geometry, mjoin_2])
lng_4 = ListLength(List=explode_15.Segments)
series = Series(Start=0, Step=1, Count=lng_3)
len_8 = Length(Curve=explode_14.Segments)
series_2 = Series(Start=0, Step=1, Count=lng_4)
len_9 = Length(Curve=explode_15.Segments)
sort_9 = SortList(Keys=len_8, ValuesB=series)  # -> Keys, ValuesB
sort_10 = SortList(Keys=len_9, ValuesB=series_2)  # -> Keys, ValuesB
brec_3 = BoundingRectangle(Geometry=mesh_10, Plane=PlaneXY(0, 0, 0), Axis=0, Slide=0, Union=True)  # -> Bounding, DimensionX, DimensionY
item_20 = ListItem(List=sort_9.ValuesB, Index=0, Wrap=True)
item_21 = ListItem(List=sort_10.ValuesB, Index=0, Wrap=True)
area_12 = Area(Geometry=brec_3.Bounding)  # -> Area, Centroid
shift_4 = ShiftList(List=explode_14.Segments, Shift=item_20, Wrap=True)
shift_5 = ShiftList(List=explode_15.Segments, Shift=item_21, Wrap=True)
scale_3 = Scale(Geometry=mesh_10, Center=area_12.Centroid, Factor=Slider(1.26, range=0..10))  # -> Geometry, Transform
wbcatmullclark_2 = WeaverbirdsCatmullClarkSubdivision(MeshCurves=scale_3.Geometry, Level=Slider(1, range=0..10), SmoothNakedEdges=Slider(0, range=0..2))
item_22 = ListItem(List=shift_4, Index=0, Wrap=True)  # -> Item, Item1, Item2
wbcatmullclark_3 = WeaverbirdsCatmullClarkSubdivision(MeshCurves=wbcatmullclark_2, Level=Slider(1, range=0..10), SmoothNakedEdges=1)
item_23 = ListItem(List=shift_5, Index=0, Wrap=True)  # -> Item, Item1, Item2
wbcatmullclark_4 = WeaverbirdsCatmullClarkSubdivision(MeshCurves=scale_3.Geometry, Level=Slider(1, range=0..10), SmoothNakedEdges=Slider(0, range=0..2))
flip = FlipCurve(Curve=item_22.Item2)  # -> Curve, Flag
flip_2 = FlipCurve(Curve=item_23.Item2)  # -> Curve, Flag
loft_2 = Loft(
    Curves=[item_22.Item, flip.Curve],
    Options={Adjust=False, Closed=False, LoftEnds=0, LoftSimp=0, LoftType=0, Rebuild=10, Refit=0.01})
loft_3 = Loft(
    Curves=[item_23.Item, flip_2.Curve],
    Options={Adjust=False, Closed=False, LoftEnds=0, LoftSimp=0, LoftType=0, Rebuild=10, Refit=0.01})
wbcatmullclark_5 = WeaverbirdsCatmullClarkSubdivision(MeshCurves=wbcatmullclark_4, Level=Slider(1, range=0..10), SmoothNakedEdges=1)  # -> simplify(OutputMeshCurves)
divide_3 = DivideDomain²(Domain=loft_2, UCount=Slider(2, range=0..10), VCount=Slider(2, range=0..10))
divide_4 = DivideDomain²(Domain=loft_3, UCount=Slider(2, range=0..10), VCount=Slider(2, range=0..10))
explode_16 = MeshExplode(Mesh=wbcatmullclark_5, Interpolate=False)
subsrf_2 = Isotrim(Surface=loft_2, Domain=divide_3)
subsrf_3 = Isotrim(Surface=loft_3, Domain=divide_4)
demesh_3 = DeconstructMesh(Mesh=explode_16)  # -> Vertices, Faces, Colours, Normals
item_24 = ListItem(List=demesh_3.Vertices, Index=0, Wrap=True)  # -> Item, Item1, Item2, Item3
wbnaked_6 = WeaverbirdsNakedBoundary(MeshClosedPolylines=wbcatmullclark_5)  # -> simplify(NakedCurves)
ln_25 = Line(StartPoint=item_24.Item, EndPoint=item_24.Item2)  # -> simplify(Line)
ln_26 = Line(StartPoint=item_24.Item1, EndPoint=item_24.Item3)  # -> simplify(Line)
shift_6 = ShiftPaths(Data=ln_26, Offset=-1)
shift_7 = ShiftPaths(Data=ln_25, Offset=-1)
explode_17 = Explode(Curve=[wbnaked_6, shift_7, shift_6], Recursive=True)  # -> Segments, Vertices
dupln = RemoveDuplicateLines(Lines=explode_17.Segments, Tolerance=0.01)
end_4 = EndPoints(Curve=dupln)  # -> Start, End
ln_27 = Line(StartPoint=end_4.Start, EndPoint=end_4.End)  # -> flatten(Line)
mcx_3 = MultipleCurves(Curves=reparameterize(ln_27))  # -> Points, IndexA, IndexB, ParamA, ParamB
clone_5 = CloneStructure(List=mcx_3.ParamB, Structure=mcx_3.IndexB)
clone_6 = CloneStructure(List=mcx_3.ParamA, Structure=mcx_3.IndexA)
shatter_5 = Shatter(Curve=reparameterize(graft(ln_27)), Parameters=[clone_6, clone_5])  # -> flatten(Segments)
mesh_11 = Mesh(wbcatmullclark_5)
wbnaked_7 = WeaverbirdsNakedBoundary(MeshClosedPolylines=mesh_11)
len_10 = Length(Curve=wbnaked_7)
midpt_8 = CurveMiddle(Curve=shatter_5)
sort_11 = SortList(Keys=len_10, ValuesA=wbnaked_7)  # -> Keys, ValuesA
pull_13 = PullPoint(Point=midpt_8, Geometry=mesh_11, ClosestOnly=True)  # -> ClosestPoint, Distance
cluster_5 = Cluster_2(M=wbcatmullclark_3)  # -> mesh_5, G; disabled
explode_18 = Explode(Curve=sort_11.ValuesA, Recursive=True)  # -> Segments, Vertices
shift_8 = ShiftPaths(Data=explode_18.Vertices, Offset=-1)
dispatch_11 = Dispatch(List=shatter_5, DispatchPattern=pull_13.Distance)  # -> ListA, ListB
mesh_12 = Mesh(cluster_5.mesh_5)  # disabled
duppt_9 = RemoveDuplicatePts(Points=explode_18.Vertices, Tolerance=0.01)
crv_23 = Curve(dispatch_11.ListB)
demesh_4 = DeconstructMesh(Mesh=mesh_12)  # -> Vertices, Faces, Colours, Normals; disabled
dupln_2 = RemoveDuplicateLines(Lines=crv_23, Tolerance=0.01)
pt_34 = Point(duppt_9)
pdecon_10 = Deconstruct(Point=demesh_4.Vertices)  # -> XComponent, YComponent, ZComponent; disabled
wbweave_5 = WeaverbirdsMeshFromLinesWeaveBack(Lines=dupln_2, MaximumValence=4)
bnd = Bounds(Numbers=pdecon_10.ZComponent)  # disabled
cluster_6 = Cluster_2(M=wbweave_5, mesh=mesh_11, pt=pt_34)  # -> mesh_5, G
remap = RemapNumbers(Value=pdecon_10.ZComponent, Source=bnd, Target=dom_3)  # -> Mapped, Clipped; disabled
neg_8 = Negative(Value=remap.Mapped)  # disabled
mjoin_3 = MeshJoin(Meshes=cluster_6.mesh_5)
pt_35 = Point(flatten(cluster_6.G))
amp = Amplitude(Vector=demesh_4.Normals, Amplitude=neg_8)  # disabled
unim_3 = UnifyMesh(Mesh=mjoin_3)  # -> Result, Count
mesh_13 = Mesh(unim_3.Result)
mesh_14 = Mesh(unim_3.Result)
move_6 = Move(Geometry=demesh_4.Vertices, Motion=amp)  # -> Geometry, Transform; disabled
demesh_5 = DeconstructMesh(Mesh=mesh_14)  # -> Vertices, Faces, Colours, Normals
mesh_15 = Mesh(unim_3.Result)
conmesh_2 = ConstructMesh(Vertices=move_6.Geometry, Faces=demesh_4.Faces)  # disabled
pdecon_11 = Deconstruct(Point=demesh_5.Vertices)  # -> XComponent, YComponent, ZComponent
demesh_6 = DeconstructMesh(Mesh=mesh_15)  # -> Vertices, Faces, Colours, Normals
bnd_2 = Bounds(Numbers=pdecon_11.ZComponent)
mesh_16 = Mesh(conmesh_2)  # disabled
mesh_17 = Mesh(mesh_12)  # disabled
recipricalthickness_3 = RecipricalThickness(Mesh=mesh_15, Angle=Slider(13, range=0..100), Distance=number_slider_37, Width=number_slider_37)
remap_2 = RemapNumbers(Value=pdecon_11.ZComponent, Source=bnd_2, Target=dom_4)  # -> Mapped, Clipped
vdis = VectorDisplay(Anchor=demesh_6.Vertices, Vector=demesh_6.Normals)
neg_9 = Negative(Value=remap_2.Mapped)

# ---- group: Define Loads
Z_7 = UnitZ(Factor="-11")
loads = LoadsKaramba3D(Vector=Z_7, Mesh=mesh_13, LCase="0", mode="MeshLoad -Const.", menu=[buttons(on, off, off), buttons(on, on)])
loads_2 = LoadsKaramba3D(Vector=Vector(0, 0, -1), LCase="0", mode="Gravity")
load_3 = LoadKaramba3D(flatten([loads_2, loads]))

# ----
wbvertices_3 = WeaverbirdsVerticesComponent(MeshClosedPolylinesGroup=mesh_16, Weld=True)  # disabled
wbvertices_4 = WeaverbirdsVerticesComponent(MeshClosedPolylinesGroup=mesh_17, Weld=True)  # disabled
amp_2 = Amplitude(Vector=demesh_5.Normals, Amplitude=remap_2.Mapped)
explode_19 = MeshExplode(Mesh=mesh_16, Interpolate=False)  # disabled
tri = Triangulate(Mesh=mesh_16)  # -> Mesh, Count; disabled
tri_2 = Triangulate(Mesh=mesh_17)  # -> Mesh, Count; disabled
pt_36 = Point(pt_35)
move_7 = Move(Geometry=demesh_5.Vertices, Motion=amp_2)  # -> Geometry, Transform
ln_28 = Line(StartPoint=wbvertices_4, EndPoint=wbvertices_3)  # disabled
wbedges_2 = WeaverbirdsMeshEdges(MeshOrPolylines=mesh_17)  # disabled
wbedges_3 = WeaverbirdsMeshEdges(MeshOrPolylines=mesh_16)  # disabled
demesh_7 = DeconstructMesh(Mesh=explode_19)  # -> Vertices, Faces, Colours, Normals; disabled
wbedges_4 = WeaverbirdsMeshEdges(MeshOrPolylines=tri.Mesh)  # disabled
wbedges_5 = WeaverbirdsMeshEdges(MeshOrPolylines=tri_2.Mesh)  # disabled
conmesh_3 = ConstructMesh(Vertices=move_7.Geometry, Faces=demesh_5.Faces)
lng_5 = ListLength(List=demesh_7.Vertices)  # disabled

# ---- group: Define Elements
meshtoshell = MeshToShellKaramba3D(Mesh=mesh_13, Identifier="S", CrossSection=crosecselect.CrossSection, LimitDistance_m=0.005)  # -> Element, Points, Info

# ---- group: Define Supports
fsim = FindSimilarMember(Data=pt_36, Set=meshtoshell.Points)  # -> Hit, Index
supp = SupportKaramba3D(PosInd=fsim.Hit, menu=[buttons(on, on, on, off, off, off)])

# ----
equals = Equality(FirstNumber=lng_5, SecondNumber=panel_4)  # -> Equality, Inequality; disabled
mesh_18 = Mesh(conmesh_3)
mesh_19 = Mesh(mesh_14)
sift_2 = SiftPattern(List=demesh_7.Vertices, SiftPattern=equals.Equality)  # -> Output0, Output1; disabled
line_3 = Line(flatten([ln_28, wbedges_5, wbedges_4]))  # disabled
explode_20 = MeshExplode(Mesh=mesh_18, Interpolate=False)
tri_3 = Triangulate(Mesh=mesh_18)  # -> Mesh, Count
tri_4 = Triangulate(Mesh=mesh_19)  # -> Mesh, Count
item_25 = ListItem(List=sift_2.Output0, Index=0, Wrap=True)  # -> Item, Item1, Item2, Item3; disabled
pt_37 = Point(sift_2.Output0)  # disabled
ln_29 = Line(StartPoint=demesh_5.Vertices, EndPoint=move_7.Geometry)
pipe_2 = Pipe(Curve=line_3, Radius=panel_5, Caps=0)  # disabled
wbedges_6 = WeaverbirdsMeshEdges(MeshOrPolylines=mesh_19)
wbedges_7 = WeaverbirdsMeshEdges(MeshOrPolylines=mesh_18)
demesh_8 = DeconstructMesh(Mesh=explode_20)  # -> Vertices, Faces, Colours, Normals
wbedges_8 = WeaverbirdsMeshEdges(MeshOrPolylines=tri_3.Mesh)
wbedges_9 = WeaverbirdsMeshEdges(MeshOrPolylines=tri_4.Mesh)
ln_30 = Line(StartPoint=item_25.Item, EndPoint=item_25.Item2)  # disabled
ln_31 = Line(StartPoint=item_25.Item1, EndPoint=item_25.Item3)  # disabled
lng_6 = ListLength(List=demesh_8.Vertices)

# ---- group: Assemble Model
assemble = AssembleModelKaramba3D(Elem=flatten(meshtoshell.Element), Support=flatten(supp), Load=flatten(load_3), LimitDistance_m=0.005)  # -> Model, Info, Mass_kg, CenterOfGravity, LoadCaseNames

# ----
line_4 = Line([ln_30, ln_31])  # disabled
equals_2 = Equality(FirstNumber=lng_6, SecondNumber="3")  # -> Equality, Inequality
len_11 = Length(Curve=line_4)  # disabled
sift_3 = SiftPattern(List=demesh_8.Vertices, SiftPattern=equals_2.Equality)  # -> Output0, Output1
sort_12 = SortList(Keys=len_11, ValuesA=line_4)  # -> Keys, ValuesA; disabled
line_5 = Line(flatten([ln_29, wbedges_9, wbedges_8]))
item_26 = ListItem(List=sort_12.ValuesA, Index=0, Wrap=True)  # disabled
end_5 = EndPoints(Curve=line_5)  # -> Start, End
item_27 = ListItem(List=sift_3.Output0, Index=0, Wrap=True)  # -> Item, Item1, Item2, Item3
pt_38 = Point(sift_3.Output0)

# ---- group: Optimize Cross Sections
opticrosec = OptimizeCrossSectionKaramba3D(
    Model=assemble.Model,
    CrossSections=cross_section,
    MaximumUtilization=1,
    MaximumDisplacement_cm="1",
    UltimateLimitStateIterations=5,
    DisplacementIterations=5,
    NumberOfSamplePoints=3,
    ElasticDesign=True,
    GammaM0=1,
    GammaM1=1.1,
    SwayFrame=True)  # -> ModelWithOptimizedCrossSections, Info, Mass_kg, MaximumDisplacement_cm, ElasticEnergy_kNm
panel_6 = Panel(opticrosec.MaximumDisplacement_cm)

# ----
line_6 = Line(item_26)  # disabled
pipe_3 = Pipe(Curve=line_5, Radius="0.008", Caps=0)
len_12 = Length(Curve=line_5)

# ---- group: Analyze Model - FREE VERSION
analyzethii = AnalyzeThIIKaramba3D(Model=assemble.Model, RTolerance=1e-07, MaxIterations=50, NoTensionalNII=False)  # -> CalculatedModel, MaximumDisplacement_cm, ResultingForceOfGravity_kN, ElasticEnergy_kNm
panel_7 = Panel(analyzethii.MaximumDisplacement_cm)

# ----
duppt_10 = RemoveDuplicatePts(Points=[end_5.Start, end_5.End], Tolerance=0.01)
ln_32 = Line(StartPoint=item_27.Item, EndPoint=item_27.Item2)
ln_33 = Line(StartPoint=item_27.Item1, EndPoint=item_27.Item3)
bnd_3 = Bounds(Numbers=len_12)
group = Group(Objects=flatten(pipe_3))
line_7 = Line([ln_32, ln_33])
panel_8 = Panel(opticrosec.Mass_kg)
len_13 = Length(Curve=line_7)

# ---- group: View Results
modelview = ModelViewKaramba3D(Model=opticrosec.ModelWithOptimizedCrossSections, ResultFactors=1, ResultCase=-1)  # -> Model, DeformedMesh, DeformedAxes, DeformedModel
shellview = ShellViewKaramba3D(Model=modelview.Model, IndexOfLayer=0)  # -> Model, MeshesOfRenderedShells, LegendColors, LegendTags
legend = Legend(Colour=shellview.LegendColors, Tags=shellview.LegendTags, LegendType=1)

# ----
sort_13 = SortList(Keys=len_13, ValuesA=line_7)  # -> Keys, ValuesA
item_28 = ListItem(List=sort_13.ValuesA, Index=0, Wrap=True)
# Anchoring Boundary Curve
# Column Height
line_8 = Line(item_28)

# ==== cluster Cluster
M = ClusterInput()
unim = UnifyMesh(Mesh=M)  # -> Result, Count
medges = MeshEdges(Mesh=unim.Result)  # -> NakedEdges, InteriorEdges, NonManifoldEdges
nv = NakedVertices(Mesh=unim.Result)  # -> ClothedIndex, NakedIndex, ClothedPts, NakedPts
join = JoinCurves(Curves=medges.NakedEdges, Preserve=False)
len = Length(Curve=join)
sort = SortList(Keys=len, ValuesA=join)  # -> Keys, ValuesA
cull_i = CullIndex(List=sort.ValuesA, Indices="-1", Wrap=True)

# ---- group: Pressure
# Pressure
facen = FaceNormals(Mesh=unim.Result)  # -> Centers, Normals
item = ListItem(List=facen.Normals, Index=0, Wrap=True)
number_slider = Slider(0.6274, range=0..1)
devec = DeconstructVector(Vector=item)  # -> XComponent, YComponent, ZComponent
larger = LargerThan(FirstNumber=devec.ZComponent, SecondNumber=Slider(0, range=0..100))  # -> LargerThan, OrEqualTo
neg = Negative(Value=number_slider)
filter = StreamFilter(Gate=larger.LargerThan, Stream0=neg, Stream1=number_slider)

# ----
crv_cp = CurveClosestPoint(Point=nv.NakedPts, Curve=graft(cull_i))  # -> Point, Parameter, Distance
B = ClusterInput()
lng = ListLength(List=cull_i)
int = Integer(crv_cp.Distance)
# Column Height
dom = ConstructDomain(DomainStart=Slider(0, range=0..10), DomainEnd=B)
bool = Boolean(int)
cull = CullPattern(List=nv.NakedPts, CullPattern=invert(bool))

# ---- group: Column Height
random = Random(Range=dom, Number=lng, Seed=2)
Z = UnitZ(Factor=random)  # -> graft(UnitVector)
move = Move(Geometry=cull, Motion=Z)  # -> Geometry, Transform

# ----
branch = TreeBranch(Tree=cull, Path="{0;0;0;0;1}", MaintainPaths=True)
remap = RemapNumbers(Value=Slider(178, range=0..300), Source=Slider(300, range=0..1000), Target=Slider(10, range=0..10))  # -> Mapped, Clipped
pt = Point(flatten(cull))
pt_2 = ConstructPoint(XCoordinate=0, YCoordinate=0, ZCoordinate=0)
index = ItemIndex(List=nv.NakedPts, Item=pt)
pt_3 = Point(pt)
pt_4 = Point(flatten(move.Geometry))
line = LineSDL(Start=pt_2, Direction=Vector(0, 0, 1), Length=1)
number_slider_2 = Slider(1, range=0..1)
number_slider_3 = Slider(0, range=0..10)
cull_i_2 = CullIndex(List=nv.NakedPts, Indices=index, Wrap=True)

# ---- group: Boundary
# Anchoring Boundary Curve
item_2 = ListItem(List=sort.ValuesA, Index="-1", Wrap=True)
Z_2 = UnitZ(Factor=Slider(3, range=0..10))
move_2 = Move(Geometry=item_2, Motion=Z_2)  # -> Geometry, Transform
crv_cp_2 = CurveClosestPoint(Point=cull_i_2, Curve=move_2.Geometry)  # -> Point, Parameter, Distance

# ----
lng_2 = ListLength(List=cull_i_2)
pt_5 = Point(crv_cp_2.Point)
divide = DivideCurve(Curve=line, Count=lng_2, Kinks=False)  # -> Points, Tangents, Parameters
pt_6 = Point(cull_i_2)
perlin = PerlinNoise(Values=divide.Points, Time=remap.Mapped, Scale=Slider(2, range=0..100))
neg_2 = Negative(Value=number_slider_3)
bnd = Bounds(Numbers=perlin)
dom_2 = ConstructDomain(DomainStart=neg_2, DomainEnd=number_slider_3)
remap_2 = RemapNumbers(Value=perlin, Source=bnd, Target=dom_2)  # -> Mapped, Clipped
Z_3 = UnitZ(Factor=remap_2.Mapped)
move_3 = Move(Geometry=crv_cp_2.Point, Motion=Z_3)  # -> Geometry, Transform

# ---- group: Goals
edgelengths = EdgeLengths(Mesh=unim.Result, LengthFactor="0", Strength=1)
pressure = Pressure(M=unim.Result, Strength=filter)
anchor = Anchor(Point=pt, Target=pt_4, Strength=10000)
show = Show(G=unim.Result)
anchor_2 = Anchor(Point=cull_i_2, Target=move_3.Geometry, Strength=10000)

# ----
entwine = Entwine(Branch00=show, Branch01=[edgelengths, anchor_2, anchor, pressure], FlattenInputs=True)
graph = QuickGraph(perlin, SortOrder=0)
zombiesolver = ZombieSolver(GoalObjects=entwine, Threshold=1e-10, Tolerance=0.0001, MaxIterations=50000)  # -> I, V, O
unflatten = UnflattenTree(Tree=zombiesolver.O, Guide=entwine)
bang = ExplodeTree(Data=unflatten)  # -> Branch0, Branch1
neg_3 = Negative(Value=Slider(0.34, range=0..1))
mesh = Mesh(bang.Branch0)
mesh_2 = ClusterOutput(mesh)
wboffset = WeaverbirdsOffsetMesh(MeshCurves=mesh, Distance=neg_3, OffsetType=0)
explode = MeshExplode(Mesh=wboffset, Interpolate=False)
explode_2 = MeshExplode(Mesh=mesh, Interpolate=False)
move_4 = Move(Geometry=cull_i, Motion=flatten(Z))  # -> Geometry, Transform; disabled
crv = Curve(move_2.Geometry)  # disabled
mesh_3 = Mesh(move_4.Geometry)  # disabled
mesh_4 = Mesh(crv)  # disabled
demesh = DeconstructMesh(Mesh=explode)  # -> Vertices, Faces, Colours, Normals
demesh_2 = DeconstructMesh(Mesh=explode_2)  # -> Vertices, Faces, Colours, Normals
number_slider_4 = Slider(0.01, range=0..0.01)  # disabled
faceb = FaceBoundaries(Mesh=[explode, explode_2])
item_3 = ListItem(List=demesh_2.Vertices, Index=0, Wrap=True)  # -> Item, Item1, Item2, Item3
item_4 = ListItem(List=demesh.Vertices, Index=0, Wrap=True)  # -> Item, Item1, Item2, Item3
pipe = Pipe(Radius=number_slider_4, Caps=0)  # disabled
clean = CombineClean(Meshes=flatten([mesh_4, mesh_3]))  # disabled
ln = Line(StartPoint=item_4.Item, EndPoint=item_3.Item2)
ln_2 = Line(StartPoint=demesh.Vertices, EndPoint=demesh_2.Vertices)
crv_2 = Curve([ln, faceb, ln_2])
explode_3 = Explode(Curve=crv_2, Recursive=True)  # -> flatten(Segments), Vertices
dupln = RemoveDuplicateLines(Lines=explode_3.Segments, Tolerance=0.01)
pipe_2 = Pipe(Curve=dupln, Radius="0.01", Caps=0)
len_2 = Length(Curve=dupln)
P = ClusterOutput(pipe_2)
bnd_2 = Bounds(Numbers=len_2)
ma = MassAddition(Input=len_2)  # -> Result, PartialResults
panel = Panel(ma.Result)

# ==== cluster Cluster_2
pt = ClusterInput()
mesh = ClusterInput()
M = ClusterInput()
pt_2 = Point(simplify(pt))
unim = UnifyMesh(Mesh=M)  # -> Result, Count
mesh_2 = Mesh(mesh)
tstat = TreeStatistics(Tree=pt_2)  # -> Paths, Length, Count
panel = Panel("""0
1""")
unweave = Unweave(List=tstat.Paths, UnweavePattern=panel)  # -> Data0, Data1
medges = MeshEdges(Mesh=mesh_2)  # -> NakedEdges, InteriorEdges, NonManifoldEdges
branch = TreeBranch(Tree=pt_2, Path=unweave.Data0, MaintainPaths=True)
branch_2 = TreeBranch(Tree=pt_2, Path=unweave.Data1, MaintainPaths=True)
join = JoinCurves(Curves=medges.NakedEdges, Preserve=False)
avr = Average(Input=branch)
pt_3 = Point([branch, branch_2])
pdecon = Deconstruct(Point=avr)  # -> XComponent, YComponent, ZComponent
shift = ShiftPaths(Data=pt_3, Offset=-1)
len = Length(Curve=join)
panel_2 = Panel(pdecon.XComponent)
sort = SortList(Keys=len, ValuesA=join)  # -> Keys, ValuesA

# ---- group: Pressure
# Pressure
facen = FaceNormals(Mesh=unim.Result)  # -> Centers, Normals
item = ListItem(List=facen.Normals, Index=0, Wrap=True)
number_slider = Slider(0.0625, range=0..1)
devec = DeconstructVector(Vector=item)  # -> XComponent, YComponent, ZComponent
larger = LargerThan(FirstNumber=devec.ZComponent, SecondNumber=Slider(0, range=0..100))  # -> LargerThan, OrEqualTo
neg = Negative(Value=number_slider)
filter = StreamFilter(Gate=larger.LargerThan, Stream0=neg, Stream1=number_slider)

# ----
cull_i = CullIndex(List=sort.ValuesA, Indices="-1", Wrap=True)
crv_cp = CurveClosestPoint(Point=shift, Curve=graft(cull_i))  # -> Point, Parameter, Distance
lng = ListLength(List=cull_i)
int = Integer(crv_cp.Distance)
int_2 = Integer(pdecon.XComponent)
# Column Height
dom = ConstructDomain(DomainStart=Slider(1.48, range=0..10), DomainEnd=Slider(1.9, range=1.2..2.5))
bool = Boolean(int)

# ---- group: Column Height
random = Random(Range=dom, Number=lng, Seed=int_2)
Z = UnitZ(Factor=random)  # -> graft(UnitVector)
move = Move(Geometry=branch, Motion=Z)  # -> Geometry, Transform

# ----
cull = CullPattern(List=shift, CullPattern=invert(bool))
neg_2 = Negative(Value=Slider(0.8617, range=0..10))
remap = RemapNumbers(Value=Slider(178, range=0..300), Source=Slider(300, range=0..1000), Target=Slider(10, range=0..10))  # -> Mapped, Clipped
pt_4 = Point(branch)
pt_5 = ConstructPoint(XCoordinate=0, YCoordinate=0, ZCoordinate=0)
index = ItemIndex(List=shift, Item=pt_4)
pt_6 = Point(pt_4)
number_slider_2 = Slider(20000, range=0..100000)
line = LineSDL(Start=pt_5, Direction=Vector(0, 0, 1), Length=1)
number_slider_3 = Slider(1, range=0..1)
number_slider_4 = Slider(0, range=0..10)
cull_i_2 = CullIndex(List=shift, Indices=index, Wrap=True)

# ---- group: Boundary
# Anchoring Boundary Curve
item_2 = ListItem(List=sort.ValuesA, Index="-1", Wrap=True)
Z_2 = UnitZ(Factor=Slider(3, range=0..10))
move_2 = Move(Geometry=item_2, Motion=Z_2)  # -> Geometry, Transform
crv_cp_2 = CurveClosestPoint(Point=cull_i_2, Curve=move_2.Geometry)  # -> Point, Parameter, Distance

# ----
lng_2 = ListLength(List=cull_i_2)
pt_7 = Point(crv_cp_2.Point)
G = ClusterOutput(move.Geometry)
mesh_3 = Mesh(unim.Result)
divide = DivideCurve(Curve=line, Count=lng_2, Kinks=False)  # -> Points, Tangents, Parameters
pt_8 = Point(cull_i_2)
perlin = PerlinNoise(Values=divide.Points, Time=remap.Mapped, Scale=Slider(2, range=0..100))
neg_3 = Negative(Value=number_slider_4)
bnd = Bounds(Numbers=perlin)
dom_2 = ConstructDomain(DomainStart=neg_3, DomainEnd=number_slider_4)
number_slider_5 = Slider(0.5, range=0..1)
wbvertices = WeaverbirdsVerticesComponent(MeshClosedPolylinesGroup=unim.Result, Weld=True)  # -> flatten(Points)
remap_2 = RemapNumbers(Value=perlin, Source=bnd, Target=dom_2)  # -> Mapped, Clipped
Z_3 = UnitZ(Factor=remap_2.Mapped)
move_3 = Move(Geometry=crv_cp_2.Point, Motion=Z_3)  # -> Geometry, Transform
pt_9 = Point(move.Geometry)
duppt = RemoveDuplicatePts(Points=wbvertices, Tolerance=0.01)
graph = QuickGraph(perlin, SortOrder=0)

# ---- group: Goals
edgelengths = EdgeLengths(Mesh=unim.Result, LengthFactor="0", Strength=Slider(1, range=0..1))
anchor = Anchor(Point=pt_4, Target=pt_9, Strength=number_slider_2)
show = Show(G=unim.Result)
anchor_2 = Anchor(Point=cull_i_2, Target=move_3.Geometry, Strength=number_slider_2)

# ----
load = Load(Point=duppt, ForceVector=Vector(0, 0, 1), Weighting=number_slider)
entwine = Entwine(Branch00=show, Branch01=[edgelengths, anchor_2, anchor, load], FlattenInputs=True)
zombiesolver = ZombieSolver(GoalObjects=entwine, Threshold=1e-10, Tolerance=0.0001, MaxIterations=50000)  # -> I, V, O
unflatten = UnflattenTree(Tree=zombiesolver.O, Guide=entwine)
bang = ExplodeTree(Data=unflatten)  # -> Branch0, Branch1
neg_4 = Negative(Value=Slider(0.34, range=0..1))
mesh_4 = Mesh(bang.Branch0)
wboffset = WeaverbirdsOffsetMesh(MeshCurves=mesh_4, Distance=neg_4, OffsetType=0)
mesh_5 = ClusterOutput(mesh_4)
explode = MeshExplode(Mesh=wboffset, Interpolate=False)
explode_2 = MeshExplode(Mesh=mesh_4, Interpolate=False)
move_4 = Move(Geometry=cull_i, Motion=flatten(Z))  # -> Geometry, Transform; disabled
crv = Curve(move_2.Geometry)  # disabled
mesh_6 = Mesh(move_4.Geometry)  # disabled
mesh_7 = Mesh(crv)  # disabled
demesh = DeconstructMesh(Mesh=explode)  # -> Vertices, Faces, Colours, Normals
demesh_2 = DeconstructMesh(Mesh=explode_2)  # -> Vertices, Faces, Colours, Normals
number_slider_6 = Slider(0.01, range=0..0.01)  # disabled
faceb = FaceBoundaries(Mesh=[explode, explode_2])
item_3 = ListItem(List=demesh_2.Vertices, Index=0, Wrap=True)  # -> Item, Item1, Item2, Item3
item_4 = ListItem(List=demesh.Vertices, Index=0, Wrap=True)  # -> Item, Item1, Item2, Item3
pipe = Pipe(Radius=number_slider_6, Caps=0)  # disabled
clean = CombineClean(Meshes=flatten([mesh_7, mesh_6]))  # disabled
ln = Line(StartPoint=item_4.Item, EndPoint=item_3.Item2)
ln_2 = Line(StartPoint=demesh.Vertices, EndPoint=demesh_2.Vertices)
crv_2 = Curve([ln, faceb, ln_2])
explode_3 = Explode(Curve=crv_2, Recursive=True)  # -> flatten(Segments), Vertices
dupln = RemoveDuplicateLines(Lines=explode_3.Segments, Tolerance=0.01)
pipe_2 = Pipe(Curve=dupln, Radius="0.01", Caps=0)
len_2 = Length(Curve=dupln)
bnd_2 = Bounds(Numbers=len_2)
ma = MassAddition(Input=len_2)  # -> Result, PartialResults
panel_3 = Panel(ma.Result)

# ==== cluster BranchLook: To see the condition of branch data.
data = ClusterInput()
data_2 = Data(data)
tstat = TreeStatistics(Tree=data_2)  # -> Paths, Length, Count
i = ClusterInput()
item = ListItem(List=tstat.Paths, Index=i, Wrap=True)
branch = TreeBranch(Tree=data_2, Path=item, MaintainPaths=True)
B = ClusterOutput(branch)
