# Grasshopper definition space_frame_wing_demo.gh (Grasshopper 1.0.7)
# plug-ins: Human, treesloth01, Kangaroo2 Components, Weaverbird, MeshEdit Components, Pufferfish, Karamba3D, ClipperComponents, Noise 4D, Kangaroo Components

number_slider = Slider(2.87, range=0..10)  # disabled
number_slider_2 = Slider(9.12, range=0..10)  # disabled
neg = Negative(Value=number_slider_2)  # disabled
brep = Brep([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])  # disabled
vec = VectorXYZ(XComponent=number_slider, YComponent=neg, ZComponent=0)  # -> Vector, Length; disabled
swatch = ColourSwatch(SwatchColor=RGB(69, 69, 69))  # disabled
move = Move(Geometry=brep, Motion=vec.Vector)  # -> Geometry, Transform; disabled

# ----
# Ex. Col.
# Offset Clearance
number_slider_3 = Slider(0.2, range=0..1)

# ----
# Starting
# View Location
pt = Point(Point(3, 6, 0))

# ----
# Existing Column
crv = Curve(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)
crv_2 = Curve(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)
crv_3 = Curve(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)
crv_4 = Curve(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)
area = Area(Geometry=crv)  # -> Area, Centroid
area_2 = Area(Geometry=crv_2)  # -> Area, Centroid
area_3 = Area(Geometry=crv_3)  # -> Area, Centroid
area_4 = Area(Geometry=crv_4)  # -> Area, Centroid

preview = CustomPreview(Geometry=move.Geometry, Material=swatch)  # disabled

# ----
# Ex. Column
# Boudrary
swatch_2 = ColourSwatch(SwatchColor=RGB(0, 0, 0))
ln = Line(StartPoint=area_2.Centroid, EndPoint=area_3.Centroid)
ln_2 = Line(StartPoint=area.Centroid, EndPoint=area_2.Centroid)
ln_3 = Line(StartPoint=area_3.Centroid, EndPoint=area_4.Centroid)
ln_4 = Line(StartPoint=area.Centroid, EndPoint=area_4.Centroid)
preview_2 = CustomPreview(Geometry=[ln_2, ln, ln_3, ln_4], Material=swatch_2)

offset = OffsetCurve(Curve=crv, Distance=number_slider_3, Corners=1)
offset_2 = OffsetCurve(Curve=crv_2, Distance=number_slider_3, Corners=1)
offset_3 = OffsetCurve(Curve=crv_3, Distance=number_slider_3, Corners=1)
offset_4 = OffsetCurve(Curve=crv_4, Distance=number_slider_3, Corners=1)
explode = Explode(Curve=offset_3, Recursive=True)  # -> Segments, Vertices
preview_3 = CustomPreview(Geometry=[offset, offset_2, offset_3, offset_4], Material=ColourSwatch(SwatchColor=RGBA(176, 135, 135, 124)))
explode_2 = Explode(Curve=offset, Recursive=True)  # -> Segments, Vertices
explode_3 = Explode(Curve=offset_2, Recursive=True)  # -> Segments, Vertices
explode_4 = Explode(Curve=offset_4, Recursive=True)  # -> Segments, Vertices
pt_2 = ConstructPoint(XCoordinate=0, YCoordinate=0, ZCoordinate=0)
midpt = CurveMiddle(Curve=ln_2)
midpt_2 = CurveMiddle(Curve=ln_3)

# ----
# Closet Pt to EX Column
item = ListItem(List=explode_3.Vertices, Index=0, Wrap=True)  # -> Item, Item1, Item2, Item3
pt_3 = Point(item.Item2)

# ----
# Closet Pt to EX Column
item_2 = ListItem(List=explode_4.Vertices, Index=0, Wrap=True)  # -> Item, Item1
pt_4 = Point(item_2.Item)

# ----
# Closet Pt to EX Column
item_3 = ListItem(List=explode_2.Vertices, Index=0, Wrap=True)  # -> Item, Item1
pt_5 = Point(item_3.Item1)

# ----
# Closet Pt to EX Column
item_4 = ListItem(List=explode.Vertices, Index=0, Wrap=True)  # -> Item, Item1, Item2, Item3
pt_6 = Point(item_4.Item3)

number_slider_4 = Slider(0.001, range=0..0.001)
line = LineSDL(Start=pt_2, Direction=Vector(0, 0, 1), Length=Slider(100, range=0..100))
remap = RemapNumbers(Value=Slider(300, range=0..300), Source=Slider(300, range=0..1000), Target=Slider(10, range=0..10))  # -> Mapped, Clipped

# ----
# Area 3
number_slider_5 = Slider(0.2, range=0..1)
pt_7 = Point(Point(17.92727553, 9.489372472, 0))
cir = Circle(Plane=pt_7, Radius=number_slider_5)

pt_8 = Point(item_3.Item)
divide = DivideCurve(Curve=line, Count=10, Kinks=False)  # -> Points, Tangents, Parameters
perlin = PerlinNoise(Values=pt_2, Time=remap.Mapped, Scale=number_slider_4)

# ----
# Symetrical Axis
ln_5 = Line(StartPoint=midpt, EndPoint=midpt_2)

eval = EvaluateCurve(SymetricalAxis=ln_5, Parameter=Slider(0.63, range=0.5..0.85))  # -> Point, Tangent, Angle

# ----
# Area 1
number_slider_6 = Slider(0.3, range=0..1)
pt_9 = Point(eval.Point)
cir_2 = Circle(Plane=pt_9, Radius=number_slider_6)

panel = Panel(perlin)
Z = UnitZ(Factor=1)
dom = ConstructDomain(DomainStart="0.55", DomainEnd="0.65")
dom_2 = ConstructDomain(DomainStart="-1", DomainEnd="1")
dom_3 = ConstructDomain(DomainStart="0.5", DomainEnd="0.6")
extr = Extrude(Base=ln_5, Direction=Z)
remap_2 = RemapNumbers(Value=perlin, Source=dom_2, Target=dom)  # -> Mapped, Clipped

# ----
# Shifted Symetrical MidPt
number_slider_7 = Slider(0.65, range=0.5..0.65)
eval_2 = EvaluateCurve(ExEdge3=reparameterize(ln_3), Parameter=remap_2.Mapped)  # -> Point, Tangent, Angle

remap_3 = RemapNumbers(Value=perlin, Source=dom_2, Target=dom_3)  # -> Mapped, Clipped
ln_6 = Line(StartPoint=pt_7, SymeOffset=eval_2.Point)

# ----
# Crv. Extend
panel_2 = Panel("6")

xz = XZPlane(Origin=pt)
cluster = Cluster(B=1)  # -> P, mesh_2; disabled
item_5 = ListItem(List=divide.Points, Index=Slider(8, range=0..10), Wrap=True)
item_6 = ListItem(List=divide.Points, Index=Slider(6, range=0..10), Wrap=True)
item_7 = ListItem(List=divide.Points, Index=Slider(4, range=0..10), Wrap=True)
item_8 = ListItem(List=divide.Points, Index=Slider(2, range=0..10), Wrap=True)
perlin_2 = PerlinNoise(Values=item_5, Time=remap.Mapped, Scale=number_slider_4)
perlin_3 = PerlinNoise(Values=item_6, Time=remap.Mapped, Scale=number_slider_4)
perlin_4 = PerlinNoise(Values=item_7, Time=remap.Mapped, Scale=number_slider_4)
perlin_5 = PerlinNoise(Values=item_8, Time=remap.Mapped, Scale=number_slider_4)
dom_4 = ConstructDomain(DomainStart="0.2", DomainEnd="0.8")
dom_5 = ConstructDomain(DomainStart="0.2", DomainEnd="0.8")
dom_6 = ConstructDomain(DomainStart="0.2", DomainEnd="0.8")
dom_7 = ConstructDomain(DomainStart="0.2", DomainEnd="0.8")
dom_8 = ConstructDomain(DomainStart="0.2", DomainEnd="0.6")
remap_4 = RemapNumbers(Value=perlin_2, Source=dom_2, Target=dom_4)  # -> Mapped, Clipped
remap_5 = RemapNumbers(Value=perlin, Source=dom_2, Target=dom_5)  # -> Mapped, Clipped
remap_6 = RemapNumbers(Value=perlin_3, Source=dom_2, Target=dom_6)  # -> Mapped, Clipped
remap_7 = RemapNumbers(Value=perlin_4, Source=dom_2, Target=dom_7)  # -> Mapped, Clipped
remap_8 = RemapNumbers(Value=perlin_5, Source=dom_2, Target=dom_8)  # -> Mapped, Clipped

number_slider_8 = Slider(0.42, range=0.2..0.8)
number_slider_9 = Slider(0.42, range=0.2..0.8)
number_slider_10 = Slider(0.57, range=0.2..0.8)
number_slider_11 = Slider(0.53, range=0.2..0.8)
number_slider_12 = Slider(0.27, range=0.2..0.6)

number_slider_13 = Slider(0.49, range=0.2..0.8)
number_slider_14 = Slider(0.71, range=0.2..0.8)
number_slider_15 = Slider(0.58, range=0.2..0.8)
number_slider_16 = Slider(0.54, range=0.2..0.8)
number_slider_17 = Slider(0.39, range=0.2..0.6)

xz_2 = XZPlane(Origin=pt_9)
number_slider_18 = Slider(0.45, range=0..1)
pdecon = Deconstruct(Point=pt)  # -> XComponent, YComponent, ZComponent
pt_10 = ConstructPoint(XCoordinate=remap_5.Mapped, YCoordinate=remap_4.Mapped, ZCoordinate=0)
pt_11 = ConstructPoint(XCoordinate=remap_7.Mapped, YCoordinate=remap_6.Mapped, ZCoordinate=0)

number_slider_19 = Slider(0.28, range=0.2..0.4)
number_slider_20 = Slider(0.31, range=0.2..0.4)
number_slider_21 = Slider(0.31, range=0.2..0.4)

number_slider_22 = Slider(0.28, range=0.2..0.4)
number_slider_23 = Slider(0.31, range=0.2..0.4)
number_slider_24 = Slider(0.31, range=0.2..0.4)

xz_3 = XZPlane(Origin=pt)
merge = Merge()
xz_4 = XZPlane(Origin=pt)
panel_3 = Panel("Layer 02")  # disabled
panel_4 = Panel("Curve")  # disabled
dpipeline = DynamicGeometryPipeline(
    LayerFilter=panel_3,
    TypeFilter=panel_4,
    NameFilter="*",
    GroupByLayer=False,
    GroupByType=False,
    IncludeHidden=True,
    IncludeLocked=True,
    enableFullPath=False,
    listenToAttributes=True)  # disabled
xz_5 = XZPlane(Origin=pt)
number_slider_25 = Slider(2, range=0..10)  # disabled
swatch_3 = ColourSwatch(SwatchColor=RGB(0, 0, 0))
swatch_4 = ColourSwatch(SwatchColor=RGB(0, 0, 0))
swatch_5 = ColourSwatch(SwatchColor=RGB(0, 0, 0))
number_slider_26 = Slider(0.12, range=0..1)  # disabled
number_slider_27 = Slider(0.19, range=0..1)  # disabled
mjoin = MeshJoin()
dom_9 = ConstructDomain(DomainStart=number_slider_27, DomainEnd=number_slider_26)  # disabled
dom_10 = ConstructDomain(DomainStart=Slider(0.19, range=0..1), DomainEnd=Slider(0.12, range=0..1))
mesh = Mesh([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])
dom_11 = ConstructDomain(DomainStart=Slider(0.19, range=0..1), DomainEnd=Slider(0.12, range=0..1))

# ---- group: Define Materials
matselect = MaterialSelectionKaramba3D(menu=[dropdown(1), dropdown(1)])

# ---- group: define cross sections
range = Range(Domain="10 to 110", Steps=20)
expression = Expression(x="Shell", y=range, Expression="x&\" \"&y")
cross_section = CrossSectionKaramba3D(
    FamilyNameOfCrossSection="Shell",
    NameOfCrossSection=graft(expression),
    Material=matselect,
    Height_cm=graft(range),
    mode="Shell - Const")  # -> flatten(CrossSection)
crosecselect = CrossSectionSelectorKaramba3D(CrossSections=cross_section, ElementsIdentifiers="S")  # -> CrossSection, Info

# ----
Z_2 = UnitZ(Factor="-50")
panel_5 = Panel("3")  # disabled
panel_6 = Panel("0.008")  # disabled
box = CenterBox(Base=PlaneXY(0, 0, 0), X=Slider(0.82, range=0..10), Y=Slider(1.51, range=0..10), Z=Slider(0.64, range=0..10))
debrep = DeconstructBrep(Brep=box)  # -> Faces, Edges, Vertices
panel_7 = Panel("""0
1""")
points = PointList(Points=debrep.Vertices, Size=Slider(0.32, range=0..1))
galapagos = Galapagos(
    fitness=opticrosec,
    gene=[number_slider_8, number_slider_9, number_slider_10, number_slider_11, number_slider_12, number_slider_23, number_slider_24, number_slider_22])
item_9 = ListItem(List=debrep.Vertices, Index=0, Wrap=True)  # -> Item, Item1, Item2, Item3, Item4, Item5, Item6, Item7
pline = PolyLine(Vertices=[item_9.Item4, item_9.Item5, item_9.Item6, item_9.Item7], Closed=invert(False))
pline_2 = PolyLine(Vertices=[item_9.Item, item_9.Item1, item_9.Item2, item_9.Item3], Closed=invert(False))
ln_7 = Line(StartPoint=item_9.Item3, EndPoint=item_9.Item5)
ln_8 = Line(StartPoint=item_9.Item1, EndPoint=item_9.Item7)
ln_9 = Line(StartPoint=item_9.Item, EndPoint=item_9.Item6)
ln_10 = Line(StartPoint=item_9.Item7, EndPoint=item_9.Item5)
ln_11 = Line(StartPoint=item_9.Item, EndPoint=item_9.Item5)
ln_12 = Line(StartPoint=item_9.Item6, EndPoint=item_9.Item1)
ln_13 = Line(StartPoint=item_9.Item1, EndPoint=item_9.Item6)
ln_14 = Line(StartPoint=item_9.Item2, EndPoint=item_9.Item)
ln_15 = Line(StartPoint=item_9.Item3, EndPoint=item_9.Item4)
ln_16 = Line(StartPoint=item_9.Item2, EndPoint=item_9.Item7)
ln_17 = Line(StartPoint=item_9.Item3, EndPoint=item_9.Item4)
explode_5 = Explode(Curve=[pline, pline_2], Recursive=True)  # -> Segments, Vertices
merge_2 = Merge(Data1=ln_11, Data2=ln_13, Data3=ln_16, Data4=ln_17)
merge_3 = Merge(Data1=ln_10, Data2=ln_12, Data3=ln_14, Data4=ln_15)
filter = StreamFilter(Gate=Slider(4, range=0..5), Stream0=ln_9, Stream1=[ln_9, ln_8], Stream2=[ln_9, ln_7], Stream3=merge_2, Stream4=merge_3)
pipe = Pipe(Curve=[explode_5.Segments, filter], Radius="0.05", Caps=0)
edges = BrepEdges(Brep=pipe)  # -> Naked, Interior, NonManifold
preview_4 = CustomPreview(Geometry=pipe, Material=ColourSwatch(SwatchColor=RGB(219, 219, 219)))
previewlw = CustomPreviewLineweights(Geometry=[edges.Naked, edges.Interior], Shader=ColourSwatch(SwatchColor=RGB(0, 0, 0)), Absolute=False)
tbox = TwistedBox(
    CornerA=item_9.Item,
    CornerB=item_9.Item1,
    CornerC=item_9.Item2,
    CornerD=item_9.Item3,
    CornerE=item_9.Item4,
    CornerF=item_9.Item5,
    CornerG=item_9.Item6,
    CornerH=item_9.Item7)

ln_18 = Line(StartPoint=eval_2.Point, StartView=pt)
ln_19 = Line(StartPoint=pt_9, ExColumn1=pt_8)

# ----
# Area 2
number_slider_28 = Slider(0.4, range=0..1)

# ----
# Center
# Connection
ln_20 = Line(StartPoint=pt_9, EndPoint=pt_7)

number_slider_29 = Slider(0.5, range=0.5..0.6)

Z_3 = UnitZ(Factor=1)

# ----
# Column 1
number_slider_30 = Slider(0.35, range=0..1)

multiplication = Multiplication(A=number_slider_30, B=Slider(2.2, range=1.5..3))
offset_5 = OffsetCurve(Curve=ln_18, Distance=multiplication, Corners=1)
ccx = CurveCurve(CurveA=ln_19, CurveB=offset_5)  # -> Points, ParamsA, ParamsB

pt_12 = Point(ccx.Points)
cir_3 = Circle(Plane=pt_12, Radius=number_slider_28)

ln_21 = Line(StartPoint=pt_9, EndPoint=pt_12)
ln_22 = Line(StartPoint=pt_12, EndPoint=pt_7)

hframe = HorizontalFrame(Curve=ln_21, Parameter=remap_3.Mapped)
hframe_2 = HorizontalFrame(Curve=ln_22, Parameter=remap_3.Mapped)
deplane = DeconstructPlane(Plane=hframe)  # -> Origin, XAxis, YAxis, ZAxis
deplane_2 = DeconstructPlane(Plane=hframe_2)  # -> Origin, XAxis, YAxis, ZAxis

vrot = Rotate(Vector=deplane_2.YAxis, Axis=deplane_2.ZAxis, Angle=degrees(Slider(-12, range=-15..15)))
vrot_2 = Rotate(Vector=deplane.YAxis, Axis=deplane.ZAxis, Angle=degrees(Slider(2, range=-20..20)))
line_2 = LineSDL(Start=deplane.Origin, Direction=vrot_2, Length=10)
line_3 = LineSDL(Start=deplane_2.Origin, Direction=vrot, Length=10)
ccx_2 = CurveCurve(CurveA=line_2, SymeAxis=ln_5)  # -> Pt1Syme, ParamsA, ParamsB

ln_23 = Line(StartPoint=ccx_2.Pt1Syme, EndPoint=pt_12)
extr_2 = Extrude(Base=ln_23, Direction=Z_3)

crv_cp = CurveClosestPoint(Point=ccx_2.Pt1Syme, ExEdge1=ln_2)  # -> Point, Parameter, Distance
ln_24 = Line(StartPoint=deplane.Origin, EndPoint=ccx_2.Pt1Syme)
mirror = Mirror(Geometry=deplane_2.Origin, Plane=extr_2)  # -> Geometry, Transform
ln_25 = Line(StartPoint=mirror.Geometry, EndPoint=pt_5)
ext = ExtendCurve(Curve=ln_24, Type=0, Start=panel_2, End=panel_2)
ccx_3 = CurveCurve(MainConnect=ext, CurveB=ln_6)  # -> Points, ParamsA, ParamsB
ln_26 = Line(StartPoint=pt_4, EndPoint=ccx_3.Points)
eval_3 = EvaluateCurve(Curve=ln_26, Parameter=Slider(0.42, range=0.3..0.6))  # -> Point, Tangent, Angle
crv_cp_2 = CurveClosestPoint(Point=eval_3.Point, ClrOffset=offset_5)  # -> Point, Parameter, Distance
merge_4 = Merge(
    Data1=deplane.Origin,
    Data2=ccx_3.Points,
    Data3=eval_3.Point,
    Data4=crv_cp_2.Point,
    Data5=eval_2.Point,
    Data6=ccx_2.Pt1Syme)
ext_2 = ExtendCurve(Curve=ln_25, Type=0, Start=panel_2, End=panel_2)
ext_3 = ExtendCurve(Curve=line_3, Type=0, Start=panel_2, End=panel_2)
midpt_3 = CurveMiddle(Curve=ext_3)

# ----
# Main Symetrical
mirror_2 = Mirror(Geometry=merge_4, Plane=extr)  # -> Geometry, Transform

orient = Orient(Geometry=ext_3, Source=midpt_3, ExCol3Clr=pt_4)  # -> Geometry, Transform
ccx_4 = CurveCurve(CurveA=orient.Geometry, CurveB=[ext, ext_2])  # -> Points, ParamsA, ParamsB
ccx_5 = CurveCurve(CurveA=ext_3, CurveB=[ext_2, ext])  # -> Points, ParamsA, ParamsB
merge_5 = Merge(Data1=ccx_5.Points, Data2=ccx_4.Points)
merge_6 = Merge(Data1=ccx_2.Pt1Syme, Data2=crv_cp.Point, Data3=mirror.Geometry, Data4=ccx_5.Points)

alongcrv = SortAlongCurve(Points=flatten(merge_6), Column2Cir=cir_3)  # -> Points, Indices
pline_3 = PolyLine(Vertices=alongcrv.Points, Closed=invert(False))
fillet = FilletDistance(Curve=pline_3, Distance=Slider(0.3, range=0..1))
boundary = BoundarySurfaces(Edges=fillet)

alongcrv_2 = SortAlongCurve(Points=flatten(merge_5), Column3Cir=cir)  # -> Points, Indices
pline_4 = PolyLine(Vertices=alongcrv_2.Points, Closed=invert(False))
fillet_2 = FilletDistance(Curve=pline_4, Distance=Slider(0.4, range=0..1))
boundary_2 = BoundarySurfaces(Edges=fillet_2)

alongcrv_3 = SortAlongCurve(Points=flatten([merge_4, mirror_2.Geometry]), Column1Cir=cir_2)  # -> Points, Indices
pline_5 = PolyLine(Vertices=alongcrv_3.Points, Closed=invert(False))
# Mushroom 1
fillet_3 = FilletDistance(Curve=pline_5, Distance=Slider(0, range=0..1))
boundary_3 = BoundarySurfaces(Edges=fillet_3)

pt_13 = Point([pt_9, pt_12, pt_7])  # disabled
relay = Relay([pt_9, pt_7, pt_12])  # disabled

crv_5 = Curve(pline_4)
crv_6 = Curve(pline_3)
crv_7 = Curve(pline_5)
mirror_3 = Mirror(Geometry=[crv_6, crv_5, pt_13], Plane=xz)  # -> Geometry, Transform
merge_7 = Merge(Data1=crv_6, Data2=crv_5, Data3=crv_7)  # -> flatten(Result)
entwine = Entwine(Branch00=crv_6, Branch01=crv_5, Branch02=crv_7, FlattenInputs=True)
area_5 = Area(Geometry=boundary)  # -> Area, Centroid
merge_8 = Merge(Data1=[crv_6, crv_5], Data2=mirror_3.Geometry, Data3=crv_7, Data4=relay)
area_6 = Area(Geometry=boundary_2)  # -> Area, Centroid
area_7 = Area(Geometry=boundary_3)  # -> Area, Centroid
disc = Discontinuity(Curve=merge_7, Level=1)  # -> Points, Parameters
merge_9 = Merge(Data1=boundary, Data2=boundary_2)

# ----
# Column 2
number_slider_31 = Slider(0.2, range=0..1)
cir_4 = Circle(Plane=area_5.Centroid, Radius=number_slider_31)
boundary_4 = BoundarySurfaces(Edges=cir_4)
preview_5 = CustomPreview(Geometry=boundary_4, Material=ColourSwatch(SwatchColor=RGB(0, 238, 255)))  # disabled

# ----
# Column 3
number_slider_32 = Slider(0.2, range=0..1)
cir_5 = Circle(Plane=area_6.Centroid, Radius=number_slider_32)
boundary_5 = BoundarySurfaces(Edges=cir_5)
preview_6 = CustomPreview(Geometry=boundary_5, Material=ColourSwatch(SwatchColor=RGB(247, 0, 255)))  # disabled

shatter = Shatter(Curve=graft(merge_7), Parameters=disc.Parameters)
brec = BoundingRectangle(Geometry=flatten(merge_8), Plane=PlaneXY(0, 0, 0), Axis=0, Slide=0, Union=True)  # -> Bounding, DimensionX, DimensionY
end = EndPoints(Curve=shatter)  # -> Start, End

# ----
# Main Symetrical
mirror_4 = Mirror(Geometry=merge_9, Plane=extr)  # -> Geometry, Transform

area_8 = Area(Geometry=brec.Bounding)  # -> Area, Centroid

cir_6 = Circle(Plane=area_7.Centroid, Radius=number_slider_30)
boundary_6 = BoundarySurfaces(Edges=cir_6)
preview_7 = CustomPreview(Geometry=boundary_6, Material=ColourSwatch(SwatchColor=RGB(252, 176, 10)))  # disabled

ln_27 = Line(StartPoint=end.Start, EndPoint=end.End)
merge_10 = Merge(Data1=mirror_4.Geometry, Data2=boundary_3, Data3=merge_9)
scale = Scale(Geometry=merge_8, Center=area_8.Centroid, Factor=Slider(1.26, range=0..10))  # -> Geometry, Transform
explode_6 = Explode(Curve=ln_27, Recursive=True)  # -> flatten(Segments), Vertices
mcx = MultipleCurves(Curves=reparameterize(explode_6.Segments))  # -> Points, IndexA, IndexB, ParamA, ParamB
previewlw_2 = CustomPreviewLineweights(Geometry=scale.Geometry, Shader=ColourSwatch(SwatchColor=RGB(0, 0, 0)), Thickness=Slider(2, range=0..10), Absolute=False)
clone = CloneStructure(List=mcx.ParamA, Structure=mcx.IndexA)
clone_2 = CloneStructure(List=mcx.ParamB, Structure=mcx.IndexB)
shatter_2 = Shatter(Curve=reparameterize(graft(explode_6.Segments)), Parameters=[clone, clone_2])  # -> flatten(Segments)
midpt_4 = CurveMiddle(Curve=shatter_2)
crv_8 = Curve(entwine)
pull = PullPoint(Point=midpt_4, Geometry=crv_8, ClosestOnly=True)  # -> ClosestPoint, Distance
dispatch = Dispatch(List=shatter_2, DispatchPattern=pull.Distance)  # -> ListA, ListB
crv_9 = Curve(dispatch.ListB)
bang = ExplodeTree(Data=crv_9)  # -> Branch0, Branch1, Branch2
crv_10 = Curve(bang.Branch2)
shatter_3 = Shatter(Curve=reparameterize(crv_10), Parameters="0.5")
midpt_5 = CurveMiddle(Curve=shatter_3)
pcx = CurvePlane(Curve=bang.Branch2, Plane=xz_2)  # -> flatten(Points), ParamsC, ParamsP
pdecon_2 = Deconstruct(Point=midpt_5)  # -> XComponent, YComponent, ZComponent
boundary_7 = BoundarySurfaces(Edges=bang.Branch0)
boundary_8 = BoundarySurfaces(Edges=bang.Branch1)
duppt = RemoveDuplicatePts(Points=pcx.Points, Tolerance=0.01)
smaller = SmallerThan(FirstNumber=pdecon_2.YComponent, SecondNumber=pdecon.YComponent)  # -> SmallerThan, OrEqualTo
polyoffset = PolylineOffset(
    Polylines=boundary_7,
    Distance=number_slider_18,
    Plane=Plane(origin=(0, 0, 0), x=(0, 0, 0), y=(0, 0, 0)),
    Tolerance=0.01,
    ClosedFillet=1,
    OpenFillet=1,
    Miter=2)  # -> Contour, Holes
polyoffset_2 = PolylineOffset(
    Polylines=boundary_8,
    Distance=number_slider_18,
    Plane=Plane(origin=(0, 0, 0), x=(0, 0, 0), y=(0, 0, 0)),
    Tolerance=0.01,
    ClosedFillet=1,
    OpenFillet=1,
    Miter=2)  # -> Contour, Holes
pline_6 = PolyLine(Vertices=duppt, Closed=False)
dispatch_2 = Dispatch(List=shatter_3, DispatchPattern=smaller.SmallerThan)  # -> ListA, ListB
evalsrf = EvaluateSurface(Surface=reparameterize(boundary_8), Point=pt_11)  # -> Point, Normal, UDirection, VDirection, Frame
evalsrf_2 = EvaluateSurface(Surface=reparameterize(boundary_7), Point=pt_10)  # -> Point, Normal, UDirection, VDirection, Frame
crv_11 = Curve(polyoffset.Holes)
crv_12 = Curve(polyoffset_2.Holes)
eval_4 = EvaluateCurve(Curve=pline_6, Parameter=remap_8.Mapped)  # -> Point, Tangent, Angle
crv_13 = Curve(dispatch_2.ListB)
boundary_9 = BoundarySurfaces(Edges=crv_11)
boundary_10 = BoundarySurfaces(Edges=crv_12)
srf_cp = SurfaceClosestPoint(Point=evalsrf_2.Point, Surface=boundary_9)  # -> Point, UVPoint, Distance
srf_cp_2 = SurfaceClosestPoint(Point=evalsrf.Point, Surface=boundary_10)  # -> Point, UVPoint, Distance
join = JoinCurves(Curves=crv_13, Preserve=False)  # -> flatten(Curves)
cir_7 = Circle(Plane=eval_4.Point, Radius=number_slider_22)
cir_8 = Circle(Plane=srf_cp.Point, Radius=number_slider_23)
cir_9 = Circle(Plane=srf_cp_2.Point, Radius=number_slider_24)
mirror_5 = Mirror(Geometry=[cir_9, cir_8], Plane=xz_3)  # -> Geometry, Transform
join_2 = JoinCurves(Curves=bang.Branch2, Preserve=False)
join_3 = JoinCurves(Curves=bang.Branch1, Preserve=False)
end_2 = EndPoints(Curve=bang.Branch1)  # -> Start, End
end_3 = EndPoints(Curve=bang.Branch0)  # -> Start, End
data = Data([merge, mirror_5.Geometry, cir_9, cir_8, cir_7])
midpt_6 = CurveMiddle(Curve=bang.Branch2)
mirror_6 = Mirror(Geometry=data, Plane=xz_4)  # -> Geometry, Transform
duppt_2 = RemoveDuplicatePts(Points=[end_2.Start, end_2.End], Tolerance=0.01)
duppt_3 = RemoveDuplicatePts(Points=[end_3.Start, end_3.End], Tolerance=0.01)
pull_2 = PullPoint(Point=duppt_3, Geometry=join_2, ClosestOnly=True)  # -> ClosestPoint, Distance
dispatch_3 = Dispatch(List=duppt_3, DispatchPattern=pull_2.Distance)  # -> ListA, ListB
pull_3 = PullPoint(Point=duppt, Geometry=cir_7, ClosestOnly=True)  # -> ClosestPoint, Distance
pdecon_3 = Deconstruct(Point=midpt_6)  # -> XComponent, YComponent, ZComponent
data_2 = Data([data, mirror_6.Geometry, merge_8])
pt_14 = Point(dispatch_3.ListB)
pull_4 = PullPoint(Point=duppt_2, Geometry=cir_9, ClosestOnly=True)  # -> ClosestPoint, Distance
pull_5 = PullPoint(Point=duppt_3, Geometry=cir_8, ClosestOnly=True)  # -> ClosestPoint, Distance
alongcrv_4 = SortAlongCurve(Points=pull_4.ClosestPoint, Curve=cir_9)  # -> Points, Indices
alongcrv_5 = SortAlongCurve(Points=pull_5.ClosestPoint, Curve=cir_8)  # -> Points, Indices
sort = SortList(Keys=pdecon_3.YComponent, ValuesA=bang.Branch2, ValuesB=midpt_6)  # -> reverse(Keys), reverse(ValuesA), reverse(ValuesB)
ln_28 = Line(StartPoint=duppt, EndPoint=pull_3.ClosestPoint)
brec_2 = BoundingRectangle(Geometry=flatten(data_2), Plane=PlaneXY(0, 0, 0), Axis=0, Slide=0, Union=True)  # -> Bounding, DimensionX, DimensionY
pull_6 = PullPoint(Point=pt_14, Geometry=join_3, ClosestOnly=True)  # -> ClosestPoint, Distance
ln_29 = Line(StartPoint=duppt_2, EndPoint=pull_4.ClosestPoint)
ln_30 = Line(StartPoint=duppt_3, EndPoint=pull_5.ClosestPoint)
pline_7 = PolyLine(Vertices=alongcrv_4.Points, Closed=invert(False))
pline_8 = PolyLine(Vertices=alongcrv_5.Points, Closed=invert(False))
item_10 = ListItem(List=ln_28, Index=0, Wrap=True)  # -> Item, Item1
dispatch_4 = Dispatch(List=pt_14, DispatchPattern=pull_6.Distance)  # -> ListA, ListB
area_9 = Area(Geometry=brec_2.Bounding)  # -> Area, Centroid
item_11 = ListItem(List=sort.ValuesA, Index=0, Wrap=True)
item_12 = ListItem(List=sort.ValuesB, Index=0, Wrap=True)
pt_15 = Point(crv_cp_2.Point)
crv_14 = Curve(flatten([pline_7, ln_29, bang.Branch1]))
scale_2 = Scale(Geometry=data_2, Center=area_9.Centroid, Factor="1.26")  # -> Geometry, Transform
pt_16 = Point(dispatch_4.ListB)
crv_15 = Curve(flatten([pline_8, ln_30, bang.Branch0]))
pt_17 = Point(dispatch_4.ListA)
midpt_7 = CurveMiddle(Curve=item_10.Item1)
previewlw_3 = CustomPreviewLineweights(
    Geometry=scale_2.Geometry,
    Shader=ColourSwatch(SwatchColor=RGB(0, 0, 0)),
    Thickness=Slider(2, range=0..10),
    Absolute=False)
ln_31 = Line(StartPoint=pt_16, EndPoint=pt_15)
explode_7 = Explode(Curve=crv_14, Recursive=True)  # -> flatten(Segments), Vertices
explode_8 = Explode(Curve=crv_15, Recursive=True)  # -> flatten(Segments), Vertices
midpt_8 = CurveMiddle(Curve=ln_31)  # disabled
wbweave = WeaverbirdsMeshFromLinesWeaveBack(Lines=explode_7.Segments, MaximumValence=4)
wbweave_2 = WeaverbirdsMeshFromLinesWeaveBack(Lines=explode_8.Segments, MaximumValence=4)
ln_32 = Line(StartPoint=pt_15, EndPoint=midpt_7)
ln_33 = Line(StartPoint=midpt_8, EndPoint=item_12)
merge_11 = Merge(Data1=pt_16, Data2=midpt_8, Data3=pt_15)
pull_7 = PullPoint(Point=merge_11, Geometry=cir_7, ClosestOnly=True)  # -> ClosestPoint, Distance
merge_12 = Merge(Data1=pull_7.ClosestPoint, Data2=pull_3.ClosestPoint)  # -> flatten(Result)
alongcrv_6 = SortAlongCurve(Points=merge_12, Curve=cir_7)  # -> Points, Indices
pline_9 = PolyLine(Vertices=alongcrv_6.Points, Closed=False)
ln_34 = Line(StartPoint=merge_11, EndPoint=pull_7.ClosestPoint)  # -> flatten(Line)
merge_13 = Merge(Data1=ln_31, Data2=ln_32, Data3=ln_33, Data4=join, Data5=ln_34, Data6=ln_28, Data7=pline_9)  # -> flatten(Result)
mcx_2 = MultipleCurves(Curves=reparameterize(merge_13))  # -> Points, IndexA, IndexB, ParamA, ParamB
clone_3 = CloneStructure(List=mcx_2.ParamA, Structure=mcx_2.IndexA)
clone_4 = CloneStructure(List=mcx_2.ParamB, Structure=mcx_2.IndexB)
shatter_4 = Shatter(Curve=reparameterize(graft(merge_13)), Parameters=[clone_3, clone_4])  # -> flatten(Segments)
wbweave_3 = WeaverbirdsMeshFromLinesWeaveBack(Lines=shatter_4, MaximumValence=4)
mirror_7 = Mirror(Geometry=wbweave_3, Plane=xz_5)  # -> Geometry, Transform
merge_14 = Merge(Data1=wbweave_2, Data2=wbweave)
mjoin_2 = MeshJoin(Meshes=[mirror_7.Geometry, wbweave_3])
mirror_8 = Mirror(Geometry=merge_14, Plane=xz_5)  # -> Geometry, Transform
mesh_2 = Mesh([merge_14, mirror_8.Geometry, mjoin_2])
brec_3 = BoundingRectangle(Geometry=mesh_2, Plane=PlaneXY(0, 0, 0), Axis=0, Slide=0, Union=True)  # -> Bounding, DimensionX, DimensionY
area_10 = Area(Geometry=brec_3.Bounding)  # -> Area, Centroid
scale_3 = Scale(Geometry=mesh_2, Center=area_10.Centroid, Factor=Slider(1.26, range=0..10))  # -> Geometry, Transform
wbcatmullclark = WeaverbirdsCatmullClarkSubdivision(MeshCurves=scale_3.Geometry, Level=Slider(1, range=0..10), SmoothNakedEdges=Slider(0, range=0..2))
wbcatmullclark_2 = WeaverbirdsCatmullClarkSubdivision(MeshCurves=scale_3.Geometry, Level=Slider(1, range=0..10), SmoothNakedEdges=Slider(0, range=0..2))
wbcatmullclark_3 = WeaverbirdsCatmullClarkSubdivision(MeshCurves=wbcatmullclark, Level=Slider(1, range=0..10), SmoothNakedEdges=1)
medges = MeshEdges(Mesh=scale_3.Geometry)  # -> NakedEdges, InteriorEdges, NonManifoldEdges
wbcatmullclark_4 = WeaverbirdsCatmullClarkSubdivision(MeshCurves=wbcatmullclark_2, Level=Slider(1, range=0..10), SmoothNakedEdges=1)  # -> simplify(OutputMeshCurves)
explode_9 = MeshExplode(Mesh=wbcatmullclark_4, Interpolate=False)
wbcatmullclark_5 = WeaverbirdsCatmullClarkSubdivision(MeshCurves=wbcatmullclark_2, Level=number_slider_25, SmoothNakedEdges=1)  # -> simplify(OutputMeshCurves); disabled
demesh = DeconstructMesh(Mesh=explode_9)  # -> Vertices, Faces, Colours, Normals
previewlw_4 = CustomPreviewLineweights(Geometry=medges.NakedEdges, Shader=swatch_3, Thickness=Slider(2, range=0..10), Absolute=False)
previewlw_5 = CustomPreviewLineweights(Geometry=medges.InteriorEdges, Shader=swatch_3, Thickness=Slider(1, range=0..10), Absolute=False)
item_13 = ListItem(List=demesh.Vertices, Index=0, Wrap=True)  # -> Item, Item1, Item2, Item3
medges_2 = MeshEdges(Mesh=wbcatmullclark_4)  # -> NakedEdges, InteriorEdges, NonManifoldEdges
wbnaked = WeaverbirdsNakedBoundary(MeshClosedPolylines=wbcatmullclark_3)
len = Length(Curve=wbnaked)
wbnaked_2 = WeaverbirdsNakedBoundary(MeshClosedPolylines=wbcatmullclark_4)  # -> simplify(NakedCurves)
ln_35 = Line(StartPoint=item_13.Item, EndPoint=item_13.Item2)  # -> simplify(Line)
ln_36 = Line(StartPoint=item_13.Item1, EndPoint=item_13.Item3)  # -> simplify(Line)
sort_2 = SortList(Keys=len, ValuesA=wbnaked)  # -> Keys, ValuesA
previewlw_6 = CustomPreviewLineweights(Geometry=medges_2.NakedEdges, Shader=swatch_4, Thickness=Slider(2, range=0..10), Absolute=False)
previewlw_7 = CustomPreviewLineweights(Geometry=medges_2.InteriorEdges, Shader=swatch_4, Thickness=Slider(1, range=0..10), Absolute=False)
shift = ShiftPaths(Data=ln_36, Offset=-1)
shift_2 = ShiftPaths(Data=ln_35, Offset=-1)
explode_10 = Explode(Curve=sort_2.ValuesA, Recursive=True)  # -> Segments, Vertices
explode_11 = Explode(Curve=[wbnaked_2, shift_2, shift], Recursive=True)  # -> Segments, Vertices
shift_3 = ShiftPaths(Data=explode_10.Vertices, Offset=-1)
duppt_4 = RemoveDuplicatePts(Points=explode_10.Vertices, Tolerance=0.01)
dupln = RemoveDuplicateLines(Lines=explode_11.Segments, Tolerance=0.01)
pt_18 = Point(duppt_4)
end_4 = EndPoints(Curve=dupln)  # -> Start, End
cluster_2 = Cluster_2(M=wbcatmullclark_3, mesh=wbcatmullclark_3, pt=pt_18)  # -> mesh_5, G
ln_37 = Line(StartPoint=end_4.Start, EndPoint=end_4.End)  # -> flatten(Line)
mcx_3 = MultipleCurves(Curves=reparameterize(ln_37))  # -> Points, IndexA, IndexB, ParamA, ParamB
clone_5 = CloneStructure(List=mcx_3.ParamB, Structure=mcx_3.IndexB)
clone_6 = CloneStructure(List=mcx_3.ParamA, Structure=mcx_3.IndexA)
mjoin_3 = MeshJoin(Meshes=flatten(cluster_2.mesh_5))
mjoin_4 = MeshJoin(Meshes=cluster_2.mesh_5)
shatter_5 = Shatter(Curve=reparameterize(graft(ln_37)), Parameters=[clone_6, clone_5])  # -> flatten(Segments)
unim = UnifyMesh(Mesh=mjoin_4)  # -> Result, Count
clean = CombineClean(Meshes=unim.Result)  # disabled
md = MeshDirection(Mesh=clean)  # disabled
warpweft = WarpWeft(Mesh=md)  # -> Warp, Weft, NakedA, NakedB; disabled
midpt_9 = CurveMiddle(Curve=shatter_5)
mesh_3 = Mesh(wbcatmullclark_4)
wbnaked_3 = WeaverbirdsNakedBoundary(MeshClosedPolylines=mesh_3)
len_2 = Length(Curve=wbnaked_3)
crv_16 = Curve(warpweft.Weft)  # disabled
sort_3 = SortList(Keys=len_2, ValuesA=wbnaked_3)  # -> Keys, ValuesA
pull_8 = PullPoint(Point=midpt_9, Geometry=mesh_3, ClosestOnly=True)  # -> ClosestPoint, Distance
explode_12 = Explode(Curve=sort_3.ValuesA, Recursive=True)  # -> Segments, Vertices
shift_4 = ShiftPaths(Data=explode_12.Vertices, Offset=-1)
dispatch_5 = Dispatch(List=shatter_5, DispatchPattern=pull_8.Distance)  # -> ListA, ListB
duppt_5 = RemoveDuplicatePts(Points=explode_12.Vertices, Tolerance=0.01)
crv_17 = Curve(dispatch_5.ListB)
dupln_2 = RemoveDuplicateLines(Lines=crv_17, Tolerance=0.01)
pt_19 = Point(duppt_5)
wbweave_4 = WeaverbirdsMeshFromLinesWeaveBack(Lines=dupln_2, MaximumValence=4)
medges_3 = MeshEdges(Mesh=wbweave_4)  # -> NakedEdges, InteriorEdges, NonManifoldEdges
cluster_3 = Cluster_2(M=wbweave_4, mesh=mesh_3, pt=pt_19)  # -> mesh_5, G
previewlw_8 = CustomPreviewLineweights(Geometry=medges_3.NakedEdges, Shader=swatch_5, Thickness=Slider(2, range=0..10), Absolute=False)
previewlw_9 = CustomPreviewLineweights(Geometry=medges_3.InteriorEdges, Shader=swatch_5, Thickness=Slider(1, range=0..10), Absolute=False)
mesh_4 = Mesh(cluster_2.mesh_5)  # disabled
mjoin_5 = MeshJoin(Meshes=cluster_3.mesh_5)
demesh_2 = DeconstructMesh(Mesh=mesh_4)  # -> Vertices, Faces, Colours, Normals; disabled
unim_2 = UnifyMesh(Mesh=mjoin_5)  # -> Result, Count
pdecon_4 = Deconstruct(Point=demesh_2.Vertices)  # -> XComponent, YComponent, ZComponent; disabled
mesh_5 = Mesh(unim_2.Result)
mesh_6 = Mesh(unim_2.Result)
demesh_3 = DeconstructMesh(Mesh=mesh_6)  # -> Vertices, Faces, Colours, Normals
wbcatmullclark_6 = WeaverbirdsCatmullClarkSubdivision(MeshCurves=cluster_3.mesh_5, Level=Slider(0, range=0..10), SmoothNakedEdges=1)
pdecon_5 = Deconstruct(Point=demesh_3.Vertices)  # -> XComponent, YComponent, ZComponent
item_14 = ListItem(List=cluster_3.mesh_5, Index=Slider(4, range=0..4), Wrap=True)
demesh_4 = DeconstructMesh(Mesh=mesh_5)  # -> Vertices, Faces, Colours, Normals
bnd = Bounds(Numbers=pdecon_4.ZComponent)  # disabled
bnd_2 = Bounds(Numbers=pdecon_5.ZComponent)
mesh_7 = Mesh(unim_2.Result)
unim_3 = UnifyMesh(Mesh=item_14)  # -> Result, Count
remap_9 = RemapNumbers(Value=pdecon_4.ZComponent, Source=bnd, Target=dom_9)  # -> Mapped, Clipped; disabled
neg_2 = Negative(Value=remap_9.Mapped)  # disabled
remap_10 = RemapNumbers(Value=pdecon_5.ZComponent, Source=bnd_2, Target=dom_10)  # -> Mapped, Clipped
vdis = VectorDisplay(Anchor=demesh_4.Vertices, Vector=demesh_4.Normals)
pt_20 = Point(flatten(cluster_3.G))
mesh_8 = Mesh(unim_3.Result)
demesh_5 = DeconstructMesh(Mesh=mesh_8)  # -> Vertices, Faces, Colours, Normals
pdecon_6 = Deconstruct(Point=demesh_5.Vertices)  # -> XComponent, YComponent, ZComponent
neg_3 = Negative(Value=remap_10.Mapped)
amp = Amplitude(Vector=demesh_2.Normals, Amplitude=neg_2)  # disabled
bnd_3 = Bounds(Numbers=pdecon_6.ZComponent)
amp_2 = Amplitude(Vector=demesh_3.Normals, Amplitude=remap_10.Mapped)
move_2 = Move(Geometry=demesh_2.Vertices, Motion=amp)  # -> Geometry, Transform; disabled
remap_11 = RemapNumbers(Value=pdecon_6.ZComponent, Source=bnd_3, Target=dom_11)  # -> Mapped, Clipped
move_3 = Move(Geometry=demesh_3.Vertices, Motion=amp_2)  # -> Geometry, Transform
neg_4 = Negative(Value=remap_11.Mapped)
conmesh = ConstructMesh(Vertices=move_2.Geometry, Faces=demesh_2.Faces)  # disabled
amp_3 = Amplitude(Vector=demesh_5.Normals, Amplitude=remap_11.Mapped)
conmesh_2 = ConstructMesh(Vertices=move_3.Geometry, Faces=demesh_3.Faces)
move_4 = Move(Geometry=demesh_5.Vertices, Motion=amp_3)  # -> Geometry, Transform
mesh_9 = Mesh(conmesh)  # disabled
mesh_10 = Mesh(mesh_4)  # disabled
mesh_11 = Mesh(conmesh_2)
mesh_12 = Mesh(mesh_6)
conmesh_3 = ConstructMesh(Vertices=move_4.Geometry, Faces=demesh_5.Faces)

# ---- group: Define Loads
Z_4 = UnitZ(Factor="-11")
loads = LoadsKaramba3D(Vector=Z_4, Mesh=mesh_7, LCase="0", mode="MeshLoad -Const.", menu=[buttons(on, off, off), buttons(on, on)])
loads_2 = LoadsKaramba3D(Vector=Z_2, LCase="0", mode="Gravity")
load = LoadKaramba3D(flatten([loads_2, loads]))

# ----
wbvertices = WeaverbirdsVerticesComponent(MeshClosedPolylinesGroup=mesh_9, Weld=True)  # disabled
wbvertices_2 = WeaverbirdsVerticesComponent(MeshClosedPolylinesGroup=mesh_10, Weld=True)  # disabled
explode_13 = MeshExplode(Mesh=mesh_9, Interpolate=False)  # disabled
tri = Triangulate(Mesh=mesh_9)  # -> Mesh, Count; disabled
tri_2 = Triangulate(Mesh=mesh_10)  # -> Mesh, Count; disabled
explode_14 = MeshExplode(Mesh=mesh_11, Interpolate=False)
mesh_13 = Mesh(conmesh_3)
pt_21 = Point(pt_20)
tri_3 = Triangulate(Mesh=mesh_11)  # -> Mesh, Count
tri_4 = Triangulate(Mesh=mesh_12)  # -> Mesh, Count
ln_38 = Line(StartPoint=wbvertices_2, EndPoint=wbvertices)  # disabled
wbedges = WeaverbirdsMeshEdges(MeshOrPolylines=mesh_10)  # disabled
wbedges_2 = WeaverbirdsMeshEdges(MeshOrPolylines=mesh_9)  # disabled
demesh_6 = DeconstructMesh(Mesh=explode_13)  # -> Vertices, Faces, Colours, Normals; disabled
ln_39 = Line(StartPoint=demesh_3.Vertices, EndPoint=move_3.Geometry)
demesh_7 = DeconstructMesh(Mesh=explode_14)  # -> Vertices, Faces, Colours, Normals
wbedges_3 = WeaverbirdsMeshEdges(MeshOrPolylines=tri.Mesh)  # disabled
wbedges_4 = WeaverbirdsMeshEdges(MeshOrPolylines=tri_2.Mesh)  # disabled
wbedges_5 = WeaverbirdsMeshEdges(MeshOrPolylines=tri_3.Mesh)
lng = ListLength(List=demesh_6.Vertices)  # disabled
wbedges_6 = WeaverbirdsMeshEdges(MeshOrPolylines=tri_4.Mesh)
explode_15 = MeshExplode(Mesh=mesh_8, Interpolate=False)  # -> simplify(graft(Faces))
lng_2 = ListLength(List=demesh_7.Vertices)

# ---- group: Define Elements
meshtoshell = MeshToShellKaramba3D(Mesh=mesh_7, Identifier="S", CrossSection=crosecselect.CrossSection, LimitDistance_m=0.005)  # -> Element, Points, Info

# ---- group: Define Supports
fsim = FindSimilarMember(Data=pt_21, Set=meshtoshell.Points)  # -> Hit, Index
supp = SupportKaramba3D(PosInd=fsim.Hit, menu=[buttons(on, on, on, off, off, off)])

# ----
equals = Equality(FirstNumber=lng, SecondNumber=panel_5)  # -> Equality, Inequality; disabled
explode_16 = MeshExplode(Mesh=mesh_13, Interpolate=False)  # -> simplify(graft(Faces))
equals_2 = Equality(FirstNumber=lng_2, SecondNumber="3")  # -> Equality, Inequality
sift = SiftPattern(List=demesh_6.Vertices, SiftPattern=equals.Equality)  # -> Output0, Output1; disabled
demesh_8 = DeconstructMesh(Mesh=explode_16)  # -> Vertices, Faces, Colours, Normals
demesh_9 = DeconstructMesh(Mesh=explode_15)  # -> Vertices, Faces, Colours, Normals
line_4 = Line(flatten([ln_38, wbedges_4, wbedges_3]))  # disabled
sift_2 = SiftPattern(List=demesh_7.Vertices, SiftPattern=equals_2.Equality)  # -> Output0, Output1
line_5 = Line(flatten([ln_39, wbedges_6, wbedges_5]))
item_15 = ListItem(List=sift.Output0, Index=0, Wrap=True)  # -> Item, Item1, Item2, Item3; disabled
pt_22 = Point(sift.Output0)  # disabled
lng_3 = ListLength(List=demesh_8.Vertices)
lng_4 = ListLength(List=demesh_9.Vertices)
end_5 = EndPoints(Curve=line_5)  # -> Start, End
pipe_2 = Pipe(Curve=line_4, Radius=panel_6, Caps=0)  # disabled
item_16 = ListItem(List=sift_2.Output0, Index=0, Wrap=True)  # -> Item, Item1, Item2, Item3
pt_23 = Point(sift_2.Output0)
pipe_3 = Pipe(Curve=line_5, Radius="0.008", Caps=0)
len_3 = Length(Curve=line_5)
equals_3 = Equality(FirstNumber=lng_3, SecondNumber="3")  # -> Equality, Inequality
equals_4 = Equality(FirstNumber=lng_4, SecondNumber="3")  # -> Equality, Inequality
duppt_6 = RemoveDuplicatePts(Points=[end_5.Start, end_5.End], Tolerance=0.01)
ln_40 = Line(StartPoint=item_15.Item, EndPoint=item_15.Item2)  # disabled
ln_41 = Line(StartPoint=item_15.Item1, EndPoint=item_15.Item3)  # disabled
ln_42 = Line(StartPoint=item_16.Item, EndPoint=item_16.Item2)
ln_43 = Line(StartPoint=item_16.Item1, EndPoint=item_16.Item3)
bnd_4 = Bounds(Numbers=len_3)
group = Group(Objects=flatten(pipe_3))

# ---- group: Assemble Model
assemble = AssembleModelKaramba3D(Elem=flatten(meshtoshell.Element), Support=flatten(supp), Load=flatten(load), LimitDistance_m=0.005)  # -> Model, Info, Mass_kg, CenterOfGravity, LoadCaseNames

# ----
sift_3 = SiftPattern(List=demesh_8.Faces, SiftPattern=equals_3.Equality)  # -> Output0, Output1
sift_4 = SiftPattern(List=demesh_8.Vertices, SiftPattern=equals_3.Equality)  # -> Output0, Output1
sift_5 = SiftPattern(List=demesh_9.Vertices, SiftPattern=equals_4.Equality)  # -> Output0, Output1
sift_6 = SiftPattern(List=demesh_9.Faces, SiftPattern=equals_4.Equality)  # -> Output0, Output1
line_6 = Line([ln_40, ln_41])  # disabled
line_7 = Line([ln_42, ln_43])
len_4 = Length(Curve=line_6)  # disabled
preview_8 = CustomPreview(Geometry=group, Material=ColourSwatch(SwatchColor=RGB(255, 255, 255)))  # disabled
clean_2 = CleanTree(RemoveNulls=True, RemoveInvalid=True, RemoveEmpty=invert(False), Tree=sift_6.Output0)
clean_3 = CleanTree(RemoveNulls=True, RemoveInvalid=True, RemoveEmpty=invert(False), Tree=sift_3.Output0)
clean_4 = CleanTree(RemoveNulls=True, RemoveInvalid=True, RemoveEmpty=invert(False), Tree=sift_5.Output0)
len_5 = Length(Curve=line_7)
clean_5 = CleanTree(RemoveNulls=True, RemoveInvalid=True, RemoveEmpty=invert(False), Tree=sift_4.Output0)
sort_4 = SortList(Keys=len_4, ValuesA=line_6)  # -> Keys, ValuesA; disabled
item_17 = ListItem(List=sort_4.ValuesA, Index=0, Wrap=True)  # disabled
sort_5 = SortList(Keys=len_5, ValuesA=line_7)  # -> Keys, ValuesA
conmesh_4 = ConstructMesh(Vertices=clean_4, Faces=clean_2)
conmesh_5 = ConstructMesh(Vertices=clean_5, Faces=clean_3)
item_18 = ListItem(List=sort_5.ValuesA, Index=0, Wrap=True)

# ---- group: Optimize Cross Sections
opticrosec = OptimizeCrossSectionKaramba3D(
    Model=assemble.Model,
    CrossSections=cross_section,
    MaximumUtilization=1,
    MaximumDisplacement_cm="1",
    UltimateLimitStateIterations=5,
    DisplacementIterations=5,
    NumberOfSamplePoints=3,
    ElasticDesign=True,
    GammaM0=1,
    GammaM1=1.1,
    SwayFrame=True)  # -> ModelWithOptimizedCrossSections, Info, Mass_kg, MaximumDisplacement_cm, ElasticEnergy_kNm
panel_8 = Panel(opticrosec.MaximumDisplacement_cm)

# ----
line_8 = Line(item_17)  # disabled

# ---- group: Analyze Model - FREE VERSION
analyzethii = AnalyzeThIIKaramba3D(Model=assemble.Model, RTolerance=1e-07, MaxIterations=50, NoTensionalNII=False)  # -> CalculatedModel, MaximumDisplacement_cm, ResultingForceOfGravity_kN, ElasticEnergy_kNm
panel_9 = Panel(analyzethii.MaximumDisplacement_cm)

# ----
line_9 = Line(item_18)
pipe_4 = Pipe(Curve=line_5, Radius="0.008", Caps=0)
item_19 = ListItem(List=sift_4.Output0, Index=0, Wrap=True)  # -> Item, Item1, Item2, Item3; disabled
pt_24 = Point(sift_4.Output0)  # disabled
item_20 = ListItem(List=sift_5.Output0, Index=0, Wrap=True)  # -> Item, Item1, Item2, Item3; disabled
pt_25 = Point(sift_5.Output0)  # disabled
group_2 = Group(Objects=flatten(pipe_4))
panel_10 = Panel(opticrosec.Mass_kg)
tbox2mshs = TwistedBoxTwoMeshes(MeshA=conmesh_4, MeshB=conmesh_5, ParametersW=panel_7)
ln_44 = Line(StartPoint=item_19.Item, EndPoint=item_19.Item1)  # disabled
ln_45 = Line(StartPoint=item_19.Item3, EndPoint=item_19.Item2)  # disabled
ln_46 = Line(StartPoint=item_20.Item3, EndPoint=item_20.Item2)  # disabled
ln_47 = Line(StartPoint=item_20.Item, EndPoint=item_20.Item1)  # disabled
preview_9 = CustomPreview(Geometry=group_2, Material=ColourSwatch(SwatchColor=RGB(255, 255, 255)))  # disabled

# ---- group: View Results
modelview = ModelViewKaramba3D(Model=opticrosec.ModelWithOptimizedCrossSections, ResultFactors=1, ResultCase=-1)  # -> Model, DeformedMesh, DeformedAxes, DeformedModel
shellview = ShellViewKaramba3D(Model=modelview.Model, IndexOfLayer=0)  # -> Model, MeshesOfRenderedShells, LegendColors, LegendTags
legend = Legend(Colour=shellview.LegendColors, Tags=shellview.LegendTags, LegendType=1)

# ----
rulesrf = RuledSurface(CurveA=ln_44, CurveB=ln_45)  # -> simplify(Surface); disabled
rulesrf_2 = RuledSurface(CurveA=ln_47, CurveB=ln_46)  # -> simplify(Surface); disabled
wbedges_7 = WeaverbirdsMeshEdges(MeshOrPolylines=mesh_13)
wbedges_8 = WeaverbirdsMeshEdges(MeshOrPolylines=mesh_8)
morph = BoxMorph(Geometry=filter, Reference=tbox, Target=tbox2mshs)
crv_18 = Curve(flatten([morph, wbedges_8, wbedges_7]))
pipe_5 = Pipe(Curve=crv_18, Radius="0.008", Caps=0)
edges_2 = BrepEdges(Brep=pipe_5)  # -> Naked, Interior, NonManifold
preview_10 = CustomPreview(Geometry=pipe_5, Material=ColourSwatch(SwatchColor=RGB(219, 219, 219)))
previewlw_10 = CustomPreviewLineweights(Geometry=[edges_2.Naked, edges_2.Interior], Shader=ColourSwatch(SwatchColor=RGB(0, 0, 0)), Absolute=False)

# ==== cluster Cluster
M = ClusterInput()
unim = UnifyMesh(Mesh=M)  # -> Result, Count
medges = MeshEdges(Mesh=unim.Result)  # -> NakedEdges, InteriorEdges, NonManifoldEdges
nv = NakedVertices(Mesh=unim.Result)  # -> ClothedIndex, NakedIndex, ClothedPts, NakedPts
join = JoinCurves(Curves=medges.NakedEdges, Preserve=False)
len = Length(Curve=join)
sort = SortList(Keys=len, ValuesA=join)  # -> Keys, ValuesA
cull_i = CullIndex(List=sort.ValuesA, Indices="-1", Wrap=True)

# ---- group: Pressure
# Pressure
facen = FaceNormals(Mesh=unim.Result)  # -> Centers, Normals
item = ListItem(List=facen.Normals, Index=0, Wrap=True)
number_slider = Slider(0.6274, range=0..1)
devec = DeconstructVector(Vector=item)  # -> XComponent, YComponent, ZComponent
larger = LargerThan(FirstNumber=devec.ZComponent, SecondNumber=Slider(0, range=0..100))  # -> LargerThan, OrEqualTo
neg = Negative(Value=number_slider)
filter = StreamFilter(Gate=larger.LargerThan, Stream0=neg, Stream1=number_slider)

# ----
crv_cp = CurveClosestPoint(Point=nv.NakedPts, Curve=graft(cull_i))  # -> Point, Parameter, Distance
B = ClusterInput()
lng = ListLength(List=cull_i)
int = Integer(crv_cp.Distance)
# Column Height
dom = ConstructDomain(DomainStart=Slider(0, range=0..10), DomainEnd=B)
bool = Boolean(int)
cull = CullPattern(List=nv.NakedPts, CullPattern=invert(bool))

# ---- group: Column Height
random = Random(Range=dom, Number=lng, Seed=2)
Z = UnitZ(Factor=random)  # -> graft(UnitVector)
move = Move(Geometry=cull, Motion=Z)  # -> Geometry, Transform

# ----
branch = TreeBranch(Tree=cull, Path="{0;0;0;0;1}", MaintainPaths=True)
remap = RemapNumbers(Value=Slider(178, range=0..300), Source=Slider(300, range=0..1000), Target=Slider(10, range=0..10))  # -> Mapped, Clipped
pt = Point(flatten(cull))
pt_2 = ConstructPoint(XCoordinate=0, YCoordinate=0, ZCoordinate=0)
index = ItemIndex(List=nv.NakedPts, Item=pt)
pt_3 = Point(pt)
pt_4 = Point(flatten(move.Geometry))
line = LineSDL(Start=pt_2, Direction=Vector(0, 0, 1), Length=1)
number_slider_2 = Slider(1, range=0..1)
number_slider_3 = Slider(0, range=0..10)
cull_i_2 = CullIndex(List=nv.NakedPts, Indices=index, Wrap=True)

# ---- group: Boundary
# Anchoring Boundary Curve
item_2 = ListItem(List=sort.ValuesA, Index="-1", Wrap=True)
Z_2 = UnitZ(Factor=Slider(3, range=0..10))
move_2 = Move(Geometry=item_2, Motion=Z_2)  # -> Geometry, Transform
crv_cp_2 = CurveClosestPoint(Point=cull_i_2, Curve=move_2.Geometry)  # -> Point, Parameter, Distance

# ----
lng_2 = ListLength(List=cull_i_2)
pt_5 = Point(crv_cp_2.Point)
divide = DivideCurve(Curve=line, Count=lng_2, Kinks=False)  # -> Points, Tangents, Parameters
pt_6 = Point(cull_i_2)
perlin = PerlinNoise(Values=divide.Points, Time=remap.Mapped, Scale=Slider(2, range=0..100))
neg_2 = Negative(Value=number_slider_3)
bnd = Bounds(Numbers=perlin)
dom_2 = ConstructDomain(DomainStart=neg_2, DomainEnd=number_slider_3)
remap_2 = RemapNumbers(Value=perlin, Source=bnd, Target=dom_2)  # -> Mapped, Clipped
Z_3 = UnitZ(Factor=remap_2.Mapped)
move_3 = Move(Geometry=crv_cp_2.Point, Motion=Z_3)  # -> Geometry, Transform

# ---- group: Goals
edgelengths = EdgeLengths(Mesh=unim.Result, LengthFactor="0", Strength=1)
pressure = Pressure(M=unim.Result, Strength=filter)
anchor = Anchor(Point=pt, Target=pt_4, Strength=10000)
show = Show(G=unim.Result)
anchor_2 = Anchor(Point=cull_i_2, Target=move_3.Geometry, Strength=10000)

# ----
entwine = Entwine(Branch00=show, Branch01=[edgelengths, anchor_2, anchor, pressure], FlattenInputs=True)
graph = QuickGraph(perlin, SortOrder=0)
zombiesolver = ZombieSolver(GoalObjects=entwine, Threshold=1e-10, Tolerance=0.0001, MaxIterations=50000)  # -> I, V, O
unflatten = UnflattenTree(Tree=zombiesolver.O, Guide=entwine)
bang = ExplodeTree(Data=unflatten)  # -> Branch0, Branch1
neg_3 = Negative(Value=Slider(0.34, range=0..1))
mesh = Mesh(bang.Branch0)
mesh_2 = ClusterOutput(mesh)
wboffset = WeaverbirdsOffsetMesh(MeshCurves=mesh, Distance=neg_3, OffsetType=0)
explode = MeshExplode(Mesh=wboffset, Interpolate=False)
explode_2 = MeshExplode(Mesh=mesh, Interpolate=False)
move_4 = Move(Geometry=cull_i, Motion=flatten(Z))  # -> Geometry, Transform; disabled
crv = Curve(move_2.Geometry)  # disabled
mesh_3 = Mesh(move_4.Geometry)  # disabled
mesh_4 = Mesh(crv)  # disabled
demesh = DeconstructMesh(Mesh=explode)  # -> Vertices, Faces, Colours, Normals
demesh_2 = DeconstructMesh(Mesh=explode_2)  # -> Vertices, Faces, Colours, Normals
number_slider_4 = Slider(0.01, range=0..0.01)  # disabled
faceb = FaceBoundaries(Mesh=[explode, explode_2])
item_3 = ListItem(List=demesh_2.Vertices, Index=0, Wrap=True)  # -> Item, Item1, Item2, Item3
item_4 = ListItem(List=demesh.Vertices, Index=0, Wrap=True)  # -> Item, Item1, Item2, Item3
pipe = Pipe(Radius=number_slider_4, Caps=0)  # disabled
clean = CombineClean(Meshes=flatten([mesh_4, mesh_3]))  # disabled
ln = Line(StartPoint=item_4.Item, EndPoint=item_3.Item2)
ln_2 = Line(StartPoint=demesh.Vertices, EndPoint=demesh_2.Vertices)
crv_2 = Curve([ln, faceb, ln_2])
explode_3 = Explode(Curve=crv_2, Recursive=True)  # -> flatten(Segments), Vertices
dupln = RemoveDuplicateLines(Lines=explode_3.Segments, Tolerance=0.01)
pipe_2 = Pipe(Curve=dupln, Radius="0.01", Caps=0)
len_2 = Length(Curve=dupln)
P = ClusterOutput(pipe_2)
bnd_2 = Bounds(Numbers=len_2)
ma = MassAddition(Input=len_2)  # -> Result, PartialResults
panel = Panel(ma.Result)

# ==== cluster Cluster_2
pt = ClusterInput()
mesh = ClusterInput()
M = ClusterInput()
pt_2 = Point(simplify(pt))
unim = UnifyMesh(Mesh=M)  # -> Result, Count
mesh_2 = Mesh(mesh)
tstat = TreeStatistics(Tree=pt_2)  # -> Paths, Length, Count
panel = Panel("""0
1""")
unweave = Unweave(List=tstat.Paths, UnweavePattern=panel)  # -> Data0, Data1
medges = MeshEdges(Mesh=mesh_2)  # -> NakedEdges, InteriorEdges, NonManifoldEdges
branch = TreeBranch(Tree=pt_2, Path=unweave.Data0, MaintainPaths=True)
branch_2 = TreeBranch(Tree=pt_2, Path=unweave.Data1, MaintainPaths=True)
avr = Average(Input=branch)
pt_3 = Point([branch, branch_2])
join = JoinCurves(Curves=medges.NakedEdges, Preserve=False)
pdecon = Deconstruct(Point=avr)  # -> XComponent, YComponent, ZComponent
shift = ShiftPaths(Data=pt_3, Offset=-1)
len = Length(Curve=join)
panel_2 = Panel(pdecon.XComponent)
sort = SortList(Keys=len, ValuesA=join)  # -> Keys, ValuesA

# ---- group: Pressure
# Pressure
facen = FaceNormals(Mesh=unim.Result)  # -> Centers, Normals
item = ListItem(List=facen.Normals, Index=0, Wrap=True)
number_slider = Slider(0.0625, range=0..1)
devec = DeconstructVector(Vector=item)  # -> XComponent, YComponent, ZComponent
larger = LargerThan(FirstNumber=devec.ZComponent, SecondNumber=Slider(0, range=0..100))  # -> LargerThan, OrEqualTo
neg = Negative(Value=number_slider)
filter = StreamFilter(Gate=larger.LargerThan, Stream0=neg, Stream1=number_slider)

# ----
cull_i = CullIndex(List=sort.ValuesA, Indices="-1", Wrap=True)
crv_cp = CurveClosestPoint(Point=shift, Curve=graft(cull_i))  # -> Point, Parameter, Distance
lng = ListLength(List=cull_i)
int = Integer(crv_cp.Distance)
int_2 = Integer(pdecon.XComponent)
# Column Height
dom = ConstructDomain(DomainStart=Slider(1.48, range=0..10), DomainEnd=Slider(1.9, range=1.2..2.5))
bool = Boolean(int)

# ---- group: Column Height
random = Random(Range=dom, Number=lng, Seed=int_2)
Z = UnitZ(Factor=random)  # -> graft(UnitVector)
move = Move(Geometry=branch, Motion=Z)  # -> Geometry, Transform

# ----
cull = CullPattern(List=shift, CullPattern=invert(bool))
neg_2 = Negative(Value=Slider(0.8617, range=0..10))
remap = RemapNumbers(Value=Slider(178, range=0..300), Source=Slider(300, range=0..1000), Target=Slider(10, range=0..10))  # -> Mapped, Clipped
pt_4 = Point(branch)
pt_5 = ConstructPoint(XCoordinate=0, YCoordinate=0, ZCoordinate=0)
index = ItemIndex(List=shift, Item=pt_4)
pt_6 = Point(pt_4)
number_slider_2 = Slider(20000, range=0..100000)
line = LineSDL(Start=pt_5, Direction=Vector(0, 0, 1), Length=1)
number_slider_3 = Slider(1, range=0..1)
number_slider_4 = Slider(0, range=0..10)
cull_i_2 = CullIndex(List=shift, Indices=index, Wrap=True)

# ---- group: Boundary
# Anchoring Boundary Curve
item_2 = ListItem(List=sort.ValuesA, Index="-1", Wrap=True)
Z_2 = UnitZ(Factor=Slider(3, range=0..10))
move_2 = Move(Geometry=item_2, Motion=Z_2)  # -> Geometry, Transform
crv_cp_2 = CurveClosestPoint(Point=cull_i_2, Curve=move_2.Geometry)  # -> Point, Parameter, Distance

# ----
lng_2 = ListLength(List=cull_i_2)
pt_7 = Point(crv_cp_2.Point)
G = ClusterOutput(move.Geometry)
mesh_3 = Mesh(unim.Result)
divide = DivideCurve(Curve=line, Count=lng_2, Kinks=False)  # -> Points, Tangents, Parameters
pt_8 = Point(cull_i_2)
perlin = PerlinNoise(Values=divide.Points, Time=remap.Mapped, Scale=Slider(2, range=0..100))
neg_3 = Negative(Value=number_slider_4)
bnd = Bounds(Numbers=perlin)
dom_2 = ConstructDomain(DomainStart=neg_3, DomainEnd=number_slider_4)
number_slider_5 = Slider(0.5, range=0..1)
wbvertices = WeaverbirdsVerticesComponent(MeshClosedPolylinesGroup=unim.Result, Weld=True)  # -> flatten(Points)
remap_2 = RemapNumbers(Value=perlin, Source=bnd, Target=dom_2)  # -> Mapped, Clipped
Z_3 = UnitZ(Factor=remap_2.Mapped)
move_3 = Move(Geometry=crv_cp_2.Point, Motion=Z_3)  # -> Geometry, Transform
pt_9 = Point(move.Geometry)
duppt = RemoveDuplicatePts(Points=wbvertices, Tolerance=0.01)
graph = QuickGraph(perlin, SortOrder=0)

# ---- group: Goals
edgelengths = EdgeLengths(Mesh=unim.Result, LengthFactor="0", Strength=Slider(1, range=0..1))
anchor = Anchor(Point=pt_4, Target=pt_9, Strength=number_slider_2)
show = Show(G=unim.Result)
anchor_2 = Anchor(Point=cull_i_2, Target=move_3.Geometry, Strength=number_slider_2)

# ----
load = Load(Point=duppt, ForceVector=Vector(0, 0, 1), Weighting=number_slider)
entwine = Entwine(Branch00=show, Branch01=[edgelengths, anchor_2, anchor, load], FlattenInputs=True)
zombiesolver = ZombieSolver(GoalObjects=entwine, Threshold=1e-10, Tolerance=0.0001, MaxIterations=50000)  # -> I, V, O
unflatten = UnflattenTree(Tree=zombiesolver.O, Guide=entwine)
number_slider_6 = Slider(0.34, range=0..1)  # disabled
bang = ExplodeTree(Data=unflatten)  # -> Branch0, Branch1
neg_4 = Negative(Value=number_slider_6)  # disabled
mesh_4 = Mesh(bang.Branch0)
wboffset = WeaverbirdsOffsetMesh(MeshCurves=mesh_4, Distance=neg_4, OffsetType=0)  # disabled
mesh_5 = ClusterOutput(mesh_4)
explode = MeshExplode(Mesh=wboffset, Interpolate=False)  # disabled
explode_2 = MeshExplode(Mesh=mesh_4, Interpolate=False)  # disabled
move_4 = Move(Geometry=cull_i, Motion=flatten(Z))  # -> Geometry, Transform; disabled
crv = Curve(move_2.Geometry)  # disabled
mesh_6 = Mesh(move_4.Geometry)  # disabled
mesh_7 = Mesh(crv)  # disabled
demesh = DeconstructMesh(Mesh=explode)  # -> Vertices, Faces, Colours, Normals; disabled
demesh_2 = DeconstructMesh(Mesh=explode_2)  # -> Vertices, Faces, Colours, Normals; disabled
number_slider_7 = Slider(0.01, range=0..0.01)  # disabled
faceb = FaceBoundaries(Mesh=[explode, explode_2])  # disabled
item_3 = ListItem(List=demesh_2.Vertices, Index=0, Wrap=True)  # -> Item, Item1, Item2, Item3; disabled
item_4 = ListItem(List=demesh.Vertices, Index=0, Wrap=True)  # -> Item, Item1, Item2, Item3; disabled
pipe = Pipe(Radius=number_slider_7, Caps=0)  # disabled
clean = CombineClean(Meshes=flatten([mesh_7, mesh_6]))  # disabled
ln = Line(StartPoint=item_4.Item, EndPoint=item_3.Item2)  # disabled
ln_2 = Line(StartPoint=demesh.Vertices, EndPoint=demesh_2.Vertices)  # disabled
crv_2 = Curve([ln, faceb, ln_2])  # disabled
explode_3 = Explode(Curve=crv_2, Recursive=True)  # -> flatten(Segments), Vertices; disabled
dupln = RemoveDuplicateLines(Lines=explode_3.Segments, Tolerance=0.01)  # disabled
panel_3 = Panel("0.01")  # disabled
pipe_2 = Pipe(Curve=dupln, Radius=panel_3, Caps=0)  # disabled
len_2 = Length(Curve=dupln)  # disabled
bnd_2 = Bounds(Numbers=len_2)  # disabled
ma = MassAddition(Input=len_2)  # -> Result, PartialResults; disabled
panel_4 = Panel(ma.Result)  # disabled
