# Grasshopper definition T2_project_nonPlanar.gh (Grasshopper 1.0.7)
# plug-ins: NGon, treesloth01, Pufferfish, Human, Mesh Pipe, Kangaroo Components

# ---- group: folders
data_folder_name = Panel("data_vase\")
data_folder_name_2 = Panel("data_Y_shape\")

# ----
data_folder_name_3 = Panel("mesh_column")
data_folder_name_4 = Panel("testing\")
data_folder_name_5 = Panel("project_1\")

# ---- group: Select example
list = ValueList({"Vase": 0, "Y shape": 1, "test": 2, "project_1": 3, "project_2": 4}, selected="project_2")

# ----
merge = Merge(
    Data1=flatten(data_folder_name),
    Data2=flatten(data_folder_name_2),
    Data3=flatten(data_folder_name_4),
    Data4=data_folder_name_5,
    Data5=data_folder_name_3)
item = ListItem(List=merge, Index=list, Wrap=True)
pline = PolyLine(
    Vertices=[Point(17.66121922, 112.92266, 15.0966506), Point(17.89418863, 113.2266608, 5.074382212), Point(23.16663913, 117.0577216, 4.840997659), Point(33.24217304, 120.055178, 4.368732939), Point(60.44299182, 121.4255979, 4.836093497), Point(76.29125183, 123.1689863, 5.033160279)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],
    Closed=False)

py = PythonScript()  # -> path
# ---------- py: Python ----------
import sys
import os

ghComp = ghenv.Component
ghDoc = ghComp.OnPingDocument()

# the full path of the gh file
path = ghDoc.FilePath
# the current directory 
path = os.path.abspath(os.path.join(path, ".."))

print path
# ---------- end py ----------

# ---- group: Folder name
data = Data(item)

# ----
load_mesh = GhPythonScript(recompute=Button(), path=py, folder=data, filename="mesh.obj")  # -> out, mesh
# ---------- load_mesh: Python ----------
__author__ = "ioanna"

import os
import Rhino.Geometry as rg
import rhinoscriptsyntax as rs
from compas.datastructures import Mesh
from compas_ghpython.artists import MeshArtist
from compas.geometry import Frame
from compas_ghpython.utilities import list_to_ghtree


vertices = []
faces = []

for line in open(os.path.join(path, folder, filename), "r"):
    if line.startswith('#'): 
        continue
    values = line.split()
    if not values: 
        continue
        
    if values[0] == 'v':
        v = map(float, values[1:4])
        vertices.append(v)
    elif values[0] == 'f':
        face = []
        for v in values[1:]:
            w = v.split('/')
            face.append(int(w[0]))
        faces.append(face)
        
print('Vertices : ', len(vertices))    
print('Faces : ', len(faces))


mesh = rg.Mesh()

for v in vertices:
    mesh.Vertices.Add(v[0], v[1], v[2]);
for i, f in enumerate(faces):
    mesh.Faces.AddFace(f[0]-1, f[1]-1, f[2]-1);
    



#mesh = Mesh.from_vertices_and_faces(vertices, faces)
#mesh = Mesh.from_obj(os.path.join(path, folder, 'output', filename))


#print (len(list(mesh.vertices())))
#artist = MeshArtist(mesh)
#mesh = artist.draw()
# ---------- end load_mesh ----------

# ---- group: Input mesh
mesh = Mesh(load_mesh.mesh)

# ----
mpipe = MeshPipe(Curve=pline, Radius=Slider(3.5, range=0..10), Accuracy=0.2, Rotation=0, Segments=10, Caps=2)
panel = Panel(py)
srf = Surface(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)
clean = CombineClean(Meshes=mpipe)
mesh_2 = MeshBrep(
    Brep=srf,
    Settings={GridMaxCount=0, GridMinCount=16, JaggedSeams=False, MaxEdgeLength=0, MinEdgeLength=0.0001, MinTolerance=0, Refine=True, RefineAngle=0, RelativeTolerance=0.65, SimplePlanes=True, Tolerance=0})
preview = CustomPreview(Geometry=clean, Material=ColourSwatch(SwatchColor=RGB(255, 255, 255)))
remesh = Remesh(Mesh=mesh_2, FixEdges=True, EdgeLength=Slider(5, range=0..10), Iterations=Slider(100, range=0..100), Project=True)
mesh_3 = Mesh(mesh)

# ----
# Output
# Load Slicer
button = Button()
panel_2 = Panel("curved_slicer.json")
csfindfilenames = CsFindFilenames(recompute=button, starts_with="curved_slicer", ends_with=".json", path=py, folder_name=data)  # -> out, filenames, n; inputs recompute: Boolean
# ---------- csfindfilenames: Python ----------
"""
Finds all the filenames from the output directory that have the specified name. 

"""

import compas_slicer_ghpython.visualization as gh_compas_slicer
gh_compas_slicer = reload(gh_compas_slicer)
import os

if starts_with and ends_with and path and folder_name:
    filenames = gh_compas_slicer.get_files_with_name(starts_with, ends_with, os.path.join(path, folder_name, 'output'))
    n = len(filenames)
else:
    gh_compas_slicer.missing_input()
# ---------- end csfindfilenames ----------
csloadslicer = CsLoadSlicer(recompute=button, json_name=csfindfilenames.filenames, path=py, folder_name=data)  # -> out, mesh, paths, are_closed, all_points; inputs recompute: Boolean
# ---------- csloadslicer: Python ----------
"""
Loads a Slicer class from its json file in the 'output' folder.

"""

import compas_slicer_ghpython.visualization as gh_compas_slicer
gh_compas_slicer = reload(gh_compas_slicer)


if path and folder_name and json_name:
    mesh, paths, are_closed, all_points = gh_compas_slicer.load_slicer(path, folder_name, json_name)
else:
    gh_compas_slicer.missing_input()
# ---------- end csloadslicer ----------

# ----
# Load Printpoints
panel_3 = Panel("out_printpoints_flat")
csfindfilenames_2 = CsFindFilenames(recompute=button, starts_with=panel_3, ends_with="json", path=py, folder_name=data)  # -> out, filenames, n; inputs recompute: Boolean; same code as csfindfilenames
panel_4 = Panel("out_printpoints_flat.json")
csloadprintpoints = CsLoadPrintpoints(recompute=Button(), json_name=csfindfilenames_2.filenames, path=py, folder_name=data)  # -> out, geometry, points, frames, layer_heights, up_vectors, mesh_normals, closest_support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; inputs recompute: Boolean
# ---------- csloadprintpoints: Python ----------
"""
Loads a dictionaly of Printpoints from a json file in the 'output' folder.

"""

import compas_slicer_ghpython.visualization as gh_compas_slicer
gh_compas_slicer = reload(gh_compas_slicer)


if path and folder_name and json_name:
    points, frames, layer_heights, up_vectors, mesh_normals, closest_support, velocities, wait_times, \
    blend_radiuses, extruder_toggles = \
        gh_compas_slicer.load_printpoints(path, folder_name, json_name)
    
else:
    gh_compas_slicer.missing_input()
# ---------- end csloadprintpoints ----------

# ----
# Load Printpoints
panel_5 = Panel("out_printpoints_nested")
panel_6 = Panel("out_printpoints_nested.json")
load_frames = BooleanToggle(False)
load_layer_heights = BooleanToggle(False)
load_up_vectors = BooleanToggle(False)
load_normals = BooleanToggle(False)
load_closest_support_pt = BooleanToggle(False)
load_velocities = BooleanToggle(True)
load_wait_times = BooleanToggle(False)
load_blend_radiuses = BooleanToggle(False)
load_extruder_toggles = BooleanToggle(True)
csfindfilenames_3 = CsFindFilenames(recompute=button, starts_with=panel_5, ends_with=".json", path=py, folder_name=data)  # -> out, filenames, n; inputs recompute: Boolean; same code as csfindfilenames
csloadprintpoints_2 = CsLoadPrintpoints(
    recompute=Button(),
    json_name=csfindfilenames_3.filenames,
    path=py,
    folder_name=data,
    load_frames=load_frames,
    load_layer_heights=load_layer_heights,
    load_up_vectors=load_up_vectors,
    load_normals=load_normals,
    load_closest_support_pt=load_closest_support_pt,
    load_velocities=load_velocities,
    load_wait_times=load_wait_times,
    load_blend_radiuses=load_blend_radiuses,
    load_extruder_toggles=load_extruder_toggles)  # -> out, layers; inputs recompute: Boolean
# ---------- csloadprintpoints_2: Python ----------
"""
Loads a dictionaly of Printpoints from a json file in the 'output' folder.

"""

import compas_slicer_ghpython.visualization as gh_compas_slicer
gh_compas_slicer = reload(gh_compas_slicer)


if path and folder_name and json_name:
    layers = gh_compas_slicer.load_nested_printpoints(path, folder_name, json_name, load_frames, load_layer_heights, load_up_vectors,
                            load_normals, load_closest_support_pt, load_velocities, load_wait_times,
                            load_blend_radiuses, load_extruder_toggles)
    
else:
    gh_compas_slicer.missing_input()
# ---------- end csloadprintpoints_2 ----------

# ---- group: Path cross-section
number_slider = Slider(0.43, range=0..1)  # disabled
number_slider_2 = Slider(2.5, range=0..10)  # disabled
number_slider_3 = Slider(1, range=0..10)  # disabled
# Visualization
xz = XZPlane(Origin=Point(0, 0, 0))  # disabled
rectangle = Rectangle(Plane=xz, XSize=number_slider_2, YSize=number_slider_3, Radius=number_slider)  # -> Rectangle, Length; disabled

# ----
medges = MeshEdges(Mesh=mesh_3)  # -> NakedEdges, InteriorEdges, NonManifoldEdges

button_2 = Button()  # disabled
panel_7 = Panel("distances_LOW.json")  # disabled
offset = Slider(0, range=0..200)  # disabled
csloadjsondata = CsLoadJsonData(recompute=button_2, json_name=panel_7, path=py, folder_name=data)  # -> out, data; inputs recompute: Boolean; disabled
# ---------- csloadjsondata: Python ----------
"""Loads a json file from the output folder. """

import compas_slicer_ghpython.visualization as gh_compas_slicer
gh_compas_slicer = reload(gh_compas_slicer)

if json_name and path and folder_name:
    data = gh_compas_slicer.load_json_file(path, folder_name, json_name)
else:
    gh_compas_slicer.missing_input()

print json_name
print path
print folder_name
# ---------- end csloadjsondata ----------
bnd = Bounds(Numbers=csloadjsondata.data)  # disabled
bounds = Panel(bnd)  # disabled
olffset = GhPythonScript(values=csloadjsondata.data, offset=offset)  # -> a; inputs values: list; disabled
# ---------- olffset: Python ----------
a = [v-offset for v in values]
# ---------- end olffset ----------

join = JoinCurves(Curves=flatten(medges.NakedEdges), Preserve=False)
item_2 = ListItem(Index=0, Wrap=True)
item_3 = ListItem(List=flatten(join), Index=0, Wrap=True)  # -> Item, Item1, Item2

panel_8 = Panel("distances_HIGH.json")  # disabled
panel_9 = Panel("distances_LOW.json")  # disabled
button_3 = Button()  # disabled
weight = Slider(0.39, range=0..1)  # disabled
csinterpolation = CsInterpolation(recompute=button_3, json_name1=panel_9, json_name2=panel_8, weight=weight, path=py, folder_name=data)  # -> out, interpolation; inputs recompute: Boolean; disabled
# ---------- csinterpolation: Python ----------
"""
Interpolation of the two distance fields that are loaded from the 'output' folder. 

"""

import compas_slicer_ghpython.visualization as gh_compas_slicer
gh_compas_slicer = reload(gh_compas_slicer)

if json_name1 and json_name2 and path and folder_name:
    interpolation = gh_compas_slicer.distance_fields_interpolation(path, folder_name, json_name1, json_name2, weight)
else:
    gh_compas_slicer.missing_input()
# ---------- end csinterpolation ----------

crv = Curve(item_3.Item)
crv_2 = Curve(item_3.Item1)
demesh = DeconstructMesh(Mesh=mesh_3)  # -> Vertices, Faces, Colours, Normals

crv_3 = Curve(crv_2)
crv_4 = Curve(crv)

curve_display = CSharpScript(Curve=[crv_3, crv_4], Width=Slider(7.82, range=0..20), Colour=ColourSwatch(SwatchColor=RGB(255, 46, 46)))  # inputs Curve: Curve, Width: Int32, Colour: Color, Dash: String
# ---------- curve_display: C# ----------
    if (Curve == null) return;
    if (Width <= 0) return;

    double[] pattern = ParseDashPattern(Dash);
    IEnumerable<Curve> segments = ApplyDashPattern(Curve, pattern);

    _clip = BoundingBox.Union(_clip, Curve.GetBoundingBox(false));
    foreach (Curve segment in segments)
    {
      _curves.Add(segment);
      _colors.Add(Colour);
      _widths.Add(Width);
    }
# ---------- curve_display: C# additional code ----------
  /// <summary>
  /// Parse a dash pattern.
  /// </summary>
  /// <param name="pattern">Pattern to parse.</param>
  /// <returns>Array of dashes and gaps.</returns>
  private double[] ParseDashPattern(string pattern)
  {
    if (string.IsNullOrWhiteSpace(pattern))
      return null;

    string[] fragments = pattern.Split(new char[] {' '});
    if (fragments == null || fragments.Length == 0)
      return null;

    double[] values = new double[fragments.Length];
    for (int i = 0; i < fragments.Length; i++)
    {
      double v;
      if (!double.TryParse(fragments[i], out v))
        throw new Exception(fragments[i] + " is a not a valid number.");

      if (v <= 0.0)
        throw new Exception("Dashes or gaps must have a strictly positive length.");

      values[i] = v;
    }

    return values;
  }
  /// <summary>
  /// Apply a dash+gap pattern to a curve.
  /// </summary>
  private IEnumerable<Curve> ApplyDashPattern(Curve curve, double[] pattern)
  {
    if (pattern == null || pattern.Length == 0)
      return new Curve[] { curve };

    double curveLength = curve.GetLength();
    List<Curve> dashes = new List<Curve>();

    double offset0 = 0.0;
    int index = 0;
    while(true)
    {
      // Get the current dash length.
      double dashLength = pattern[index++];
      if (index >= pattern.Length)
        index = 0;

      // Compute the offset of the current dash from the curve start.
      double offset1 = offset0 + dashLength;
      if (offset1 > curveLength)
        offset1 = curveLength;

      // Solve the curve parameters at the current dash start and end.
      double t0, t1;
      curve.LengthParameter(offset0, out t0);
      curve.LengthParameter(offset1, out t1);

      Curve dash = curve.Trim(t0, t1);
      if (dash != null)
        dashes.Add(dash);

      // Get the current gap length.
      double gapLength = pattern[index++];
      if (index >= pattern.Length)
        index = 0;

      // Set the start of the next dash to be the end of the current
      // dash + the length of the adjacent gap.
      offset0 = offset1 + gapLength;

      // Abort when we've reached the end of the curve.
      if (offset0 >= curveLength)
        break;
    }

    return dashes;
  }

  private BoundingBox _clip;
  private readonly List<Curve> _curves = new List<Curve>();
  private readonly List<Color> _colors = new List<Color>();
  private readonly List<int> _widths = new List<int>();

  /// <summary>
  /// This method will be called once every solution, before any calls to RunScript.
  /// </summary>
  public override void BeforeRunScript()
  {
    _clip = BoundingBox.Empty;
    _curves.Clear();
    _colors.Clear();
    _widths.Clear();
  }

  /// <summary>
  /// Return a BoundingBox that contains all the geometry you are about to draw.
  /// </summary>
  public override BoundingBox ClippingBox
  {
    get { return _clip; }
  }
  /// <summary>
  /// Draw all wires and points in this method.
  /// </summary>
  public override void DrawViewportWires(IGH_PreviewArgs args)
  {
    for (int i = 0; i < _curves.Count; i++)
      args.Display.DrawCurve(_curves[i], _colors[i], _widths[i]);
  }
# ---------- end curve_display ----------

panel_10 = Panel(csloadjsondata.out)  # disabled
panel_11 = Panel(csinterpolation.out)  # disabled
panel_12 = Panel(csloadprintpoints_2.out)

# ---- group: Visualization settings
layer_index_start = Slider(0, range=0..100)
pt_index_end = Slider(206, range=0..1000)
layer_index_end = Slider(14, range=1..100)

# ----
pull = PullPoint(Point=demesh.Vertices, Geometry=crv_4, ClosestOnly=True)  # -> ClosestPoint, Distance
dist = Distance(PointA=demesh.Vertices, PointB=pull.ClosestPoint)
smaller = SmallerThan(FirstNumber=dist, SecondNumber="0.001")  # -> SmallerThan, OrEqualTo
index = ItemIndex(List=demesh.Vertices, Item=demesh.Vertices)
dispatch = Dispatch(List=index, DispatchPattern=smaller.SmallerThan)  # -> ListA, ListB
dispatch_2 = Dispatch(List=demesh.Vertices, DispatchPattern=smaller.SmallerThan)  # -> ListA, ListB
pt = Point(dispatch_2.ListA)
int = Integer(dispatch.ListA)

pull_2 = PullPoint(Point=demesh.Vertices, Geometry=crv_3, ClosestOnly=True)  # -> ClosestPoint, Distance
dist_2 = Distance(PointA=demesh.Vertices, PointB=pull_2.ClosestPoint)
smaller_2 = SmallerThan(FirstNumber=dist_2, SecondNumber="0.001")  # -> SmallerThan, OrEqualTo
index_2 = ItemIndex(List=demesh.Vertices, Item=demesh.Vertices)
dispatch_3 = Dispatch(List=index_2, DispatchPattern=smaller_2.SmallerThan)  # -> ListA, ListB
dispatch_4 = Dispatch(List=demesh.Vertices, DispatchPattern=smaller_2.SmallerThan)  # -> ListA, ListB
pt_2 = Point(dispatch_4.ListA)
int_2 = Integer(dispatch_3.ListA)

# ---- group: Visualization settings / true/false to display all/only selected printpoitns
display_all = BooleanToggle(False)

# ----
all_points = Point(csloadslicer.all_points)
paths = Curve(csloadslicer.paths)

panel_13 = Panel(csloadslicer.out)
panel_14 = Panel(csloadprintpoints.out)

layer_heights = Number(csloadprintpoints.layer_heights)
up_vectors = Vector(csloadprintpoints.up_vectors)
mesh_normals = Vector(csloadprintpoints.mesh_normals)
points = Point(csloadprintpoints.points)
frames = Plane(csloadprintpoints.frames)
cpts = Point(csloadprintpoints.closest_support)

frames_2 = Plane(frames)  # disabled
pflip = FlipPlane(Plane=frames_2, ReverseX=False, ReverseY=False, SwapAxes=True)  # disabled

print_planes = Plane(pflip)  # disabled
tool_mesh = Mesh(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)  # disabled

# ----
# Tool Visualization
# Note: This is only an example. The actual tool orientation depends on the definition of the frame of your tool
number_slider_4 = Slider(1104, range=0..2000)  # disabled
tool_origin = Panel("""0
0
99.507""")  # disabled
cstoolviz = CsToolViz(origin_coords=tool_origin, mesh=tool_mesh, planes=print_planes, index=number_slider_4)  # -> out, mesh, passed_path; inputs origin_coords: list, mesh: Mesh, planes: list, index: Int32; disabled
# ---------- cstoolviz: Python ----------
"""
Example visualization of tool motion during the print.

"""

import compas_slicer_ghpython.visualization as gh_compas_slicer
gh_compas_slicer = reload(gh_compas_slicer)

if origin_coords and mesh and planes and (index or index==0):
    mesh, passed_path = gh_compas_slicer.tool_visualization(origin_coords, mesh, planes, index)
else:
    gh_compas_slicer.missing_input()
# ---------- end cstoolviz ----------

mesh_normals_2 = Vector(mesh_normals)  # disabled
points_2 = Point(points)  # disabled
section = Curve(rectangle.Rectangle)  # disabled

velocities = Number(csloadprintpoints.velocities)
wait_times = Number(csloadprintpoints.wait_times)
blend_radiuses = Number(csloadprintpoints.blend_radiuses)
extruder_toggles = Number(csloadprintpoints.extruder_toggles)

# ----
# Ligthweight Path Visualization
number_slider_5 = Slider(3.9, range=0..10)
extruder_toggles_2 = Number(extruder_toggles)
all_points_2 = Point(points)
cslightpathviz = CsLightPathViz(
    points=all_points_2,
    extruder_toggles=extruder_toggles_2,
    domain_start=Slider(0, range=0..100),
    domain_end=Slider(1263, range=0..2000),
    pipe_diameter=number_slider_5)  # -> out, print_path_pipes, travel_path_lines; inputs points: list of Point3d, extruder_toggles: list of Boolean, domain_start: Int32, domain_end: Int32
# ---------- cslightpathviz: Python ----------
"""
Creates a lightweight visualization of the print paths. Segments with extruder_toggle=True are visualized as pipes, 
segments with extruder_toggle=False are visualized as lines.
Loads files from the 'output' folder.

"""

import compas_slicer_ghpython.visualization as gh_compas_slicer
gh_compas_slicer = reload(gh_compas_slicer)

pipe_resolution = 14

if points:
    
    # assign default values to parameters where possible. 
    if not extruder_toggles:
        extruder_toggles = [False for i in range(len(points))]
    if not domain_start:
        domain_start = 0
    if not domain_end:
        domain_end = len(points)
    if not pipe_diameter:
        pipe_diameter = 2.0
        
    print_path_pipes, travel_path_lines = \
        gh_compas_slicer.lightweight_path_visualization(points, extruder_toggles, pipe_diameter, pipe_resolution)
    
else:
    gh_compas_slicer.missing_input()
# ---------- end cslightpathviz ----------

# ----
# Render Path Visualization
toggle = BooleanToggle(False)  # disabled
toggle_2 = BooleanToggle(True)  # disabled
extruder_toggles_3 = Number(extruder_toggles)  # disabled
layer_heights_2 = Number(layer_heights)  # disabled
up_vectors_2 = Vector(up_vectors)  # disabled

python = CsRenderPathViz(
    points=points_2,
    mesh_normals=mesh_normals_2,
    layer_heights=layer_heights_2,
    up_vectors=up_vectors_2,
    extruder_toggles=extruder_toggles_3,
    cross_section=section,
    planar_printing=toggle,
    compute=toggle_2)  # -> out, loft_surfaces, travel_path_lines; inputs points: list of Point3d, mesh_normals: list of Vector3d, layer_heights: list, up_vectors: list of Vector3d, extruder_toggles: list of Boolean, cross_section: Curve, planar_printing: Boolean, compute: Boolean; disabled
# ---------- python: Python ----------
"""
Creates a render visualization of the print paths with loft surfaces where extruder_toggle=True.
For large number of points, this can take a while to compute, so keep it turned off unless you need it.
Loads files from the 'output' folder.

"""

import compas_slicer_ghpython.visualization as gh_compas_slicer
gh_compas_slicer = reload(gh_compas_slicer)

pipe_resolution = 14

if points and mesh_normals and layer_heights and extruder_toggles and cross_section:
    if compute:
        loft_surfaces, travel_path_lines = \
            gh_compas_slicer.render_path_visualization(points, mesh_normals, layer_heights, up_vectors, extruder_toggles, cross_section, planar_printing)
    else:
        print('Compute is set to False')
else:
    gh_compas_slicer.missing_input()
# ---------- end python ----------

distances = Number(olffset)  # disabled
distances_2 = Number(csinterpolation.interpolation)  # disabled

panel_15 = Panel(csinterpolation.interpolation)  # disabled

# ---- group: Color output
geo = Geometry(cslightpathviz.print_path_pipes)  # disabled
geo_2 = Geometry(cslightpathviz.travel_path_lines)  # disabled
swatch = ColourSwatch(SwatchColor=RGB(199, 199, 199))  # disabled
swatch_2 = ColourSwatch(SwatchColor=RGB(255, 156, 36))  # disabled
preview_2 = CustomPreview(Geometry=geo, Material=swatch)  # disabled
preview_3 = CustomPreview(Geometry=geo_2, Material=swatch_2)  # disabled

geo_3 = Geometry(python.travel_path_lines)  # disabled
geo_4 = Geometry(python.loft_surfaces)  # disabled
swatch_3 = ColourSwatch(SwatchColor=RGB(255, 156, 36))  # disabled
swatch_4 = ColourSwatch(SwatchColor=RGB(222, 222, 222))  # disabled
preview_4 = CustomPreview(Geometry=geo_4, Material=swatch_4)  # disabled
preview_5 = CustomPreview(Geometry=geo_3, Material=swatch_3)  # disabled

# ----
mesh_4 = Mesh(cstoolviz.mesh)  # disabled
geo_5 = Geometry(cstoolviz.passed_path)  # disabled
swatch_5 = ColourSwatch(SwatchColor=RGB(171, 171, 171))  # disabled
swatch_6 = ColourSwatch(SwatchColor=RGB(255, 156, 36))  # disabled
preview_6 = CustomPreview(Geometry=mesh_4, Material=swatch_5)  # disabled
# Basic Parameters
preview_7 = CustomPreview(Geometry=geo_5, Material=swatch_6)  # disabled

ln = Line(StartPoint=points, EndPoint=cpts)
vdis = VectorDisplay(Anchor=points, Vector=expr("x*5", up_vectors))
python_2 = GhPythonScript(
    layers=csloadprintpoints_2.layers,
    layer_index_start=layer_index_start,
    layer_index_end=layer_index_end,
    pt_index_end=pt_index_end,
    display_all=display_all)  # -> out, geometry, points, frames, layer_heights, up_vectors, mesh_normals, closest_support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; inputs layers: list, layer_index_start: Int32, layer_index_end: Int32, pt_index_end: Int32, display_all: Boolean
# ---------- python_2: Python ----------
"""
Visualizes PrintPoints information of compas_slicer paths.
"""

import compas_slicer_ghpython.visualization as gh_compas_slicer
gh_compas_slicer = reload(gh_compas_slicer)

points = []
frames = []
layer_heights = []
up_vectors = []
mesh_normals = []
closest_support = []

velocities = []
wait_times = []
blend_radiuses = []
extruder_toggles = []

if layer_index_start >= len(layers) - 2:
    layer_index_start = len(layers) -2
   
    
if layer_index_end >= len(layers):
    layer_index_end = len(layers)
    
if layer_index_start > layer_index_end:
    layer_index_start = layer_index_end
    
print('layer_index_start = ' + str(layer_index_start))
print('layer_index_end = ' + str(layer_index_end))
    

if len(layers) > 0:
    # display all
    if display_all:
        for layer in layers:
            for path in layer.paths:
                for ppt in path.ppts:
                    
                    points.append(ppt.pt)
                    frames.append(ppt.frame)
                    layer_heights.append(ppt.layer_height)
                    up_vectors.append(ppt.up_vector)
                    mesh_normals.append(ppt.mesh_normal)
                    closest_support.append(ppt.closest_support_pt)
                    
                    velocities.append(ppt.velocity)
                    wait_times.append(ppt.wait_time)
                    blend_radiuses.append(ppt.blend_radius)
                    extruder_toggles.append(ppt.extruder_toggle)
        
    else:
        # display selection
        for i, layer in enumerate(layers[layer_index_start:layer_index_end]):
            if i < layer_index_end-layer_index_start -1:
                # fully displayed layers
                for path in layer.paths:
                    for ppt in path.ppts:
                        points.append(ppt.pt)
                        frames.append(ppt.frame)
                        layer_heights.append(ppt.layer_height)
                        up_vectors.append(ppt.up_vector)
                        mesh_normals.append(ppt.mesh_normal)
                        closest_support.append(ppt.closest_support_pt)
                        
                        velocities.append(ppt.velocity)
                        wait_times.append(ppt.wait_time)
                        blend_radiuses.append(ppt.blend_radius)
                        extruder_toggles.append(ppt.extruder_toggle)
            else:
                # partly displayed layers (using pt_index_end)
                count = 0
                for path in layer.paths:
                    for ppt in path.ppts:
                        if count < pt_index_end:
                            points.append(ppt.pt)
                            frames.append(ppt.frame)
                            layer_heights.append(ppt.layer_height)
                            up_vectors.append(ppt.up_vector)
                            mesh_normals.append(ppt.mesh_normal)
                            closest_support.append(ppt.closest_support_pt)
                            
                            velocities.append(ppt.velocity)
                            wait_times.append(ppt.wait_time)
                            blend_radiuses.append(ppt.blend_radius)
                            extruder_toggles.append(ppt.extruder_toggle)
                            
                            count += 1
# ---------- end python_2 ----------

# ---- group: Press button to save json files
button_4 = Button()

# ----
abs = Absolute(Value=distances_2)  # disabled

# ---- group: Select parameter
num = Number(layer_heights)

# ---- group: Visualize distance values on mesh
distances_3 = Number(abs)  # disabled
mesh_5 = Mesh(mesh)  # disabled

bnd_2 = Bounds(Numbers=distances_3)  # disabled
dedomain = DeconstructDomain(Domain=bnd_2)  # -> Start, End; disabled
gradient = Gradient(
    LowerLimit=dedomain.Start,
    UpperLimit=dedomain.End,
    Parameter=distances_3,
    stops=[0: RGB(0, 128, 0), 0.0566: RGB(255, 255, 0), 0.915: RGB(255, 0, 0)])  # disabled
demesh_2 = DeconstructMesh(Mesh=mesh_5)  # -> Vertices, Faces, Colours, Normals; disabled
conmesh = ConstructMesh(Vertices=demesh_2.Vertices, Faces=demesh_2.Faces, Colours=gradient)  # disabled

# ---- group: Visualize parameter with color
bnd_3 = Bounds(Numbers=num)
avr = Average(Input=num)
dedomain_2 = DeconstructDomain(Domain=bnd_3)  # -> Start, End
average = Panel(avr)
gradient_2 = Gradient(
    LowerLimit=dedomain_2.Start,
    UpperLimit=dedomain_2.End,
    Parameter=num,
    stops=[0: RGB(0, 128, 0), 0.5: RGB(255, 255, 0), 1: RGB(255, 0, 0)])
pt_3 = Point(points)  # disabled
cloud = CloudDisplay(Points=pt_3, Colours=gradient_2, Size=Slider(1.72, range=0..10), SpriteType=1)  # disabled

# ---- group: Visualize parameter with text
tag_offset = Slider(1, range=0..100)
pdecon = Deconstruct(Point=points)  # -> XComponent, YComponent, ZComponent
addition = Addition(A=pdecon.ZComponent, B=tag_offset)
pt_4 = ConstructPoint(XCoordinate=pdecon.XComponent, YCoordinate=pdecon.YComponent, ZCoordinate=addition)
tag = TextTag(Location=pt_4, Text=num, Colour=ColourSwatch(SwatchColor=RGB(50, 130, 186)))  # disabled

# ---- group: Slicer data
len = Length(Curve=flatten(paths))
lng = ListLength(List=flatten(paths))
sum = GhPythonScript(x=len)  # -> out, a; inputs x: list
# ---------- sum: Python ----------
__author__ = "Ioanna"
__version__ = "2020.10.25"

import rhinoscriptsyntax as rs

a = 0
for v in x:
    a += v
# ---------- end sum ----------
total_path_length = Panel(sum.a)
total_number_of_paths = Panel(lng)

# ----
panel_16 = Panel(python_2.out)

extruder_toggles_4 = Number(python_2.extruder_toggles)
blend_radiuses_2 = Number(python_2.blend_radiuses)
velocities_2 = Number(python_2.velocities)
wait_times_2 = Number(python_2.wait_times)

layer_heights_3 = Number(python_2.layer_heights)
up_vectors_3 = Vector(python_2.up_vectors)
mesh_normals_3 = Vector(python_2.mesh_normals)
points_3 = Point(python_2.points)
cpts_2 = Point(python_2.closest_support)
frames_3 = Plane(python_2.frames)

save_to_json = GhPythonScript(save=button_4, list=int_2, path=py, folder_name=data, json_name="boundaryHIGH.json")  # -> out; inputs save: Boolean, list: list
# ---------- save_to_json: Python ----------
"""
Saves to Json

"""

import compas_slicer_ghpython.visualization as gh_compas_slicer
gh_compas_slicer = reload(gh_compas_slicer)


if save:
    if list and path and folder_name and json_name:
        gh_compas_slicer.save_json_file(list, path, folder_name, json_name)
    else:
        gh_compas_slicer.missing_input()
else:
    print('No files were saved because save = False')
# ---------- end save_to_json ----------
save_to_json_2 = GhPythonScript(save=button_4, list=int, path=py, folder_name=data, json_name="boundaryLOW.json")  # -> out; inputs save: Boolean, list: list; same code as save_to_json
min = Panel(dedomain_2.Start)
max = Panel(dedomain_2.End)
vdis_2 = VectorDisplay(Anchor=points_3, Vector=expr("x*5", up_vectors_3))
pline_2 = PolyLine(Vertices=points_3, Closed=False)
panel_17 = Panel(save_to_json)
panel_18 = Panel(save_to_json_2)
num_2 = Number(velocities_2)  # disabled
paths_2 = Curve(csloadslicer.paths)
end = EndPoints(Curve=csloadslicer.paths)  # -> Start, End

# ---- group: Visualize parameter with color
bnd_4 = Bounds(Numbers=num_2)  # disabled
avr_2 = Average(Input=num_2)  # disabled
dedomain_3 = DeconstructDomain(Domain=bnd_4)  # -> Start, End; disabled
average_2 = Panel(avr_2)  # disabled
number_slider_6 = Slider(1, range=0..10)  # disabled
gradient_3 = Gradient(
    LowerLimit=dedomain_3.Start,
    UpperLimit=dedomain_3.End,
    Parameter=num_2,
    stops=[0: RGB(0, 128, 0), 0.5: RGB(255, 255, 0), 1: RGB(255, 0, 0)])  # disabled
pt_5 = Point()  # disabled
cloud_2 = CloudDisplay(Points=pt_5, Colours=gradient_3, Size=number_slider_6, SpriteType=0)  # disabled

# ---- group: Visualize parameter with text
tag_offset_2 = Slider(1, range=0..100)  # disabled
pdecon_2 = Deconstruct(Point=points_3)  # -> XComponent, YComponent, ZComponent; disabled
addition_2 = Addition(A=pdecon_2.ZComponent, B=tag_offset_2)  # disabled
pt_6 = ConstructPoint(XCoordinate=pdecon_2.XComponent, YCoordinate=pdecon_2.YComponent, ZCoordinate=addition_2)  # disabled
swatch_7 = ColourSwatch(SwatchColor=RGB(50, 130, 186))  # disabled
tag_2 = TextTag(Location=pt_6, Text=num_2, Colour=swatch_7)  # disabled

# ----
clscrv = CloseCurve(Curve=paths_2, CloseType=0, Bulge=0.5, Tolerance=0)  # -> Closed, R
ln_2 = Line(StartPoint=end.Start, EndPoint=end.End)

panel_19 = Panel("gradient.json")  # disabled
button_5 = Button()  # disabled
csloadjsonvectors = CsLoadJsonVectors(recompute=button_5, json_name=panel_19, path=py, folder_name=data)  # -> out, vectors; inputs recompute: Boolean; disabled
# ---------- csloadjsonvectors: Python ----------
"""
Loads a json file from the 'output' folder, 
that stores a vector field in the format: 
data['0']=[x0,y0,z0], ...,  data['N']=[xN,yN,zN]


"""

import compas_slicer_ghpython.visualization as gh_compas_slicer
gh_compas_slicer = reload(gh_compas_slicer)

if json_name and path and folder_name:
    vectors = gh_compas_slicer.load_json_vectors(path, folder_name, json_name)
else:
    gh_compas_slicer.missing_input()
# ---------- end csloadjsonvectors ----------
demesh_3 = DeconstructMesh(Mesh=mesh)  # -> Vertices, Faces, Colours, Normals; disabled
vdis_3 = VectorDisplay(Anchor=demesh_3.Vertices, Vector=csloadjsonvectors.vectors)  # disabled

button_6 = Button()  # disabled
panel_20 = Panel("pts_boundary_HIGH_0.json")  # disabled
csloadjsonpoints = CsLoadJsonPoints(recompute=button_6, json_name=panel_20, path=py, folder_name=data)  # -> out, points; inputs recompute: Boolean; disabled
# ---------- csloadjsonpoints: Python ----------
"""
Loads a json file that stores a dictionary of N points in the format: 
data['0']=[x0,y0,z0], ...,  data['N']=[xN,yN,zN]


"""

import compas_slicer_ghpython.visualization as gh_compas_slicer
gh_compas_slicer = reload(gh_compas_slicer)

if json_name and path and folder_name:
    points = gh_compas_slicer.load_json_points(path, folder_name, json_name)
else:
    gh_compas_slicer.missing_input()
# ---------- end csloadjsonpoints ----------
pt_7 = Point(csloadjsonpoints.points)  # disabled

frames_4 = Plane(frames)
min_2 = Panel(dedomain_3.Start)  # disabled
max_2 = Panel(dedomain_3.End)  # disabled
ext = ExtendCurve(Curve=clscrv.Closed, Type=0, Start="0", End="-1")
previewlw = CustomPreviewLineweights(Geometry=ext, Shader=ColourSwatch(SwatchColor=RGB(255, 255, 255)), Thickness=Slider(1, range=0..10), Absolute=False)
end_2 = EndPoints(Curve=ext)  # -> Start, End
deplane = DeconstructPlane(Plane=frames_4)  # -> Origin, XAxis, YAxis, ZAxis
pt_8 = Point(end_2.End)
lng_2 = ListLength(List=ext)
lng_3 = ListLength(List=ext)
cp = ClosestPoint(Point=pt_8, Cloud=deplane.Origin)  # -> ClosestPoint, CPIndex, Distance
series = Series(Start=0, Step=1, Count=lng_2)
series_2 = Series(Start="1", Step=1, Count=lng_3)
item_4 = ListItem(List=frames_4, Index=cp.CPIndex, Wrap=True)
culln = CullNth(List=series, CullFrequency=lng_2)
culln_2 = CullNth(List=series_2, CullFrequency=lng_3)
pt_9 = Point(item_4)
partition = PartitionList(List=culln, Size="2")
partition_2 = PartitionList(List=culln_2, Size="2")
orient = Orient(Geometry=item_4, Source=pt_9, Target=pt_8)  # -> Geometry, Transform
item_5 = ListItem(List=ext, Index=partition, Wrap=True)
item_6 = ListItem(List=ext, Index=partition_2, Wrap=True)
merge_2 = Merge(Data1=frames_4, Data2=orient.Geometry)  # -> flatten(Result)
end_3 = EndPoints(Curve=item_5)  # -> Start, End
end_4 = EndPoints(Curve=item_6)  # -> Start, End
pline_3 = PolyLine(Vertices=end_3.Start, Closed=False)
pline_4 = PolyLine(Vertices=end_4.End, Closed=False)
frames_5 = Plane(merge_2)
cull_i = CullIndex(List=frames_5, Indices="0", Wrap=True)  # -> reverse(List)
first_last = FirstLast(List=frames_5)  # -> FirstValue, LastValue
join_2 = JoinCurves(Curves=flatten([ext, pline_3, pline_4]), Preserve=False)
cull_i_2 = CullIndex(List=cull_i, Indices="0", Wrap=True)  # -> reverse(List)

button_7 = Button()  # disabled
panel_21 = Panel("curved_slicer_")  # disabled
panel_22 = Panel(".json")  # disabled
csfindfilenames_4 = CsFindFilenames(recompute=button_7, starts_with=panel_21, ends_with=panel_22, path=py, folder_name=data)  # -> out, filenames, n; inputs recompute: Boolean; disabled; same code as csfindfilenames
filenames = Panel(csfindfilenames_4.filenames)  # disabled
number_of_files = Panel(csfindfilenames_4.n)  # disabled

pt_10 = Point(cull_i_2)
alongcrv = SortAlongCurve(Points=pt_10, Curve=join_2)  # -> Points, Indices
item_7 = ListItem(List=cull_i_2, Index=alongcrv.Indices, Wrap=True)
number_slider_7 = Slider(303, range=0..30510)
entwine = Entwine(Branch00=first_last.FirstValue, Branch01=item_7, Branch02=first_last.LastValue, FlattenInputs=True)  # -> flatten(Result)
number_slider_8 = Slider(1683, range=0..1683)
lng_4 = ListLength(List=entwine)
subtraction = Subtraction(A=lng_4, B=10270)
split = SplitList(List=entwine, Index=subtraction)  # -> ListA, ListB
pline_5 = PolyLine(Vertices=split.ListB, Closed=False)
# rib width
# Basic Parameters
number_slider_9 = Slider(2, range=0..10)
# input your geometry
# rib depth
previewlw_2 = CustomPreviewLineweights(Geometry=pline_5, Shader=ColourSwatch(SwatchColor=RGB(255, 255, 255)), Thickness=number_slider_9, Absolute=False)

button_8 = Button()  # disabled
panel_23 = Panel("point_clusters_polylines_0.json")  # disabled

csloadjsonpolylines = CsLoadJsonPolylines(recompute=button_8, json_name=panel_23, path=py, folder_name=data)  # -> out, polylines, points; inputs recompute: Boolean; disabled
# ---------- csloadjsonpolylines: Python ----------
"""
Loads a json file that stores a dictionary of N polylines in the format:
data['0']=points_dict_0, ..., data['N'] = points_dict_N, where points_dict is in the format:
points_dict['0']=[x0,y0,z0], ...,  points_dict['N']=[xN,yN,zN]


"""

import compas_slicer_ghpython.visualization as gh_compas_slicer
gh_compas_slicer = reload(gh_compas_slicer)

if json_name and path and folder_name:
    polylines, points = gh_compas_slicer.load_json_polylines(path, folder_name, json_name)
else:
    gh_compas_slicer.missing_input()
# ---------- end csloadjsonpolylines ----------

crv_5 = Curve(csloadjsonpolylines.polylines)  # disabled

button_9 = Button()  # disabled

csloadjsonboundary = CsLoadJsonBoundary(recompute=button_9, path=py, folder_name=data)  # -> out, points, vectors, n; inputs recompute: Boolean; disabled
# ---------- csloadjsonboundary: Python ----------
"""
Loads a json file that stores a dictionary of BaseBoundary classes in the format:
data['0']=base_boundary_1.to_data(), ..., data['N']=base_boundary_N.to_data()


"""

import compas_slicer_ghpython.visualization as gh_compas_slicer
gh_compas_slicer = reload(gh_compas_slicer)

if json_name and path and folder_name:
    points, vectors, n = gh_compas_slicer.load_base_boundaries(path, folder_name, json_name)
else:
    gh_compas_slicer.missing_input()
# ---------- end csloadjsonboundary ----------

no_of_boundaries = Panel(csloadjsonboundary.n)  # disabled
vdis_4 = VectorDisplay(Anchor=csloadjsonboundary.points, Vector=expr("x*3", csloadjsonboundary.vectors))  # disabled

panel_24 = Panel("gradient_norm.json")  # disabled
button_10 = Button()  # disabled
number_slider_10 = Slider(0.1, range=0..0.1)  # disabled
number_slider_11 = Slider(1, range=0..1)  # disabled
mesh_6 = Mesh(mesh)  # disabled
demesh_4 = DeconstructMesh(Mesh=mesh_6)  # -> Vertices, Faces, Colours, Normals; disabled

csloadjsondata_2 = CsLoadJsonData(recompute=button_10, json_name=panel_24, path=py, folder_name=data)  # -> out, data; inputs recompute: Boolean; disabled
# ---------- csloadjsondata_2: Python ----------
"""Loads a json file from the output folder. """

import compas_slicer_ghpython.visualization as gh_compas_slicer
gh_compas_slicer = reload(gh_compas_slicer)

if json_name and path and folder_name:
    data = gh_compas_slicer.load_json_file(path, folder_name, json_name)
else:
    gh_compas_slicer.missing_input()
# ---------- end csloadjsondata_2 ----------

data_2 = Data(csloadjsondata_2.data)  # disabled
bnd_5 = Bounds(Numbers=data_2)  # disabled
gradient_4 = Gradient(
    LowerLimit=number_slider_10,
    UpperLimit=number_slider_11,
    Parameter=data_2,
    stops=[0: RGB(234, 38, 0), 0.25: RGB(234, 126, 0), 0.5: RGB(254, 244, 84), 0.75: RGB(173, 203, 249), 1: RGB(75, 107, 169)])  # disabled
avr_3 = Average(Input=data_2)  # disabled
dedomain_4 = DeconstructDomain(Domain=bnd_5)  # -> Start, End; disabled
max_3 = Panel(dedomain_4.End)  # disabled
min_3 = Panel(dedomain_4.Start)  # disabled
average_3 = Panel(avr_3)  # disabled
conmesh_2 = ConstructMesh(Vertices=demesh_4.Vertices, Faces=demesh_4.Faces, Colours=gradient_4)  # disabled

panel_25 = Panel("minima.json")  # disabled
panel_26 = Panel("maxima.json")  # disabled
panel_27 = Panel("saddles.json")  # disabled
button_11 = Button()  # disabled
number_slider_12 = Slider(3.73, range=0..20)  # disabled
demesh_5 = DeconstructMesh(Mesh=mesh)  # -> Vertices, Faces, Colours, Normals; disabled
merge_3 = Merge(Data1=panel_25, Data2=panel_26, Data3=panel_27)  # disabled
panel_28 = Panel("0")  # disabled
panel_29 = Panel("1")  # disabled
panel_30 = Panel("2")  # disabled
swatch_8 = ColourSwatch(SwatchColor=RGB(18, 18, 18))  # disabled
swatch_9 = ColourSwatch(SwatchColor=RGB(107, 235, 52))  # disabled
swatch_10 = ColourSwatch(SwatchColor=RGB(235, 52, 52))  # disabled

csloadjsondata_3 = CsLoadJsonData(recompute=button_11, json_name=merge_3, path=py, folder_name=data)  # -> out, simplify(data); inputs recompute: Boolean; disabled; same code as csloadjsondata_2

branch = TreeBranch(Tree=csloadjsondata_3.data, Path=panel_28, MaintainPaths=True)  # disabled
branch_2 = TreeBranch(Tree=csloadjsondata_3.data, Path=panel_29, MaintainPaths=True)  # disabled
branch_3 = TreeBranch(Tree=csloadjsondata_3.data, Path=panel_30, MaintainPaths=True)  # disabled
item_8 = ListItem(List=demesh_5.Vertices, Index=branch, Wrap=True)  # disabled
item_9 = ListItem(List=demesh_5.Vertices, Index=branch_2, Wrap=True)  # disabled
item_10 = ListItem(List=demesh_5.Vertices, Index=branch_3, Wrap=True)  # disabled
cloud_3 = CloudDisplay(Points=item_8, Colours=swatch_9, Size=number_slider_12, SpriteType=1)  # disabled
cloud_4 = CloudDisplay(Points=item_9, Colours=swatch_10, Size=number_slider_12, SpriteType=1)  # disabled
cloud_5 = CloudDisplay(Points=item_10, Colours=swatch_8, Size=number_slider_12, SpriteType=1)  # disabled

button_12 = Button()  # disabled
panel_31 = Panel("split_mesh_")  # disabled
panel_32 = Panel(".obj")  # disabled

csloadmeshesbyname = CsLoadMeshesByName(recompute=button_12, starts_with=panel_31, ends_with=panel_32, path=py, folder_name=data)  # -> out, loaded_meshes, number_of_meshes; inputs recompute: Boolean; disabled
# ---------- csloadmeshesbyname: Python ----------
"""
Loads all the meshes from the output directory that have the specified filename, and displays them with color.

"""

import compas_slicer_ghpython.visualization as gh_compas_slicer
gh_compas_slicer = reload(gh_compas_slicer)

if starts_with and ends_with and path and folder_name:
    loaded_meshes = gh_compas_slicer.load_multiple_meshes(starts_with, ends_with, path, folder_name)
    number_of_meshes = len(loaded_meshes)
else:
    gh_compas_slicer.missing_input()
# ---------- end csloadmeshesbyname ----------
mesh_7 = Mesh(csloadmeshesbyname.loaded_meshes)  # disabled

medges_2 = MeshEdges(Mesh=csloadmeshesbyname.loaded_meshes)  # -> NakedEdges, InteriorEdges, NonManifoldEdges; disabled
number_of_meshes = Panel(csloadmeshesbyname.number_of_meshes)  # disabled
crv_6 = Curve(medges_2.NakedEdges)  # disabled
