# Grasshopper definition column_version2.ghx (Grasshopper 1.0.7)

geometry = Geometry(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)

number_slider = Slider(6, range=0..10)  # disabled
panel = Panel("1000")  # disabled
division = Division(A=panel, B=number_slider)  # disabled
repeat_data = RepeatData(Data=number_slider, Length=division)  # disabled
contour_ex = ContourEx(Shape=flatten(geometry), Plane=PlaneXY(0, 0, 0), Distances=repeat_data)  # -> flatten(Contours); disabled

pt = Point(Point(0, 0, 0))
xz = XZPlane(Origin=Point(0, 0, 0))
cir = Circle(Plane=pt, Radius=Slider(300, range=0..1000))
contour = Contour(Shape=geometry, Point=Point(0, 0, 0), Direction=Vector(0, 0, 1), Distance=Slider(100, range=0..100))
item = ListItem(List=flatten(contour), Index=Slider(7, range=0..7), Wrap=True)
area = Area(Geometry=item)  # -> Area, Centroid
scale = Scale(Geometry=item, Center=area.Centroid, Factor=Slider(3.1, range=0..10))  # -> Geometry, Transform
pcx = CurvePlane(Curve=scale.Geometry, Plane=xz)  # -> Points, ParamsC, ParamsP
number_slider_2 = Slider(4, range=0..10)
pdecon = Deconstruct(Point=pcx.Points)  # -> XComponent, YComponent, ZComponent
item_2 = ListItem(List=flatten(contour), Index=Slider(7, range=0..7), Wrap=True)
xz_2 = XZPlane(Origin=Point(0, 0, 0))
sort = SortList(Keys=pdecon.XComponent, ValuesA=pcx.ParamsC)  # -> Keys, reverse(ValuesA)
geometry_2 = Geometry([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])
pcx_2 = CurvePlane(Curve=item_2, Plane=xz_2)  # -> Points, ParamsC, ParamsP
item_3 = ListItem(List=sort.ValuesA, Index=0, Wrap=True)
seam = Seam(Curve=scale.Geometry, Seam=item_3)
divide = DivideCurve(Curve=seam, Count=number_slider_2, Kinks=False)  # -> Points, Tangents, Parameters
ln = Line(StartPoint=divide.Points, EndPoint=pt)
division_2 = Division(A="360", B=number_slider_2)
shatter = Shatter(Curve=item_2, Parameters=pcx_2.ParamsC)
curvepoint = PointOnCurve(ln, parameter=0.575)
yz = YZPlane(Origin=Point(0, 0, 0))
division_3 = Division(A=division_2, B=Slider(2.79, range=0.9..10))
item_4 = ListItem(List=shatter, Index=0, Wrap=True)
pcx_3 = CurvePlane(Curve=item_4, Plane=yz)  # -> Points, ParamsC, ParamsP
rot3d = Rotate3D(Geometry=curvepoint, Angle=degrees(division_3), Center=Point(0, 0, 0), Axis=Vector(0, 0, 1))  # -> Geometry, Transform
shatter_2 = Shatter(Curve=item_4, Parameters=pcx_3.ParamsC)
curvepoint_2 = PointOnCurve(ln, parameter=0.388)
curvepoint_3 = PointOnCurve(ln, parameter=0.797)
item_5 = ListItem(List=shatter_2, Index=0, Wrap=True)
ln_2 = Line(StartPoint=curvepoint_2, EndPoint=rot3d.Geometry)
ln_3 = Line(StartPoint=curvepoint_3, EndPoint=rot3d.Geometry)
end = EndPoints(Curve=item_5)  # -> Start, End
pt_2 = ConstructPoint(XCoordinate=0, YCoordinate=0, ZCoordinate=0)
ln_4 = Line(StartPoint=curvepoint_2, EndPoint=divide.Points)
join = JoinCurves(Curves=[ln_2, ln_3], Preserve=False)
ln_5 = Line(StartPoint=pt_2, EndPoint=[end.Start, end.End])
join_2 = JoinCurves(Curves=[ln_5, item_5], Preserve=False)
fillet = Fillet(Curve=join, Radius=Slider(16, range=0..100))
ln_6 = Line(StartPoint=curvepoint_3, EndPoint=pt)  # -> graft(Line)
join_3 = JoinCurves(Curves=flatten([fillet, ln_6]), Preserve=False)  # -> graft(Curves)
join_4 = JoinCurves(Curves=ln_4, Preserve=False)
boundary = BoundarySurfaces(Edges=seam)
join_5 = JoinCurves(Curves=flatten([join_4, join_3]), Preserve=False)
srfsplit = SurfaceSplit(Surface=boundary, Curves=join_5)
preview = CustomPreview(Geometry=join_5, Material=ColourSwatch(SwatchColor=RGB(188, 0, 191)))
