# Grasshopper definition curlykale.ghx (Grasshopper 1.0.7)
# plug-ins: Kangaroo Components, PlanktonGh, Kangaroo2 Components

cir = Circle(Plane=PlaneXY(0, 0, 0), Radius=12)  # disabled
cir_2 = Circle(Plane=PlaneXY(0, 0, 0), Radius=12)
crv = Curve(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)
end = EndPoints(Curve=cir)  # -> Start, End; disabled
mesh = Mesh(cir)  # disabled
sequence = Sequence(Frames=50)  # disabled
end_2 = EndPoints(Curve=cir_2)  # -> Start, End
mesh_2 = Mesh(cir_2)
sequence_2 = Sequence(Frames=50)
meshmachine = MeshMachine(
    Geometry=mesh,
    Length=3,
    FixCurves=cir,
    FixVertices=end.Start,
    Flip=1,
    PullStrength=0.8,
    CurvatureAdaptivity=0,
    BoundaryScale=0.04,
    BoundaryDistance=6,
    Exponent=2,
    Background=0.5,
    Iterations=1,
    Reset=sequence)  # disabled
divide = DivideCurve(Curve=crv, Count=Slider(33, range=0..100), Kinks=False)  # -> Points, Tangents, Parameters
meshmachine_2 = MeshMachine(
    Geometry=mesh_2,
    Length=3,
    FixCurves=cir_2,
    FixVertices=end_2.Start,
    Flip=1,
    PullStrength=0.8,
    CurvatureAdaptivity=0,
    BoundaryScale=0.04,
    BoundaryDistance=6,
    Exponent=2,
    Background=0.5,
    Iterations=1,
    Reset=sequence_2)
item = ListItem(List=reverse(meshmachine), Index=0, Wrap=True)  # disabled
item_2 = ListItem(List=reverse(meshmachine_2), Index=0, Wrap=True)
pmesh = PlanktonMesh(item)  # disabled
pmesh_2 = PlanktonMesh(item_2)
mesh_3 = Mesh(pmesh)  # disabled
mesh_4 = Mesh(pmesh_2)
rotate = Rotate(Geometry=mesh_3, Angle=0.1, Plane=PlaneYZ(0, 0, 0))  # -> Geometry, Transform; disabled
rotate_2 = Rotate(Geometry=mesh_4, Angle=0.1, Plane=PlaneYZ(0, 0, 0))  # -> Geometry, Transform
dam = DataDam(DataA=rotate.Geometry, BufferDelay=10000000, BufferMode=0)  # disabled
dam_2 = DataDam(DataA=divide.Points, BufferDelay=10000000, BufferMode=0)
pline = PolyLine(Vertices=dam_2, Closed=False)
medges = MeshEdges(Mesh=dam)  # -> NakedEdges, InteriorEdges, NonManifoldEdges; disabled
explode = Explode(Curve=pline, Recursive=True)  # -> Segments, Vertices
panel = Panel("0")  # disabled
show = Show(G=dam)  # disabled

# ---- group: gradually increase to start buckling
number_slider = Slider(4, range=0..4)  # disabled

# ----
show_2 = Show(G=dam_2)
length_line = LengthLine(Line=[medges.NakedEdges, medges.InteriorEdges], Length=panel, Strength=14)  # disabled

# ---- group: gradually increase to start buckling
number_slider_2 = Slider(4, range=0..4)

# ----
number_slider_3 = Slider(10, range=0..10)  # disabled
grab = Grab(On=True, Strength=200, Range=14)  # -> Grab, Anchors; disabled
smooth = Smooth(M=dam, Strength=10)  # disabled
length_line_2 = LengthLine(Line=explode.Segments, Length="0", Strength=14)
number_slider_4 = Slider(4, range=0..10)
demesh = DeconstructMesh(Mesh=dam)  # -> Vertices, Faces, Colours, Normals; disabled
sc = SphereCollide(Points=demesh.Vertices, Radius=number_slider_3, Strength=number_slider_3)  # disabled
sc_2 = SphereCollide(Points=dam_2, Radius=number_slider_4, Strength=number_slider_4)
reset = Button()  # disabled

# ---- group: switch off once happy with the form
on = BooleanToggle(False)  # disabled

# ----
reset_2 = Button()

# ---- group: switch off once happy with the form
on_2 = BooleanToggle(True)

# ----
solver = Solver(
    GoalObjects=[length_line, sc, show, grab.Grab, smooth],
    Reset=reset,
    Restart=False,
    Parallel=True,
    Threshold=1e-15,
    Tolerance=0.01,
    AddCurrent=False,
    On=on)  # -> V, O; disabled
solver_2 = Solver(
    GoalObjects=[length_line_2, sc_2, show_2],
    Reset=reset_2,
    Restart=False,
    Parallel=True,
    Threshold=1e-15,
    Tolerance=0.01,
    AddCurrent=False,
    On=on_2)  # -> V, O
item_3 = ListItem(List=solver.O, Index=0, Wrap=True)  # disabled
item_4 = ListItem(List=solver_2.O, Index=0, Wrap=True)
