# Grasshopper definition linegrowthgradual.ghx (Grasshopper 1.0.7)
# plug-ins: Kangaroo2 Components, Kangaroo Components, Weaverbird

rad = Radians(Degrees=Slider(90, range=0..100))
arc = Arc(Plane=PlaneXY(0, 0, 0), Radius=Slider(0.53, range=0..1), Angle=rad)  # -> Arc, Length
arc_2 = Arc(Plane=PlaneXY(0, 0, 0), Radius=Slider(0.16, range=0..1), Angle=rad)  # -> Arc, Length
crv = Curve(arc_2.Arc)
divide = DivideCurve(Curve=crv, Count=Slider(6, range=0..10), Kinks=False)  # -> Points, Tangents, Parameters
pt = ConstructPoint(XCoordinate=0, YCoordinate=0, ZCoordinate=0)
panel = Panel("""0
1""")
end = EndPoints(Curve=arc.Arc)  # -> Start, End
pt_2 = ConstructPoint(XCoordinate=0, YCoordinate=0, ZCoordinate=0)
sift = SiftPattern(List=divide.Points, SiftPattern=panel)  # -> Output0, Output1
crv_2 = Curve(arc.Arc)
vec2pt = Vector2Pt(PointA=pt, PointB=sift.Output1, Unitize=False)  # -> Vector, Length
ln = Line(StartPoint=pt_2, EndPoint=[end.Start, end.End])
neg = Negative(Value=Slider(0.01, range=0..1))
amp = Amplitude(Vector=vec2pt.Vector, Amplitude=Slider(0.03, range=0..1))
join = JoinCurves(Curves=[ln, arc.Arc], Preserve=False)
offset = OffsetCurve(Curve=join, Distance=neg, Corners=1)
move = Move(Geometry=sift.Output1, Motion=amp)  # -> Geometry, Transform
boundary = BoundarySurfaces(Edges=offset)
combine = CombineData(Input0=sift.Output0, Input1=move.Geometry)  # -> Result, Index
intcrv = Interpolate(Vertices=combine.Result, Degree=3, Periodic=False, KnotStyle=1)  # -> Curve, Length, Domain
crv_3 = Curve(intcrv.Curve)
mesh = Mesh(boundary)
divide_2 = DivideCurve(Curve=crv_3, Count=Slider(150, range=0..1000), Kinks=False)  # -> Points, Tangents, Parameters
pline = PolyLine(Vertices=divide_2.Points, Closed=False)
reset = Button()
on = BooleanToggle(False)
onmesh = OnMesh(Points=divide_2.Points, Mesh=mesh, Strength=Slider(1000, range=0..1000))
explode = Explode(Curve=pline, Recursive=True)  # -> Segments, Vertices
lng = ListLength(List=explode.Segments)
culln = CullNth(List=explode.Segments, CullFrequency=lng)  # -> graft(List)
shift = ShiftList(List=explode.Segments, Shift=1, Wrap=True)  # -> graft(List)
number_slider = Slider(1, range=1..50)
merge = Merge(Data1=shift, Data2=culln)
timer = Timer(Interval=20, TimerInterval=20, Target=counter)  # disabled
len = Length(Curve=explode.Segments)
counter = Counter(Reset=reset)
num = Number(Slider(0.03, range=0..0.1))
item = ListItem(List=len, Index=0, Wrap=True)
item_2 = ListItem(List=merge, Index=0, Wrap=True)  # -> Item, Item1
rad_2 = Radians(Degrees=Slider(0, range=0..1000))
multiplication = Multiplication(A=counter, B=num)
end_2 = EndPoints(Curve=crv_3)  # -> Start, End
clampangle = ClampAngle(LineA=item_2.Item, LineB=item_2.Item1, UpperLimit=rad_2, LowerLimit=rad_2, Strength=Slider(0.01, range=0..1))
addition = Addition(A=multiplication, B=Slider(2, range=0..10))
multiplication_2 = Multiplication(A=addition, B=item)
multiplication_3 = Multiplication(A=Slider(0.34, range=0..10), B=multiplication_2)
length_line = LengthLine(Line=explode.Segments, Length=multiplication_2, Strength=1)
anchor = Anchor(Point=[end_2.Start, end_2.End], Strength=10000)
sc = SphereCollide(Points=divide_2.Points, Radius=multiplication_3, Strength=10)
show = Show(G=divide_2.Points)
entwine = Entwine(
    Branch00=anchor,
    Branch01=onmesh,
    Branch02=sc,
    Branch03=length_line,
    Branch04=show,
    Branch05=clampangle,
    FlattenInputs=True)
solver = Solver(GoalObjects=entwine, Reset=reset, Threshold=1e-15, Tolerance=0.0001, On=on)  # -> I, V, O
bang = ExplodeTree(Data=solver.O)  # -> Branch0, Branch1, Branch2, Branch3, Branch4, Branch5
intcrv_2 = Interpolate(Vertices=bang.Branch4, Degree=3, Periodic=False, KnotStyle=1)  # -> Curve, Length, Domain
cir = Circle(Plane=bang.Branch4, Radius=multiplication_3)
pt_3 = Point(bang.Branch4)
not = GateNot(A=on)
end_3 = EndPoints(Curve=intcrv_2.Curve)  # -> Start, End
repeat = RepeatData(Data="0", Length=Slider(83, range=0..100))
datarec_boolean = DataRecBoolean(reset=Toggle(False))  # -> out, A; inputs d: tree
# ---------- datarec_boolean: VB ----------
    If reset = True Then
      out_tree.clear
      Else 
      For Each p As GH_Path In d.Paths
        Dim out_list As List(Of Object) = d.Branch(p)
        out_tree.AddRange(out_list, New GH_Path(p))
      Next
      
    End If

    A = out_tree
# ---------- datarec_boolean: VB additional code ----------
  Dim out_tree As New DataTree(Of Object)
# ---------- end datarec_boolean ----------
merge_2 = Merge(Data1="1", Data2=repeat)  # -> flatten(Result)
cull = CullPattern(List=datarec_boolean.A, CullPattern=merge_2)
item_3 = ListItem(List=datarec_boolean.A, Index=0, Wrap=True)  # -> Item1, Item
panel_2 = Panel(datarec_boolean.A)
merge_3 = Merge(Data1=cull, Data2=item_3.Item1)  # -> flatten(Result)
lng_2 = ListLength(List=merge_3)
series = Series(Start=0, Step=Slider(0.37, range=0..1), Count=lng_2)
Z = UnitZ(Factor=series)
move_2 = Move(Geometry=merge_3, Motion=Z)  # -> Geometry, Transform
number_slider_2 = Slider(78, range=0..100)
divlength = DivideLength(Curve=move_2.Geometry, Length=Slider(0.07, range=0..1))  # -> Points, Tangents, Parameters
lng_3 = ListLength(List=divlength.Points)
panel_3 = Panel(lng_3)
reb = RebuildCurve(Curve=graft(move_2.Geometry), Degree=Slider(3, range=0..10), Count=lng_3, Tangents=False)  # -> flatten(Curve)
loft = Loft(Curves=move_2.Geometry, Options={Adjust=False, Closed=False, LoftEnds=0, LoftSimp=0, LoftType=0, Rebuild=10, Refit=0.01})
mirror = Mirror(Geometry=loft, Plane=PlaneYZ(0, 0, 0))  # -> Geometry, Transform
xz = XZPlane(Origin=Point(0, 0, 0))
mirror_2 = Mirror(Geometry=[mirror.Geometry, loft], Plane=xz)  # -> Geometry, Transform
join_2 = BrepJoin(Breps=[mirror_2.Geometry, loft, mirror.Geometry])  # -> Breps, Closed
mesh_2 = Mesh(join_2.Breps)
wbthicken = WeaverbirdsMeshThicken(MeshCurves=mesh_2, Distance=Slider(0.005, range=0..0.01), OffsetType=0)
preview = CustomPreview(Geometry=wbthicken, Material=ColourSwatch(SwatchColor=RGB(255, 255, 255)))
