# Grasshopper definition rigid.ghx (Grasshopper 1.0.7)
# plug-ins: Kangaroo2 Components

number_slider = Slider(75, range=0..100)  # disabled
number_slider_2 = Slider(50, range=0..100)  # disabled
number_slider_3 = Slider(28, range=0..100)  # disabled
pt = ConstructPoint(XCoordinate=0, YCoordinate=Slider(100, range=0..100), ZCoordinate=0)
pt_2 = ConstructPoint(XCoordinate=0, YCoordinate=Slider(119, range=0..200), ZCoordinate=0)
pt_3 = ConstructPoint(XCoordinate=0, YCoordinate=0, ZCoordinate=0)
pt_4 = ConstructPoint(XCoordinate=0, YCoordinate=0, ZCoordinate=0)
number_slider_4 = Slider(100, range=0..100)
number_slider_5 = Slider(13, range=0..100)  # disabled
pt_5 = ConstructPoint(XCoordinate=number_slider_3, YCoordinate=number_slider, ZCoordinate=0)  # disabled
pt_6 = ConstructPoint(XCoordinate=number_slider_2, YCoordinate=number_slider_2, ZCoordinate=0)  # disabled
pt_7 = ConstructPoint(XCoordinate=0, YCoordinate=0, ZCoordinate=0)  # disabled
merge = Merge(Data1=pt, Data2=pt_4)
merge_2 = Merge(Data1=pt_2, Data2=pt_3)
number_slider_6 = Slider(7, range=0..10)  # disabled
Y = UnitY(Factor=number_slider_5)  # disabled
merge_3 = Merge(Data1=pt_5, Data2=pt_6, Data3=pt_7)  # disabled
anchor = Anchor(Point=merge, Target=merge_2, Strength=10000)
pline = PolyLine(Vertices=merge_3, Closed=False)  # disabled
X = UnitX(Factor=number_slider_4)
X_2 = UnitX(Factor=number_slider_4)
move = Move(Geometry=pt_5, Motion=Y)  # -> Geometry, Transform; disabled
move_2 = Move(Geometry=pt, Motion=X)  # -> Geometry, Transform
move_3 = Move(Geometry=pt_4, Motion=X_2)  # -> Geometry, Transform
pipe = Pipe(Curve=pline, Radius=number_slider_6, Caps=0)  # disabled
load = Load(Point=merge_3, ForceVector=Vector(0, 0, 1), Weighting=1)  # disabled
rigidbody = RigidBody(Part=pipe, Points=merge_3, Strength=10)  # -> RigidBody, Planes; disabled
anchor_2 = Anchor(Point=pt_5, Target=move.Geometry, Strength=10000)  # disabled
ln = Line(StartPoint=pt_4, EndPoint=move_2.Geometry)
ln_2 = Line(StartPoint=pt, EndPoint=move_3.Geometry)
end = EndPoints(Curve=ln_2)  # -> Start, End
midpt = CurveMiddle(Curve=ln_2)
end_2 = EndPoints(Curve=ln)  # -> Start, End
button = Button()  # disabled
toggle = BooleanToggle(True)  # disabled
entwine = Entwine(Branch00=rigidbody.RigidBody, Branch01=anchor_2, Branch02=load, FlattenInputs=True)  # disabled
merge_4 = Merge(Data1=end.Start, Data2=midpt, Data3=end.End)
merge_5 = Merge(Data1=end_2.Start, Data2=midpt, Data3=end_2.End)
solver = Solver(GoalObjects=entwine, Reset=button, Threshold=1e-15, Tolerance=0.0001, On=toggle)  # -> I, V, O; disabled
bouncysolver = BouncySolver(GoalObjects=entwine, Reset=button, Threshold=1e-15, Tolerance=0.0001, Damping=0.99, Iterations=10, On=toggle)  # -> I, V, O; disabled
group = Group(Objects=merge_4)
group_2 = Group(Objects=merge_5)
series = Series(Start=0, Step=number_slider_4, Count=10)
X_3 = UnitX(Factor=series)
move_4 = Move(Geometry=[group, group_2], Motion=graft(X_3))  # -> flatten(Geometry), Transform
ungroup = Ungroup(Group=graft(move_4.Geometry))
pline_2 = PolyLine(Vertices=ungroup, Closed=False)
onplane = OnPlane(Points=ungroup, Plane=PlaneXY(0, 0, 0), Strength=1)
load_2 = Load(Point=ungroup, ForceVector=Vector(0, 0, 1), Weighting=1)  # disabled
pipe_2 = Pipe(Curve=pline_2, Radius=Slider(7, range=0..10), Caps=0)
rigidbody_2 = RigidBody(Part=pipe_2, Points=ungroup, Strength="100000")  # -> RigidBody, Planes
entwine_2 = Entwine(Branch00=rigidbody_2.RigidBody, Branch01=anchor, Branch02=load_2, Branch03=onplane, FlattenInputs=True)
solver_2 = Solver(GoalObjects=entwine_2, Reset=Button(), Threshold=1e-15, Tolerance=0.0001, On=Toggle(True))  # -> I, V, O
