# Grasshopper definition wasp.gh (Grasshopper 1.0.7)
# plug-ins: treesloth01

# ----
# Set Part Form
part_geometry = Brep([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])
part_geometry_2 = Brep([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])
part_geometry_3 = Brep([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])
sunion = SolidUnion(Breps=part_geometry)
sunion_2 = SolidUnion(Breps=part_geometry_2)
sunion_3 = SolidUnion(Breps=part_geometry_3)
debrep = DeconstructBrep(Brep=sunion)  # -> Faces, Edges, Vertices
debrep_2 = DeconstructBrep(Brep=sunion_2)  # -> Faces, Edges, Vertices
debrep_3 = DeconstructBrep(Brep=sunion_3)  # -> Faces, Edges, Vertices
area = Area(Geometry=debrep.Faces)  # -> Area, Centroid
area_2 = Area(Geometry=debrep_2.Faces)  # -> Area, Centroid
area_3 = Area(Geometry=debrep_3.Faces)  # -> Area, Centroid
line = LineSDL(Start=area.Centroid, Direction=Vector(0, 0, 1), Length=1)
line_2 = LineSDL(Start=area_2.Centroid, Direction=Vector(0, 0, 1), Length=1)
line_3 = LineSDL(Start=area_3.Centroid, Direction=Vector(0, 0, 1), Length=1)
connections_centers = Point(area.Centroid)
connections_x_axis = Curve(line)
connections_centers_2 = Point(area_2.Centroid)
connections_x_axis_2 = Curve(line_2)
connections_centers_3 = Point(area_3.Centroid)
connections_x_axis_3 = Curve(line_3)
conndir = Wasp_ConnectionFromDirection(GEO=sunion, CEN=connections_centers, UP=connections_x_axis)  # -> CONN, PLN_OUT; inputs CEN: list of Point3d, UP: list of Curve, T: list; plug-in component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
conndir_2 = Wasp_ConnectionFromDirection(GEO=sunion_2, CEN=connections_centers_2, UP=connections_x_axis_2)  # -> CONN, PLN_OUT; inputs CEN: list of Point3d, UP: list of Curve, T: list; plug-in component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
conndir_3 = Wasp_ConnectionFromDirection(GEO=sunion_3, CEN=connections_centers_3, UP=connections_x_axis_3)  # -> CONN, PLN_OUT; inputs CEN: list of Point3d, UP: list of Curve, T: list; plug-in component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
part_name = Panel("A")
points = PointList(Points=connections_centers, Size=Slider(2, range=0..10))
points_2 = PointList(Points=connections_centers_2, Size=Slider(2, range=0..10))
part_name_2 = Panel("B")
points_3 = PointList(Points=connections_centers_3, Size=Slider(2, range=0..10))
part_name_3 = Panel("C")
part = Wasp_BasicPart(NAME=part_name, GEO=sunion, CONN=flatten(conndir.CONN))  # -> PART; inputs GEO: Mesh, CONN: list, ATTR: list; plug-in component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
part_2 = Wasp_BasicPart(NAME=part_name_2, GEO=sunion_2, CONN=flatten(conndir_2.CONN))  # -> PART; inputs GEO: Mesh, CONN: list, ATTR: list; plug-in component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
part_3 = Wasp_BasicPart(NAME=part_name_3, GEO=sunion_3, CONN=flatten(conndir_3.CONN))  # -> PART; inputs GEO: Mesh, CONN: list, ATTR: list; plug-in component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

brep_cp = BrepClosestPoint(Point=connections_centers_3, Brep=sunion_3)  # -> Point, Normal, Distance
brep_cp_2 = BrepClosestPoint(Point=connections_centers_2, Brep=sunion_2)  # -> Point, Normal, Distance
# Set Regulation
brep_cp_3 = BrepClosestPoint(Point=connections_centers, Brep=sunion)  # -> Point, Normal, Distance
pdecon = Deconstruct(Point=brep_cp.Normal)  # -> XComponent, YComponent, ZComponent
pdecon_2 = Deconstruct(Point=brep_cp_2.Normal)  # -> XComponent, YComponent, ZComponent
pdecon_3 = Deconstruct(Point=brep_cp_3.Normal)  # -> XComponent, YComponent, ZComponent
points_4 = PointList(Points=brep_cp_2.Point, Size=Slider(1, range=0..1))
pt = ConstructPoint(XCoordinate=0, YCoordinate=0, ZCoordinate=pdecon.ZComponent)
pt_2 = ConstructPoint(XCoordinate=0, YCoordinate=0, ZCoordinate=pdecon_2.ZComponent)
pt_3 = ConstructPoint(XCoordinate=0, YCoordinate=0, ZCoordinate=pdecon_3.ZComponent)
pgroups = PointGroups(Points=pt, Distance="0.1")  # -> Groups, Indices
pgroups_2 = PointGroups(Points=pt_2, Distance="0.1")  # -> Groups, Indices
pgroups_3 = PointGroups(Points=pt_3, Distance="0.1")  # -> Groups, Indices
item = ListItem(List=pgroups.Groups, Index=0, Wrap=True)
item_2 = ListItem(List=pgroups_2.Groups, Index=0, Wrap=True)
item_3 = ListItem(List=pgroups_3.Groups, Index=0, Wrap=True)
tstat = TreeStatistics(Tree=pgroups.Indices)  # -> Paths, Length, Count
pdecon_4 = Deconstruct(Point=item)  # -> XComponent, YComponent, ZComponent
tstat_2 = TreeStatistics(Tree=pgroups_2.Indices)  # -> Paths, Length, Count
tstat_3 = TreeStatistics(Tree=pgroups_3.Indices)  # -> Paths, Length, Count
pdecon_5 = Deconstruct(Point=item_2)  # -> XComponent, YComponent, ZComponent
panel = Panel(pdecon_4.ZComponent)
pdecon_6 = Deconstruct(Point=item_3)  # -> XComponent, YComponent, ZComponent
panel_2 = Panel(pdecon_5.ZComponent)
panel_3 = Panel(pdecon_6.ZComponent)
sort = SortList(Keys=flatten(pdecon_4.ZComponent), ValuesA=tstat.Paths)  # -> Keys, ValuesA
sort_2 = SortList(Keys=flatten(pdecon_5.ZComponent), ValuesA=tstat_2.Paths)  # -> Keys, ValuesA
sort_3 = SortList(Keys=flatten(pdecon_6.ZComponent), ValuesA=tstat_3.Paths)  # -> Keys, ValuesA
branch = TreeBranch(Tree=pgroups.Indices, Path=sort.ValuesA, MaintainPaths=False)
branch_2 = TreeBranch(Tree=pgroups_2.Indices, Path=sort_2.ValuesA, MaintainPaths=False)
branch_3 = TreeBranch(Tree=pgroups_3.Indices, Path=sort_3.ValuesA, MaintainPaths=False)
panel_4 = Panel("""C-d-
C-m-
C-u-""")
panel_5 = Panel("""B-d-
B-m-
B-u-""")
panel_6 = Panel("""A-d-
A-m-
A-u-""")
panel_7 = Panel(branch_2)
graft = GraftTree(Tree=panel_5, IncludeEmptyLists=True, IncludeNullItems=True)
graft_2 = GraftTree(Tree=panel_4, IncludeEmptyLists=True, IncludeNullItems=True)
graft_3 = GraftTree(Tree=panel_6, IncludeEmptyLists=True, IncludeNullItems=True)
lng = ListLength(List=branch_2)
lng_2 = ListLength(List=branch)
lng_3 = ListLength(List=branch_3)
graft_4 = GraftTree(Tree=branch_2, IncludeEmptyLists=True, IncludeNullItems=True)
repeat = RepeatData(Data=graft, Length=lng)  # -> simplify(graft(Data))
repeat_2 = RepeatData(Data=graft_2, Length=lng_2)  # -> simplify(graft(Data))
repeat_3 = RepeatData(Data=graft_3, Length=lng_3)  # -> simplify(graft(Data))
graft_5 = GraftTree(Tree=branch, IncludeEmptyLists=True, IncludeNullItems=True)
graft_6 = GraftTree(Tree=branch_3, IncludeEmptyLists=True, IncludeNullItems=True)
merge = Merge(Data1=repeat, Data2=graft_4)
merge_2 = Merge(Data1=repeat_2, Data2=graft_5)
merge_3 = Merge(Data1=repeat_3, Data2=graft_6)
join = TextJoin(Text=merge)  # -> flatten(Result)
join_2 = TextJoin(Text=merge_2)  # -> flatten(Result)
join_3 = TextJoin(Text=merge_3)  # -> flatten(Result)
panel_8 = Panel(join)
panel_9 = Panel(join_3)
panel_10 = Panel(join_2)
merge_4 = Merge(Data1=join_3, Data2=join, Data3=join_2)
crossref = CrossReference(ListA=merge_4, ListB=merge_4, CrossMode=1)  # -> graft(ListA), graft(ListB)
panel_11 = Panel(crossref.ListA)
merge_5 = Merge(Data1=crossref.ListA, Data2=crossref.ListB)  # -> simplify(Result)
fragment = TextFragment(Text=crossref.ListB, Start=Slider(2, range=0..4), Count="1")  # -> flatten(Fragment)
fragment_2 = TextFragment(Text=crossref.ListA, Start=Slider(2, range=0..4), Count="1")  # -> flatten(Fragment)
panel_12 = Panel(fragment_2)
tstat_4 = TreeStatistics(Tree=merge_5)  # -> Paths, Length, Count
python = GhPythonScript(x=fragment_2, y=fragment)  # -> out, a; inputs x: list, y: list
# ---------- python: Python ----------
a = []
for i in range(len(x)):
    if(x[i]=="m" and y[i]=="m"):
        a.append(1)
    elif(x[i]=="d" and y[i]=="u"):
        a.append(1)
    elif(x[i]=="u" and y[i]=="d"):
        a.append(1)
    else:
        a.append(0)
# ---------- end python ----------
merge_6 = Merge(Data1=part, Data2=part_2, Data3=part_3)
dispatch = Dispatch(List=tstat_4.Paths, DispatchPattern=python.a)  # -> ListA, ListB
branch_4 = TreeBranch(Tree=merge_5, Path=dispatch.ListA, MaintainPaths=True)
panel_13 = Panel(branch_4)
split = TextSplit(Text=branch_4, Separators="-")
panel_14 = Panel(split)
item_4 = ListItem(List=split, Index=0, Wrap=True)
item_5 = ListItem(List=split, Index="2", Wrap=True)
shift = ShiftPaths(Data=item_4, Offset=-1)
shift_2 = ShiftPaths(Data=item_5, Offset=-1)
panel_15 = Panel(shift_2)
panel_16 = Panel("""X
|
X
_
X
|
X""")
panel_17 = Panel("""0
4""")

# ----
# Set boundry
number_slider = Slider(34, range=0..100)
dom = ConstructDomain(DomainStart=0, DomainEnd=Slider(42, range=0..100))
dom_2 = ConstructDomain(DomainStart=0, DomainEnd=number_slider)
rectangle = Rectangle(Plane=PlaneXY(0, 0, 0), XSize=dom, YSize=dom_2, Radius=0)  # -> Rectangle, Length
Z = UnitZ(Factor=Slider(90, range=0..100))
boundary = BoundarySurfaces(Edges=rectangle.Rectangle)
extr = Extrude(Base=boundary, Direction=Z)

replace = ReplaceItems(List=panel_16, Item=shift, Indices=panel_17, Wrap=False)
panel_18 = Panel("""2
6""")
panel_19 = Panel(replace)
replace_2 = ReplaceItems(List=replace, Item=shift_2, Indices=panel_18, Wrap=False)
join_4 = TextJoin(Text=replace_2)  # -> flatten(Result)
panel_20 = Panel(join_4)
ruletxt = Wasp_RuleFromText(TXT=join_4)  # -> R; plug-in component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
area_4 = Area(Geometry=rectangle.Rectangle)  # -> Area, Centroid
orient = Orient(Geometry=extr, Source=area_4.Centroid, Target=PlaneXY(0, 0, 0))  # -> Geometry, Transform
brep = Brep(orient.Geometry)
genes = GenePool(Decimals=2, Maximum=1000, Minimum=0, Value=[893.96, 191.16, 206.16])
brep_2 = Brep(brep)
item_6 = ListItem(List=genes, Index=0, Wrap=True)  # -> Item, Item1, Item2
number_slider_2 = Slider(20, range=0..100)
number_slider_3 = Slider(0.038, range=0..1)
number_slider_4 = Slider(26.68, range=0..100)
number_slider_5 = Slider(26.68, range=0..100)
panel_21 = Panel("""25
25
25""")
partcat = Wasp_PartsCatalog(PART=flatten(merge_6), NUM=panel_21, LIM=Toggle(False), AD=Toggle(True))  # -> CAT; inputs PART: list, NUM: list, LIM: Boolean, AD: Boolean; plug-in component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
item_7 = ListItem(List=panel_21, Index=0, Wrap=True)  # -> Item, Item1
division = Division(A=item_7.Item, B=item_7.Item1)
button = Button()
part_name_4 = Panel("A")
part_name_5 = Panel("B")
part_name_6 = Panel("C")
area_5 = Area(Geometry=sunion)  # -> Area, Centroid
area_6 = Area(Geometry=sunion_2)  # -> Area, Centroid
area_7 = Area(Geometry=sunion_3)  # -> Area, Centroid

fieldpts = Wasp_FieldPoints(BOU=brep_2, RES=Slider(2, range=0..10))  # -> E_FIELD, PTS; inputs BOU: list of Mesh, PLN: Plane; plug-in component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

pt_4 = Point(fieldpts.PTS)
python_2 = GhPythonScript(
    pts=pt_4,
    scaleX=number_slider_3,
    scaleY=number_slider_3,
    scaleZ=number_slider_3,
    shiftX=item_6.Item,
    shiftY=item_6.Item1,
    shiftZ=item_6.Item2,
    domainStart=Slider(0.1, range=0..180),
    domainEnd=Slider(1, range=0..1))  # -> out, a; inputs pts: list of Point3d
# ---------- python_2: Python ----------
import rhinoscriptsyntax as rs
import perlin

sn = perlin.SimplexNoise()

def ReMapNum(value, minInput, maxInput, minOutput, maxOutput):
    reMapValue = minOutput + (value - minInput)/(maxInput - minInput) * (maxOutput - minOutput)
    return reMapValue


a = []
for i in pts:
    perlinValue = sn.noise3((i[0]+shiftX)*scaleX, (i[1]+shiftY)*scaleY, (i[2]+shiftZ)*scaleZ)
    num = ReMapNum(perlinValue, -1, 1, domainStart, domainEnd)
    a.append(num)
# ---------- end python_2 ----------
panel_22 = Panel(python_2.a)

field = Wasp_Field(NAME="myVolField", E_FIELD=fieldpts.E_FIELD, VAL=python_2.a)  # -> FIELD; inputs VAL: list; plug-in component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

defield = Wasp_DeconstructField(FIELD=field)  # -> NAME, PTS, COUNT, RES, PLN, VAL, BOU, BB; plug-in component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
gradient = Gradient(LowerLimit=0, UpperLimit=1, Parameter=defield.VAL, stops=[0: RGB(0, 128, 0), 0.5: RGB(255, 255, 0), 1: RGB(255, 0, 0)])
preview = CustomPreview(Geometry=defield.PTS, Material=gradient)

smaller = SmallerThan(FirstNumber=defield.VAL, SecondNumber=Slider(0.473, range=0..1))  # -> SmallerThan, OrEqualTo
dispatch_2 = Dispatch(List=gradient, DispatchPattern=smaller.SmallerThan)  # -> ListA, ListB
dispatch_3 = Dispatch(List=defield.PTS, DispatchPattern=smaller.SmallerThan)  # -> ListA, ListB
fieldaggregation = Wasp_FieldDrivenAggregation(
    PART=flatten(merge_6),
    N=Slider(200, range=0..1000),
    RULES=ruletxt,
    FIELD=field,
    CAT=partcat,
    RESET=Slider(1, range=0..10))  # -> AGGR, PART_OUT; inputs PART: list, PREV: list, N: Int32, RULES: list, FIELD: list, MODE: Int32, GC: list, RESET: Boolean; plug-in component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
preview_2 = CustomPreview(Geometry=dispatch_3.ListB, Material=dispatch_2.ListB)
depart = Wasp_DeconstructPart(PART=fieldaggregation.PART_OUT)  # -> NAME, ID, GEO, CENTER, CONN, COLL, TR, PARENT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; plug-in component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
namefilter = Wasp_FilterPartsByName(PART=fieldaggregation.PART_OUT, NAME=part_name_4)  # -> PART_OUT, MASK; inputs PART: list, NAME: list; plug-in component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
namefilter_2 = Wasp_FilterPartsByName(PART=fieldaggregation.PART_OUT, NAME=part_name_5)  # -> PART_OUT, MASK; inputs PART: list, NAME: list; plug-in component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
namefilter_3 = Wasp_FilterPartsByName(PART=fieldaggregation.PART_OUT, NAME=part_name_6)  # -> PART_OUT, MASK; inputs PART: list, NAME: list; plug-in component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
dispatch_4 = Dispatch(List=depart.TR, DispatchPattern=namefilter.MASK)  # -> ListA, ListB
dispatch_5 = Dispatch(List=depart.TR, DispatchPattern=namefilter_2.MASK)  # -> ListA, ListB
dispatch_6 = Dispatch(List=depart.TR, DispatchPattern=namefilter_3.MASK)  # -> ListA, ListB
transform = Transform(Geometry=sunion, Transform=dispatch_4.ListA)
transform_2 = Transform(Geometry=sunion_2, Transform=dispatch_5.ListA)
transform_3 = Transform(Geometry=sunion_3, Transform=dispatch_6.ListA)
lng_4 = ListLength(List=transform)
lng_5 = ListLength(List=transform_2)
lng_6 = ListLength(List=transform_3)
brep_3 = Brep([transform, transform_2, transform_3])
multiplication = Multiplication(A=area_5.Area, B=lng_4)
multiplication_2 = Multiplication(A=area_6.Area, B=lng_5)
multiplication_3 = Multiplication(A=area_7.Area, B=lng_6)
bbox = BoundingBox(Content=brep_3, Plane=PlaneXY(0, 0, 0), UnionBox=True)  # -> Box, Box_2
panel_23 = Panel(multiplication)
panel_24 = Panel(multiplication_2)
panel_25 = Panel(multiplication_3)
debrep_4 = DeconstructBrep(Brep=bbox.Box)  # -> Faces, Edges, Vertices
area_8 = Area(Geometry=debrep_4.Faces)  # -> Area, Centroid
pdecon_7 = Deconstruct(Point=area_8.Centroid)  # -> XComponent, YComponent, ZComponent
sort_4 = SortList(Keys=pdecon_7.ZComponent, ValuesA=area_8.Centroid)  # -> Keys, ValuesA
item_8 = ListItem(List=sort_4.ValuesA, Index=0, Wrap=True)
orient_2 = Orient(Geometry=transform_3, Source=item_8, Target=PlaneXY(0, 0, 0))  # -> Geometry, Transform
orient_3 = Orient(Geometry=transform, Source=item_8, Target=PlaneXY(0, 0, 0))  # -> Geometry, Transform
orient_4 = Orient(Geometry=transform_2, Source=item_8, Target=PlaneXY(0, 0, 0))  # -> Geometry, Transform
preview_3 = CustomPreview(Geometry=orient_3.Geometry, Material=ColourSwatch(SwatchColor=RGB(255, 0, 0)))  # disabled
preview_4 = CustomPreview(Geometry=orient_4.Geometry, Material=ColourSwatch(SwatchColor=RGB(0, 255, 17)))  # disabled
preview_5 = CustomPreview(Geometry=orient_2.Geometry, Material=ColourSwatch(SwatchColor=RGB(0, 60, 255)))  # disabled
brep_4 = Brep(orient_3.Geometry)
brep_5 = Brep(orient_4.Geometry)
brep_6 = Brep(orient_2.Geometry)
