# Grasshopper definition wasp2.gh (Grasshopper 1.0.7)

crv = Curve([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])
crv_2 = Curve([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])
loft = Loft(Curves=crv, Options={Adjust=False, Closed=False, LoftEnds=0, LoftSimp=0, LoftType=0, Rebuild=10, Refit=0.01})
cluster = Cluster(
    A=[Slider(285, range=0..360), Slider(286, range=0..360), Slider(303, range=0..360)],
    A_2=[Slider(26, range=0..360), Slider(117, range=0..360), Slider(264, range=0..360)])  # -> crv_3, pt_4, line_6, brep_3, mesh_2
cluster_2 = Cluster(
    A=[Slider(304, range=0..360), Slider(313, range=0..360), Slider(330, range=0..360)],
    A_2=[Slider(0, range=0..360), Slider(93, range=0..360), Slider(272, range=0..360)])  # -> crv_3, pt_4, line_6, brep_3, mesh_2
number_slider = Slider(0.3, range=0..10)
number_slider_2 = Slider(0.47, range=0..10)
connections_x_axis = Curve(flatten(cluster.line_6))
connections_centers = Point(flatten(cluster.pt_4))
connections_centers_2 = Point(flatten(cluster_2.pt_4))
connections_x_axis_2 = Curve(flatten(cluster_2.line_6))
conndir = Wasp_ConnectionFromDirection(GEO=cluster.brep_3, CEN=connections_centers, UP=connections_x_axis)  # -> CONN, PLN_OUT; inputs CEN: list of Point3d, UP: list of Curve, T: list; plug-in component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
points = PointList(Points=connections_centers, Size=Slider(0.05, range=0..1))
conndir_2 = Wasp_ConnectionFromDirection(GEO=cluster_2.brep_3, CEN=connections_centers_2, UP=connections_x_axis_2, T=Slider(1, range=0..1))  # -> CONN, PLN_OUT; inputs CEN: list of Point3d, UP: list of Curve, T: list; plug-in component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
part_name = Panel("A")
points_2 = PointList(Points=connections_centers_2, Size=Slider(0.05, range=0..1))

# ----
# Set boundry
number_slider_3 = Slider(34, range=0..100)
dom = ConstructDomain(DomainStart=0, DomainEnd=Slider(42, range=0..100))
dom_2 = ConstructDomain(DomainStart=0, DomainEnd=number_slider_3)
rectangle = Rectangle(Plane=PlaneXY(0, 0, 0), XSize=dom, YSize=dom_2, Radius=0)  # -> Rectangle, Length
Z = UnitZ(Factor=Slider(90, range=0..100))
boundary = BoundarySurfaces(Edges=rectangle.Rectangle)
extr = Extrude(Base=boundary, Direction=Z)

part_name_2 = Panel("B")
part = Wasp_BasicPart(NAME=part_name, GEO=cluster.brep_3, CONN=conndir.CONN)  # -> PART; inputs GEO: Mesh, CONN: list, ATTR: list; plug-in component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
panel = Panel(part)
part_2 = Wasp_BasicPart(NAME=part_name_2, GEO=cluster_2.brep_3, CONN=conndir_2.CONN)  # -> PART; inputs GEO: Mesh, CONN: list, ATTR: list; plug-in component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
area = Area(Geometry=rectangle.Rectangle)  # -> Area, Centroid
orient = Orient(Geometry=extr, Source=area.Centroid, Target=PlaneXY(0, 0, 0))  # -> Geometry, Transform
brep = Brep(orient.Geometry)
rulegen = Wasp_RulesGenerator(PART=[part, part_2], SELF_P=Toggle(False), SELF_C=Toggle(False))  # -> R; inputs PART: list, SELF_P: Boolean, SELF_C: Boolean, TYP: Boolean, GR: list; plug-in component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
merge = Merge(Data1=part, Data2=part_2)
genes = GenePool(Decimals=2, Maximum=1000, Minimum=0, Value=[893.96, 191.16, 206.16])
brep_2 = Brep(brep)
item = ListItem(List=genes, Index=0, Wrap=True)  # -> Item, Item1, Item2
number_slider_4 = Slider(20, range=0..100)
number_slider_5 = Slider(0.038, range=0..1)
number_slider_6 = Slider(26.68, range=0..100)
number_slider_7 = Slider(26.68, range=0..100)
panel_2 = Panel("""1
1""")
partcat = Wasp_PartsCatalog(PART=flatten(merge), NUM=panel_2, LIM=Toggle(False), AD=Toggle(False))  # -> CAT; inputs PART: list, NUM: list, LIM: Boolean, AD: Boolean; plug-in component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
number_slider_8 = Slider(1, range=0..10)
part_name_3 = Panel("A")
part_name_4 = Panel("B")
pt = Point(<point referenced from the Rhino model>)
number_slider_9 = Slider(0.05, range=0..0.1)
yz = YZPlane(Origin=pt)

# ----
# Define field
number_slider_10 = Slider(10, range=0..100)
crv_3 = Curve(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)
offset_l = OffsetCurveLoose(Curve=crv_3, Distance=number_slider_10)
loft_2 = Loft(
    Curves=flatten([offset_l, crv_3]),
    Options={Adjust=False, Closed=False, LoftEnds=0, LoftSimp=0, LoftType=0, Rebuild=10, Refit=0.01})
geo = Geometry(loft)
bbox = BoundingBox(Content=geo, Plane=PlaneXY(0, 0, 0))  # -> Box, Box_2
number_slider_11 = Slider(0.3, range=0..10)
number_slider_12 = Slider(0.3, range=0..10)
volume = Volume(Geometry=bbox.Box)  # -> Volume, Centroid
scale_nu = ScaleNU(Geometry=bbox.Box, Plane=volume.Centroid, ScaleX=number_slider_12, ScaleY=number_slider_12, ScaleZ=number_slider_11)  # -> Geometry, Transform
preview = CustomPreview(Geometry=geo, Material=ColourSwatch(SwatchColor=RGB(194, 194, 194)))  # disabled
fieldpts = Wasp_FieldPoints(BOU=scale_nu.Geometry, RES=Slider(0.4, range=0..10))  # -> E_FIELD, PTS; inputs BOU: list of Mesh, PLN: Plane; plug-in component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
dom_3 = ConstructDomain(DomainStart="1", DomainEnd="0")

scale_nu_2 = ScaleNU(Geometry=geo, Plane=volume.Centroid, ScaleX=number_slider_12, ScaleY=number_slider_12, ScaleZ=number_slider_11)  # -> Geometry, Transform

geo_2 = Geometry(scale_nu_2.Geometry)
pull = PullPoint(Point=fieldpts.PTS, Geometry=geo_2, ClosestOnly=True)  # -> ClosestPoint, Distance
bnd = Bounds(Numbers=pull.Distance)
remap = RemapNumbers(Value=pull.Distance, Source=bnd, Target=dom_3)  # -> Mapped, Clipped
num = Number(remap.Mapped)
field = Wasp_Field(E_FIELD=fieldpts.E_FIELD, VAL=num)  # -> FIELD; inputs VAL: list; plug-in component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

larger = LargerThan(FirstNumber=remap.Mapped, SecondNumber=Slider(0.91, range=0..1))  # -> LargerThan, OrEqualTo
dispatch = Dispatch(List=fieldpts.PTS, DispatchPattern=larger.LargerThan)  # -> ListA, ListB
dispatch_2 = Dispatch(List=num, DispatchPattern=larger.LargerThan)  # -> ListA, ListB
bnd_2 = Bounds(Numbers=dispatch_2.ListA)
dedomain = DeconstructDomain(Domain=bnd_2)  # -> Start, End
gradient = Gradient(
    LowerLimit=dedomain.Start,
    UpperLimit=dedomain.End,
    Parameter=dispatch_2.ListA,
    stops=[0: RGB(0, 128, 0), 0.5: RGB(255, 255, 0), 1: RGB(255, 0, 0)])
preview_2 = CustomPreview(Geometry=dispatch.ListA, Material=gradient)

fieldaggregation = Wasp_FieldDrivenAggregation(PART=flatten(merge), N=Slider(200, range=0..1000), RULES=rulegen, FIELD=field, CAT=partcat, RESET=Button())  # -> AGGR, PART_OUT; inputs PART: list, PREV: list, N: Int32, RULES: list, FIELD: list, MODE: Int32, GC: list, RESET: Boolean; plug-in component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
depart = Wasp_DeconstructPart(PART=fieldaggregation.PART_OUT)  # -> NAME, ID, GEO, CENTER, CONN, COLL, TR, PARENT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; plug-in component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
namefilter = Wasp_FilterPartsByName(PART=fieldaggregation.PART_OUT, NAME=part_name_3)  # -> PART_OUT, MASK; inputs PART: list, NAME: list; plug-in component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
namefilter_2 = Wasp_FilterPartsByName(PART=fieldaggregation.PART_OUT, NAME=part_name_4)  # -> PART_OUT, MASK; inputs PART: list, NAME: list; plug-in component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
dispatch_3 = Dispatch(List=depart.TR, DispatchPattern=namefilter.MASK)  # -> ListA, ListB
dispatch_4 = Dispatch(List=depart.TR, DispatchPattern=namefilter_2.MASK)  # -> ListA, ListB
transform = Transform(Geometry=cluster.crv_3, Transform=dispatch_3.ListA)
transform_2 = Transform(Geometry=cluster_2.crv_3, Transform=dispatch_4.ListA)
pipe = Pipe(Curve=transform_2, Radius=number_slider_9, Caps=0)
pipe_2 = Pipe(Curve=transform, Radius=number_slider_9, Caps=0)
mirror = Mirror(Geometry=pipe_2, Plane=yz)  # -> Geometry, Transform
mirror_2 = Mirror(Geometry=pipe, Plane=yz)  # -> Geometry, Transform
preview_3 = CustomPreview(Geometry=[mirror.Geometry, pipe_2], Material=ColourSwatch(SwatchColor=RGB(133, 133, 133)))
preview_4 = CustomPreview(Geometry=[mirror_2.Geometry, pipe], Material=ColourSwatch(SwatchColor=RGB(255, 20, 20)))

fieldpts_2 = Wasp_FieldPoints(BOU=brep_2, RES=Slider(2, range=0..10))  # -> E_FIELD, PTS; inputs BOU: list of Mesh, PLN: Plane; plug-in component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

pt_2 = Point(fieldpts_2.PTS)
python = GhPythonScript(
    pts=pt_2,
    scaleX=number_slider_5,
    scaleY=number_slider_5,
    scaleZ=number_slider_5,
    shiftX=item.Item,
    shiftY=item.Item1,
    shiftZ=item.Item2,
    domainStart=Slider(0.1, range=0..180),
    domainEnd=Slider(1, range=0..1))  # -> out, a; inputs pts: list of Point3d
# ---------- python: Python ----------
import rhinoscriptsyntax as rs
import perlin

sn = perlin.SimplexNoise()

def ReMapNum(value, minInput, maxInput, minOutput, maxOutput):
    reMapValue = minOutput + (value - minInput)/(maxInput - minInput) * (maxOutput - minOutput)
    return reMapValue


a = []
for i in pts:
    perlinValue = sn.noise3((i[0]+shiftX)*scaleX, (i[1]+shiftY)*scaleY, (i[2]+shiftZ)*scaleZ)
    num = ReMapNum(perlinValue, -1, 1, domainStart, domainEnd)
    a.append(num)
# ---------- end python ----------
panel_3 = Panel(python.a)

field_2 = Wasp_Field(NAME="myVolField", E_FIELD=fieldpts_2.E_FIELD, VAL=python.a)  # -> FIELD; inputs VAL: list; plug-in component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

defield = Wasp_DeconstructField(FIELD=field_2)  # -> NAME, PTS, COUNT, RES, PLN, VAL, BOU, BB; plug-in component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
gradient_2 = Gradient(LowerLimit=0, UpperLimit=1, Parameter=defield.VAL, stops=[0: RGB(0, 128, 0), 0.5: RGB(255, 255, 0), 1: RGB(255, 0, 0)])
preview_5 = CustomPreview(Geometry=defield.PTS, Material=gradient_2)

smaller = SmallerThan(FirstNumber=defield.VAL, SecondNumber=Slider(0.473, range=0..1))  # -> SmallerThan, OrEqualTo
dispatch_5 = Dispatch(List=gradient_2, DispatchPattern=smaller.SmallerThan)  # -> ListA, ListB
dispatch_6 = Dispatch(List=defield.PTS, DispatchPattern=smaller.SmallerThan)  # -> ListA, ListB
preview_6 = CustomPreview(Geometry=dispatch_6.ListB, Material=dispatch_5.ListB)

# ==== cluster Cluster
number_slider = Slider(1, range=0..1)
pt = ConstructPoint(XCoordinate=0, YCoordinate=0, ZCoordinate=0)
Z = UnitZ(Factor=number_slider)
line = LineSDL(Start=pt, Direction=Vector(0, 0, 1), Length=number_slider)
move = Move(Geometry=pt, Motion=Z)  # -> Geometry, Transform
X = UnitX(Factor=1)
line_2 = LineSDL(Start=move.Geometry, Direction=Vector(0, 0, 1), Length=Slider(0.55, range=0..1))
A = ClusterInput()
line_3 = LineSDL(Start=move.Geometry, Direction=X, Length="1")
A_2 = ClusterInput()
rotax = RotateAxis(Geometry=line_2, Angle=degrees(A), Axis=line_3)  # -> Geometry, Transform
rotax_2 = RotateAxis(Geometry=rotax.Geometry, Angle=degrees(A_2), Axis=line)  # -> Geometry, Transform
crv = Curve(graft([line, rotax_2.Geometry]))
end = EndPoints(Curve=crv)  # -> Start, End
merge = Merge(Data1=end.Start, Data2=end.End)
dist = Distance(PointA=move.Geometry, PointB=merge)
sort = SortList(Keys=dist, ValuesA=merge)  # -> Keys, ValuesA
number_slider_2 = Slider(0.08, range=0..0.1)
pline = PolyLine(Vertices=sort.ValuesA, Closed=False)
pipe = Pipe(Curve=pline, Radius=number_slider_2, Caps=0)
capex = CapHolesEx(Brep=pipe)  # -> Brep, Caps, Solid
flatten = FlattenTree(Tree=capex.Brep, Path="{0}")
debrep = DeconstructBrep(Brep=capex.Brep)  # -> Faces, Edges, Vertices
item = ListItem(List=debrep.Faces, Index=0, Wrap=True)  # -> Item, Item1, Item2
brep = Brep(item.Item1)
pt_2 = ConstructPoint(XCoordinate="0.5", YCoordinate="0.5", ZCoordinate=0)
range = Range(Domain="360", Steps=Slider(5, range=0..10))
area = Area(Geometry=brep)  # -> Area, Centroid
evalsrf = EvaluateSurface(Surface=reparameterize(brep), Point=pt_2)  # -> Point, Normal, UDirection, VDirection, Frame
mpipe = MeshPipe(Curve=pline, Radius=number_slider_2, Accuracy=0.2, Rotation=0, Segments=Slider(10, range=0..10), Caps="1")  # -> flatten(Mesh)
msphere = MeshSphere(Base=move.Geometry, Radius=Slider(0.08, range=0..0.1), UCount=10, VCount=20)
lng = ListLength(List=range)
munion = MeshUnion(Meshes=flatten([mpipe, msphere]))
culln = CullNth(List=range, CullFrequency=lng)
prot = RotatePlane(Plane=evalsrf.Frame, Angle=culln)
sunion = SolidUnion(Breps=flatten)
brep_2 = Brep(sunion)
mesh = Mesh(munion)
deplane = DeconstructPlane(Plane=prot)  # -> Origin, XAxis, YAxis, ZAxis
mesh_2 = ClusterOutput(mesh)
brep_3 = ClusterOutput(brep_2)
line_4 = LineSDL(Start=deplane.Origin, Direction=deplane.YAxis, Length=1)
pt_3 = Point(deplane.Origin)
crv_2 = Curve(pline)
line_5 = Line(line_4)
crv_3 = ClusterOutput(crv_2)
pt_4 = ClusterOutput(pt_3)
line_6 = ClusterOutput(line_5)
