# Grasshopper definition wasp_house.gh (Grasshopper 1.0.7)

# ----
# Define field
number_slider = Slider(10, range=0..100)
crv = Curve(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)
offset_l = OffsetCurveLoose(Curve=crv, Distance=number_slider)
loft = Loft(
    Curves=flatten([offset_l, crv]),
    Options={Adjust=False, Closed=False, LoftEnds=0, LoftSimp=0, LoftType=0, Rebuild=10, Refit=0.01})
geo = Geometry(loft)
bbox = BoundingBox(Content=geo, Plane=PlaneXY(0, 0, 0))  # -> Box, Box_2
number_slider_2 = Slider(1.5, range=0..10)
volume = Volume(Geometry=bbox.Box)  # -> Volume, Centroid
scale_nu = ScaleNU(
    Geometry=bbox.Box,
    Plane=volume.Centroid,
    ScaleX=number_slider_2,
    ScaleY=number_slider_2,
    ScaleZ=Slider(2.17, range=0..10))  # -> Geometry, Transform
preview = CustomPreview(Geometry=geo, Material=ColourSwatch(SwatchColor=RGB(194, 194, 194)))
fieldpts = Wasp_FieldPoints(BOU=scale_nu.Geometry, RES=Slider(2.5, range=0..10))  # -> E_FIELD, PTS; inputs BOU: list of Mesh, PLN: Plane; plug-in component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
geo_2 = Geometry(geo)
pull = PullPoint(Point=fieldpts.PTS, Geometry=geo_2, ClosestOnly=True)  # -> ClosestPoint, Distance
dom = ConstructDomain(DomainStart="1", DomainEnd="0")
bnd = Bounds(Numbers=pull.Distance)
remap = RemapNumbers(Value=pull.Distance, Source=bnd, Target=dom)  # -> Mapped, Clipped
num = Number(remap.Mapped)
field = Wasp_Field(E_FIELD=fieldpts.E_FIELD, VAL=num)  # -> FIELD; inputs VAL: list; plug-in component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

# ----
# Define unit property
pt = Point([Point(2.5, 2.5, 4), Point(2.5, 5, 4), Point(2.5, 7.5, 4)])
# 2_09_Field_From_Surface
geo_3 = Geometry(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)
crv_2 = Curve([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])
crv_3 = Curve([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])
pt_2 = Point([Point(2.5, 2.5, 0), Point(2.5, 7.5, 0)])
pt_3 = Point([Point(2.5, 0, 2), Point(5, 2.5, 1), Point(5, 7.5, 2), Point(2.5, 10, 2), Point(0, 7.5, 3), Point(0, 2.5, 2)])
crv_4 = Curve([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])
conndir = Wasp_ConnectionFromDirection(GEO=geo_3, CEN=pt, UP=crv_2, T="TOP")  # -> CONN, PLN_OUT; inputs CEN: list of Point3d, UP: list of Curve, T: list; plug-in component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
conndir_2 = Wasp_ConnectionFromDirection(GEO=geo_3, CEN=pt_2, UP=crv_4, T="BOTTOM")  # -> CONN, PLN_OUT; inputs CEN: list of Point3d, UP: list of Curve, T: list; plug-in component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
conndir_3 = Wasp_ConnectionFromDirection(GEO=geo_3, CEN=pt_3, UP=crv_3, T="SIDES")  # -> CONN, PLN_OUT; inputs CEN: list of Point3d, UP: list of Curve, T: list; plug-in component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
geo_4 = Geometry(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)
geo_5 = Geometry([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])
geo_6 = Geometry([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])
attribute = Wasp_Attribute(ID="house", VAL=geo_4, TR=Toggle(True))  # -> ATTR; inputs VAL: list, TR: Boolean; plug-in component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
attribute_2 = Wasp_Attribute(ID="window", VAL=geo_5, TR=Toggle(True))  # -> ATTR; inputs VAL: list, TR: Boolean; plug-in component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
attribute_3 = Wasp_Attribute(ID="door", VAL=geo_6, TR=Toggle(True))  # -> ATTR; inputs VAL: list, TR: Boolean; plug-in component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
merge = Merge(Data1=conndir_3.CONN, Data2=conndir_2.CONN, Data3=conndir.CONN)
part = Wasp_BasicPart(NAME="BLOCK01", GEO=geo_3, CONN=flatten(merge), ATTR=[attribute, attribute_2, attribute_3])  # -> PART; inputs GEO: Mesh, CONN: list, ATTR: list; plug-in component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

# ----
# Define rule
panel = Panel("""SIDES>SIDES
TOP>BOTTOM
BOTTOM>TOP""")
rulegen = Wasp_RulesGenerator(PART=part, GR=panel)  # -> R; inputs PART: list, SELF_P: Boolean, SELF_C: Boolean, TYP: Boolean, GR: list; plug-in component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

larger = LargerThan(FirstNumber=remap.Mapped, SecondNumber=Slider(0.39, range=0..1))  # -> LargerThan, OrEqualTo
dispatch = Dispatch(List=fieldpts.PTS, DispatchPattern=larger.LargerThan)  # -> ListA, ListB
dispatch_2 = Dispatch(List=num, DispatchPattern=larger.LargerThan)  # -> ListA, ListB
bnd_2 = Bounds(Numbers=dispatch_2.ListA)
dedomain = DeconstructDomain(Domain=bnd_2)  # -> Start, End
gradient = Gradient(
    LowerLimit=dedomain.Start,
    UpperLimit=dedomain.End,
    Parameter=dispatch_2.ListA,
    stops=[0: RGB(0, 128, 0), 0.5: RGB(255, 255, 0), 1: RGB(255, 0, 0)])
preview_2 = CustomPreview(Geometry=dispatch.ListA, Material=gradient)  # disabled

# ----
# Calculation
number_slider_3 = Slider(350, range=0..1000)
button = Button()
fieldaggregation = Wasp_FieldDrivenAggregation(PART=flatten(part), N=number_slider_3, RULES=rulegen, FIELD=field, RESET=Toggle(True))  # -> AGGR, PART_OUT; inputs PART: list, PREV: list, N: Int32, RULES: list, FIELD: list, MODE: Int32, GC: list, RESET: Boolean; plug-in component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

# ----
# Visual
number_slider_4 = Slider(2, range=0..10)
lng = ListLength(List=fieldaggregation.PART_OUT)
getattr = Wasp_GetAttributeByName(PART=fieldaggregation.PART_OUT, ID="house")  # -> VAL; plug-in component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
getattr_2 = Wasp_GetAttributeByName(PART=fieldaggregation.PART_OUT, ID="window")  # -> VAL; plug-in component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
getattr_3 = Wasp_GetAttributeByName(PART=fieldaggregation.PART_OUT, ID="door")  # -> VAL; plug-in component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
random = Random(Range=number_slider_4, Number=lng, Seed=2, Integers=True)
merge_2 = Merge(
    Data1=ColourSwatch(SwatchColor=RGB(42, 181, 14)),
    Data2=ColourSwatch(SwatchColor=RGB(110, 255, 0)),
    Data3=ColourSwatch(SwatchColor=RGB(207, 255, 77)))
preview_3 = CustomPreview(Geometry=flatten(getattr_2), Material=ColourSwatch(SwatchColor=RGB(14, 170, 181)))
preview_4 = CustomPreview(Geometry=flatten(getattr_3), Material=ColourSwatch(SwatchColor=RGB(181, 131, 14)))
item = ListItem(List=merge_2, Index=random, Wrap=True)
preview_5 = CustomPreview(Geometry=flatten(getattr), Material=item)

partgeo = Wasp_GetPartGeometry(PART=fieldaggregation.PART_OUT)  # -> GEO; plug-in component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

# ----
# Define field
number_slider_5 = Slider(10, range=0..100)
crv_5 = Curve(<curve referenced from the Rhino model>)
offset_l_2 = OffsetCurveLoose(Curve=crv_5, Distance=number_slider_5)
loft_2 = Loft(
    Curves=flatten([offset_l_2, crv_5]),
    Options={Adjust=False, Closed=False, LoftEnds=0, LoftSimp=0, LoftType=0, Rebuild=10, Refit=0.01})
geo_7 = Geometry(loft_2)
bbox_2 = BoundingBox(Content=geo_7, Plane=PlaneXY(0, 0, 0))  # -> Box, Box_2
number_slider_6 = Slider(1.5, range=0..10)
volume_2 = Volume(Geometry=bbox_2.Box)  # -> Volume, Centroid
scale_nu_2 = ScaleNU(
    Geometry=bbox_2.Box,
    Plane=volume_2.Centroid,
    ScaleX=number_slider_6,
    ScaleY=number_slider_6,
    ScaleZ=Slider(2.17, range=0..10))  # -> Geometry, Transform
preview_6 = CustomPreview(Geometry=geo_7, Material=ColourSwatch(SwatchColor=RGB(194, 194, 194)))
fieldpts_2 = Wasp_FieldPoints(BOU=scale_nu_2.Geometry, RES=Slider(2.5, range=0..10))  # -> E_FIELD, PTS; inputs BOU: list of Mesh, PLN: Plane; plug-in component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
geo_8 = Geometry(geo_7)
pull_2 = PullPoint(Point=fieldpts_2.PTS, Geometry=geo_8, ClosestOnly=True)  # -> ClosestPoint, Distance
dom_2 = ConstructDomain(DomainStart="1", DomainEnd="0")
bnd_3 = Bounds(Numbers=pull_2.Distance)
remap_2 = RemapNumbers(Value=pull_2.Distance, Source=bnd_3, Target=dom_2)  # -> Mapped, Clipped
num_2 = Number(remap_2.Mapped)
field_2 = Wasp_Field(E_FIELD=fieldpts_2.E_FIELD, VAL=num_2)  # -> FIELD; inputs VAL: list; plug-in component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

geo_9 = Geometry([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])
attribute_4 = Wasp_Attribute(ID="house2", VAL=geo_9, TR=Toggle(True))  # -> ATTR; inputs VAL: list, TR: Boolean; plug-in component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

geo_10 = Geometry(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)
attribute_5 = Wasp_Attribute(ID="house", VAL=geo_10, TR=Toggle(True))  # -> ATTR; inputs VAL: list, TR: Boolean; plug-in component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

larger_2 = LargerThan(FirstNumber=remap_2.Mapped, SecondNumber=Slider(0.91, range=0..1))  # -> LargerThan, OrEqualTo
dispatch_3 = Dispatch(List=fieldpts_2.PTS, DispatchPattern=larger_2.LargerThan)  # -> ListA, ListB
dispatch_4 = Dispatch(List=num_2, DispatchPattern=larger_2.LargerThan)  # -> ListA, ListB
bnd_4 = Bounds(Numbers=dispatch_4.ListA)
dedomain_2 = DeconstructDomain(Domain=bnd_4)  # -> Start, End
gradient_2 = Gradient(
    LowerLimit=dedomain_2.Start,
    UpperLimit=dedomain_2.End,
    Parameter=dispatch_4.ListA,
    stops=[0: RGB(0, 128, 0), 0.5: RGB(255, 255, 0), 1: RGB(255, 0, 0)])
preview_7 = CustomPreview(Geometry=dispatch_3.ListA, Material=gradient_2)

pt_4 = Point([Point(2.5, 2.5, 4), Point(2.5, 5, 4), Point(2.5, 7.5, 4)])
crv_6 = Curve([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])
pt_5 = Point([Point(2.5, 0, 2), Point(5, 2.5, 1), Point(5, 7.5, 2), Point(2.5, 10, 2), Point(0, 7.5, 3), Point(0, 2.5, 2)])
crv_7 = Curve([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])
pt_6 = Point([Point(2.5, 2.5, 0), Point(2.5, 7.5, 0)])
crv_8 = Curve([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])

# ----
# Define unit property
geo_11 = Geometry(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)

conndir_4 = Wasp_ConnectionFromDirection(GEO=geo_11, CEN=pt_4, UP=crv_6, T="TOP")  # -> CONN, PLN_OUT; inputs CEN: list of Point3d, UP: list of Curve, T: list; plug-in component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
conndir_5 = Wasp_ConnectionFromDirection(GEO=geo_11, CEN=pt_6, UP=crv_8, T="BOTTOM")  # -> CONN, PLN_OUT; inputs CEN: list of Point3d, UP: list of Curve, T: list; plug-in component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
conndir_6 = Wasp_ConnectionFromDirection(GEO=geo_11, CEN=pt_5, UP=crv_7, T="SIDES")  # -> CONN, PLN_OUT; inputs CEN: list of Point3d, UP: list of Curve, T: list; plug-in component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
merge_3 = Merge(Data1=conndir_6.CONN, Data2=conndir_5.CONN, Data3=conndir_4.CONN)

part_2 = Wasp_BasicPart(NAME="BLOCK02", GEO=geo_11, CONN=flatten(merge_3), ATTR=attribute_4)  # -> PART; inputs GEO: Mesh, CONN: list, ATTR: list; plug-in component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

pt_7 = Point([Point(2.5, 2.5, 4), Point(2.5, 5, 4), Point(2.5, 7.5, 4)])
crv_9 = Curve([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])
pt_8 = Point([Point(2.5, 0, 2), Point(5, 2.5, 1), Point(5, 7.5, 2), Point(2.5, 10, 2), Point(0, 7.5, 3), Point(0, 2.5, 2)])
crv_10 = Curve([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])
pt_9 = Point([Point(2.5, 2.5, 0), Point(2.5, 7.5, 0)])
crv_11 = Curve([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])

# ----
# Define unit property
geo_12 = Geometry(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)

conndir_7 = Wasp_ConnectionFromDirection(GEO=geo_12, CEN=pt_7, UP=crv_9, T="TOP")  # -> CONN, PLN_OUT; inputs CEN: list of Point3d, UP: list of Curve, T: list; plug-in component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
conndir_8 = Wasp_ConnectionFromDirection(GEO=geo_12, CEN=pt_9, UP=crv_11, T="BOTTOM")  # -> CONN, PLN_OUT; inputs CEN: list of Point3d, UP: list of Curve, T: list; plug-in component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
conndir_9 = Wasp_ConnectionFromDirection(GEO=geo_12, CEN=pt_8, UP=crv_10, T="SIDES")  # -> CONN, PLN_OUT; inputs CEN: list of Point3d, UP: list of Curve, T: list; plug-in component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
merge_4 = Merge(Data1=conndir_9.CONN, Data2=conndir_8.CONN, Data3=conndir_7.CONN)

part_3 = Wasp_BasicPart(NAME="BLOCK01", GEO=geo_12, CONN=flatten(merge_4), ATTR=attribute_5)  # -> PART; inputs GEO: Mesh, CONN: list, ATTR: list; plug-in component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

merge_5 = Merge(Data1=part_3, Data2=part_2)

# ----
# Define rule
panel_2 = Panel("""SIDES>SIDES
TOP>BOTTOM
BOTTOM>TOP""")
rulegen_2 = Wasp_RulesGenerator(PART=merge_5, GR=panel_2)  # -> R; inputs PART: list, SELF_P: Boolean, SELF_C: Boolean, TYP: Boolean, GR: list; plug-in component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

# ----
# Define proportion
toggle = BooleanToggle(False)
panel_3 = Panel("""200
200""")
partcat = Wasp_PartsCatalog(PART=flatten(merge_5), NUM=panel_3, LIM=toggle, AD=Toggle(True))  # -> CAT; inputs PART: list, NUM: list, LIM: Boolean, AD: Boolean; plug-in component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

# ----
# Calculation
number_slider_7 = Slider(250, range=0..1000)
button_2 = Button()
fieldaggregation_2 = Wasp_FieldDrivenAggregation(PART=flatten(merge_5), N=number_slider_7, RULES=rulegen_2, FIELD=field_2, CAT=partcat, RESET=Toggle(True))  # -> AGGR, PART_OUT; inputs PART: list, PREV: list, N: Int32, RULES: list, FIELD: list, MODE: Int32, GC: list, RESET: Boolean; plug-in component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

# ----
# Visual
panel_4 = Panel("BLOCK02")
namefilter = Wasp_FilterPartsByName(PART=fieldaggregation_2.PART_OUT, NAME=panel_4)  # -> PART_OUT, MASK; inputs PART: list, NAME: list; plug-in component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
namefilter_2 = Wasp_FilterPartsByName(PART=fieldaggregation_2.PART_OUT, NAME="BLOCK01")  # -> PART_OUT, MASK; inputs PART: list, NAME: list; plug-in component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
lng_2 = ListLength(List=fieldaggregation_2.PART_OUT)
lng_3 = ListLength(List=fieldaggregation_2.PART_OUT)
getattr_4 = Wasp_GetAttributeByName(PART=namefilter.PART_OUT, ID="house2")  # -> VAL; plug-in component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
random_2 = Random(Range=Slider(2, range=0..10), Number=lng_2, Seed=2, Integers=True)
merge_6 = Merge(
    Data1=ColourSwatch(SwatchColor=RGB(42, 181, 14)),
    Data2=ColourSwatch(SwatchColor=RGB(110, 255, 0)),
    Data3=ColourSwatch(SwatchColor=RGB(207, 255, 77)))
random_3 = Random(Range=Slider(2, range=0..10), Number=lng_3, Seed=2, Integers=True)
merge_7 = Merge(
    Data1=ColourSwatch(SwatchColor=RGB(181, 14, 95)),
    Data2=ColourSwatch(SwatchColor=RGB(255, 0, 77)),
    Data3=ColourSwatch(SwatchColor=RGB(255, 77, 204)))
getattr_5 = Wasp_GetAttributeByName(PART=namefilter_2.PART_OUT, ID="house")  # -> flatten(VAL); plug-in component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
group = Group(Objects=getattr_4)  # -> flatten(Group)
item_2 = ListItem(List=merge_6, Index=random_2, Wrap=True)
item_3 = ListItem(List=merge_7, Index=random_3, Wrap=True)
preview_8 = CustomPreview(Geometry=group, Material=item_2)  # disabled
preview_9 = CustomPreview(Geometry=getattr_5, Material=item_3)  # disabled
lng_4 = ListLength(List=group)
lng_5 = ListLength(List=getattr_5)
division = Division(A=lng_5, B=lng_4)

# ----
# percentage
panel_5 = Panel(division)
