# Grasshopper definition wasp_yShape.gh (Grasshopper 1.0.7)
# plug-ins: Human, LunchBox, Pufferfish

brep = Brep(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)
brep_2 = Brep(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)
brep_3 = Brep(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)
geo = Geometry(brep)
debrep = DeconstructBrep(Brep=geo)  # -> Faces, Edges, Vertices
crv = Curve([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])
crv_2 = Curve([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])
crv_3 = Curve([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])
mesh = MeshBrep(
    Brep=geo,
    Settings={GridMaxCount=0, GridMinCount=16, JaggedSeams=False, MaxEdgeLength=0, MinEdgeLength=0.0001, MinTolerance=0, Refine=True, RefineAngle=0, RelativeTolerance=0.65, SimplePlanes=True, Tolerance=0})
number_slider = Slider(1, range=0..1)
area = Area(Geometry=debrep.Faces)  # -> Area, Centroid
loft = Loft(Curves=crv_2, Options={Adjust=False, Closed=False, LoftEnds=0, LoftSimp=0, LoftType=0, Rebuild=10, Refit=0.01})

# ----
# Define field
number_slider_2 = Slider(10, range=0..100)
crv_4 = Curve(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)
offset_l = OffsetCurveLoose(Curve=crv_4, Distance=number_slider_2)
loft_2 = Loft(
    Curves=flatten([offset_l, crv_4]),
    Options={Adjust=False, Closed=False, LoftEnds=0, LoftSimp=0, LoftType=0, Rebuild=10, Refit=0.01})
geo_2 = Geometry(loft)
bbox = BoundingBox(Content=geo_2, Plane=PlaneXY(0, 0, 0))  # -> Box, Box_2
number_slider_3 = Slider(1.5, range=0..10)
volume = Volume(Geometry=bbox.Box)  # -> Volume, Centroid
scale_nu = ScaleNU(
    Geometry=bbox.Box,
    Plane=volume.Centroid,
    ScaleX=number_slider_3,
    ScaleY=number_slider_3,
    ScaleZ=Slider(2.17, range=0..10))  # -> Geometry, Transform
preview = CustomPreview(Geometry=geo_2, Material=ColourSwatch(SwatchColor=RGB(194, 194, 194)))  # disabled
fieldpts = Wasp_FieldPoints(BOU=scale_nu.Geometry, RES=Slider(2.5, range=0..10))  # -> E_FIELD, PTS; inputs BOU: list of Mesh, PLN: Plane; plug-in component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
geo_3 = Geometry(geo_2)
pull = PullPoint(Point=fieldpts.PTS, Geometry=geo_3, ClosestOnly=True)  # -> ClosestPoint, Distance
dom = ConstructDomain(DomainStart="1", DomainEnd="0")
bnd = Bounds(Numbers=pull.Distance)
remap = RemapNumbers(Value=pull.Distance, Source=bnd, Target=dom)  # -> Mapped, Clipped
num = Number(remap.Mapped)
field = Wasp_Field(E_FIELD=fieldpts.E_FIELD, VAL=num)  # -> FIELD; inputs VAL: list; plug-in component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

redumsh = ReduceMesh(Mesh=mesh, FaceCount=Slider(1000, range=0..1000), Accuracy=1, FaceType=0, Distort=True, Normalize=False)  # -> Reduced, CountDifference
item = ListItem(List=area.Centroid, Index=0, Wrap=True)  # -> Item, Item1, Item2, Item3, Item4, Item5
number_slider_4 = Slider(3, range=0..10)
torus = TorusSurface(
    UDivisions=90,
    VDivisions=96,
    CParameter=Slider(4, range=0..10),
    RParameter=Slider(2, range=0..10),
    TParameter=1,
    Scale=5,
    Domain1=Domain(0, 6.283185307),
    Domain2=Domain(-3.141592654, 3.141592654))

fieldpts_2 = Wasp_FieldPoints(BOU=torus, RES=Slider(2, range=0..10))  # -> E_FIELD, PTS; inputs BOU: list of Mesh, PLN: Plane; plug-in component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
srf_cp = SurfaceClosestPoint(Point=fieldpts_2.PTS, Surface=torus)  # -> Point, UVPoint, Distance
bnd_2 = Bounds(Numbers=srf_cp.Distance)
remap_2 = RemapNumbers(Value=srf_cp.Distance, Source=bnd_2, Target=Domain(0, 1))  # -> Mapped, Clipped
graph = GraphMapper(
    remap_2.Mapped,
    x0=0,
    x1=1,
    y0=0,
    y1=1,
    container_name="Bezier",
    cpx=[0, 0, 0.319324851, 1],
    cpy=[0, 0.6395096779, 0.9993216991, 1])
field_2 = Wasp_Field(NAME="myVolField", E_FIELD=fieldpts_2.E_FIELD, VAL=graph)  # -> FIELD; inputs VAL: list; plug-in component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

range = Range(Domain=Domain(0, 1), Steps=Slider(16, range=0..100))
range_2 = Range(Domain=Domain(0, 1), Steps=Slider(8, range=0..100))
pt = ConstructPoint(XCoordinate=range, YCoordinate=range_2, ZCoordinate=0)
iso = IsoCurve(Surface=reparameterize(torus), UVPoint=pt)  # -> UIsocurve, VIsocurve
previewlw = CustomPreviewLineweights(Geometry=[iso.UIsocurve, iso.VIsocurve], Shader=ColourSwatch(SwatchColor=RGB(64, 64, 64)), Absolute=False)

multiplication = Multiplication(A=number_slider_4, B=3)
brep_cp = BrepClosestPoint(Point=item.Item1, Brep=geo)  # -> Point, Normal, Distance
brep_cp_2 = BrepClosestPoint(Point=item.Item2, Brep=geo)  # -> Point, Normal, Distance
brep_cp_3 = BrepClosestPoint(Point=item.Item, Brep=geo)  # -> Point, Normal, Distance
random = Random(Range="360", Number=multiplication, Seed=Slider(68, range=0..100))
pl = PlaneNormal(Origin=brep_cp.Point, ZAxis=brep_cp.Normal)
pl_2 = PlaneNormal(Origin=brep_cp_2.Point, ZAxis=brep_cp_2.Normal)
pl_3 = PlaneNormal(Origin=brep_cp_3.Point, ZAxis=brep_cp_3.Normal)
partition = PartitionList(List=random, Size=number_slider_4)
number_slider_5 = Slider(1, range=0..10)
number_slider_6 = Slider(0.5, range=0..1)
bang = ExplodeTree(Data=partition)  # -> Branch0, Branch1, Branch2
midpt = CurveMiddle(Curve=crv)
prot = RotatePlane(Plane=pl_3, Angle=bang.Branch0)
deplane = DeconstructPlane(Plane=prot)  # -> Origin, XAxis, YAxis, ZAxis
prot_2 = RotatePlane(Plane=pl, Angle=bang.Branch1)
deplane_2 = DeconstructPlane(Plane=prot_2)  # -> Origin, XAxis, YAxis, ZAxis
prot_3 = RotatePlane(Plane=pl_2, Angle=bang.Branch2)
deplane_3 = DeconstructPlane(Plane=prot_3)  # -> Origin, XAxis, YAxis, ZAxis
pt_2 = Point([Point(-0.04177004099, -5.982283592, 5.238283157), Point(-0.04176998138, -2.483065605, 5.279659033), Point(-0.04176998138, -5.982280731, -1.437273026)])
pt_3 = Point(midpt)
line = LineSDL(Start=deplane_2.Origin, Direction=deplane_2.YAxis, Length=1)
line_2 = LineSDL(Start=deplane_3.Origin, Direction=deplane_3.YAxis, Length=1)
line_3 = LineSDL(Start=deplane.Origin, Direction=deplane.YAxis, Length=1)
points = PointList(Points=pt_2, Size=number_slider_6)
points_2 = PointList(Points=area.Centroid, Size=number_slider_6)
mesh_2 = Mesh(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)

defield = Wasp_DeconstructField(FIELD=field_2)  # -> NAME, PTS, COUNT, RES, PLN, VAL, BOU, BB; plug-in component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
gradient = Gradient(LowerLimit=0, UpperLimit=1, Parameter=defield.VAL, stops=[0: RGB(0, 128, 0), 0.5: RGB(255, 255, 0), 1: RGB(255, 0, 0)])
preview_2 = CustomPreview(Geometry=defield.PTS, Material=gradient)

geo_4 = Geometry(mesh_2)
conndir = Wasp_ConnectionFromDirection(GEO=geo, CEN=deplane.Origin, UP=line_3)  # -> CONN, PLN_OUT; inputs CEN: list of Point3d, UP: list of Curve, T: list; plug-in component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
conndir_2 = Wasp_ConnectionFromDirection(GEO=geo, CEN=deplane_3.Origin, UP=line_2)  # -> CONN, PLN_OUT; inputs CEN: list of Point3d, UP: list of Curve, T: list; plug-in component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
conndir_3 = Wasp_ConnectionFromDirection(GEO=geo, CEN=deplane_2.Origin, UP=line)  # -> CONN, PLN_OUT; inputs CEN: list of Point3d, UP: list of Curve, T: list; plug-in component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
attribute = Wasp_Attribute(ID="unit", VAL=geo_4, TR=Toggle(True))  # -> ATTR; inputs VAL: list, TR: Boolean; plug-in component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
bnd_3 = Bounds(Numbers=defield.VAL)
merge = Merge(Data1=conndir.CONN, Data2=conndir_3.CONN, Data3=conndir_2.CONN)  # -> flatten(Result)
pln = Plane([conndir.PLN_OUT, conndir_3.PLN_OUT, conndir_2.PLN_OUT])
part = Wasp_BasicPart(NAME="L", GEO=geo, CONN=flatten(merge), ATTR=attribute)  # -> PART; inputs GEO: Mesh, CONN: list, ATTR: list; plug-in component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

larger = LargerThan(FirstNumber=remap.Mapped, SecondNumber=Slider(0.91, range=0..1))  # -> LargerThan, OrEqualTo
dispatch = Dispatch(List=fieldpts.PTS, DispatchPattern=larger.LargerThan)  # -> ListA, ListB
dispatch_2 = Dispatch(List=num, DispatchPattern=larger.LargerThan)  # -> ListA, ListB
bnd_4 = Bounds(Numbers=dispatch_2.ListA)
dedomain = DeconstructDomain(Domain=bnd_4)  # -> Start, End
gradient_2 = Gradient(
    LowerLimit=dedomain.Start,
    UpperLimit=dedomain.End,
    Parameter=dispatch_2.ListA,
    stops=[0: RGB(0, 128, 0), 0.5: RGB(255, 255, 0), 1: RGB(255, 0, 0)])
preview_3 = CustomPreview(Geometry=dispatch.ListA, Material=gradient_2)

rulegen = Wasp_RulesGenerator(PART=part)  # -> R; inputs PART: list, SELF_P: Boolean, SELF_C: Boolean, TYP: Boolean, GR: list; plug-in component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
button = Button()
fieldaggregation = Wasp_FieldDrivenAggregation(PART=flatten(part), N=Slider(150, range=0..1000), RULES=rulegen, FIELD=field, RESET=Toggle(True))  # -> AGGR, PART_OUT; inputs PART: list, PREV: list, N: Int32, RULES: list, FIELD: list, MODE: Int32, GC: list, RESET: Boolean; plug-in component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

parts_num = Slider(40, range=0..10000)
reset = Button()
stochasticaggregation = Wasp_StochasticAggregation(PART=flatten(part), N=parts_num, RULES=rulegen, SEED=Slider(23, range=0..100), RESET=reset)  # -> AGGR, PART_OUT; inputs PART: list, PREV: list, N: Int32, RULES: list, SEED: Int32, MODE: Int32, GC: list, RESET: Boolean; disabled; plug-in component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

lng = ListLength(List=fieldaggregation.PART_OUT)
partgeo = Wasp_GetPartGeometry(PART=fieldaggregation.PART_OUT)  # -> GEO; plug-in component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
merge_2 = Merge(
    Data1=ColourSwatch(SwatchColor=RGB(195, 255, 0)),
    Data2=ColourSwatch(SwatchColor=RGB(53, 168, 0)),
    Data3=ColourSwatch(SwatchColor=RGB(89, 255, 0)))
random_2 = Random(Range=Slider(2, range=0..10), Number=lng, Seed=2)
getattr = Wasp_GetAttributeByName(PART=fieldaggregation.PART_OUT, ID="unit")  # -> VAL; plug-in component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
item_2 = ListItem(List=merge_2, Index=random_2, Wrap=True)
preview_4 = CustomPreview(Geometry=getattr, Material=ColourSwatch(SwatchColor=RGB(135, 135, 135)))
preview_5 = CustomPreview(Geometry=partgeo, Material=item_2)  # disabled
